# Grasshopper definition CoverDimensions.gh (Grasshopper 1.0.7)
# plug-ins: Brontosaurus, T-Rex

# Unit Tests inside Grasshopper
# 
# Required plugins:
# - T-Rex
# - Brontosaurus
number_slider = Slider(100, range=0..1000)
division = Division(A=Slider(7750, range=0..10000), B="10e9")
cover_dimensions = CoverDimensions(Left=number_slider, Right=Slider(200, range=0..1000), Top=Slider(300, range=0..1000), Bottom=Slider(400, range=0..1000))
panel = Panel("""Cover Dimensions
Left: 0.01
Right: 0.02
Top: 0.03
Bottom: 0.045""")
cover_dimensions_2 = CoverDimensions(
    Left=Slider(0.01, range=0..0.1),
    Right=Slider(0.02, range=0..0.1),
    Top=Slider(0.03, range=0..0.1),
    Bottom=Slider(0.045, range=0..0.1))
panel_2 = Panel("""Material
Name: Name of the material
Grade: Grade of the material
Density: 7750""")
panel_3 = Panel("""Material
Name: Name of the material
Grade: Grade of the material
Density: 7.75E-07""")
panel_4 = Panel("""Cover Dimensions
Left: 100
Right: 200
Top: 300
Bottom: 400""")
material = Material(Name="Name of the material", Grade="Grade of the material", Density="7750")
material_2 = Material(Name="Name of the material", Grade="Grade of the material", Density=division)
assert = Assert(TestNames="TestInitMilimeters", Expected=panel_2, Actual=material)  # -> Result, FailedInfo
assert_2 = Assert(TestNames="TestInitMeters", Expected=panel_3, Actual=material_2)  # -> Result, FailedInfo
assert_3 = Assert(TestNames="TestInitMilimeters", Expected=panel_4, Actual=cover_dimensions)  # -> Result, FailedInfo
assert_4 = Assert(TestNames="TestInitMeters", Expected=panel, Actual=cover_dimensions_2)  # -> Result, FailedInfo
total = Total(Results=[assert.Result, assert_2.Result])  # -> TotalResult, ReportPart
total_2 = Total(Results=[assert_3.Result, assert_4.Result])  # -> TotalResult, ReportPart
