# Grasshopper definition GrasshopperUnitTests.gh (Grasshopper 1.0.7)
# plug-ins: Brontosaurus, T-Rex

# ----
# Rebar Properties
number_slider = Slider(7750, range=0..10000)
division = Division(A=number_slider, B="10e9")
material = Material(Name="Name of the material", Grade="Grade of the material", Density=division)
material_2 = Material(Name="Name of the material", Grade="Grade of the material", Density="7750")
panel = Panel("""Rebar Properties
Diameter: 20
Material: Name of the material""")
panel_2 = Panel("""Rebar Properties
Diameter: 0.02
Material: Name of the material""")
rebar_properties = RebarProperties(Diameter="20", Material=material)
rebar_properties_2 = RebarProperties(Diameter="0.020", Material=material_2)
assert = Assert(TestNames="TestRebarPropertiesInitMilimeters", Expected=panel, Actual=rebar_properties)  # -> Result, FailedInfo
assert_2 = Assert(TestNames="TestRebarPropertiesInitMeters", Expected=panel_2, Actual=rebar_properties_2)  # -> Result, FailedInfo

# ----
# Cover Dimensions
number_slider_2 = Slider(300, range=0..1000)
# Unit Tests inside Grasshopper
# 
# Required plugins:
# - T-Rex
# - Brontosaurus
number_slider_3 = Slider(100, range=0..1000)
cover_dimensions = CoverDimensions(Left=number_slider_3, Right=Slider(200, range=0..1000), Top=number_slider_2, Bottom=Slider(400, range=0..1000))
panel_3 = Panel("""Cover Dimensions
Left: 0.01
Right: 0.02
Top: 0.03
Bottom: 0.045""")
cover_dimensions_2 = CoverDimensions(
    Left=Slider(0.01, range=0..0.1),
    Right=Slider(0.02, range=0..0.1),
    Top=Slider(0.03, range=0..0.1),
    Bottom=Slider(0.045, range=0..0.1))
panel_4 = Panel("""Cover Dimensions
Left: 100
Right: 200
Top: 300
Bottom: 400""")
assert_3 = Assert(TestNames="TestCoverDimensionsInitMilimeters", Expected=panel_4, Actual=cover_dimensions)  # -> Result, FailedInfo
assert_4 = Assert(TestNames="TestCoverDimensionsInitMeters", Expected=panel_3, Actual=cover_dimensions_2)  # -> Result, FailedInfo

# ----
# Material
number_slider_4 = Slider(7750, range=0..10000)
division_2 = Division(A=number_slider_4, B="10e9")
panel_5 = Panel("""Material
Name: Name of the material
Grade: Grade of the material
Density: 7.75E-07""")
panel_6 = Panel("""Material
Name: Name of the material
Grade: Grade of the material
Density: 7750""")
material_3 = Material(Name="Name of the material", Grade="Grade of the material", Density=division_2)
material_4 = Material(Name="Name of the material", Grade="Grade of the material", Density="7750")
assert_5 = Assert(TestNames="TestMaterialInitMilimeters", Expected=panel_5, Actual=material_3)  # -> Result, FailedInfo
assert_6 = Assert(TestNames="TestMaterialInitMeters", Expected=panel_6, Actual=material_4)  # -> Result, FailedInfo

division_3 = Division(A=Slider(7750, range=0..10000), B="10e9")
material_5 = Material(Name="Name of the material", Grade="Grade of the material", Density=division_3)
rebar_properties_3 = RebarProperties(Diameter="20", Material=material_5)

# ----
# Result:
total = Total(Results=[assert_3.Result, assert_4.Result, assert_6.Result, assert_5.Result, assert_2.Result, assert.Result])  # -> TotalResult, ReportPart
panel_7 = Panel(total.TotalResult)

xy = XYPlane(Origin=Point(0, 0, 0))
l_bar_shape = LBarShape(
    Plane=xy,
    Height=Slider(100, range=0..1000),
    Width=Slider(200, range=0..1000),
    Properties=rebar_properties_3,
    BendingRollerDiameter="80")  # -> RebarShape, Mesh
