# Grasshopper definition Material.gh (Grasshopper 1.0.7)
# plug-ins: Brontosaurus, T-Rex

division = Division(A=Slider(7750, range=0..10000), B="10e9")
panel = Panel("""Material
Name: Name of the material
Grade: Grade of the material
Density: 7750""")
panel_2 = Panel("""Material
Name: Name of the material
Grade: Grade of the material
Density: 7.75E-07""")
# Unit Tests inside Grasshopper
# 
# Required plugins:
# - T-Rex
# - Brontosaurus
panel_3 = Panel("TestInitMilimeters")
material = Material(Name="Name of the material", Grade="Grade of the material", Density="7750")
material_2 = Material(Name="Name of the material", Grade="Grade of the material", Density=division)
assert = Assert(TestNames=panel_3, Expected=panel, Actual=material)  # -> Result, FailedInfo
assert_2 = Assert(TestNames="TestInitMeters", Expected=panel_2, Actual=material_2)  # -> Result, FailedInfo
total = Total(Results=[assert.Result, assert_2.Result])  # -> TotalResult, ReportPart
