# Grasshopper definition GrasshopperTests.gh (Grasshopper 1.0.7)
# plug-ins: Pterodactyl, Brontosaurus, T-Rex

calendar = Calendar()

# ----
# Rebar Properties
number_slider = Slider(7850, range=0..10000)
division = Division(A=number_slider, B="1e9")
material = Material(Name="Name of the material", Grade="Grade of the material", Density=division)
material_2 = Material(Name="Name of the material", Grade="Grade of the material", Density="7850")
panel = Panel("""Rebar Properties
Diameter: 20
Material: Name of the material""")
panel_2 = Panel("""Rebar Properties
Diameter: 0.02
Material: Name of the material""")
rebar_properties = RebarProperties(Diameter="20", Material=material)
rebar_properties_2 = RebarProperties(Diameter="0.020", Material=material_2)
assert = Assert(TestNames="RebarPropertiesMilimeters_Normal_Init", Expected=panel, Actual=rebar_properties)  # -> Result, FailedInfo
assert_2 = Assert(TestNames="RebarPropertiesMeters_Normal_Init", Expected=panel_2, Actual=rebar_properties_2)  # -> Result, FailedInfo
entwine = Entwine(Branch00=assert.Result, Branch01=assert_2.Result, FlattenInputs=True)  # -> flatten(Result)

# ----
# Profile
panel_3 = Panel("Profile name")
pt = Point([Point(-31.45969094, -214.6890178, 0), Point(194.1926615, 13.64967215, 0), Point(-7.282653176, 201.6932992, 0), Point(-243.6803558, 107.6714857, 0), Point(-7.282653176, -61.56777867, 0), Point(-98.61812917, -171.7076174, 0)])
profile = Profile(Name=panel_3, Points=pt, Tolerance="0.001")  # -> Profile, Brep
pt_2 = Point([Point(-31.45969094, -214.6890178, 0), Point(194.1926615, 13.64967215, 0), Point(-7.282653176, 201.6932992, 0), Point(-243.6803558, 107.6714857, 0), Point(-7.282653176, -61.56777867, 0), Point(-98.61812917, -171.7076174, 0)])
panel_4 = Panel("""Profile
Name: Profile name""")
mesh_uv = MeshSurface(Surface=profile.Brep, UCount="20", VCount="20", Overhang=False, Equalize=False)
profile_2 = Profile(Name="Profile name", Points=pt_2, Tolerance="0.001")  # -> Profile, Brep
demesh = DeconstructMesh(Mesh=mesh_uv)  # -> Vertices, Faces, Colours, Normals
pt_3 = Point([Point(-44.43113115, -205.7934682, 0), Point(-58.12641602, -192.2593043, 0), Point(-71.82170089, -178.7251404, 0), Point(-85.51698576, -165.1909765, 0), Point(-32.326536, -193.5447707, 0), Point(-46.02182087, -180.0106068, 0)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])
assert_3 = Assert(TestNames="ProfileMillimeters_Normal_Init", Expected=panel_4, Actual=profile_2.Profile)  # -> Result, FailedInfo
assert_point_list = AssertPointList(TestName="ProfileMillimeters_Normal_Brep", ExpectedPointList=pt_3, ActualPointList=demesh.Vertices, Tolerance="0.00001")  # -> Result, FailedInfo
entwine_2 = Entwine(Branch00=assert_3.Result, Branch01=assert_point_list.Result, FlattenInputs=True)  # -> flatten(Result)

# ----
# Cover Dimensions
number_slider_2 = Slider(200, range=0..1000)
# Curve To Rebar Shape
# Polyline To Rebar Shape
# Vector Count Spacing
# Vector Length Spacing
number_slider_3 = Slider(0.045, range=0..0.1)
cover_dimensions = CoverDimensions(
    Left=Slider(100, range=0..1000),
    Right=number_slider_2,
    Top=Slider(300, range=0..1000),
    Bottom=Slider(400, range=0..1000))
panel_5 = Panel("""Cover Dimensions
Left: 0.01
Right: 0.02
Top: 0.03
Bottom: 0.045""")
cover_dimensions_2 = CoverDimensions(
    Left=Slider(0.01, range=0..0.1),
    Right=Slider(0.02, range=0..0.1),
    Top=Slider(0.03, range=0..0.1),
    Bottom=number_slider_3)
# Naming convencion:
# ComponentNameUnits_Input_Output
panel_6 = Panel("""Cover Dimensions
Left: 100
Right: 200
Top: 300
Bottom: 400""")
assert_4 = Assert(TestNames="CoverDimensionsMilimeters_Normal_Init", Expected=panel_6, Actual=cover_dimensions)  # -> Result, FailedInfo
assert_5 = Assert(TestNames="CoverDimensionsMeters_Normal_Init", Expected=panel_5, Actual=cover_dimensions_2)  # -> Result, FailedInfo
entwine_3 = Entwine(Branch00=assert_4.Result, Branch01=assert_5.Result, FlattenInputs=True)  # -> flatten(Result)

# ----
# Material
# Curve Spacing
# Custom Spacing
# Rebar Group Info
# Profile
# Profile To Elements
number_slider_4 = Slider(7850, range=0..10000)
division_2 = Division(A=number_slider_4, B="1e9")
panel_7 = Panel("""Material
Name: Name of the material
Grade: Grade of the material
Density: 7.85E-06""")
panel_8 = Panel("""Material
Name: Name of the material
Grade: Grade of the material
Density: 7850""")
material_3 = Material(Name="Name of the material", Grade="Grade of the material", Density=division_2)
material_4 = Material(Name="Name of the material", Grade="Grade of the material", Density="7850")
assert_6 = Assert(TestNames="MaterialMilimeters_Normal_Init", Expected=panel_7, Actual=material_3)  # -> Result, FailedInfo
assert_7 = Assert(TestNames="MaterialMeters_Normal_Init", Expected=panel_8, Actual=material_4)  # -> Result, FailedInfo
entwine_4 = Entwine(Branch00=assert_6.Result, Branch01=assert_7.Result, FlattenInputs=True)  # -> flatten(Result)

# ----
# Profile Exceptions
panel_9 = Panel("Profile name")
pt_4 = Point([Point(-19.93103058, 5.382563177, 0), Point(22.7762455, 17.55828767, 0), Point(36.52005573, -16.01719503, 0), Point(-10.52251619, 23.36942891, 0), Point(0.9152856104, -18.59992447, 0), Point(-23.80512473, 20.78669947, 0)])
pt_5 = Point([Point(-16.93505802, -15.11468863, 0), Point(-16.93505802, 19.59445074, 0), Point(15.55493401, 13.55301108, 0), Point(0, 3.237052137, 11.74930035), Point(6.085435526, -17.89464106, 0)])
pt_6 = Point([Point(-78.75506755, -72.31075164, 0), Point(-85.77656783, 256.8970188, 0), Point(221.8790061, 192.5876189, 0), Point(335.3516598, -32.24985543, 0), Point(275.2579831, -197.3238069, 0), Point(163.9274592, -222.3962593, 0)])
pt_7 = Point(Point(42.50210973, -17.48474193, 0))
pt_8 = Point([Point(6.931400555, -58.7017553, 0), Point(6.931400555, 20.66105567, 0)])
profile_3 = Profile(Name=panel_9, Points=pt_4, Tolerance="0.001")  # -> Profile, Brep
profile_4 = Profile(Name="Profile name", Points=pt_5, Tolerance="0.001")  # -> Profile, Brep
profile_5 = Profile(Name="Profile name", Points=pt_6, Tolerance="0.000")  # -> Profile, Brep
profile_6 = Profile(Name="Profile name", Points=pt_7, Tolerance="0.001")  # -> Profile, Brep
profile_7 = Profile(Name="Profile name", Points=pt_8, Tolerance="0.001")  # -> Profile, Brep

# ----
# Bending Roller
panel_10 = Panel("RebarPropertiesMilimeters_Normal_Init")
panel_11 = Panel("""Bending Roller
Diameter: 80
Tolerance: 0.0001
Angle Tolerance: 0.0175""")
panel_12 = Panel("""Bending Roller
Diameter: 0.08
Tolerance: 0.001
Angle Tolerance: 0.002""")
bending_roller = BendingRoller(Diameter="80", Tolerance=0.0001, AngleTolerance=0.0175)
bending_roller_2 = BendingRoller(Diameter="0.080", Tolerance="0.001", AngleTolerance="0.002")
assert_8 = Assert(TestNames=panel_10, Expected=panel_11, Actual=bending_roller)  # -> Result, FailedInfo
assert_9 = Assert(TestNames="RebarPropertiesMilimeters_Custom_Init", Expected=panel_12, Actual=bending_roller_2)  # -> Result, FailedInfo
entwine_5 = Entwine(Branch00=assert_8.Result, Branch01=assert_9.Result, FlattenInputs=True)  # -> flatten(Result)

# ----
# Stirrup Shape
number_slider_5 = Slider(7850, range=0..10000)
division_3 = Division(A=number_slider_5, B="1e9")
division_4 = Division(A=Slider(7850, range=0..10000), B="1e9")
division_5 = Division(A=Slider(7850, range=0..10000), B="1e9")
division_6 = Division(A=Slider(7850, range=0..10000), B="1e9")
material_5 = Material(Name="Name of the material", Grade="Grade of the material", Density=division_3)
material_6 = Material(Name="Name of the material", Grade="Grade of the material", Density=Slider(7850, range=0..10000))
material_7 = Material(Name="Name of the material", Grade="Grade of the material", Density=division_4)
material_8 = Material(Name="Name of the material", Grade="Grade of the material", Density=division_5)
material_9 = Material(Name="Name of the material", Grade="Grade of the material", Density=Slider(7850, range=0..10000))
material_10 = Material(Name="Name of the material", Grade="Grade of the material", Density=division_6)
material_11 = Material(Name="Name of the material", Grade="Grade of the material", Density=Slider(7850, range=0..10000))
material_12 = Material(Name="Name of the material", Grade="Grade of the material", Density=Slider(7850, range=0..10000))
material_13 = Material(Name="Name of the material", Grade="Grade of the material", Density=Slider(7850, range=0..10000))
material_14 = Material(Name="Name of the material", Grade="Grade of the material", Density=Slider(7850, range=0..10000))
rebar_properties_3 = RebarProperties(Diameter="12", Material=material_5)
rebar_properties_4 = RebarProperties(Diameter="12", Material=material_7)
rebar_properties_5 = RebarProperties(Diameter="0.012", Material=material_6)
rebar_properties_6 = RebarProperties(Diameter="12", Material=material_8)
rebar_properties_7 = RebarProperties(Diameter="12", Material=material_10)
rebar_properties_8 = RebarProperties(Diameter="0.012", Material=material_9)
rebar_properties_9 = RebarProperties(Diameter="0.012", Material=material_11)
rebar_properties_10 = RebarProperties(Diameter="0.012", Material=material_12)
rebar_properties_11 = RebarProperties(Diameter="0.008", Material=material_13)
rebar_properties_12 = RebarProperties(Diameter="0.012", Material=material_14)
bending_roller_3 = BendingRoller(Diameter="80", Tolerance=0.0001, AngleTolerance=0.0175)
bending_roller_4 = BendingRoller(Diameter="0.080", Tolerance=0.0001, AngleTolerance=0.0175)
bending_roller_5 = BendingRoller(Diameter="80", Tolerance=0.0001, AngleTolerance=0.0175)
bending_roller_6 = BendingRoller(Diameter="0.080", Tolerance=0.0001, AngleTolerance=0.0175)
bending_roller_7 = BendingRoller(Diameter="80", Tolerance=0.0001, AngleTolerance=0.0175)
xy = XYPlane(Origin=Point(0, 0, 0))
bending_roller_8 = BendingRoller(Diameter="80", Tolerance=0.0001, AngleTolerance=0.0175)
bending_roller_9 = BendingRoller(Diameter="0.080", Tolerance=0.0001, AngleTolerance=0.0175)
bending_roller_10 = BendingRoller(Diameter="0.048", Tolerance=0.0001, AngleTolerance=0.0175)
xy_2 = XYPlane(Origin=Point(0, 0, 0))
bending_roller_11 = BendingRoller(Diameter="0.080", Tolerance=0.0001, AngleTolerance=0.0175)
xz = XZPlane(Origin=Point(0, 0, 0))
xy_3 = XYPlane(Origin=Point(0, 0, 0))
bending_roller_12 = BendingRoller(Diameter="0.080", Tolerance=0.0001, AngleTolerance=0.0175)
xy_4 = XYPlane(Origin=Point(0, 0, 0))
xy_5 = XYPlane(Origin=Point(0, 0, 0))
xz_2 = XZPlane(Origin=Point(0, 0, 0))
xy_6 = XYPlane(Origin=Point(0, 0, 0))
xy_7 = XYPlane(Origin=Point(0, 0, 0))
xy_8 = XYPlane(Origin=Point(0, 0, 0))
stirrup_shape = StirrupShape(
    Plane=xy,
    Height=Slider(250, range=0..1000),
    Width=Slider(300, range=0..1000),
    HooksType="0",
    HookLength=Slider(100, range=0..100),
    Properties=rebar_properties_3,
    BendingRoller=bending_roller_3)  # -> RebarShape, Mesh
stirrup_shape_2 = StirrupShape(
    Plane=xy_2,
    Height=Slider(250, range=0..1000),
    Width=Slider(300, range=0..1000),
    HooksType="0",
    HookLength=Slider(200, range=0..1100),
    Properties=rebar_properties_4,
    BendingRoller=bending_roller_5)  # -> RebarShape, Mesh
stirrup_shape_3 = StirrupShape(
    Plane=xy_3,
    Height=Slider(0.25, range=0..1),
    Width=Slider(0.3, range=0..1),
    HooksType="0",
    HookLength=Slider(0.1, range=0..0.1),
    Properties=rebar_properties_5,
    BendingRoller=bending_roller_4)  # -> RebarShape, Mesh
stirrup_shape_4 = StirrupShape(
    Plane=xz,
    Height=Slider(250, range=0..1000),
    Width=Slider(300, range=0..1000),
    HooksType="0",
    HookLength=Slider(100, range=0..100),
    Properties=rebar_properties_6,
    BendingRoller=bending_roller_7)  # -> RebarShape, Mesh
stirrup_shape_5 = StirrupShape(
    Plane=xy_4,
    Height=Slider(250, range=0..1000),
    Width=Slider(300, range=0..1000),
    HooksType="1",
    HookLength=Slider(100, range=0..1100),
    Properties=rebar_properties_7,
    BendingRoller=bending_roller_8)  # -> RebarShape, Mesh
stirrup_shape_6 = StirrupShape(
    Plane=xy_5,
    Height=Slider(0.25, range=0..1),
    Width=Slider(0.3, range=0..1),
    HooksType="0",
    HookLength=Slider(0.2, range=0..0.2),
    Properties=rebar_properties_8,
    BendingRoller=bending_roller_6)  # -> RebarShape, Mesh
stirrup_shape_7 = StirrupShape(
    Plane=xz_2,
    Height=Slider(0.25, range=0..1),
    Width=Slider(0.3, range=0..1),
    HooksType="0",
    HookLength=Slider(0.1, range=0..0.1),
    Properties=rebar_properties_9,
    BendingRoller=bending_roller_11)  # -> RebarShape, Mesh
stirrup_shape_8 = StirrupShape(
    Plane=xy_7,
    Height=Slider(0.25, range=0..1),
    Width=Slider(0.3, range=0..1),
    HooksType="0",
    HookLength=Slider(0.1, range=0..0.1),
    Properties=rebar_properties_11,
    BendingRoller=bending_roller_9)  # -> RebarShape, Mesh
stirrup_shape_9 = StirrupShape(
    Plane=xy_6,
    Height=Slider(0.25, range=0..1),
    Width=Slider(0.3, range=0..1),
    HooksType="1",
    HookLength=Slider(0.1, range=0..0.1),
    Properties=rebar_properties_10,
    BendingRoller=bending_roller_10)  # -> RebarShape, Mesh
stirrup_shape_10 = StirrupShape(
    Plane=xy_8,
    Height=Slider(0.8, range=0..1),
    Width=Slider(0.2, range=0..1),
    HooksType="0",
    HookLength=Slider(0.1, range=0..0.1),
    Properties=rebar_properties_12,
    BendingRoller=bending_roller_12)  # -> RebarShape, Mesh
mesh = Mesh(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)
mesh_2 = Mesh(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)
mesh_3 = Mesh(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)
mesh_4 = Mesh(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)
mesh_5 = Mesh(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)
demesh_2 = DeconstructMesh(Mesh=mesh)  # -> Vertices, Faces, Colours, Normals
demesh_3 = DeconstructMesh(Mesh=stirrup_shape.Mesh)  # -> Vertices, Faces, Colours, Normals
mesh_6 = Mesh(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)
mesh_7 = Mesh(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)
mesh_8 = Mesh(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)
demesh_4 = DeconstructMesh(Mesh=mesh_2)  # -> Vertices, Faces, Colours, Normals
demesh_5 = DeconstructMesh(Mesh=stirrup_shape_2.Mesh)  # -> Vertices, Faces, Colours, Normals
mesh_9 = Mesh(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)
demesh_6 = DeconstructMesh(Mesh=mesh_3)  # -> Vertices, Faces, Colours, Normals
demesh_7 = DeconstructMesh(Mesh=stirrup_shape_3.Mesh)  # -> Vertices, Faces, Colours, Normals
mesh_10 = Mesh(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)
demesh_8 = DeconstructMesh(Mesh=mesh_4)  # -> Vertices, Faces, Colours, Normals
demesh_9 = DeconstructMesh(Mesh=stirrup_shape_4.Mesh)  # -> Vertices, Faces, Colours, Normals
demesh_10 = DeconstructMesh(Mesh=mesh_5)  # -> Vertices, Faces, Colours, Normals
demesh_11 = DeconstructMesh(Mesh=stirrup_shape_5.Mesh)  # -> Vertices, Faces, Colours, Normals
demesh_12 = DeconstructMesh(Mesh=mesh_6)  # -> Vertices, Faces, Colours, Normals
demesh_13 = DeconstructMesh(Mesh=stirrup_shape_6.Mesh)  # -> Vertices, Faces, Colours, Normals
demesh_14 = DeconstructMesh(Mesh=mesh_7)  # -> Vertices, Faces, Colours, Normals
demesh_15 = DeconstructMesh(Mesh=stirrup_shape_7.Mesh)  # -> Vertices, Faces, Colours, Normals
demesh_16 = DeconstructMesh(Mesh=mesh_8)  # -> Vertices, Faces, Colours, Normals
demesh_17 = DeconstructMesh(Mesh=stirrup_shape_9.Mesh)  # -> Vertices, Faces, Colours, Normals
demesh_18 = DeconstructMesh(Mesh=mesh_9)  # -> Vertices, Faces, Colours, Normals
demesh_19 = DeconstructMesh(Mesh=stirrup_shape_8.Mesh)  # -> Vertices, Faces, Colours, Normals
demesh_20 = DeconstructMesh(Mesh=mesh_10)  # -> Vertices, Faces, Colours, Normals
demesh_21 = DeconstructMesh(Mesh=stirrup_shape_10.Mesh)  # -> Vertices, Faces, Colours, Normals
assert_point_list_2 = AssertPointList(
    TestName="StirrupShapeMilimeters_XYPlane_Mesh",
    ExpectedPointList=demesh_2.Vertices,
    ActualPointList=demesh_3.Vertices,
    Tolerance="0.00001")  # -> Result, FailedInfo
assert_point_list_3 = AssertPointList(
    TestName="StirrupShapeMilimeters_HookLength_Mesh",
    ExpectedPointList=demesh_4.Vertices,
    ActualPointList=demesh_5.Vertices,
    Tolerance="0.00001")  # -> Result, FailedInfo
assert_point_list_4 = AssertPointList(
    TestName="StirrupShapeMeters_XYPlane_Mesh",
    ExpectedPointList=demesh_6.Vertices,
    ActualPointList=demesh_7.Vertices,
    Tolerance="0.00001")  # -> Result, FailedInfo
assert_point_list_5 = AssertPointList(
    TestName="StirrupShapeMilimeters_XZPlane_Mesh",
    ExpectedPointList=demesh_8.Vertices,
    ActualPointList=demesh_9.Vertices,
    Tolerance="0.00001")  # -> Result, FailedInfo
assert_point_list_6 = AssertPointList(
    TestName="StirrupShapeMilimeters_HookType1_Mesh",
    ExpectedPointList=demesh_10.Vertices,
    ActualPointList=demesh_11.Vertices,
    Tolerance="0.00001")  # -> Result, FailedInfo
assert_point_list_7 = AssertPointList(
    TestName="StirrupShapeMeters_HookLength_Mesh",
    ExpectedPointList=demesh_12.Vertices,
    ActualPointList=demesh_13.Vertices,
    Tolerance="0.00001")  # -> Result, FailedInfo
assert_point_list_8 = AssertPointList(
    TestName="StirrupShapeMeters_XZPlane_Mesh",
    ExpectedPointList=demesh_14.Vertices,
    ActualPointList=demesh_15.Vertices,
    Tolerance="0.00001")  # -> Result, FailedInfo
assert_point_list_9 = AssertPointList(
    TestName="StirrupShapeMeters_HookType1AndBendingRoller_Mesh",
    ExpectedPointList=demesh_16.Vertices,
    ActualPointList=demesh_17.Vertices,
    Tolerance="0.00001")  # -> Result, FailedInfo
assert_point_list_10 = AssertPointList(
    TestName="StirrupShapeMeters_Diameter_Mesh",
    ExpectedPointList=demesh_18.Vertices,
    ActualPointList=demesh_19.Vertices,
    Tolerance="0.00001")  # -> Result, FailedInfo
assert_point_list_11 = AssertPointList(
    TestName="StirrupShapeMeters_HeightAndWidth_Mesh",
    ExpectedPointList=demesh_20.Vertices,
    ActualPointList=demesh_21.Vertices,
    Tolerance="0.00001")  # -> Result, FailedInfo
entwine_6 = Entwine(
    Branch00=assert_point_list_2.Result,
    Branch01=assert_point_list_3.Result,
    Branch02=assert_point_list_6.Result,
    Branch03=assert_point_list_5.Result,
    Branch04=assert_point_list_4.Result,
    Branch05=assert_point_list_7.Result,
    Branch06=assert_point_list_9.Result,
    Branch07=assert_point_list_8.Result,
    Branch08=assert_point_list_10.Result,
    Branch09=assert_point_list_11.Result,
    FlattenInputs=True)  # -> flatten(Result)

# ----
# Spacer Shape
number_slider_6 = Slider(7850, range=0..10000)
division_7 = Division(A=number_slider_6, B="1e9")
division_8 = Division(A=Slider(7850, range=0..10000), B="1e9")
material_15 = Material(Name="Name of the material", Grade="Grade of the material", Density=division_7)
material_16 = Material(Name="Name of the material", Grade="Grade of the material", Density=division_8)
material_17 = Material(Name="Name of the material", Grade="Grade of the material", Density=Slider(7850, range=0..10000))
material_18 = Material(Name="Name of the material", Grade="Grade of the material", Density=Slider(7850, range=0..10000))
bending_roller_13 = BendingRoller(Diameter="80", Tolerance=0.0001, AngleTolerance=0.0175)
rebar_properties_13 = RebarProperties(Diameter="20", Material=material_15)
rebar_properties_14 = RebarProperties(Diameter="20", Material=material_16)
rebar_properties_15 = RebarProperties(Diameter="0.010", Material=material_17)
bending_roller_14 = BendingRoller(Diameter="0.080", Tolerance=0.0001, AngleTolerance=0.0175)
bending_roller_15 = BendingRoller(Diameter="80", Tolerance=0.0001, AngleTolerance=0.0175)
rebar_properties_16 = RebarProperties(Diameter="0.020", Material=material_18)
pt_9 = Point(Point(0, 0, 0))
bending_roller_16 = BendingRoller(Diameter="0.080", Tolerance=0.0001, AngleTolerance=0.0175)
xy_9 = XYPlane(Origin=Point(0, 0, 0))
xy_10 = XYPlane(Origin=Point(0, 0, 0))
xz_3 = XZPlane(Origin=pt_9)
xy_11 = XYPlane(Origin=Point(0, 0, 0))
spacer_shape = SpacerShape(
    Plane=xy_9,
    Height=Slider(200, range=0..1000),
    Length=Slider(300, range=0..1000),
    Width=Slider(500, range=0..1000),
    Properties=rebar_properties_13,
    BendingRoller=bending_roller_13)  # -> RebarShape, Mesh
spacer_shape_2 = SpacerShape(
    Plane=xz_3,
    Height=Slider(200, range=0..1000),
    Length=Slider(300, range=0..1000),
    Width=Slider(500, range=0..1000),
    Properties=rebar_properties_14,
    BendingRoller=bending_roller_15)  # -> RebarShape, Mesh
spacer_shape_3 = SpacerShape(
    Plane=xy_11,
    Height=Slider(0.2, range=0..0.2),
    Length=Slider(0.3, range=0..0.3),
    Width=Slider(0.5, range=0..0.5),
    Properties=rebar_properties_16,
    BendingRoller=bending_roller_16)  # -> RebarShape, Mesh
spacer_shape_4 = SpacerShape(
    Plane=xy_10,
    Height=Slider(0.2, range=0..0.2),
    Length=Slider(0.3, range=0..0.3),
    Width=Slider(0.5, range=0..0.5),
    Properties=rebar_properties_15,
    BendingRoller=bending_roller_14)  # -> RebarShape, Mesh
mesh_11 = Mesh(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)
mesh_12 = Mesh(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)
mesh_13 = Mesh(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)
mesh_14 = Mesh(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)
demesh_22 = DeconstructMesh(Mesh=mesh_11)  # -> Vertices, Faces, Colours, Normals
demesh_23 = DeconstructMesh(Mesh=spacer_shape.Mesh)  # -> Vertices, Faces, Colours, Normals
demesh_24 = DeconstructMesh(Mesh=mesh_12)  # -> Vertices, Faces, Colours, Normals
demesh_25 = DeconstructMesh(Mesh=spacer_shape_2.Mesh)  # -> Vertices, Faces, Colours, Normals
demesh_26 = DeconstructMesh(Mesh=mesh_13)  # -> Vertices, Faces, Colours, Normals
demesh_27 = DeconstructMesh(Mesh=spacer_shape_4.Mesh)  # -> Vertices, Faces, Colours, Normals
demesh_28 = DeconstructMesh(Mesh=mesh_14)  # -> Vertices, Faces, Colours, Normals
demesh_29 = DeconstructMesh(Mesh=spacer_shape_3.Mesh)  # -> Vertices, Faces, Colours, Normals
assert_point_list_12 = AssertPointList(
    TestName="SpacerShapeMilimeters_XYPlane_Mesh",
    ExpectedPointList=demesh_22.Vertices,
    ActualPointList=demesh_23.Vertices,
    Tolerance="0.00001")  # -> Result, FailedInfo
assert_point_list_13 = AssertPointList(
    TestName="SpacerShapeMilimeters_XZPlane_Mesh",
    ExpectedPointList=demesh_24.Vertices,
    ActualPointList=demesh_25.Vertices,
    Tolerance="0.00001")  # -> Result, FailedInfo
assert_point_list_14 = AssertPointList(
    TestName="SpacerShapeMeters_Diameter_Mesh",
    ExpectedPointList=demesh_26.Vertices,
    ActualPointList=demesh_27.Vertices,
    Tolerance="0.00001")  # -> Result, FailedInfo
assert_point_list_15 = AssertPointList(
    TestName="SpacerShapeMeters_XYPlane_Mesh",
    ExpectedPointList=demesh_28.Vertices,
    ActualPointList=demesh_29.Vertices,
    Tolerance="0.00001")  # -> Result, FailedInfo
entwine_7 = Entwine(
    Branch00=assert_point_list_12.Result,
    Branch01=assert_point_list_13.Result,
    Branch02=assert_point_list_15.Result,
    Branch03=assert_point_list_14.Result,
    FlattenInputs=True)  # -> flatten(Result)

# ----
# L-Bar Shape
number_slider_7 = Slider(7850, range=0..10000)
division_9 = Division(A=number_slider_7, B="1e9")
division_10 = Division(A=Slider(7850, range=0..10000), B="1e9")
material_19 = Material(Name="Name of the material", Grade="Grade of the material", Density=Slider(7850, range=0..10000))
material_20 = Material(Name="Name of the material", Grade="Grade of the material", Density=division_9)
material_21 = Material(Name="Name of the material", Grade="Grade of the material", Density=Slider(7850, range=0..10000))
material_22 = Material(Name="Name of the material", Grade="Grade of the material", Density=division_10)
bending_roller_17 = BendingRoller(Diameter="0.080", Tolerance=0.0001, AngleTolerance=0.0175)
bending_roller_18 = BendingRoller(Diameter="0.080", Tolerance=0.0001, AngleTolerance=0.0175)
bending_roller_19 = BendingRoller(Diameter="80", Tolerance=0.0001, AngleTolerance=0.0175)
rebar_properties_17 = RebarProperties(Diameter="0.010", Material=material_19)
pt_10 = Point(Point(1.360044089, 1.132041681, 0))
rebar_properties_18 = RebarProperties(Diameter="20", Material=material_20)
rebar_properties_19 = RebarProperties(Diameter="0.020", Material=material_21)
bending_roller_20 = BendingRoller(Diameter="80", Tolerance=0.0001, AngleTolerance=0.0175)
rebar_properties_20 = RebarProperties(Diameter="20", Material=material_22)
pt_11 = Point(Point(1.360044089, 1.132041681, 0))
pt_12 = Point(Point(10, 20, 30))
panel_13 = Panel("0.080")
yz = YZPlane(Origin=pt_10)
xy_12 = XYPlane(Origin=Point(0, 0, 0))
yz_2 = YZPlane(Origin=pt_11)
xz_4 = XZPlane(Origin=pt_12)
panel_15 = Panel("80")
l_bar_shape = LBarShape(
    Plane=yz,
    Height=Slider(0.2, range=0..0.2),
    Width=Slider(0.1, range=0..0.2),
    Properties=rebar_properties_17,
    BendingRoller=bending_roller_17)  # -> RebarShape, Mesh
l_bar_shape_2 = LBarShape(
    Plane=xz_4,
    Height=Slider(100, range=0..1000),
    Width=Slider(200, range=0..1000),
    Properties=rebar_properties_20,
    BendingRoller=bending_roller_19)  # -> RebarShape, Mesh
l_bar_shape_3 = LBarShape(
    Plane=xy_12,
    Height=Slider(100, range=0..1000),
    Width=Slider(200, range=0..1000),
    Properties=rebar_properties_18,
    BendingRoller=bending_roller_20)  # -> RebarShape, Mesh
l_bar_shape_4 = LBarShape(
    Plane=yz_2,
    Height=Slider(0.2, range=0..0.2),
    Width=Slider(0.1, range=0..0.2),
    Properties=rebar_properties_19,
    BendingRoller=bending_roller_18)  # -> RebarShape, Mesh
mesh_15 = Mesh(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)
mesh_16 = Mesh(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)
mesh_17 = Mesh(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)
mesh_18 = Mesh(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)
demesh_30 = DeconstructMesh(Mesh=mesh_15)  # -> Vertices, Faces, Colours, Normals
demesh_31 = DeconstructMesh(Mesh=l_bar_shape.Mesh)  # -> Vertices, Faces, Colours, Normals
demesh_32 = DeconstructMesh(Mesh=mesh_16)  # -> Vertices, Faces, Colours, Normals
demesh_33 = DeconstructMesh(Mesh=l_bar_shape_3.Mesh)  # -> Vertices, Faces, Colours, Normals
demesh_34 = DeconstructMesh(Mesh=mesh_17)  # -> Vertices, Faces, Colours, Normals
demesh_35 = DeconstructMesh(Mesh=l_bar_shape_4.Mesh)  # -> Vertices, Faces, Colours, Normals
demesh_36 = DeconstructMesh(Mesh=mesh_18)  # -> Vertices, Faces, Colours, Normals
demesh_37 = DeconstructMesh(Mesh=l_bar_shape_2.Mesh)  # -> Vertices, Faces, Colours, Normals
assert_point_list_16 = AssertPointList(
    TestName="LBarShapeMeters_Diameter_Mesh",
    ExpectedPointList=demesh_30.Vertices,
    ActualPointList=demesh_31.Vertices,
    Tolerance="0.00001")  # -> Result, FailedInfo
assert_point_list_17 = AssertPointList(
    TestName="LBarShapeMilimeters_XYPlane_Mesh",
    ExpectedPointList=demesh_32.Vertices,
    ActualPointList=demesh_33.Vertices,
    Tolerance="0.00001")  # -> Result, FailedInfo
assert_point_list_18 = AssertPointList(
    TestName="LBarShapeMilimeters_XZPlane_Mesh",
    ExpectedPointList=demesh_36.Vertices,
    ActualPointList=demesh_37.Vertices,
    Tolerance="0.00001")  # -> Result, FailedInfo
assert_point_list_19 = AssertPointList(
    TestName="LBarShapeMeters_YZPlane_Mesh",
    ExpectedPointList=demesh_34.Vertices,
    ActualPointList=demesh_35.Vertices,
    Tolerance="0.00001")  # -> Result, FailedInfo
entwine_8 = Entwine(
    Branch00=assert_point_list_17.Result,
    Branch01=assert_point_list_18.Result,
    Branch02=assert_point_list_19.Result,
    Branch03=assert_point_list_16.Result,
    FlattenInputs=True)  # -> flatten(Result)

# ----
# Rectangle To Line Bar Shape
number_slider_8 = Slider(7850, range=0..10000)
number_slider_9 = Slider(100, range=0..1000)
number_slider_10 = Slider(100, range=0..1000)
number_slider_11 = Slider(150, range=0..1000)
number_slider_12 = Slider(150, range=0..1000)
number_slider_13 = Slider(100, range=0..1000)
number_slider_14 = Slider(150, range=0..1000)
division_11 = Division(A=number_slider_8, B="1e9")
division_12 = Division(A=Slider(7850, range=0..10000), B="1e9")
division_13 = Division(A=Slider(7850, range=0..10000), B="1e9")
division_14 = Division(A=Slider(7850, range=0..10000), B="1e9")
neg = Negative(Value=number_slider_10)
neg_2 = Negative(Value=number_slider_11)
material_23 = Material(Name="Name of the material", Grade="Grade of the material", Density=division_11)
neg_3 = Negative(Value=number_slider_9)
division_15 = Division(A=Slider(7850, range=0..10000), B="1e9")
neg_4 = Negative(Value=number_slider_12)
material_24 = Material(Name="Name of the material", Grade="Grade of the material", Density=division_12)
xy_13 = XYPlane(Origin=Point(0, 0, 0))
division_16 = Division(A=Slider(7850, range=0..10000), B="1e9")
xy_14 = XYPlane(Origin=Point(0, 0, 0))
material_25 = Material(Name="Name of the material", Grade="Grade of the material", Density=division_13)
xy_15 = XYPlane(Origin=Point(0, 0, 0))
material_26 = Material(Name="Name of the material", Grade="Grade of the material", Density=division_14)
dom = ConstructDomain(DomainStart=number_slider_10, DomainEnd=neg)
dom_2 = ConstructDomain(DomainStart=0, DomainEnd=Slider(300, range=0..1000))
division_17 = Division(A=Slider(7850, range=0..10000), B="1e9")
dom_3 = ConstructDomain(DomainStart=0, DomainEnd=Slider(200, range=0..1000))
dom_4 = ConstructDomain(DomainStart=number_slider_11, DomainEnd=neg_2)
division_18 = Division(A=Slider(7850, range=0..10000), B="1e9")
neg_5 = Negative(Value=number_slider_13)
xy_16 = XYPlane(Origin=Point(0, 0, 0))
material_27 = Material(Name="Name of the material", Grade="Grade of the material", Density=division_15)
neg_6 = Negative(Value=number_slider_14)
dom_5 = ConstructDomain(DomainStart=number_slider_9, DomainEnd=neg_3)
dom_6 = ConstructDomain(DomainStart=number_slider_12, DomainEnd=neg_4)
division_19 = Division(A=Slider(7850, range=0..10000), B="1e9")
rectangle = Rectangle(Plane=xy_13, XSize=Slider(200, range=0..1000), YSize=Slider(300, range=0..1000), Radius=0)  # -> Rectangle, Length
xy_17 = XYPlane(Origin=Point(0, 0, 0))
neg_7 = Negative(Value=Slider(200, range=0..1000))
material_28 = Material(Name="Name of the material", Grade="Grade of the material", Density=division_16)
rectangle_2 = Rectangle(Plane=xy_14, XSize=Slider(200, range=0..1000), YSize=Slider(300, range=0..1000), Radius=0)  # -> Rectangle, Length
xy_18 = XYPlane(Origin=Point(0, 0, 0))
neg_8 = Negative(Value=Slider(200, range=0..1000))
neg_9 = Negative(Value=Slider(300, range=0..1000))
material_29 = Material(Name="Name of the material", Grade="Grade of the material", Density=Slider(7850, range=0..10000))
rectangle_3 = Rectangle(Plane=xy_15, XSize=Slider(200, range=0..1000), YSize=Slider(300, range=0..1000), Radius=0)  # -> Rectangle, Length
material_30 = Material(Name="Name of the material", Grade="Grade of the material", Density=division_17)
xy_19 = XYPlane(Origin=Point(0, 0, 0))
material_31 = Material(Name="Name of the material", Grade="Grade of the material", Density=division_18)
rectangle_4 = Rectangle(Plane=xy_16, XSize=Slider(200, range=0..1000), YSize=Slider(300, range=0..1000), Radius=0)  # -> Rectangle, Length
material_32 = Material(Name="Name of the material", Grade="Grade of the material", Density=Slider(7850, range=0..10000))
xy_20 = XYPlane(Origin=Point(0, 0, 0))
dom_7 = ConstructDomain(DomainStart=number_slider_13, DomainEnd=neg_5)
dom_8 = ConstructDomain(DomainStart=number_slider_14, DomainEnd=neg_6)
division_20 = Division(A=Slider(7850, range=0..10000), B="1e9")
material_33 = Material(Name="Name of the material", Grade="Grade of the material", Density=division_19)
xy_21 = XYPlane(Origin=Point(0, 0, 0))
xz_5 = XZPlane(Origin=Point(0, 0, 0))
cover_dimensions_3 = CoverDimensions(
    Left=Slider(10, range=0..100),
    Right=Slider(20, range=0..100),
    Top=Slider(30, range=0..100),
    Bottom=Slider(40, range=0..100))
rectangle_5 = Rectangle(Plane=xy_17, XSize=neg_7, YSize=Slider(300, range=0..1000), Radius=0)  # -> Rectangle, Length
xy_22 = XYPlane(Origin=Point(0, 0, 0))
rebar_properties_21 = RebarProperties(Diameter="20", Material=material_23)
cover_dimensions_4 = CoverDimensions(
    Left=Slider(10, range=0..100),
    Right=Slider(20, range=0..100),
    Top=Slider(30, range=0..100),
    Bottom=Slider(40, range=0..100))
rectangle_6 = Rectangle(Plane=xy_18, XSize=neg_8, YSize=neg_9, Radius=0)  # -> Rectangle, Length
rebar_properties_22 = RebarProperties(Diameter="20", Material=material_24)
cover_dimensions_5 = CoverDimensions(
    Left=Slider(10, range=0..100),
    Right=Slider(20, range=0..100),
    Top=Slider(30, range=0..100),
    Bottom=Slider(40, range=0..100))
rectangle_7 = Rectangle(Plane=xy_19, XSize=Slider(0.2, range=0..1), YSize=Slider(0.3, range=0..1), Radius=0)  # -> Rectangle, Length
rebar_properties_23 = RebarProperties(Diameter="20", Material=material_25)
cover_dimensions_6 = CoverDimensions(
    Left=Slider(10, range=0..100),
    Right=Slider(20, range=0..100),
    Top=Slider(30, range=0..100),
    Bottom=Slider(40, range=0..100))
rectangle_8 = Rectangle(Plane=xy_20, XSize=dom, YSize=dom_2, Radius=0)  # -> Rectangle, Length
material_34 = Material(Name="Name of the material", Grade="Grade of the material", Density=division_20)
rectangle_9 = Rectangle(Plane=xy_21, XSize=dom_3, YSize=dom_4, Radius=0)  # -> Rectangle, Length
rebar_properties_24 = RebarProperties(Diameter="20", Material=material_26)
rectangle_10 = Rectangle(Plane=xz_5, XSize=Slider(0.2, range=0..1), YSize=Slider(0.3, range=0..1), Radius=0)  # -> Rectangle, Length
cover_dimensions_7 = CoverDimensions(
    Left=Slider(10, range=0..100),
    Right=Slider(20, range=0..100),
    Top=Slider(30, range=0..100),
    Bottom=Slider(40, range=0..100))
xy_23 = XYPlane(Origin=Point(0, 0, 0))
rectangle_11 = Rectangle(Plane=xy_22, XSize=dom_5, YSize=dom_6, Radius=0)  # -> Rectangle, Length
rebar_properties_25 = RebarProperties(Diameter="20", Material=material_27)
cover_dimensions_8 = CoverDimensions(
    Left=Slider(10, range=0..100),
    Right=Slider(20, range=0..100),
    Top=Slider(30, range=0..100),
    Bottom=Slider(40, range=0..100))
rebar_properties_26 = RebarProperties(Diameter="20", Material=material_28)
cover_dimensions_9 = CoverDimensions(
    Left=Slider(0.01, range=0..0.11),
    Right=Slider(0.02, range=0..0.11),
    Top=Slider(0.03, range=0..0.11),
    Bottom=Slider(0.04, range=0..0.11))
cover_dimensions_10 = CoverDimensions(
    Left=Slider(10, range=0..100),
    Right=Slider(20, range=0..100),
    Top=Slider(30, range=0..100),
    Bottom=Slider(40, range=0..100))
rebar_properties_27 = RebarProperties(Diameter="0.020", Material=material_29)
cover_dimensions_11 = CoverDimensions(
    Left=Slider(10, range=0..100),
    Right=Slider(20, range=0..100),
    Top=Slider(30, range=0..100),
    Bottom=Slider(40, range=0..100))
rebar_properties_28 = RebarProperties(Diameter="20", Material=material_30)
cover_dimensions_12 = CoverDimensions(
    Left=Slider(0.01, range=0..0.11),
    Right=Slider(0.02, range=0..0.11),
    Top=Slider(0.03, range=0..0.11),
    Bottom=Slider(0.04, range=0..0.11))
rectangle_12 = Rectangle(Plane=xy_23, XSize=dom_7, YSize=dom_8, Radius=0)  # -> Rectangle, Length
rebar_properties_29 = RebarProperties(Diameter="20", Material=material_31)
cover_dimensions_13 = CoverDimensions(
    Left=Slider(10, range=0..100),
    Right=Slider(20, range=0..100),
    Top=Slider(30, range=0..100),
    Bottom=Slider(40, range=0..100))
rebar_properties_30 = RebarProperties(Diameter="0.020", Material=material_32)
rebar_properties_31 = RebarProperties(Diameter="20", Material=material_33)
rectangle_to_line_bar_shape = RectangleToLineBarShape(
    Rectangle=rectangle.Rectangle,
    Properties=rebar_properties_21,
    Position=Slider(0, range=0..3),
    CoverDimensions=cover_dimensions_3)  # -> RebarShape, Mesh
rectangle_to_line_bar_shape_2 = RectangleToLineBarShape(
    Rectangle=rectangle_2.Rectangle,
    Properties=rebar_properties_22,
    Position=Slider(1, range=0..3),
    CoverDimensions=cover_dimensions_4)  # -> RebarShape, Mesh
rectangle_to_line_bar_shape_3 = RectangleToLineBarShape(
    Rectangle=rectangle_3.Rectangle,
    Properties=rebar_properties_23,
    Position=Slider(2, range=0..3),
    CoverDimensions=cover_dimensions_5)  # -> RebarShape, Mesh
cover_dimensions_14 = CoverDimensions(
    Left=Slider(10, range=0..100),
    Right=Slider(20, range=0..100),
    Top=Slider(30, range=0..100),
    Bottom=Slider(40, range=0..100))
rectangle_to_line_bar_shape_4 = RectangleToLineBarShape(
    Rectangle=rectangle_4.Rectangle,
    Properties=rebar_properties_24,
    Position=Slider(3, range=0..3),
    CoverDimensions=cover_dimensions_6)  # -> RebarShape, Mesh
rebar_properties_32 = RebarProperties(Diameter="12", Material=material_34)
panel_16 = Panel("LineBarShapeMilimeters_XYPlaneRectangleWithDescendingX_Mesh")
panel_17 = Panel("LineBarShapeMilimeters_XYPlaneRectangleWithDescendingXAndY_Mesh")
panel_18 = Panel("LineBarShapeMilimeters_XYPlaneRectangleWithDescendingY_Mesh")
rectangle_to_line_bar_shape_5 = RectangleToLineBarShape(
    Rectangle=rectangle_5.Rectangle,
    Properties=rebar_properties_25,
    Position=Slider(0, range=0..3),
    CoverDimensions=cover_dimensions_7)  # -> RebarShape, Mesh
rectangle_to_line_bar_shape_6 = RectangleToLineBarShape(
    Rectangle=rectangle_6.Rectangle,
    Properties=rebar_properties_26,
    Position=Slider(0, range=0..3),
    CoverDimensions=cover_dimensions_8)  # -> RebarShape, Mesh
rectangle_to_line_bar_shape_7 = RectangleToLineBarShape(
    Rectangle=rectangle_7.Rectangle,
    Properties=rebar_properties_27,
    Position=Slider(0, range=0..3),
    CoverDimensions=cover_dimensions_9)  # -> RebarShape, Mesh
rectangle_to_line_bar_shape_8 = RectangleToLineBarShape(
    Rectangle=rectangle_8.Rectangle,
    Properties=rebar_properties_28,
    Position=Slider(0, range=0..3),
    CoverDimensions=cover_dimensions_10)  # -> RebarShape, Mesh
rectangle_to_line_bar_shape_9 = RectangleToLineBarShape(
    Rectangle=rectangle_9.Rectangle,
    Properties=rebar_properties_29,
    Position=Slider(0, range=0..3),
    CoverDimensions=cover_dimensions_11)  # -> RebarShape, Mesh
rectangle_to_line_bar_shape_10 = RectangleToLineBarShape(
    Rectangle=rectangle_10.Rectangle,
    Properties=rebar_properties_30,
    Position=Slider(0, range=0..3),
    CoverDimensions=cover_dimensions_12)  # -> RebarShape, Mesh
rectangle_to_line_bar_shape_11 = RectangleToLineBarShape(
    Rectangle=rectangle_11.Rectangle,
    Properties=rebar_properties_31,
    Position=Slider(0, range=0..3),
    CoverDimensions=cover_dimensions_13)  # -> RebarShape, Mesh
mesh_19 = Mesh(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)
mesh_20 = Mesh(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)
rectangle_to_line_bar_shape_12 = RectangleToLineBarShape(
    Rectangle=rectangle_12.Rectangle,
    Properties=rebar_properties_32,
    Position=Slider(0, range=0..3),
    CoverDimensions=cover_dimensions_14)  # -> RebarShape, Mesh
mesh_21 = Mesh(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)
demesh_38 = DeconstructMesh(Mesh=rectangle_to_line_bar_shape.Mesh)  # -> Vertices, Faces, Colours, Normals
demesh_39 = DeconstructMesh(Mesh=mesh_19)  # -> Vertices, Faces, Colours, Normals
mesh_22 = Mesh(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)
demesh_40 = DeconstructMesh(Mesh=rectangle_to_line_bar_shape_2.Mesh)  # -> Vertices, Faces, Colours, Normals
demesh_41 = DeconstructMesh(Mesh=mesh_20)  # -> Vertices, Faces, Colours, Normals
mesh_23 = Mesh(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)
mesh_24 = Mesh(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)
demesh_42 = DeconstructMesh(Mesh=rectangle_to_line_bar_shape_3.Mesh)  # -> Vertices, Faces, Colours, Normals
demesh_43 = DeconstructMesh(Mesh=mesh_21)  # -> Vertices, Faces, Colours, Normals
demesh_44 = DeconstructMesh(Mesh=rectangle_to_line_bar_shape_4.Mesh)  # -> Vertices, Faces, Colours, Normals
demesh_45 = DeconstructMesh(Mesh=mesh_22)  # -> Vertices, Faces, Colours, Normals
mesh_25 = Mesh(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)
demesh_46 = DeconstructMesh(Mesh=rectangle_to_line_bar_shape_5.Mesh)  # -> Vertices, Faces, Colours, Normals
demesh_47 = DeconstructMesh(Mesh=mesh_23)  # -> Vertices, Faces, Colours, Normals
mesh_26 = Mesh(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)
mesh_27 = Mesh(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)
mesh_28 = Mesh(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)
demesh_48 = DeconstructMesh(Mesh=rectangle_to_line_bar_shape_6.Mesh)  # -> Vertices, Faces, Colours, Normals
demesh_49 = DeconstructMesh(Mesh=mesh_24)  # -> Vertices, Faces, Colours, Normals
mesh_29 = Mesh(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)
demesh_50 = DeconstructMesh(Mesh=rectangle_to_line_bar_shape_7.Mesh)  # -> Vertices, Faces, Colours, Normals
demesh_51 = DeconstructMesh(Mesh=mesh_25)  # -> Vertices, Faces, Colours, Normals
demesh_52 = DeconstructMesh(Mesh=rectangle_to_line_bar_shape_8.Mesh)  # -> Vertices, Faces, Colours, Normals
demesh_53 = DeconstructMesh(Mesh=mesh_26)  # -> Vertices, Faces, Colours, Normals
demesh_54 = DeconstructMesh(Mesh=rectangle_to_line_bar_shape_9.Mesh)  # -> Vertices, Faces, Colours, Normals
demesh_55 = DeconstructMesh(Mesh=mesh_27)  # -> Vertices, Faces, Colours, Normals
assert_point_list_20 = AssertPointList(
    TestName="LineBarShapeMilimeters_XYPlaneRectangle_Mesh",
    ExpectedPointList=demesh_39.Vertices,
    ActualPointList=demesh_38.Vertices,
    Tolerance="0.00001")  # -> Result, FailedInfo
demesh_56 = DeconstructMesh(Mesh=rectangle_to_line_bar_shape_10.Mesh)  # -> Vertices, Faces, Colours, Normals
demesh_57 = DeconstructMesh(Mesh=mesh_28)  # -> Vertices, Faces, Colours, Normals
demesh_58 = DeconstructMesh(Mesh=rectangle_to_line_bar_shape_11.Mesh)  # -> Vertices, Faces, Colours, Normals
demesh_59 = DeconstructMesh(Mesh=mesh_29)  # -> Vertices, Faces, Colours, Normals
assert_point_list_21 = AssertPointList(
    TestName="LineBarShapeMilimeters_Position1_Mesh",
    ExpectedPointList=demesh_41.Vertices,
    ActualPointList=demesh_40.Vertices,
    Tolerance="0.00001")  # -> Result, FailedInfo
mesh_30 = Mesh(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)
assert_point_list_22 = AssertPointList(
    TestName="LineBarShapeMilimeters_Position2_Mesh",
    ExpectedPointList=demesh_43.Vertices,
    ActualPointList=demesh_42.Vertices,
    Tolerance="0.00001")  # -> Result, FailedInfo
assert_point_list_23 = AssertPointList(
    TestName="LineBarShapeMilimeters_Position3_Mesh",
    ExpectedPointList=demesh_45.Vertices,
    ActualPointList=demesh_44.Vertices,
    Tolerance="0.00001")  # -> Result, FailedInfo
assert_point_list_24 = AssertPointList(
    TestName="LineBarShapeMilimeters_XYPlaneRectangleNegativeX_Mesh",
    ExpectedPointList=demesh_47.Vertices,
    ActualPointList=demesh_46.Vertices,
    Tolerance="0.00001")  # -> Result, FailedInfo
demesh_60 = DeconstructMesh(Mesh=rectangle_to_line_bar_shape_12.Mesh)  # -> Vertices, Faces, Colours, Normals
demesh_61 = DeconstructMesh(Mesh=mesh_30)  # -> Vertices, Faces, Colours, Normals
assert_point_list_25 = AssertPointList(
    TestName="LineBarShapeMilimeters_XYPlaneRectangleNegativeXAndY_Mesh",
    ExpectedPointList=demesh_49.Vertices,
    ActualPointList=demesh_48.Vertices,
    Tolerance="0.00001")  # -> Result, FailedInfo
assert_point_list_26 = AssertPointList(
    TestName="LineBarShapeMeters_XYPlaneRectangle_Mesh",
    ExpectedPointList=demesh_51.Vertices,
    ActualPointList=demesh_50.Vertices,
    Tolerance="0.00001")  # -> Result, FailedInfo
assert_point_list_27 = AssertPointList(TestName=panel_16, ExpectedPointList=demesh_53.Vertices, ActualPointList=demesh_52.Vertices, Tolerance="0.00001")  # -> Result, FailedInfo
assert_point_list_28 = AssertPointList(TestName=panel_18, ExpectedPointList=demesh_55.Vertices, ActualPointList=demesh_54.Vertices, Tolerance="0.00001")  # -> Result, FailedInfo
assert_point_list_29 = AssertPointList(
    TestName="LineBarShapeMeters_XZPlaneRectangle_Mesh",
    ExpectedPointList=demesh_57.Vertices,
    ActualPointList=demesh_56.Vertices,
    Tolerance="0.00001")  # -> Result, FailedInfo
assert_point_list_30 = AssertPointList(TestName=panel_17, ExpectedPointList=demesh_59.Vertices, ActualPointList=demesh_58.Vertices, Tolerance="0.00001")  # -> Result, FailedInfo
assert_point_list_31 = AssertPointList(
    TestName="LineBarShapeMilimeters_Diameter_Mesh",
    ExpectedPointList=demesh_61.Vertices,
    ActualPointList=demesh_60.Vertices,
    Tolerance="0.00001")  # -> Result, FailedInfo
entwine_9 = Entwine(
    Branch00=assert_point_list_20.Result,
    Branch01=assert_point_list_21.Result,
    Branch02=assert_point_list_22.Result,
    Branch03=assert_point_list_23.Result,
    Branch04=assert_point_list_24.Result,
    Branch05=assert_point_list_25.Result,
    Branch06=assert_point_list_27.Result,
    Branch07=assert_point_list_28.Result,
    Branch08=assert_point_list_30.Result,
    Branch09=assert_point_list_31.Result,
    Branch010=assert_point_list_26.Result,
    Branch011=assert_point_list_29.Result,
    FlattenInputs=True)  # -> flatten(Result)

# ----
# Rectangle To U-Bar Shape
number_slider_15 = Slider(7850, range=0..10000)
division_21 = Division(A=number_slider_15, B="1e9")
division_22 = Division(A=Slider(7850, range=0..10000), B="1e9")
division_23 = Division(A=Slider(7850, range=0..10000), B="1e9")
number_slider_16 = Slider(0.2, range=0..1)
material_35 = Material(Name="Name of the material", Grade="Grade of the material", Density=division_21)
material_36 = Material(Name="Name of the material", Grade="Grade of the material", Density=division_22)
division_24 = Division(A=Slider(7850, range=0..10000), B="1e9")
division_25 = Division(A=Slider(7850, range=0..10000), B="1e9")
material_37 = Material(Name="Name of the material", Grade="Grade of the material", Density=division_23)
xy_24 = XYPlane(Origin=Point(0, 0, 0))
xy_25 = XYPlane(Origin=Point(0, 0, 0))
division_26 = Division(A=Slider(7850, range=0..10000), B="1e9")
xy_26 = XYPlane(Origin=Point(0, 0, 0))
material_38 = Material(Name="Name of the material", Grade="Grade of the material", Density=division_24)
material_39 = Material(Name="Name of the material", Grade="Grade of the material", Density=division_25)
xy_27 = XYPlane(Origin=Point(0, 0, 0))
material_40 = Material(Name="Name of the material", Grade="Grade of the material", Density=division_26)
xy_28 = XYPlane(Origin=Point(0, 0, 0))
neg_10 = Negative(Value=number_slider_16)
bending_roller_21 = BendingRoller(Diameter="60", Tolerance=0.0001, AngleTolerance=0.0175)
bending_roller_22 = BendingRoller(Diameter="60", Tolerance=0.0001, AngleTolerance=0.0175)
rectangle_13 = Rectangle(Plane=xy_24, XSize=Slider(200, range=0..1000), YSize=Slider(300, range=0..1000), Radius=0)  # -> Rectangle, Length
material_41 = Material(Name="Name of the material", Grade="Grade of the material", Density=Slider(7850, range=0..10000))
rectangle_14 = Rectangle(Plane=xy_25, XSize=Slider(200, range=0..1000), YSize=Slider(300, range=0..1000), Radius=0)  # -> Rectangle, Length
material_42 = Material(Name="Name of the material", Grade="Grade of the material", Density=Slider(7850, range=0..10000))
bending_roller_23 = BendingRoller(Diameter="80", Tolerance=0.0001, AngleTolerance=0.0175)
rebar_properties_33 = RebarProperties(Diameter="12", Material=material_35)
cover_dimensions_15 = CoverDimensions(
    Left=Slider(10, range=0..100),
    Right=Slider(20, range=0..100),
    Top=Slider(30, range=0..100),
    Bottom=Slider(40, range=0..100))
rectangle_15 = Rectangle(Plane=xy_26, XSize=Slider(200, range=0..1000), YSize=Slider(300, range=0..1000), Radius=0)  # -> Rectangle, Length
material_43 = Material(Name="Name of the material", Grade="Grade of the material", Density=Slider(7850, range=0..10000))
rebar_properties_34 = RebarProperties(Diameter="20", Material=material_36)
cover_dimensions_16 = CoverDimensions(
    Left=Slider(10, range=0..100),
    Right=Slider(20, range=0..100),
    Top=Slider(30, range=0..100),
    Bottom=Slider(40, range=0..100))
material_44 = Material(Name="Name of the material", Grade="Grade of the material", Density=Slider(7850, range=0..10000))
rebar_properties_35 = RebarProperties(Diameter="12", Material=material_37)
cover_dimensions_17 = CoverDimensions(
    Left=Slider(10, range=0..100),
    Right=Slider(20, range=0..100),
    Top=Slider(30, range=0..100),
    Bottom=Slider(40, range=0..100))
dom_9 = ConstructDomain(DomainStart=number_slider_16, DomainEnd=neg_10)
xy_29 = XYPlane(Origin=Point(0, 0, 0))
bending_roller_24 = BendingRoller(Diameter="60", Tolerance=0.0001, AngleTolerance=0.0175)
xy_30 = XYPlane(Origin=Point(0, 0, 0))
xz_6 = XZPlane(Origin=Point(0, 0, 0))
rectangle_16 = Rectangle(Plane=xy_27, XSize=Slider(200, range=0..1000), YSize=Slider(300, range=0..1000), Radius=0)  # -> Rectangle, Length
bending_roller_25 = BendingRoller(Diameter="60", Tolerance=0.0001, AngleTolerance=0.0175)
xy_31 = XYPlane(Origin=Point(0, 0, 0))
rectangle_17 = Rectangle(Plane=xy_28, XSize=Slider(200, range=0..1000), YSize=Slider(300, range=0..1000), Radius=0)  # -> Rectangle, Length
bending_roller_26 = BendingRoller(Diameter="0.060", Tolerance=0.0001, AngleTolerance=0.0175)
rebar_properties_36 = RebarProperties(Diameter="12", Material=material_38)
cover_dimensions_18 = CoverDimensions(
    Left=Slider(10, range=0..100),
    Right=Slider(20, range=0..100),
    Top=Slider(30, range=0..100),
    Bottom=Slider(40, range=0..100))
xy_32 = XYPlane(Origin=Point(0, 0, 0))
bending_roller_27 = BendingRoller(Diameter="60", Tolerance=0.0001, AngleTolerance=0.0175)
bending_roller_28 = BendingRoller(Diameter="0.060", Tolerance=0.0001, AngleTolerance=0.0175)
rebar_properties_37 = RebarProperties(Diameter="12", Material=material_39)
cover_dimensions_19 = CoverDimensions(
    Left=Slider(10, range=0..100),
    Right=Slider(20, range=0..100),
    Top=Slider(30, range=0..100),
    Bottom=Slider(40, range=0..100))
rectangle_18 = Rectangle(Plane=xy_29, XSize=Slider(200, range=0..1000), YSize=Slider(300, range=0..1000), Radius=0)  # -> Rectangle, Length
bending_roller_29 = BendingRoller(Diameter="0.060", Tolerance=0.0001, AngleTolerance=0.0175)
rectangle_19 = Rectangle(Plane=xy_30, XSize=Slider(0.2, range=0..1), YSize=Slider(0.3, range=0..1), Radius=0)  # -> Rectangle, Length
rectangle_20 = Rectangle(Plane=xz_6, XSize=Slider(0.2, range=0..1), YSize=Slider(0.3, range=0..1), Radius=0)  # -> Rectangle, Length
cover_dimensions_20 = CoverDimensions(
    Left=Slider(0.01, range=0..0.11),
    Right=Slider(0.02, range=0..0.11),
    Top=Slider(0.03, range=0..0.11),
    Bottom=Slider(0.04, range=0..0.11))
rebar_properties_38 = RebarProperties(Diameter="12", Material=material_40)
cover_dimensions_21 = CoverDimensions(
    Left=Slider(10, range=0..100),
    Right=Slider(20, range=0..100),
    Top=Slider(30, range=0..100),
    Bottom=Slider(40, range=0..100))
bending_roller_30 = BendingRoller(Diameter="0.060", Tolerance=0.0001, AngleTolerance=0.0175)
cover_dimensions_22 = CoverDimensions(
    Left=Slider(0.01, range=0..0.11),
    Right=Slider(0.02, range=0..0.11),
    Top=Slider(0.03, range=0..0.11),
    Bottom=Slider(0.04, range=0..0.11))
rectangle_21 = Rectangle(Plane=xy_31, XSize=Slider(0.2, range=0..1), YSize=Slider(0.3, range=0..1), Radius=0)  # -> Rectangle, Length
cover_dimensions_23 = CoverDimensions(
    Left=Slider(0.01, range=0..0.11),
    Right=Slider(0.02, range=0..0.11),
    Top=Slider(0.03, range=0..0.11),
    Bottom=Slider(0.04, range=0..0.11))
rebar_properties_39 = RebarProperties(Diameter="0.012", Material=material_41)
rectangle_22 = Rectangle(Plane=xy_32, XSize=dom_9, YSize=Slider(0.3, range=0..1), Radius=0)  # -> Rectangle, Length
rebar_properties_40 = RebarProperties(Diameter="0.012", Material=material_42)
cover_dimensions_24 = CoverDimensions(
    Left=Slider(0.01, range=0..0.11),
    Right=Slider(0.02, range=0..0.11),
    Top=Slider(0.03, range=0..0.11),
    Bottom=Slider(0.04, range=0..0.11))
rebar_properties_41 = RebarProperties(Diameter="0.012", Material=material_43)
rebar_properties_42 = RebarProperties(Diameter="0.012", Material=material_44)
rectangle_to_u_bar_shape = RectangleToUBarShape(
    Rectangle=rectangle_13.Rectangle,
    Properties=rebar_properties_33,
    BendingRoller=bending_roller_21,
    Position=Slider(0, range=0..3),
    CoverDimensions=cover_dimensions_15,
    HookLength=Slider(100, range=0..1000))  # -> RebarShape, Mesh
rectangle_to_u_bar_shape_2 = RectangleToUBarShape(
    Rectangle=rectangle_14.Rectangle,
    Properties=rebar_properties_34,
    BendingRoller=bending_roller_22,
    Position=Slider(0, range=0..3),
    CoverDimensions=cover_dimensions_16,
    HookLength=Slider(100, range=0..1000))  # -> RebarShape, Mesh
rectangle_to_u_bar_shape_3 = RectangleToUBarShape(
    Rectangle=rectangle_15.Rectangle,
    Properties=rebar_properties_35,
    BendingRoller=bending_roller_23,
    Position=Slider(0, range=0..3),
    CoverDimensions=cover_dimensions_17,
    HookLength=Slider(100, range=0..1000))  # -> RebarShape, Mesh
rectangle_to_u_bar_shape_4 = RectangleToUBarShape(
    Rectangle=rectangle_16.Rectangle,
    Properties=rebar_properties_36,
    BendingRoller=bending_roller_27,
    Position=Slider(1, range=0..3),
    CoverDimensions=cover_dimensions_18,
    HookLength=Slider(100, range=0..1000))  # -> RebarShape, Mesh
rectangle_to_u_bar_shape_5 = RectangleToUBarShape(
    Rectangle=rectangle_17.Rectangle,
    Properties=rebar_properties_37,
    BendingRoller=bending_roller_24,
    Position=Slider(2, range=0..3),
    CoverDimensions=cover_dimensions_19,
    HookLength=Slider(100, range=0..1000))  # -> RebarShape, Mesh
rectangle_to_u_bar_shape_6 = RectangleToUBarShape(
    Rectangle=rectangle_18.Rectangle,
    Properties=rebar_properties_38,
    BendingRoller=bending_roller_25,
    Position=Slider(3, range=0..3),
    CoverDimensions=cover_dimensions_21,
    HookLength=Slider(100, range=0..1000))  # -> RebarShape, Mesh
rectangle_to_u_bar_shape_7 = RectangleToUBarShape(
    Rectangle=rectangle_19.Rectangle,
    Properties=rebar_properties_39,
    BendingRoller=bending_roller_26,
    Position=Slider(0, range=0..3),
    CoverDimensions=cover_dimensions_20,
    HookLength=Slider(0.1, range=0..0.1))  # -> RebarShape, Mesh
rectangle_to_u_bar_shape_8 = RectangleToUBarShape(
    Rectangle=rectangle_20.Rectangle,
    Properties=rebar_properties_40,
    BendingRoller=bending_roller_28,
    Position=Slider(0, range=0..3),
    CoverDimensions=cover_dimensions_22,
    HookLength=Slider(0.1, range=0..0.1))  # -> RebarShape, Mesh
rectangle_to_u_bar_shape_9 = RectangleToUBarShape(
    Rectangle=rectangle_21.Rectangle,
    Properties=rebar_properties_41,
    BendingRoller=bending_roller_29,
    Position=Slider(0, range=0..3),
    CoverDimensions=cover_dimensions_23,
    HookLength=Slider(0.05, range=0..0.1))  # -> RebarShape, Mesh
mesh_31 = Mesh(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)
mesh_32 = Mesh(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)
rectangle_to_u_bar_shape_10 = RectangleToUBarShape(
    Rectangle=rectangle_22.Rectangle,
    Properties=rebar_properties_42,
    BendingRoller=bending_roller_30,
    Position=Slider(0, range=0..3),
    CoverDimensions=cover_dimensions_24,
    HookLength=Slider(0.1, range=0..0.1))  # -> RebarShape, Mesh
mesh_33 = Mesh(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)
demesh_62 = DeconstructMesh(Mesh=rectangle_to_u_bar_shape.Mesh)  # -> Vertices, Faces, Colours, Normals
demesh_63 = DeconstructMesh(Mesh=mesh_31)  # -> Vertices, Faces, Colours, Normals
demesh_64 = DeconstructMesh(Mesh=rectangle_to_u_bar_shape_2.Mesh)  # -> Vertices, Faces, Colours, Normals
demesh_65 = DeconstructMesh(Mesh=mesh_32)  # -> Vertices, Faces, Colours, Normals
demesh_66 = DeconstructMesh(Mesh=rectangle_to_u_bar_shape_3.Mesh)  # -> Vertices, Faces, Colours, Normals
mesh_34 = Mesh(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)
demesh_67 = DeconstructMesh(Mesh=mesh_33)  # -> Vertices, Faces, Colours, Normals
mesh_35 = Mesh(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)
mesh_36 = Mesh(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)
demesh_68 = DeconstructMesh(Mesh=rectangle_to_u_bar_shape_4.Mesh)  # -> Vertices, Faces, Colours, Normals
demesh_69 = DeconstructMesh(Mesh=mesh_34)  # -> Vertices, Faces, Colours, Normals
mesh_37 = Mesh(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)
demesh_70 = DeconstructMesh(Mesh=rectangle_to_u_bar_shape_5.Mesh)  # -> Vertices, Faces, Colours, Normals
demesh_71 = DeconstructMesh(Mesh=mesh_35)  # -> Vertices, Faces, Colours, Normals
mesh_38 = Mesh(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)
mesh_39 = Mesh(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)
demesh_72 = DeconstructMesh(Mesh=rectangle_to_u_bar_shape_6.Mesh)  # -> Vertices, Faces, Colours, Normals
demesh_73 = DeconstructMesh(Mesh=mesh_36)  # -> Vertices, Faces, Colours, Normals
mesh_40 = Mesh(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)
assert_point_list_32 = AssertPointList(
    TestName="UBarShapeMilimeters_XYPlaneRectangle_Mesh",
    ExpectedPointList=demesh_63.Vertices,
    ActualPointList=demesh_62.Vertices,
    Tolerance="0.00001")  # -> Result, FailedInfo
demesh_74 = DeconstructMesh(Mesh=rectangle_to_u_bar_shape_7.Mesh)  # -> Vertices, Faces, Colours, Normals
demesh_75 = DeconstructMesh(Mesh=mesh_37)  # -> Vertices, Faces, Colours, Normals
assert_point_list_33 = AssertPointList(
    TestName="UBarShapeMilimeters_Diameter_Mesh",
    ExpectedPointList=demesh_65.Vertices,
    ActualPointList=demesh_64.Vertices,
    Tolerance="0.00001")  # -> Result, FailedInfo
demesh_76 = DeconstructMesh(Mesh=rectangle_to_u_bar_shape_8.Mesh)  # -> Vertices, Faces, Colours, Normals
demesh_77 = DeconstructMesh(Mesh=mesh_38)  # -> Vertices, Faces, Colours, Normals
assert_point_list_34 = AssertPointList(
    TestName="UBarShapeMilimeters_BendingRoller_Mesh",
    ExpectedPointList=demesh_67.Vertices,
    ActualPointList=demesh_66.Vertices,
    Tolerance="0.00001")  # -> Result, FailedInfo
demesh_78 = DeconstructMesh(Mesh=rectangle_to_u_bar_shape_9.Mesh)  # -> Vertices, Faces, Colours, Normals
demesh_79 = DeconstructMesh(Mesh=mesh_39)  # -> Vertices, Faces, Colours, Normals
demesh_80 = DeconstructMesh(Mesh=rectangle_to_u_bar_shape_10.Mesh)  # -> Vertices, Faces, Colours, Normals
demesh_81 = DeconstructMesh(Mesh=mesh_40)  # -> Vertices, Faces, Colours, Normals
assert_point_list_35 = AssertPointList(
    TestName="UBarShapeMilimeters_Position1_Mesh",
    ExpectedPointList=demesh_69.Vertices,
    ActualPointList=demesh_68.Vertices,
    Tolerance="0.00001")  # -> Result, FailedInfo
assert_point_list_36 = AssertPointList(
    TestName="UBarShapeMilimeters_Position2_Mesh",
    ExpectedPointList=demesh_71.Vertices,
    ActualPointList=demesh_70.Vertices,
    Tolerance="0.00001")  # -> Result, FailedInfo
assert_point_list_37 = AssertPointList(
    TestName="UBarShapeMilimeters_Position3_Mesh",
    ExpectedPointList=demesh_73.Vertices,
    ActualPointList=demesh_72.Vertices,
    Tolerance="0.00001")  # -> Result, FailedInfo
assert_point_list_38 = AssertPointList(
    TestName="UBarShapeMeters_XYPlaneRectangle_Mesh",
    ExpectedPointList=demesh_75.Vertices,
    ActualPointList=demesh_74.Vertices,
    Tolerance="0.00001")  # -> Result, FailedInfo
assert_point_list_39 = AssertPointList(
    TestName="UBarShapeMeters_XZPlaneRectangle_Mesh",
    ExpectedPointList=demesh_77.Vertices,
    ActualPointList=demesh_76.Vertices,
    Tolerance="0.00001")  # -> Result, FailedInfo
assert_point_list_40 = AssertPointList(
    TestName="UBarShapeMeters_HookLength_Mesh",
    ExpectedPointList=demesh_79.Vertices,
    ActualPointList=demesh_78.Vertices,
    Tolerance="0.00001")  # -> Result, FailedInfo
assert_point_list_41 = AssertPointList(
    TestName="UBarShapeMeters_XYPlaneRectangleDescendingX_Mesh",
    ExpectedPointList=demesh_81.Vertices,
    ActualPointList=demesh_80.Vertices,
    Tolerance="0.00001")  # -> Result, FailedInfo
entwine_10 = Entwine(
    Branch00=assert_point_list_32.Result,
    Branch01=assert_point_list_33.Result,
    Branch02=assert_point_list_34.Result,
    Branch03=assert_point_list_35.Result,
    Branch04=assert_point_list_36.Result,
    Branch05=assert_point_list_37.Result,
    Branch06=assert_point_list_38.Result,
    Branch07=assert_point_list_39.Result,
    Branch08=assert_point_list_40.Result,
    Branch09=assert_point_list_41.Result,
    FlattenInputs=True)  # -> flatten(Result)

# ----
# Rectangle To Stirrup Shape
number_slider_17 = Slider(7850, range=0..10000)
number_slider_18 = Slider(0.2, range=0..1)
division_27 = Division(A=number_slider_17, B="1e9")
division_28 = Division(A=Slider(7850, range=0..10000), B="1e9")
division_29 = Division(A=Slider(7850, range=0..10000), B="1e9")
division_30 = Division(A=Slider(7850, range=0..10000), B="1e9")
division_31 = Division(A=Slider(7850, range=0..10000), B="1e9")
division_32 = Division(A=Slider(7850, range=0..10000), B="1e9")
division_33 = Division(A=Slider(7850, range=0..10000), B="1e9")
material_45 = Material(Name="Name of the material", Grade="Grade of the material", Density=division_27)
material_46 = Material(Name="Name of the material", Grade="Grade of the material", Density=division_28)
material_47 = Material(Name="Name of the material", Grade="Grade of the material", Density=division_29)
material_48 = Material(Name="Name of the material", Grade="Grade of the material", Density=division_30)
material_49 = Material(Name="Name of the material", Grade="Grade of the material", Density=division_31)
material_50 = Material(Name="Name of the material", Grade="Grade of the material", Density=division_32)
material_51 = Material(Name="Name of the material", Grade="Grade of the material", Density=division_33)
xy_33 = XYPlane(Origin=Point(0, 0, 0))
neg_11 = Negative(Value=number_slider_18)
material_52 = Material(Name="Name of the material", Grade="Grade of the material", Density=Slider(7850, range=0..10000))
material_53 = Material(Name="Name of the material", Grade="Grade of the material", Density=Slider(7850, range=0..10000))
xy_34 = XYPlane(Origin=Point(0, 0, 0))
material_54 = Material(Name="Name of the material", Grade="Grade of the material", Density=Slider(7850, range=0..10000))
xy_35 = XYPlane(Origin=Point(0, 0, 0))
xy_36 = XYPlane(Origin=Point(0, 0, 0))
xy_37 = XYPlane(Origin=Point(0, 0, 0))
xy_38 = XYPlane(Origin=Point(0, 0, 0))
xy_39 = XYPlane(Origin=Point(0, 0, 0))
dom_10 = ConstructDomain(DomainStart=number_slider_18, DomainEnd=neg_11)
rebar_properties_43 = RebarProperties(Diameter="12", Material=material_45)
cover_dimensions_25 = CoverDimensions(
    Left=Slider(10, range=0..100),
    Right=Slider(20, range=0..100),
    Top=Slider(30, range=0..100),
    Bottom=Slider(40, range=0..100))
rectangle_23 = Rectangle(Plane=xy_33, XSize=Slider(200, range=0..1000), YSize=Slider(300, range=0..1000), Radius=0)  # -> Rectangle, Length
bending_roller_31 = BendingRoller(Diameter="60", Tolerance=0.0001, AngleTolerance=0.0175)
bending_roller_32 = BendingRoller(Diameter="60", Tolerance=0.0001, AngleTolerance=0.0175)
rebar_properties_44 = RebarProperties(Diameter="12", Material=material_46)
cover_dimensions_26 = CoverDimensions(
    Left=Slider(10, range=0..100),
    Right=Slider(20, range=0..100),
    Top=Slider(30, range=0..100),
    Bottom=Slider(40, range=0..100))
rebar_properties_45 = RebarProperties(Diameter="12", Material=material_47)
rebar_properties_46 = RebarProperties(Diameter="12", Material=material_48)
rectangle_24 = Rectangle(Plane=xy_34, XSize=Slider(200, range=0..1000), YSize=Slider(300, range=0..1000), Radius=0)  # -> Rectangle, Length
cover_dimensions_27 = CoverDimensions(
    Left=Slider(10, range=0..100),
    Right=Slider(20, range=0..100),
    Top=Slider(30, range=0..100),
    Bottom=Slider(40, range=0..100))
cover_dimensions_28 = CoverDimensions(
    Left=Slider(10, range=0..100),
    Right=Slider(20, range=0..100),
    Top=Slider(30, range=0..100),
    Bottom=Slider(40, range=0..100))
bending_roller_33 = BendingRoller(Diameter="60", Tolerance=0.0001, AngleTolerance=0.0175)
rectangle_25 = Rectangle(Plane=xy_35, XSize=Slider(200, range=0..1000), YSize=Slider(300, range=0..1000), Radius=0)  # -> Rectangle, Length
rectangle_26 = Rectangle(Plane=xy_36, XSize=Slider(200, range=0..1000), YSize=Slider(300, range=0..1000), Radius=0)  # -> Rectangle, Length
bending_roller_34 = BendingRoller(Diameter="60", Tolerance=0.0001, AngleTolerance=0.0175)
bending_roller_35 = BendingRoller(Diameter="80", Tolerance=0.0001, AngleTolerance=0.0175)
xy_40 = XYPlane(Origin=Point(0, 0, 0))
rebar_properties_47 = RebarProperties(Diameter="12", Material=material_49)
cover_dimensions_29 = CoverDimensions(
    Left=Slider(0.01, range=0..0.11),
    Right=Slider(0.02, range=0..0.11),
    Top=Slider(0.03, range=0..0.11),
    Bottom=Slider(0.04, range=0..0.11))
cover_dimensions_30 = CoverDimensions(
    Left=Slider(0.01, range=0..0.11),
    Right=Slider(0.02, range=0..0.11),
    Top=Slider(0.03, range=0..0.11),
    Bottom=Slider(0.04, range=0..0.11))
rebar_properties_48 = RebarProperties(Diameter="16", Material=material_50)
cover_dimensions_31 = CoverDimensions(
    Left=Slider(10, range=0..100),
    Right=Slider(20, range=0..100),
    Top=Slider(30, range=0..100),
    Bottom=Slider(40, range=0..100))
cover_dimensions_32 = CoverDimensions(
    Left=Slider(10, range=0..100),
    Right=Slider(20, range=0..100),
    Top=Slider(30, range=0..100),
    Bottom=Slider(40, range=0..100))
xy_41 = XYPlane(Origin=Point(0, 0, 0))
cover_dimensions_33 = CoverDimensions(
    Left=Slider(0.01, range=0..0.11),
    Right=Slider(0.02, range=0..0.11),
    Top=Slider(0.03, range=0..0.11),
    Bottom=Slider(0.04, range=0..0.11))
rebar_properties_49 = RebarProperties(Diameter="12", Material=material_51)
bending_roller_36 = BendingRoller(Diameter="80", Tolerance=0.0001, AngleTolerance=0.0175)
xz_7 = XZPlane(Origin=Point(0, 0, 0))
rectangle_27 = Rectangle(Plane=xy_37, XSize=Slider(200, range=0..1000), YSize=Slider(300, range=0..1000), Radius=0)  # -> Rectangle, Length
cover_dimensions_34 = CoverDimensions(
    Left=Slider(10, range=0..100),
    Right=Slider(20, range=0..100),
    Top=Slider(30, range=0..100),
    Bottom=Slider(40, range=0..100))
rectangle_28 = Rectangle(Plane=xy_38, XSize=Slider(200, range=0..1000), YSize=Slider(300, range=0..1000), Radius=0)  # -> Rectangle, Length
rectangle_29 = Rectangle(Plane=xy_39, XSize=Slider(200, range=0..1000), YSize=Slider(300, range=0..1000), Radius=0)  # -> Rectangle, Length
bending_roller_37 = BendingRoller(Diameter="0.060", Tolerance=0.0001, AngleTolerance=0.0175)
bending_roller_38 = BendingRoller(Diameter="0.060", Tolerance=0.0001, AngleTolerance=0.0175)
bending_roller_39 = BendingRoller(Diameter="0.060", Tolerance=0.0001, AngleTolerance=0.0175)
rebar_properties_50 = RebarProperties(Diameter="0.012", Material=material_52)
rebar_properties_51 = RebarProperties(Diameter="0.012", Material=material_53)
rebar_properties_52 = RebarProperties(Diameter="0.012", Material=material_54)
bending_roller_40 = BendingRoller(Diameter="60", Tolerance=0.0001, AngleTolerance=0.0175)
rectangle_30 = Rectangle(Plane=xz_7, XSize=Slider(0.2, range=0..1), YSize=Slider(0.3, range=0..1), Radius=0)  # -> Rectangle, Length
rectangle_31 = Rectangle(Plane=xy_40, XSize=dom_10, YSize=Slider(0.3, range=0..1), Radius=0)  # -> Rectangle, Length
rectangle_32 = Rectangle(Plane=xy_41, XSize=Slider(0.2, range=0..1), YSize=Slider(0.3, range=0..1), Radius=0)  # -> Rectangle, Length
rectangle_to_stirrup_shape = RectangleToStirrupShape(
    Rectangle=rectangle_23.Rectangle,
    Properties=rebar_properties_43,
    BendingRoller=bending_roller_31,
    HooksType="0",
    HookLength=Slider(100, range=0..1000),
    CoverDimensions=cover_dimensions_25)  # -> RebarShape, Mesh
rectangle_to_stirrup_shape_2 = RectangleToStirrupShape(
    Rectangle=rectangle_24.Rectangle,
    Properties=rebar_properties_44,
    BendingRoller=bending_roller_32,
    HooksType="0",
    HookLength=Slider(200, range=0..1000),
    CoverDimensions=cover_dimensions_26)  # -> RebarShape, Mesh
rectangle_to_stirrup_shape_3 = RectangleToStirrupShape(
    Rectangle=rectangle_26.Rectangle,
    Properties=rebar_properties_46,
    BendingRoller=bending_roller_33,
    HooksType="1",
    HookLength=Slider(200, range=0..1000),
    CoverDimensions=cover_dimensions_28)  # -> RebarShape, Mesh
rectangle_to_stirrup_shape_4 = RectangleToStirrupShape(
    Rectangle=rectangle_25.Rectangle,
    Properties=rebar_properties_45,
    BendingRoller=bending_roller_34,
    HooksType="1",
    HookLength=Slider(100, range=0..1000),
    CoverDimensions=cover_dimensions_27)  # -> RebarShape, Mesh
rectangle_to_stirrup_shape_5 = RectangleToStirrupShape(
    Rectangle=rectangle_28.Rectangle,
    Properties=rebar_properties_48,
    BendingRoller=bending_roller_40,
    HooksType="0",
    HookLength=Slider(100, range=0..1000),
    CoverDimensions=cover_dimensions_32)  # -> RebarShape, Mesh
rectangle_to_stirrup_shape_6 = RectangleToStirrupShape(
    Rectangle=rectangle_27.Rectangle,
    Properties=rebar_properties_47,
    BendingRoller=bending_roller_35,
    HooksType="0",
    HookLength=Slider(100, range=0..1000),
    CoverDimensions=cover_dimensions_31)  # -> RebarShape, Mesh
rectangle_to_stirrup_shape_7 = RectangleToStirrupShape(
    Rectangle=rectangle_29.Rectangle,
    Properties=rebar_properties_49,
    BendingRoller=bending_roller_36,
    HooksType="1",
    HookLength=Slider(100, range=0..1000),
    CoverDimensions=cover_dimensions_34)  # -> RebarShape, Mesh
rectangle_to_stirrup_shape_8 = RectangleToStirrupShape(
    Rectangle=rectangle_30.Rectangle,
    Properties=rebar_properties_50,
    BendingRoller=bending_roller_37,
    HooksType="0",
    HookLength=Slider(0.1, range=0..0.1),
    CoverDimensions=cover_dimensions_29)  # -> RebarShape, Mesh
rectangle_to_stirrup_shape_9 = RectangleToStirrupShape(
    Rectangle=rectangle_32.Rectangle,
    Properties=rebar_properties_52,
    BendingRoller=bending_roller_38,
    HooksType="0",
    HookLength=Slider(0.1, range=0..0.1),
    CoverDimensions=cover_dimensions_33)  # -> RebarShape, Mesh
rectangle_to_stirrup_shape_10 = RectangleToStirrupShape(
    Rectangle=rectangle_31.Rectangle,
    Properties=rebar_properties_51,
    BendingRoller=bending_roller_39,
    HooksType="0",
    HookLength=Slider(0.1, range=0..0.1),
    CoverDimensions=cover_dimensions_30)  # -> RebarShape, Mesh
mesh_41 = Mesh(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)
mesh_42 = Mesh(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)
mesh_43 = Mesh(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)
mesh_44 = Mesh(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)
demesh_82 = DeconstructMesh(Mesh=rectangle_to_stirrup_shape.Mesh)  # -> Vertices, Faces, Colours, Normals
demesh_83 = DeconstructMesh(Mesh=mesh_41)  # -> Vertices, Faces, Colours, Normals
mesh_45 = Mesh(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)
mesh_46 = Mesh(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)
mesh_47 = Mesh(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)
demesh_84 = DeconstructMesh(Mesh=rectangle_to_stirrup_shape_2.Mesh)  # -> Vertices, Faces, Colours, Normals
demesh_85 = DeconstructMesh(Mesh=mesh_42)  # -> Vertices, Faces, Colours, Normals
demesh_86 = DeconstructMesh(Mesh=rectangle_to_stirrup_shape_4.Mesh)  # -> Vertices, Faces, Colours, Normals
demesh_87 = DeconstructMesh(Mesh=rectangle_to_stirrup_shape_3.Mesh)  # -> Vertices, Faces, Colours, Normals
demesh_88 = DeconstructMesh(Mesh=mesh_43)  # -> Vertices, Faces, Colours, Normals
demesh_89 = DeconstructMesh(Mesh=mesh_44)  # -> Vertices, Faces, Colours, Normals
mesh_48 = Mesh(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)
mesh_49 = Mesh(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)
mesh_50 = Mesh(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)
demesh_90 = DeconstructMesh(Mesh=rectangle_to_stirrup_shape_6.Mesh)  # -> Vertices, Faces, Colours, Normals
demesh_91 = DeconstructMesh(Mesh=rectangle_to_stirrup_shape_5.Mesh)  # -> Vertices, Faces, Colours, Normals
demesh_92 = DeconstructMesh(Mesh=mesh_46)  # -> Vertices, Faces, Colours, Normals
demesh_93 = DeconstructMesh(Mesh=mesh_45)  # -> Vertices, Faces, Colours, Normals
demesh_94 = DeconstructMesh(Mesh=rectangle_to_stirrup_shape_7.Mesh)  # -> Vertices, Faces, Colours, Normals
demesh_95 = DeconstructMesh(Mesh=mesh_47)  # -> Vertices, Faces, Colours, Normals
demesh_96 = DeconstructMesh(Mesh=rectangle_to_stirrup_shape_8.Mesh)  # -> Vertices, Faces, Colours, Normals
demesh_97 = DeconstructMesh(Mesh=rectangle_to_stirrup_shape_10.Mesh)  # -> Vertices, Faces, Colours, Normals
demesh_98 = DeconstructMesh(Mesh=mesh_49)  # -> Vertices, Faces, Colours, Normals
demesh_99 = DeconstructMesh(Mesh=mesh_48)  # -> Vertices, Faces, Colours, Normals
demesh_100 = DeconstructMesh(Mesh=rectangle_to_stirrup_shape_9.Mesh)  # -> Vertices, Faces, Colours, Normals
demesh_101 = DeconstructMesh(Mesh=mesh_50)  # -> Vertices, Faces, Colours, Normals
assert_point_list_42 = AssertPointList(
    TestName="StirrupShapeMilimeters_XYPlaneRectangle_Mesh",
    ExpectedPointList=demesh_83.Vertices,
    ActualPointList=demesh_82.Vertices,
    Tolerance="0.00001")  # -> Result, FailedInfo
assert_point_list_43 = AssertPointList(
    TestName="StirrupShapeMilimeters_HookLength_Mesh",
    ExpectedPointList=demesh_85.Vertices,
    ActualPointList=demesh_84.Vertices,
    Tolerance="0.00001")  # -> Result, FailedInfo
assert_point_list_44 = AssertPointList(
    TestName="StirrupShapeMilimeters_HookType1_Mesh",
    ExpectedPointList=demesh_88.Vertices,
    ActualPointList=demesh_86.Vertices,
    Tolerance="0.00001")  # -> Result, FailedInfo
assert_point_list_45 = AssertPointList(
    TestName="StirrupShapeMilimeters_HookType1HookLength_Mesh",
    ExpectedPointList=demesh_89.Vertices,
    ActualPointList=demesh_87.Vertices,
    Tolerance="0.00001")  # -> Result, FailedInfo
assert_point_list_46 = AssertPointList(
    TestName="StirrupShapeMeters_XZPlaneRectangle_Mesh",
    ExpectedPointList=demesh_98.Vertices,
    ActualPointList=demesh_96.Vertices,
    Tolerance="0.00001")  # -> Result, FailedInfo
assert_point_list_47 = AssertPointList(
    TestName="StirrupShapeMeters_XYPlaneRectangle_Mesh",
    ExpectedPointList=demesh_101.Vertices,
    ActualPointList=demesh_100.Vertices,
    Tolerance="0.00001")  # -> Result, FailedInfo
assert_point_list_48 = AssertPointList(
    TestName="StirrupShapeMilimeters_BendingRoller_Mesh",
    ExpectedPointList=demesh_92.Vertices,
    ActualPointList=demesh_90.Vertices,
    Tolerance="0.00001")  # -> Result, FailedInfo
assert_point_list_49 = AssertPointList(
    TestName="StirrupShapeMeters_XYPlaneRectangleDescendingX_Mesh",
    ExpectedPointList=demesh_99.Vertices,
    ActualPointList=demesh_97.Vertices,
    Tolerance="0.00001")  # -> Result, FailedInfo
assert_point_list_50 = AssertPointList(
    TestName="StirrupShapeMilimeters_Diameter_Mesh",
    ExpectedPointList=demesh_93.Vertices,
    ActualPointList=demesh_91.Vertices,
    Tolerance="0.00001")  # -> Result, FailedInfo
assert_point_list_51 = AssertPointList(
    TestName="StirrupShapeMilimeters_BendingRoller_Mesh",
    ExpectedPointList=demesh_95.Vertices,
    ActualPointList=demesh_94.Vertices,
    Tolerance="0.00001")  # -> Result, FailedInfo
entwine_11 = Entwine(
    Branch00=assert_point_list_42.Result,
    Branch01=assert_point_list_43.Result,
    Branch02=assert_point_list_44.Result,
    Branch03=assert_point_list_45.Result,
    Branch04=assert_point_list_50.Result,
    Branch05=assert_point_list_48.Result,
    Branch06=assert_point_list_51.Result,
    Branch07=assert_point_list_47.Result,
    Branch08=assert_point_list_46.Result,
    Branch09=assert_point_list_49.Result,
    FlattenInputs=True)  # -> flatten(Result)

# ----
# Curve To Rebar Shape
number_slider_19 = Slider(7850, range=0..10000)
division_34 = Division(A=number_slider_19, B="1e9")
division_35 = Division(A=Slider(7850, range=0..10000), B="1e9")
division_36 = Division(A=Slider(7850, range=0..10000), B="1e9")
division_37 = Division(A=Slider(7850, range=0..10000), B="1e9")
division_38 = Division(A=Slider(7850, range=0..10000), B="1e9")
division_39 = Division(A=Slider(7850, range=0..10000), B="1e9")
material_55 = Material(Name="Name of the material", Grade="Grade of the material", Density=division_34)
material_56 = Material(Name="Name of the material", Grade="Grade of the material", Density=division_35)
material_57 = Material(Name="Name of the material", Grade="Grade of the material", Density=division_36)
material_58 = Material(Name="Name of the material", Grade="Grade of the material", Density=division_37)
material_59 = Material(Name="Name of the material", Grade="Grade of the material", Density=Slider(7850, range=0..10000))
material_60 = Material(Name="Name of the material", Grade="Grade of the material", Density=division_38)
material_61 = Material(Name="Name of the material", Grade="Grade of the material", Density=division_39)
ellipse = Ellipse(Plane=PlaneXY(0, 0, 0), Radius1=Slider(200, range=0..1000), Radius2=Slider(100, range=0..1000))  # -> Ellipse, Focus1, Focus2
rebar_properties_53 = RebarProperties(Diameter="12", Material=material_55)
rebar_properties_54 = RebarProperties(Diameter="12", Material=material_56)
line = Line(Line((-81.16418806, -64.05420542, 0), (94.88515152, 87.27587757, 0)))
nurbs = NurbsCurve(
    Vertices=[Point(0.1585539077, 0.2753550561, 0), Point(0.8894101777, 1.006211326, 0), Point(2.374510118, 0.4039857597, 0), Point(2.280960516, -0.9290960768, 0), Point(-0.6892393655, -1.162970083, 0), Point(-1.373320834, 1.14653573, 0)],
    Degree=3,
    Periodic=False)  # -> Curve, Length, Domain
rebar_properties_55 = RebarProperties(Diameter="12", Material=material_57)
rebar_properties_56 = RebarProperties(Diameter="12", Material=material_58)
rebar_properties_57 = RebarProperties(Diameter=Slider(0.012, range=0..0.1), Material=material_59)
arc = CircularArc({Angle=0, Angle=1.009932145, Plane=Plane(origin=(-87.19327504, -77.31819676, 0), x=(0.4280863447, 0.9037378389, 0), y=(0.9037378389, -0.4280863447, 0)), Radius=202.8068717})
nurbs_2 = NurbsCurve(
    Vertices=[Point(-8.81453456, -143.9775576, 0), Point(147.4593998, 16.20322509, 0), Point(14.13819954, 104.1073131, 0), Point(-125.5316292, 33.7840427, 0), Point(-83.41305005, 0, 120.7480426), Point(118.3008474, 0, 122.9810378), Point(0, 131.2518109, 108.3551092)],
    Degree=3,
    Periodic=False)  # -> Curve, Length, Domain
nurbs_3 = NurbsCurve(
    Vertices=[Point(-8.81453456, -143.9775576, 0), Point(147.4593998, 16.20322509, 0), Point(14.13819954, 104.1073131, 0), Point(-125.5316292, 33.7840427, 0), Point(-83.41305005, 0, 120.7480426), Point(118.3008474, 0, 122.9810378), Point(0, 131.2518109, 108.3551092)],
    Degree=3,
    Periodic=False)  # -> Curve, Length, Domain
rebar_properties_58 = RebarProperties(Diameter="16", Material=material_60)
rebar_properties_59 = RebarProperties(Diameter="12", Material=material_61)
circle = Circle({Plane=Plane(origin=(-32.13135757, 13.7159424, 0), x=(0.6322674225, 0.774750222, 0), y=(-0.774750222, 0.6322674225, 0)), Radius=83.5841775})
curve_to_rebar_shape = CurveToRebarShape(Curve=line, Properties=rebar_properties_53)  # -> RebarShape, Mesh
curve_to_rebar_shape_2 = CurveToRebarShape(Curve=arc, Properties=rebar_properties_54)  # -> RebarShape, Mesh
curve_to_rebar_shape_3 = CurveToRebarShape(Curve=ellipse.Ellipse, Properties=rebar_properties_55)  # -> RebarShape, Mesh
curve_to_rebar_shape_4 = CurveToRebarShape(Curve=nurbs.Curve, Properties=rebar_properties_57)  # -> RebarShape, Mesh
curve_to_rebar_shape_5 = CurveToRebarShape(Curve=circle, Properties=rebar_properties_56)  # -> RebarShape, Mesh
curve_to_rebar_shape_6 = CurveToRebarShape(Curve=nurbs_2.Curve, Properties=rebar_properties_58)  # -> RebarShape, Mesh
curve_to_rebar_shape_7 = CurveToRebarShape(Curve=nurbs_3.Curve, Properties=rebar_properties_59)  # -> RebarShape, Mesh
mesh_51 = Mesh(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)
mesh_52 = Mesh(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)
mesh_53 = Mesh(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)
mesh_54 = Mesh(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)
mesh_55 = Mesh(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)
mesh_56 = Mesh(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)
mesh_57 = Mesh(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)
demesh_102 = DeconstructMesh(Mesh=curve_to_rebar_shape.Mesh)  # -> Vertices, Faces, Colours, Normals
demesh_103 = DeconstructMesh(Mesh=mesh_51)  # -> Vertices, Faces, Colours, Normals
demesh_104 = DeconstructMesh(Mesh=curve_to_rebar_shape_2.Mesh)  # -> Vertices, Faces, Colours, Normals
demesh_105 = DeconstructMesh(Mesh=mesh_52)  # -> Vertices, Faces, Colours, Normals
demesh_106 = DeconstructMesh(Mesh=curve_to_rebar_shape_3.Mesh)  # -> Vertices, Faces, Colours, Normals
demesh_107 = DeconstructMesh(Mesh=curve_to_rebar_shape_5.Mesh)  # -> Vertices, Faces, Colours, Normals
demesh_108 = DeconstructMesh(Mesh=mesh_53)  # -> Vertices, Faces, Colours, Normals
demesh_109 = DeconstructMesh(Mesh=curve_to_rebar_shape_4.Mesh)  # -> Vertices, Faces, Colours, Normals
demesh_110 = DeconstructMesh(Mesh=mesh_54)  # -> Vertices, Faces, Colours, Normals
demesh_111 = DeconstructMesh(Mesh=mesh_57)  # -> Vertices, Faces, Colours, Normals
demesh_112 = DeconstructMesh(Mesh=curve_to_rebar_shape_6.Mesh)  # -> Vertices, Faces, Colours, Normals
demesh_113 = DeconstructMesh(Mesh=curve_to_rebar_shape_7.Mesh)  # -> Vertices, Faces, Colours, Normals
demesh_114 = DeconstructMesh(Mesh=mesh_55)  # -> Vertices, Faces, Colours, Normals
demesh_115 = DeconstructMesh(Mesh=mesh_56)  # -> Vertices, Faces, Colours, Normals
assert_point_list_52 = AssertPointList(
    TestName="CurveToRebarMilimeters_Line_Mesh",
    ExpectedPointList=demesh_103.Vertices,
    ActualPointList=demesh_102.Vertices,
    Tolerance="0.00001")  # -> Result, FailedInfo
assert_point_list_53 = AssertPointList(
    TestName="CurveToRebarMilimeters_Arc_Mesh",
    ExpectedPointList=demesh_105.Vertices,
    ActualPointList=demesh_104.Vertices,
    Tolerance="0.00001")  # -> Result, FailedInfo
assert_point_list_54 = AssertPointList(
    TestName="CurveToRebarMilimeters_Ellipse_Mesh",
    ExpectedPointList=demesh_108.Vertices,
    ActualPointList=demesh_106.Vertices,
    Tolerance="0.00001")  # -> Result, FailedInfo
assert_point_list_55 = AssertPointList(
    TestName="CurveToRebarMilimeters_Circle_Mesh",
    ExpectedPointList=demesh_110.Vertices,
    ActualPointList=demesh_107.Vertices,
    Tolerance="0.00001")  # -> Result, FailedInfo
assert_point_list_56 = AssertPointList(
    TestName="CurveToRebarMeters_Nurbs_Mesh",
    ExpectedPointList=demesh_111.Vertices,
    ActualPointList=demesh_109.Vertices,
    Tolerance="0.00001")  # -> Result, FailedInfo
assert_point_list_57 = AssertPointList(
    TestName="CurveToRebarMilimeters_Diameter_Mesh",
    ExpectedPointList=demesh_114.Vertices,
    ActualPointList=demesh_112.Vertices,
    Tolerance="0.00001")  # -> Result, FailedInfo
assert_point_list_58 = AssertPointList(
    TestName="CurveToRebarMilimeters_Nurbs_Mesh",
    ExpectedPointList=demesh_115.Vertices,
    ActualPointList=demesh_113.Vertices,
    Tolerance="0.00001")  # -> Result, FailedInfo
entwine_12 = Entwine(
    Branch00=assert_point_list_52.Result,
    Branch01=assert_point_list_53.Result,
    Branch02=assert_point_list_55.Result,
    Branch03=assert_point_list_54.Result,
    Branch04=assert_point_list_58.Result,
    Branch05=assert_point_list_57.Result,
    Branch06=assert_point_list_56.Result,
    FlattenInputs=True)  # -> flatten(Result)

# ----
# Polyline To Rebar Shape
number_slider_20 = Slider(7850, range=0..10000)
division_40 = Division(A=number_slider_20, B="1e9")
division_41 = Division(A=Slider(7850, range=0..10000), B="1e9")
material_62 = Material(Name="Name of the material", Grade="Grade of the material", Density=Slider(7850, range=0..10000))
pt_13 = ConstructPoint(XCoordinate="0.200", YCoordinate=0, ZCoordinate=0)
material_63 = Material(Name="Name of the material", Grade="Grade of the material", Density=Slider(7850, range=0..10000))
pt_14 = ConstructPoint(XCoordinate=0, YCoordinate=0, ZCoordinate=0)
pt_15 = ConstructPoint(XCoordinate="0.200", YCoordinate="0.200", ZCoordinate=0)
pt_16 = ConstructPoint(XCoordinate="0.100", YCoordinate="0.100", ZCoordinate=0)
pt_17 = ConstructPoint(XCoordinate="0.200", YCoordinate=0, ZCoordinate=0)
pt_18 = ConstructPoint(XCoordinate=0, YCoordinate=0, ZCoordinate=0)
pt_19 = ConstructPoint(XCoordinate="0.200", YCoordinate="0.200", ZCoordinate=0)
pt_20 = ConstructPoint(XCoordinate="0.100", YCoordinate="0.100", ZCoordinate=0)
material_64 = Material(Name="Name of the material", Grade="Grade of the material", Density=Slider(7850, range=0..10000))
material_65 = Material(Name="Name of the material", Grade="Grade of the material", Density=division_40)
material_66 = Material(Name="Name of the material", Grade="Grade of the material", Density=Slider(7850, range=0..10000))
pt_21 = ConstructPoint(XCoordinate=0, YCoordinate=0, ZCoordinate=0)
pt_22 = ConstructPoint(XCoordinate="200", YCoordinate=0, ZCoordinate=0)
pt_23 = ConstructPoint(XCoordinate="200", YCoordinate="200", ZCoordinate=0)
pt_24 = ConstructPoint(XCoordinate="100", YCoordinate="100", ZCoordinate=0)
material_67 = Material(Name="Name of the material", Grade="Grade of the material", Density=division_41)
pt_25 = ConstructPoint(XCoordinate="0.200", YCoordinate=0, ZCoordinate=0)
pt_26 = ConstructPoint(XCoordinate=0, YCoordinate=0, ZCoordinate=0)
pt_27 = ConstructPoint(XCoordinate="0.200", YCoordinate="0.200", ZCoordinate=0)
pt_28 = ConstructPoint(XCoordinate=0, YCoordinate=0, ZCoordinate=0)
pt_29 = ConstructPoint(XCoordinate="200", YCoordinate=0, ZCoordinate=0)
pt_30 = ConstructPoint(XCoordinate="200", YCoordinate="200", ZCoordinate=0)
pt_31 = ConstructPoint(XCoordinate="0.100", YCoordinate="0.100", ZCoordinate=0)
material_68 = Material(Name="Name of the material", Grade="Grade of the material", Density=Slider(7850, range=0..10000))
pt_32 = ConstructPoint(XCoordinate=0, YCoordinate=0, ZCoordinate=0)
pt_33 = ConstructPoint(XCoordinate="0.200", YCoordinate=0, ZCoordinate=0)
pt_34 = ConstructPoint(XCoordinate="0.200", YCoordinate="0.200", ZCoordinate=0)
pt_35 = Point([pt_14, pt_13, pt_15, pt_16])
pt_36 = Point([pt_18, pt_17, pt_19, pt_20])
pt_37 = Point([pt_21, pt_22, pt_23, pt_24])
pt_38 = Point([pt_28, pt_29, pt_30])
pt_39 = Point([pt_26, pt_25, pt_27, pt_31])
rebar_properties_60 = RebarProperties(Diameter="0.012", Material=material_62)
bending_roller_41 = BendingRoller(Diameter="60", Tolerance=0.0001, AngleTolerance=0.0175)
rebar_properties_61 = RebarProperties(Diameter="0.016", Material=material_63)
pt_40 = Point([Point(-0.2684051523, -0.08360179232, 0), Point(0.4489489867, 0.8063776742, 0), Point(1.338928453, 0.2117793237, 0), Point(0.698296682, -0.2447187647, 0), Point(1.512489271, 0, 1.986786819), Point(-0.6471390444, 0, 1.728718027), Point(0, 2.395697116, 1.67504026)])
pt_41 = Point([pt_32, pt_33, pt_34])
rebar_properties_62 = RebarProperties(Diameter="0.012", Material=material_64)
bending_roller_42 = BendingRoller(Diameter="60", Tolerance=0.0001, AngleTolerance=0.0175)
bending_roller_43 = BendingRoller(Diameter="0.050", Tolerance=0.0001, AngleTolerance=0.0175)
bending_roller_44 = BendingRoller(Diameter="0.060", Tolerance=0.0001, AngleTolerance=0.0175)
rebar_properties_63 = RebarProperties(Diameter="12", Material=material_65)
rebar_properties_64 = RebarProperties(Diameter="0.012", Material=material_66)
bending_roller_45 = BendingRoller(Diameter="0.060", Tolerance=0.0001, AngleTolerance=0.0175)
rebar_properties_65 = RebarProperties(Diameter="12", Material=material_67)
bending_roller_46 = BendingRoller(Diameter="0.060", Tolerance=0.0001, AngleTolerance=0.0175)
pline = PolyLine(Vertices=pt_35, Closed=False)
rebar_properties_66 = RebarProperties(Diameter="0.012", Material=material_68)
bending_roller_47 = BendingRoller(Diameter="0.060", Tolerance=0.0001, AngleTolerance=0.0175)
pline_2 = PolyLine(Vertices=pt_36, Closed=False)
pline_3 = PolyLine(Vertices=pt_40, Closed=False)
pline_4 = PolyLine(Vertices=pt_37, Closed=False)
pline_5 = PolyLine(Vertices=pt_38, Closed=False)
pline_6 = PolyLine(Vertices=pt_39, Closed=False)
pline_7 = PolyLine(Vertices=pt_41, Closed=False)
polyline_to_rebar_shape = PolylineToRebarShape(Polyline=pline, Properties=rebar_properties_60, BendingRoller=bending_roller_43)  # -> RebarShape, Mesh
polyline_to_rebar_shape_2 = PolylineToRebarShape(Polyline=pline_2, Properties=rebar_properties_61, BendingRoller=bending_roller_44)  # -> RebarShape, Mesh
polyline_to_rebar_shape_3 = PolylineToRebarShape(Polyline=pline_6, Properties=rebar_properties_64, BendingRoller=bending_roller_45)  # -> RebarShape, Mesh
polyline_to_rebar_shape_4 = PolylineToRebarShape(Polyline=pline_5, Properties=rebar_properties_63, BendingRoller=bending_roller_42)  # -> RebarShape, Mesh
polyline_to_rebar_shape_5 = PolylineToRebarShape(Polyline=pline_4, Properties=rebar_properties_65, BendingRoller=bending_roller_41)  # -> RebarShape, Mesh
polyline_to_rebar_shape_6 = PolylineToRebarShape(Polyline=pline_3, Properties=rebar_properties_62, BendingRoller=bending_roller_47)  # -> RebarShape, Mesh
polyline_to_rebar_shape_7 = PolylineToRebarShape(Polyline=pline_7, Properties=rebar_properties_66, BendingRoller=bending_roller_46)  # -> RebarShape, Mesh
mesh_58 = Mesh(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)
mesh_59 = Mesh(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)
mesh_60 = Mesh(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)
mesh_61 = Mesh(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)
mesh_62 = Mesh(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)
mesh_63 = Mesh(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)
demesh_116 = DeconstructMesh(Mesh=polyline_to_rebar_shape.Mesh)  # -> Vertices, Faces, Colours, Normals
demesh_117 = DeconstructMesh(Mesh=mesh_58)  # -> Vertices, Faces, Colours, Normals
mesh_64 = Mesh(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)
demesh_118 = DeconstructMesh(Mesh=polyline_to_rebar_shape_2.Mesh)  # -> Vertices, Faces, Colours, Normals
demesh_119 = DeconstructMesh(Mesh=mesh_59)  # -> Vertices, Faces, Colours, Normals
demesh_120 = DeconstructMesh(Mesh=polyline_to_rebar_shape_5.Mesh)  # -> Vertices, Faces, Colours, Normals
demesh_121 = DeconstructMesh(Mesh=mesh_60)  # -> Vertices, Faces, Colours, Normals
demesh_122 = DeconstructMesh(Mesh=polyline_to_rebar_shape_6.Mesh)  # -> Vertices, Faces, Colours, Normals
demesh_123 = DeconstructMesh(Mesh=mesh_62)  # -> Vertices, Faces, Colours, Normals
demesh_124 = DeconstructMesh(Mesh=polyline_to_rebar_shape_4.Mesh)  # -> Vertices, Faces, Colours, Normals
demesh_125 = DeconstructMesh(Mesh=polyline_to_rebar_shape_3.Mesh)  # -> Vertices, Faces, Colours, Normals
demesh_126 = DeconstructMesh(Mesh=mesh_61)  # -> Vertices, Faces, Colours, Normals
demesh_127 = DeconstructMesh(Mesh=mesh_63)  # -> Vertices, Faces, Colours, Normals
demesh_128 = DeconstructMesh(Mesh=polyline_to_rebar_shape_7.Mesh)  # -> Vertices, Faces, Colours, Normals
demesh_129 = DeconstructMesh(Mesh=mesh_64)  # -> Vertices, Faces, Colours, Normals
assert_point_list_59 = AssertPointList(
    TestName="PolylineToRebarMeters_BendingRollerDiameter_Mesh",
    ExpectedPointList=demesh_117.Vertices,
    ActualPointList=demesh_116.Vertices,
    Tolerance="0.00001")  # -> Result, FailedInfo
assert_point_list_60 = AssertPointList(
    TestName="PolylineToRebarMeters_Diameter_Mesh",
    ExpectedPointList=demesh_119.Vertices,
    ActualPointList=demesh_118.Vertices,
    Tolerance="0.00001")  # -> Result, FailedInfo
assert_point_list_61 = AssertPointList(
    TestName="PolylineToRebarMilimeters_PolyLine4Points_Mesh",
    ExpectedPointList=demesh_121.Vertices,
    ActualPointList=demesh_120.Vertices,
    Tolerance="0.00001")  # -> Result, FailedInfo
assert_point_list_62 = AssertPointList(
    TestName="PolylineToRebarMeters_MultiplePoints_Mesh",
    ExpectedPointList=demesh_123.Vertices,
    ActualPointList=demesh_122.Vertices,
    Tolerance="0.00001")  # -> Result, FailedInfo
assert_point_list_63 = AssertPointList(
    TestName="PolylineToRebarMeters_PolyLine4Points_Mesh",
    ExpectedPointList=demesh_127.Vertices,
    ActualPointList=demesh_125.Vertices,
    Tolerance="0.00001")  # -> Result, FailedInfo
assert_point_list_64 = AssertPointList(
    TestName="PolylineToRebarMilimeters_PolyLine3Points_Mesh",
    ExpectedPointList=demesh_126.Vertices,
    ActualPointList=demesh_124.Vertices,
    Tolerance="0.00001")  # -> Result, FailedInfo
assert_point_list_65 = AssertPointList(
    TestName="PolylineToRebarMeters_PolyLine3Points_Mesh",
    ExpectedPointList=demesh_129.Vertices,
    ActualPointList=demesh_128.Vertices,
    Tolerance="0.00001")  # -> Result, FailedInfo
entwine_13 = Entwine(
    Branch00=assert_point_list_64.Result,
    Branch01=assert_point_list_61.Result,
    Branch02=assert_point_list_65.Result,
    Branch03=assert_point_list_63.Result,
    Branch04=assert_point_list_62.Result,
    Branch05=assert_point_list_60.Result,
    Branch06=assert_point_list_59.Result,
    FlattenInputs=True)  # -> flatten(Result)

# ----
# Polyline To Rebar Shape Exceptions
number_slider_21 = Slider(7850, range=0..10000)
panel_19 = Panel("PolylineToRebarMilimeters_Line_Mesh")
division_42 = Division(A=number_slider_21, B="1e9")
panel_20 = Panel("PolylineToRebarMilimeters_NurbsCurve_Mesh")
division_43 = Division(A=Slider(7850, range=0..10000), B="1e9")
division_44 = Division(A=Slider(7850, range=0..10000), B="1e9")
material_69 = Material(Name="Name of the material", Grade="Grade of the material", Density=division_42)
pt_42 = ConstructPoint(XCoordinate=0, YCoordinate=0, ZCoordinate=0)
pt_43 = ConstructPoint(XCoordinate="200", YCoordinate=0, ZCoordinate=0)
pt_44 = ConstructPoint(XCoordinate="400", YCoordinate=0, ZCoordinate=0)
material_70 = Material(Name="Name of the material", Grade="Grade of the material", Density=division_43)
material_71 = Material(Name="Name of the material", Grade="Grade of the material", Density=division_44)
pt_45 = Point([pt_42, pt_43, pt_44])
rebar_properties_67 = RebarProperties(Diameter="12", Material=material_69)
panel_21 = Panel("PolylineToRebarMilimeters_PolyLine3Points_Mesh")
rebar_properties_68 = RebarProperties(Diameter="12", Material=material_70)
rebar_properties_69 = RebarProperties(Diameter="12", Material=material_71)
pline_8 = PolyLine(Vertices=pt_45, Closed=False)
pline_9 = PolyLine(Vertices=[Point(-21.77442644, -38.62833443, 0), Point(99.94628077, 45.97923605, 0)], Closed=False)
bending_roller_48 = BendingRoller(Diameter="60", Tolerance=0.0001, AngleTolerance=0.0175)
nurbs_4 = NurbsCurve(
    Vertices=[Point(-157.637452, -167.6548747, 0), Point(-91.47463202, 217.3759806, 0), Point(252.2044607, 166.8349375, 0), Point(286.2047988, -86.78920579, 0), Point(159.3927271, -102.4109827, 0)],
    Degree=3,
    Periodic=False)  # -> Curve, Length, Domain
bending_roller_49 = BendingRoller(Diameter="60", Tolerance=0.0001, AngleTolerance=0.0175)
bending_roller_50 = BendingRoller(Diameter="60", Tolerance=0.0001, AngleTolerance=0.0175)
polyline_to_rebar_shape_8 = PolylineToRebarShape(Polyline=pline_9, Properties=rebar_properties_69, BendingRoller=bending_roller_50)  # -> RebarShape, Mesh
polyline_to_rebar_shape_9 = PolylineToRebarShape(Polyline=nurbs_4.Curve, Properties=rebar_properties_68, BendingRoller=bending_roller_49)  # -> RebarShape, Mesh
polyline_to_rebar_shape_10 = PolylineToRebarShape(Polyline=pline_8, Properties=rebar_properties_67, BendingRoller=bending_roller_48)  # -> RebarShape, Mesh

# ----
# Vector Count Spacing
number_slider_22 = Slider(7850, range=0..10000)
division_45 = Division(A=number_slider_22, B="1e9")
division_46 = Division(A=Slider(7850, range=0..10000), B="1e9")
division_47 = Division(A=Slider(7850, range=0..10000), B="1e9")
number_slider_23 = Slider(700, range=0..1000)
division_48 = Division(A=Slider(7850, range=0..10000), B="1e9")
number_slider_24 = Slider(700, range=0..1000)
division_49 = Division(A=Slider(7850, range=0..10000), B="1e9")
division_50 = Division(A=Slider(7850, range=0..10000), B="1e9")
division_51 = Division(A=Slider(7850, range=0..10000), B="1e9")
number_slider_25 = Slider(0.5, range=0..1)
number_slider_26 = Slider(0.5, range=0..1)
material_72 = Material(Name="Name of the material", Grade="Grade of the material", Density=division_45)
material_73 = Material(Name="Name of the material", Grade="Grade of the material", Density=division_46)
material_74 = Material(Name="Name of the material", Grade="Grade of the material", Density=division_47)
material_75 = Material(Name="Name of the material", Grade="Grade of the material", Density=division_48)
material_76 = Material(Name="Name of the material", Grade="Grade of the material", Density=division_49)
material_77 = Material(Name="Name of the material", Grade="Grade of the material", Density=Slider(7850, range=0..10000))
material_78 = Material(Name="Name of the material", Grade="Grade of the material", Density=division_50)
material_79 = Material(Name="Name of the material", Grade="Grade of the material", Density=Slider(7850, range=0..10000))
material_80 = Material(Name="Name of the material", Grade="Grade of the material", Density=division_51)
material_81 = Material(Name="Name of the material", Grade="Grade of the material", Density=Slider(7850, range=0..10000))
material_82 = Material(Name="Name of the material", Grade="Grade of the material", Density=Slider(7850, range=0..10000))
pt_46 = ConstructPoint(XCoordinate=0, YCoordinate=0, ZCoordinate=0)
pt_47 = ConstructPoint(XCoordinate=0, YCoordinate=0, ZCoordinate=0)
pt_48 = ConstructPoint(XCoordinate=Slider(700, range=0..1000), YCoordinate=0, ZCoordinate=0)
pt_49 = ConstructPoint(XCoordinate=Slider(500, range=0..1000), YCoordinate=0, ZCoordinate=0)
pt_50 = ConstructPoint(XCoordinate=0, YCoordinate=0, ZCoordinate=0)
pt_51 = ConstructPoint(XCoordinate=Slider(500, range=0..1000), YCoordinate=0, ZCoordinate=0)
pt_52 = ConstructPoint(XCoordinate=0, YCoordinate=0, ZCoordinate=0)
pt_53 = ConstructPoint(XCoordinate=number_slider_23, YCoordinate=0, ZCoordinate=0)
pt_54 = ConstructPoint(XCoordinate=0, YCoordinate=0, ZCoordinate=0)
pt_55 = ConstructPoint(XCoordinate=number_slider_24, YCoordinate=0, ZCoordinate=0)
pt_56 = ConstructPoint(XCoordinate=0, YCoordinate=0, ZCoordinate=0)
pt_57 = ConstructPoint(XCoordinate=Slider(0.5, range=0..1), YCoordinate=0, ZCoordinate=0)
pt_58 = ConstructPoint(XCoordinate=0, YCoordinate=0, ZCoordinate=0)
pt_59 = ConstructPoint(XCoordinate=Slider(700, range=0..1000), YCoordinate=0, ZCoordinate=0)
pt_60 = ConstructPoint(XCoordinate=0, YCoordinate=0, ZCoordinate=0)
pt_61 = ConstructPoint(XCoordinate=Slider(0.5, range=0..1), YCoordinate=0, ZCoordinate=0)
pt_62 = ConstructPoint(XCoordinate=0, YCoordinate=0, ZCoordinate=0)
pt_63 = ConstructPoint(XCoordinate=Slider(700, range=0..1000), YCoordinate=0, ZCoordinate=0)
pt_64 = ConstructPoint(XCoordinate=0, YCoordinate=0, ZCoordinate=0)
pt_65 = ConstructPoint(XCoordinate=number_slider_25, YCoordinate=0, ZCoordinate=0)
pt_66 = ConstructPoint(XCoordinate=0, YCoordinate=0, ZCoordinate=0)
pt_67 = ConstructPoint(XCoordinate=number_slider_26, YCoordinate=0, ZCoordinate=0)
rebar_properties_70 = RebarProperties(Diameter="12", Material=material_72)
rebar_properties_71 = RebarProperties(Diameter="16", Material=material_73)
rebar_properties_72 = RebarProperties(Diameter="12", Material=material_74)
ln = Line(StartPoint=pt_46, EndPoint=pt_48)
ln_2 = Line(StartPoint=pt_47, EndPoint=pt_49)
rebar_properties_73 = RebarProperties(Diameter="12", Material=material_75)
ln_3 = Line(StartPoint=pt_50, EndPoint=pt_51)
rebar_properties_74 = RebarProperties(Diameter="12", Material=material_76)
rebar_properties_75 = RebarProperties(Diameter="0.012", Material=material_77)
ln_4 = Line(StartPoint=pt_52, EndPoint=pt_53)
rebar_properties_76 = RebarProperties(Diameter="12", Material=material_78)
rebar_properties_77 = RebarProperties(Diameter="0.012", Material=material_79)
ln_5 = Line(StartPoint=pt_54, EndPoint=pt_55)
rebar_properties_78 = RebarProperties(Diameter="12", Material=material_80)
ln_6 = Line(StartPoint=pt_56, EndPoint=pt_57)
ln_7 = Line(StartPoint=pt_58, EndPoint=pt_59)
rebar_properties_79 = RebarProperties(Diameter="0.012", Material=material_81)
rebar_properties_80 = RebarProperties(Diameter="0.012", Material=material_82)
ln_8 = Line(StartPoint=pt_60, EndPoint=pt_61)
ln_9 = Line(StartPoint=pt_62, EndPoint=pt_63)
ln_10 = Line(StartPoint=pt_64, EndPoint=pt_65)
ln_11 = Line(StartPoint=pt_66, EndPoint=pt_67)
curve_to_rebar_shape_8 = CurveToRebarShape(Curve=ln, Properties=rebar_properties_70)  # -> RebarShape, Mesh
curve_to_rebar_shape_9 = CurveToRebarShape(Curve=ln_2, Properties=rebar_properties_71)  # -> RebarShape, Mesh
curve_to_rebar_shape_10 = CurveToRebarShape(Curve=ln_3, Properties=rebar_properties_72)  # -> RebarShape, Mesh
curve_to_rebar_shape_11 = CurveToRebarShape(Curve=ln_4, Properties=rebar_properties_73)  # -> RebarShape, Mesh
curve_to_rebar_shape_12 = CurveToRebarShape(Curve=ln_5, Properties=rebar_properties_74)  # -> RebarShape, Mesh
curve_to_rebar_shape_13 = CurveToRebarShape(Curve=ln_6, Properties=rebar_properties_75)  # -> RebarShape, Mesh
curve_to_rebar_shape_14 = CurveToRebarShape(Curve=ln_7, Properties=rebar_properties_76)  # -> RebarShape, Mesh
curve_to_rebar_shape_15 = CurveToRebarShape(Curve=ln_8, Properties=rebar_properties_77)  # -> RebarShape, Mesh
curve_to_rebar_shape_16 = CurveToRebarShape(Curve=ln_9, Properties=rebar_properties_78)  # -> RebarShape, Mesh
curve_to_rebar_shape_17 = CurveToRebarShape(Curve=ln_10, Properties=rebar_properties_79)  # -> RebarShape, Mesh
curve_to_rebar_shape_18 = CurveToRebarShape(Curve=ln_11, Properties=rebar_properties_80)  # -> RebarShape, Mesh
pt_68 = ConstructPoint(XCoordinate=expr("X/2", number_slider_25), YCoordinate=0, ZCoordinate=0)
pt_69 = ConstructPoint(XCoordinate=expr("X/2", number_slider_26), YCoordinate=0, ZCoordinate=0)
vec = VectorXYZ(XComponent=Slider(0.5, range=0..1), YComponent=Slider(0.6, range=0..1), ZComponent=Slider(0.7, range=0..1))  # -> Vector, Length
vec_2 = VectorXYZ(XComponent=Slider(0.5, range=0..1), YComponent=Slider(0.6, range=0..1), ZComponent=Slider(0.7, range=0..1))  # -> Vector, Length
vec_3 = VectorXYZ(XComponent=0, YComponent=Slider(1000, range=0..1000), ZComponent=0)  # -> Vector, Length
vec_4 = VectorXYZ(XComponent=0, YComponent=Slider(1000, range=0..1000), ZComponent=0)  # -> Vector, Length
vec_5 = VectorXYZ(XComponent=0, YComponent=Slider(1000, range=0..1000), ZComponent=0)  # -> Vector, Length
pt_70 = ConstructPoint(XCoordinate=expr("X/2", number_slider_23), YCoordinate=0, ZCoordinate=0)
vec_6 = VectorXYZ(XComponent=Slider(500, range=0..1000), YComponent=Slider(600, range=0..1000), ZComponent=Slider(700, range=0..1000))  # -> Vector, Length
pt_71 = ConstructPoint(XCoordinate=expr("X/2", number_slider_24), YCoordinate=0, ZCoordinate=0)
vec_7 = VectorXYZ(XComponent=Slider(500, range=0..1000), YComponent=Slider(600, range=0..1000), ZComponent=Slider(700, range=0..1000))  # -> Vector, Length
vec_8 = VectorXYZ(XComponent=0, YComponent=Slider(1, range=0..1), ZComponent=0)  # -> Vector, Length
vec_9 = VectorXYZ(XComponent=0, YComponent=Slider(1000, range=0..1000), ZComponent=0)  # -> Vector, Length
vec_10 = VectorXYZ(XComponent=0, YComponent=Slider(1, range=0..1), ZComponent=0)  # -> Vector, Length
vec_11 = VectorXYZ(XComponent=0, YComponent=Slider(1000, range=0..1000), ZComponent=0)  # -> Vector, Length
vector_count_spacing = VectorCountSpacing(Id="0", RebarShape=curve_to_rebar_shape_8.RebarShape, Vector=vec_3.Vector, Count=Slider(10, range=0..100))  # -> RebarGroup, Mesh, Curve
vector_count_spacing_2 = VectorCountSpacing(Id="0", RebarShape=curve_to_rebar_shape_9.RebarShape, Vector=vec_4.Vector, Count=Slider(10, range=0..100))  # -> RebarGroup, Mesh, Curve
vdis = VectorDisplay(Anchor=pt_68, Vector=vec.Vector)
vector_count_spacing_3 = VectorCountSpacing(Id="0", RebarShape=curve_to_rebar_shape_10.RebarShape, Vector=vec_5.Vector, Count=Slider(10, range=0..100))  # -> RebarGroup, Mesh, Curve
vdis_2 = VectorDisplay(Anchor=pt_69, Vector=vec_2.Vector)
vector_count_spacing_4 = VectorCountSpacing(Id="1", RebarShape=curve_to_rebar_shape_14.RebarShape, Vector=vec_9.Vector, Count=Slider(10, range=0..100))  # -> RebarGroup, Mesh, Curve
vector_count_spacing_5 = VectorCountSpacing(Id="0", RebarShape=curve_to_rebar_shape_11.RebarShape, Vector=vec_6.Vector, Count=Slider(10, range=0..100))  # -> RebarGroup, Mesh, Curve
vector_count_spacing_6 = VectorCountSpacing(Id="0", RebarShape=curve_to_rebar_shape_12.RebarShape, Vector=vec_7.Vector, Count=Slider(10, range=0..100))  # -> RebarGroup, Mesh, Curve
vector_count_spacing_7 = VectorCountSpacing(Id="0", RebarShape=curve_to_rebar_shape_13.RebarShape, Vector=vec_8.Vector, Count=Slider(10, range=0..100))  # -> RebarGroup, Mesh, Curve
vector_count_spacing_8 = VectorCountSpacing(Id="0", RebarShape=curve_to_rebar_shape_15.RebarShape, Vector=vec_10.Vector, Count=Slider(7, range=0..100))  # -> RebarGroup, Mesh, Curve
vector_count_spacing_9 = VectorCountSpacing(Id="0", RebarShape=curve_to_rebar_shape_16.RebarShape, Vector=vec_11.Vector, Count=Slider(6, range=0..100))  # -> RebarGroup, Mesh, Curve
vector_count_spacing_10 = VectorCountSpacing(Id="0", RebarShape=curve_to_rebar_shape_17.RebarShape, Vector=vec.Vector, Count=Slider(7, range=0..100))  # -> RebarGroup, Mesh, Curve
vector_count_spacing_11 = VectorCountSpacing(Id="0", RebarShape=curve_to_rebar_shape_18.RebarShape, Vector=vec_2.Vector, Count=Slider(7, range=0..100))  # -> RebarGroup, Mesh, Curve
vdis_3 = VectorDisplay(Anchor=pt_70, Vector=vec_6.Vector)
vdis_4 = VectorDisplay(Anchor=pt_71, Vector=vec_7.Vector)
panel_22 = Panel("""Rebar Group
Id: 1
Count: 10""")
mesh_65 = Mesh([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])
mesh_66 = Mesh([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])
mesh_67 = Mesh([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])
mesh_68 = Mesh([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])
mesh_69 = Mesh([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])
mesh_70 = Mesh([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])
mesh_71 = Mesh([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])
mesh_72 = Mesh([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])
demesh_130 = DeconstructMesh(Mesh=vector_count_spacing.Mesh)  # -> flatten(Vertices), Faces, Colours, Normals
demesh_131 = DeconstructMesh(Mesh=vector_count_spacing_2.Mesh)  # -> flatten(Vertices), Faces, Colours, Normals
demesh_132 = DeconstructMesh(Mesh=mesh_66)  # -> flatten(Vertices), Faces, Colours, Normals
demesh_133 = DeconstructMesh(Mesh=mesh_65)  # -> flatten(Vertices), Faces, Colours, Normals
demesh_134 = DeconstructMesh(Mesh=vector_count_spacing_3.Mesh)  # -> flatten(Vertices), Faces, Colours, Normals
demesh_135 = DeconstructMesh(Mesh=mesh_67)  # -> flatten(Vertices), Faces, Colours, Normals
demesh_136 = DeconstructMesh(Mesh=vector_count_spacing_5.Mesh)  # -> flatten(Vertices), Faces, Colours, Normals
demesh_137 = DeconstructMesh(Mesh=mesh_68)  # -> flatten(Vertices), Faces, Colours, Normals
divide = DivideCurve(Curve=vector_count_spacing_6.Curve, Count=10, Kinks=False)  # -> flatten(Points), Tangents, Parameters
demesh_138 = DeconstructMesh(Mesh=vector_count_spacing_7.Mesh)  # -> flatten(Vertices), Faces, Colours, Normals
demesh_139 = DeconstructMesh(Mesh=mesh_69)  # -> flatten(Vertices), Faces, Colours, Normals
demesh_140 = DeconstructMesh(Mesh=vector_count_spacing_8.Mesh)  # -> flatten(Vertices), Faces, Colours, Normals
demesh_141 = DeconstructMesh(Mesh=mesh_70)  # -> flatten(Vertices), Faces, Colours, Normals
demesh_142 = DeconstructMesh(Mesh=vector_count_spacing_9.Mesh)  # -> flatten(Vertices), Faces, Colours, Normals
demesh_143 = DeconstructMesh(Mesh=mesh_71)  # -> flatten(Vertices), Faces, Colours, Normals
demesh_144 = DeconstructMesh(Mesh=vector_count_spacing_11.Mesh)  # -> flatten(Vertices), Faces, Colours, Normals
demesh_145 = DeconstructMesh(Mesh=mesh_72)  # -> flatten(Vertices), Faces, Colours, Normals
assert_10 = Assert(TestNames="VectorCountSpacingMilimeters_Id_Init", Expected=panel_22, Actual=vector_count_spacing_4.RebarGroup)  # -> Result, FailedInfo
divide_2 = DivideCurve(Curve=vector_count_spacing_10.Curve, Count=10, Kinks=False)  # -> flatten(Points), Tangents, Parameters
pt_72 = Point([Point(0, 0, 0), Point(70, 0, 0), Point(140, 0, 0), Point(210, 0, 0), Point(280, 0, 0), Point(350, 0, 0)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])
pt_73 = Point([Point(0, 0, 0), Point(0.05, 0, 0), Point(0.1, 0, 0), Point(0.15, 0, 0), Point(0.2, 0, 0), Point(0.25, 0, 0)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])
assert_point_list_66 = AssertPointList(
    TestName="VectorCountSpacingMilimeters_RebarLength_Mesh",
    ExpectedPointList=demesh_132.Vertices,
    ActualPointList=demesh_130.Vertices,
    Tolerance="0.00001")  # -> Result, FailedInfo
assert_point_list_67 = AssertPointList(
    TestName="VectorCountSpacingMilimeters_Diameter_Mesh",
    ExpectedPointList=demesh_133.Vertices,
    ActualPointList=demesh_131.Vertices,
    Tolerance="0.00001")  # -> Result, FailedInfo
assert_point_list_68 = AssertPointList(
    TestName="VectorCountSpacingMilimeters_Normal_Mesh",
    ExpectedPointList=demesh_135.Vertices,
    ActualPointList=demesh_134.Vertices,
    Tolerance="0.00001")  # -> Result, FailedInfo
assert_point_list_69 = AssertPointList(
    TestName="VectorCountSpacingMilimeters_Vector_Mesh",
    ExpectedPointList=demesh_137.Vertices,
    ActualPointList=demesh_136.Vertices,
    Tolerance="0.00001")  # -> Result, FailedInfo
assert_point_list_70 = AssertPointList(
    TestName="VectorCountSpacingMilimeters_Vector_Curve",
    ExpectedPointList=pt_72,
    ActualPointList=divide.Points,
    Tolerance="0.00001")  # -> Result, FailedInfo
assert_point_list_71 = AssertPointList(
    TestName="VectorCountSpacingMeters_Normal_Mesh",
    ExpectedPointList=demesh_139.Vertices,
    ActualPointList=demesh_138.Vertices,
    Tolerance="0.00001")  # -> Result, FailedInfo
assert_point_list_72 = AssertPointList(
    TestName="VectorCountSpacingMeters_Count_Mesh",
    ExpectedPointList=demesh_141.Vertices,
    ActualPointList=demesh_140.Vertices,
    Tolerance="0.00001")  # -> Result, FailedInfo
assert_point_list_73 = AssertPointList(
    TestName="VectorCountSpacingMilimeters_Count_Mesh",
    ExpectedPointList=demesh_143.Vertices,
    ActualPointList=demesh_142.Vertices,
    Tolerance="0.00001")  # -> Result, FailedInfo
assert_point_list_74 = AssertPointList(
    TestName="VectorCountSpacingMeters_Vector_Curve",
    ExpectedPointList=pt_73,
    ActualPointList=divide_2.Points,
    Tolerance="0.00001")  # -> Result, FailedInfo
assert_point_list_75 = AssertPointList(
    TestName="VectorCountSpacingMeters_Vector_Mesh",
    ExpectedPointList=demesh_145.Vertices,
    ActualPointList=demesh_144.Vertices,
    Tolerance="0.00001")  # -> Result, FailedInfo
entwine_14 = Entwine(
    Branch00=assert_point_list_68.Result,
    Branch01=assert_point_list_67.Result,
    Branch02=assert_point_list_66.Result,
    Branch03=assert_10.Result,
    Branch04=assert_point_list_73.Result,
    Branch05=assert_point_list_69.Result,
    Branch06=assert_point_list_70.Result,
    Branch07=assert_point_list_71.Result,
    Branch08=assert_point_list_72.Result,
    Branch09=assert_point_list_75.Result,
    Branch010=assert_point_list_74.Result,
    FlattenInputs=True)  # -> flatten(Result)

# ----
# Vector Length Spacing
number_slider_27 = Slider(7850, range=0..10000)
division_52 = Division(A=number_slider_27, B="1e9")
division_53 = Division(A=Slider(7850, range=0..10000), B="1e9")
division_54 = Division(A=Slider(7850, range=0..10000), B="1e9")
division_55 = Division(A=Slider(7850, range=0..10000), B="1e9")
material_83 = Material(Name="Name of the material", Grade="Grade of the material", Density=division_52)
material_84 = Material(Name="Name of the material", Grade="Grade of the material", Density=Slider(7850, range=0..10000))
material_85 = Material(Name="Name of the material", Grade="Grade of the material", Density=Slider(7850, range=0..10000))
material_86 = Material(Name="Name of the material", Grade="Grade of the material", Density=Slider(7850, range=0..10000))
division_56 = Division(A=Slider(7850, range=0..10000), B="1e9")
material_87 = Material(Name="Name of the material", Grade="Grade of the material", Density=division_53)
material_88 = Material(Name="Name of the material", Grade="Grade of the material", Density=division_54)
material_89 = Material(Name="Name of the material", Grade="Grade of the material", Density=division_55)
division_57 = Division(A=Slider(7850, range=0..10000), B="1e9")
division_58 = Division(A=Slider(7850, range=0..10000), B="1e9")
division_59 = Division(A=Slider(7850, range=0..10000), B="1e9")
division_60 = Division(A=Slider(7850, range=0..10000), B="1e9")
division_61 = Division(A=Slider(7850, range=0..10000), B="1e9")
material_90 = Material(Name="Name of the material", Grade="Grade of the material", Density=Slider(7850, range=0..10000))
division_62 = Division(A=Slider(7850, range=0..10000), B="1e9")
division_63 = Division(A=Slider(7850, range=0..10000), B="1e9")
material_91 = Material(Name="Name of the material", Grade="Grade of the material", Density=Slider(7850, range=0..10000))
material_92 = Material(Name="Name of the material", Grade="Grade of the material", Density=Slider(7850, range=0..10000))
material_93 = Material(Name="Name of the material", Grade="Grade of the material", Density=division_56)
material_94 = Material(Name="Name of the material", Grade="Grade of the material", Density=Slider(7850, range=0..10000))
material_95 = Material(Name="Name of the material", Grade="Grade of the material", Density=division_57)
material_96 = Material(Name="Name of the material", Grade="Grade of the material", Density=Slider(7850, range=0..10000))
material_97 = Material(Name="Name of the material", Grade="Grade of the material", Density=division_58)
pt_74 = ConstructPoint(XCoordinate=0, YCoordinate=0, ZCoordinate=0)
pt_75 = ConstructPoint(XCoordinate=Slider(500, range=0..1000), YCoordinate=0, ZCoordinate=0)
pt_76 = ConstructPoint(XCoordinate=0, YCoordinate=0, ZCoordinate=0)
pt_77 = ConstructPoint(XCoordinate=Slider(0.5, range=0..1), YCoordinate=0, ZCoordinate=0)
material_98 = Material(Name="Name of the material", Grade="Grade of the material", Density=division_59)
material_99 = Material(Name="Name of the material", Grade="Grade of the material", Density=Slider(7850, range=0..10000))
material_100 = Material(Name="Name of the material", Grade="Grade of the material", Density=division_60)
pt_78 = ConstructPoint(XCoordinate=0, YCoordinate=0, ZCoordinate=0)
pt_79 = ConstructPoint(XCoordinate=Slider(0.5, range=0..1), YCoordinate=0, ZCoordinate=0)
pt_80 = ConstructPoint(XCoordinate=0, YCoordinate=0, ZCoordinate=0)
pt_81 = ConstructPoint(XCoordinate=Slider(0.5, range=0..1), YCoordinate=0, ZCoordinate=0)
material_101 = Material(Name="Name of the material", Grade="Grade of the material", Density=Slider(7850, range=0..10000))
material_102 = Material(Name="Name of the material", Grade="Grade of the material", Density=division_61)
material_103 = Material(Name="Name of the material", Grade="Grade of the material", Density=Slider(7850, range=0..10000))
pt_82 = ConstructPoint(XCoordinate=0, YCoordinate=0, ZCoordinate=0)
pt_83 = ConstructPoint(XCoordinate=Slider(500, range=0..1000), YCoordinate=0, ZCoordinate=0)
pt_84 = ConstructPoint(XCoordinate=0, YCoordinate=0, ZCoordinate=0)
pt_85 = ConstructPoint(XCoordinate=Slider(500, range=0..1000), YCoordinate=0, ZCoordinate=0)
pt_86 = ConstructPoint(XCoordinate=0, YCoordinate=0, ZCoordinate=0)
pt_87 = ConstructPoint(XCoordinate=Slider(500, range=0..1000), YCoordinate=0, ZCoordinate=0)
material_104 = Material(Name="Name of the material", Grade="Grade of the material", Density=division_62)
material_105 = Material(Name="Name of the material", Grade="Grade of the material", Density=division_63)
rebar_properties_81 = RebarProperties(Diameter="12", Material=material_83)
rebar_properties_82 = RebarProperties(Diameter="0.012", Material=material_84)
rebar_properties_83 = RebarProperties(Diameter="0.012", Material=material_85)
rebar_properties_84 = RebarProperties(Diameter="0.012", Material=material_86)
rebar_properties_85 = RebarProperties(Diameter="12", Material=material_87)
rebar_properties_86 = RebarProperties(Diameter="12", Material=material_88)
pt_88 = ConstructPoint(XCoordinate=0, YCoordinate=0, ZCoordinate=0)
rebar_properties_87 = RebarProperties(Diameter="12", Material=material_89)
pt_89 = ConstructPoint(XCoordinate=Slider(0.5, range=0..1), YCoordinate=0, ZCoordinate=0)
ln_12 = Line(StartPoint=pt_74, EndPoint=pt_75)
ln_13 = Line(StartPoint=pt_76, EndPoint=pt_77)
pt_90 = ConstructPoint(XCoordinate=0, YCoordinate=0, ZCoordinate=0)
pt_91 = ConstructPoint(XCoordinate=Slider(0.5, range=0..1), YCoordinate=0, ZCoordinate=0)
pt_92 = ConstructPoint(XCoordinate=0, YCoordinate=0, ZCoordinate=0)
pt_93 = ConstructPoint(XCoordinate=Slider(0.5, range=0..1), YCoordinate=0, ZCoordinate=0)
pt_94 = ConstructPoint(XCoordinate=0, YCoordinate=0, ZCoordinate=0)
pt_95 = ConstructPoint(XCoordinate=Slider(500, range=0..1000), YCoordinate=0, ZCoordinate=0)
ln_14 = Line(StartPoint=pt_78, EndPoint=pt_79)
ln_15 = Line(StartPoint=pt_80, EndPoint=pt_81)
pt_96 = ConstructPoint(XCoordinate=0, YCoordinate=0, ZCoordinate=0)
pt_97 = ConstructPoint(XCoordinate=0, YCoordinate=0, ZCoordinate=0)
pt_98 = ConstructPoint(XCoordinate=Slider(0.5, range=0..1), YCoordinate=0, ZCoordinate=0)
pt_99 = ConstructPoint(XCoordinate=Slider(500, range=0..1000), YCoordinate=0, ZCoordinate=0)
pt_100 = ConstructPoint(XCoordinate=0, YCoordinate=0, ZCoordinate=0)
pt_101 = ConstructPoint(XCoordinate=0, YCoordinate=0, ZCoordinate=0)
pt_102 = ConstructPoint(XCoordinate=Slider(0.5, range=0..1), YCoordinate=0, ZCoordinate=0)
pt_103 = ConstructPoint(XCoordinate=Slider(500, range=0..1000), YCoordinate=0, ZCoordinate=0)
ln_16 = Line(StartPoint=pt_82, EndPoint=pt_83)
ln_17 = Line(StartPoint=pt_84, EndPoint=pt_85)
ln_18 = Line(StartPoint=pt_86, EndPoint=pt_87)
pt_104 = ConstructPoint(XCoordinate=0, YCoordinate=0, ZCoordinate=0)
pt_105 = ConstructPoint(XCoordinate=0, YCoordinate=0, ZCoordinate=0)
pt_106 = ConstructPoint(XCoordinate=Slider(500, range=0..1000), YCoordinate=0, ZCoordinate=0)
pt_107 = ConstructPoint(XCoordinate=Slider(0.5, range=0..1), YCoordinate=0, ZCoordinate=0)
pt_108 = ConstructPoint(XCoordinate=0, YCoordinate=0, ZCoordinate=0)
pt_109 = ConstructPoint(XCoordinate=Slider(500, range=0..1000), YCoordinate=0, ZCoordinate=0)
rebar_properties_88 = RebarProperties(Diameter="0.012", Material=material_90)
pt_110 = ConstructPoint(XCoordinate=0, YCoordinate=0, ZCoordinate=0)
pt_111 = ConstructPoint(XCoordinate=Slider(0.5, range=0..1), YCoordinate=0, ZCoordinate=0)
pt_112 = ConstructPoint(XCoordinate=0, YCoordinate=0, ZCoordinate=0)
rebar_properties_89 = RebarProperties(Diameter="0.012", Material=material_91)
pt_113 = ConstructPoint(XCoordinate=Slider(500, range=0..1000), YCoordinate=0, ZCoordinate=0)
rebar_properties_90 = RebarProperties(Diameter="0.012", Material=material_92)
pt_114 = ConstructPoint(XCoordinate=0, YCoordinate=0, ZCoordinate=0)
pt_115 = ConstructPoint(XCoordinate=Slider(0.5, range=0..1), YCoordinate=0, ZCoordinate=0)
rebar_properties_91 = RebarProperties(Diameter="12", Material=material_93)
pt_116 = ConstructPoint(XCoordinate=0, YCoordinate=0, ZCoordinate=0)
pt_117 = ConstructPoint(XCoordinate=Slider(500, range=0..1000), YCoordinate=0, ZCoordinate=0)
rebar_properties_92 = RebarProperties(Diameter="0.012", Material=material_94)
rebar_properties_93 = RebarProperties(Diameter="12", Material=material_95)
rebar_properties_94 = RebarProperties(Diameter="0.012", Material=material_96)
rebar_properties_95 = RebarProperties(Diameter="12", Material=material_97)
pt_118 = ConstructPoint(XCoordinate=0, YCoordinate=0, ZCoordinate=0)
pt_119 = ConstructPoint(XCoordinate=Slider(500, range=0..1000), YCoordinate=0, ZCoordinate=0)
ln_19 = Line(StartPoint=pt_88, EndPoint=pt_89)
rebar_properties_96 = RebarProperties(Diameter="12", Material=material_98)
rebar_properties_97 = RebarProperties(Diameter="0.012", Material=material_99)
rebar_properties_98 = RebarProperties(Diameter="12", Material=material_100)
ln_20 = Line(StartPoint=pt_90, EndPoint=pt_91)
ln_21 = Line(StartPoint=pt_92, EndPoint=pt_93)
rebar_properties_99 = RebarProperties(Diameter="0.016", Material=material_101)
ln_22 = Line(StartPoint=pt_94, EndPoint=pt_95)
rebar_properties_100 = RebarProperties(Diameter="12", Material=material_102)
rebar_properties_101 = RebarProperties(Diameter="0.012", Material=material_103)
curve_to_rebar_shape_19 = CurveToRebarShape(Curve=ln_12, Properties=rebar_properties_81)  # -> RebarShape, Mesh
ln_23 = Line(StartPoint=pt_96, EndPoint=pt_98)
ln_24 = Line(StartPoint=pt_97, EndPoint=pt_99)
ln_25 = Line(StartPoint=pt_100, EndPoint=pt_102)
ln_26 = Line(StartPoint=pt_101, EndPoint=pt_103)
rebar_properties_102 = RebarProperties(Diameter="16", Material=material_104)
curve_to_rebar_shape_20 = CurveToRebarShape(Curve=ln_13, Properties=rebar_properties_82)  # -> RebarShape, Mesh
rebar_properties_103 = RebarProperties(Diameter="12", Material=material_105)
ln_27 = Line(StartPoint=pt_104, EndPoint=pt_106)
ln_28 = Line(StartPoint=pt_105, EndPoint=pt_107)
ln_29 = Line(StartPoint=pt_108, EndPoint=pt_109)
curve_to_rebar_shape_21 = CurveToRebarShape(Curve=ln_14, Properties=rebar_properties_83)  # -> RebarShape, Mesh
curve_to_rebar_shape_22 = CurveToRebarShape(Curve=ln_15, Properties=rebar_properties_84)  # -> RebarShape, Mesh
ln_30 = Line(StartPoint=pt_110, EndPoint=pt_111)
vec_12 = VectorXYZ(XComponent=0, YComponent=Slider(1000, range=0..1000), ZComponent=0)  # -> Vector, Length
curve_to_rebar_shape_23 = CurveToRebarShape(Curve=ln_16, Properties=rebar_properties_85)  # -> RebarShape, Mesh
ln_31 = Line(StartPoint=pt_112, EndPoint=pt_113)
vec_13 = VectorXYZ(XComponent=0, YComponent=Slider(1, range=0..1), ZComponent=0)  # -> Vector, Length
ln_32 = Line(StartPoint=pt_114, EndPoint=pt_115)
curve_to_rebar_shape_24 = CurveToRebarShape(Curve=ln_17, Properties=rebar_properties_86)  # -> RebarShape, Mesh
curve_to_rebar_shape_25 = CurveToRebarShape(Curve=ln_18, Properties=rebar_properties_87)  # -> RebarShape, Mesh
ln_33 = Line(StartPoint=pt_116, EndPoint=pt_117)
vec_14 = VectorXYZ(XComponent=0, YComponent=Slider(1, range=0..1), ZComponent=0)  # -> Vector, Length
ln_34 = Line(StartPoint=pt_118, EndPoint=pt_119)
vec_15 = VectorXYZ(XComponent=0, YComponent=Slider(0.6, range=0..1), ZComponent=Slider(0.7, range=0..1))  # -> Vector, Length
vec_16 = VectorXYZ(XComponent=0, YComponent=Slider(1000, range=0..1000), ZComponent=0)  # -> Vector, Length
vec_17 = VectorXYZ(XComponent=0, YComponent=Slider(1000, range=0..1000), ZComponent=0)  # -> Vector, Length
vec_18 = VectorXYZ(XComponent=0, YComponent=Slider(600, range=0..1000), ZComponent=Slider(700, range=0..1000))  # -> Vector, Length
curve_to_rebar_shape_26 = CurveToRebarShape(Curve=ln_19, Properties=rebar_properties_88)  # -> RebarShape, Mesh
curve_to_rebar_shape_27 = CurveToRebarShape(Curve=ln_20, Properties=rebar_properties_89)  # -> RebarShape, Mesh
curve_to_rebar_shape_28 = CurveToRebarShape(Curve=ln_21, Properties=rebar_properties_90)  # -> RebarShape, Mesh
curve_to_rebar_shape_29 = CurveToRebarShape(Curve=ln_22, Properties=rebar_properties_91)  # -> RebarShape, Mesh
curve_to_rebar_shape_30 = CurveToRebarShape(Curve=ln_23, Properties=rebar_properties_92)  # -> RebarShape, Mesh
curve_to_rebar_shape_31 = CurveToRebarShape(Curve=ln_24, Properties=rebar_properties_93)  # -> RebarShape, Mesh
curve_to_rebar_shape_32 = CurveToRebarShape(Curve=ln_25, Properties=rebar_properties_94)  # -> RebarShape, Mesh
curve_to_rebar_shape_33 = CurveToRebarShape(Curve=ln_26, Properties=rebar_properties_95)  # -> RebarShape, Mesh
vec_19 = VectorXYZ(XComponent=0, YComponent=Slider(1, range=0..1), ZComponent=0)  # -> Vector, Length
vec_20 = VectorXYZ(XComponent=0, YComponent=Slider(1, range=0..1), ZComponent=0)  # -> Vector, Length
curve_to_rebar_shape_34 = CurveToRebarShape(Curve=ln_27, Properties=rebar_properties_96)  # -> RebarShape, Mesh
vec_21 = VectorXYZ(XComponent=0, YComponent=Slider(1, range=0..1), ZComponent=0)  # -> Vector, Length
curve_to_rebar_shape_35 = CurveToRebarShape(Curve=ln_28, Properties=rebar_properties_97)  # -> RebarShape, Mesh
curve_to_rebar_shape_36 = CurveToRebarShape(Curve=ln_29, Properties=rebar_properties_98)  # -> RebarShape, Mesh
vec_22 = VectorXYZ(XComponent=0, YComponent=Slider(1000, range=0..1000), ZComponent=0)  # -> Vector, Length
curve_to_rebar_shape_37 = CurveToRebarShape(Curve=ln_30, Properties=rebar_properties_99)  # -> RebarShape, Mesh
vec_23 = VectorXYZ(XComponent=0, YComponent=Slider(1, range=0..1), ZComponent=0)  # -> Vector, Length
vec_24 = VectorXYZ(XComponent=0, YComponent=Slider(1000, range=0..1000), ZComponent=0)  # -> Vector, Length
vec_25 = VectorXYZ(XComponent=0, YComponent=Slider(1, range=0..1), ZComponent=0)  # -> Vector, Length
vec_26 = VectorXYZ(XComponent=0, YComponent=Slider(1000, range=0..1000), ZComponent=0)  # -> Vector, Length
curve_to_rebar_shape_38 = CurveToRebarShape(Curve=ln_31, Properties=rebar_properties_100)  # -> RebarShape, Mesh
curve_to_rebar_shape_39 = CurveToRebarShape(Curve=ln_32, Properties=rebar_properties_101)  # -> RebarShape, Mesh
curve_to_rebar_shape_40 = CurveToRebarShape(Curve=ln_33, Properties=rebar_properties_102)  # -> RebarShape, Mesh
vec_27 = VectorXYZ(XComponent=0, YComponent=Slider(1000, range=0..1000), ZComponent=0)  # -> Vector, Length
vec_28 = VectorXYZ(XComponent=0, YComponent=Slider(1, range=0..1), ZComponent=0)  # -> Vector, Length
vec_29 = VectorXYZ(XComponent=0, YComponent=Slider(1000, range=0..1000), ZComponent=0)  # -> Vector, Length
curve_to_rebar_shape_41 = CurveToRebarShape(Curve=ln_34, Properties=rebar_properties_103)  # -> RebarShape, Mesh
vec_30 = VectorXYZ(XComponent=0, YComponent=Slider(1, range=0..1), ZComponent=0)  # -> Vector, Length
vec_31 = VectorXYZ(XComponent=0, YComponent=Slider(1000, range=0..1000), ZComponent=0)  # -> Vector, Length
vec_32 = VectorXYZ(XComponent=0, YComponent=Slider(1, range=0..2.001), ZComponent=0)  # -> Vector, Length
vec_33 = VectorXYZ(XComponent=0, YComponent=Slider(1000, range=0..1000), ZComponent=0)  # -> Vector, Length
vec_34 = VectorXYZ(XComponent=0, YComponent=Slider(1000, range=0..1000), ZComponent=0)  # -> Vector, Length
vector_length_spacing = VectorLengthSpacing(
    Id="0",
    RebarShape=curve_to_rebar_shape_20.RebarShape,
    Vector=vec_13.Vector,
    SpacingLength=Slider(0.1, range=0..0.1),
    Type="0",
    Tolerance=0.0001)  # -> RebarGroup, Mesh, Curve
vector_length_spacing_2 = VectorLengthSpacing(
    Id="0",
    RebarShape=curve_to_rebar_shape_19.RebarShape,
    Vector=vec_12.Vector,
    SpacingLength=Slider(100, range=0..1000),
    Type="0",
    Tolerance="0.0001")  # -> RebarGroup, Mesh, Curve
vector_length_spacing_3 = VectorLengthSpacing(
    Id="0",
    RebarShape=curve_to_rebar_shape_21.RebarShape,
    Vector=vec_14.Vector,
    SpacingLength=Slider(0.121, range=0..1),
    Type="0",
    Tolerance=0.0001)  # -> RebarGroup, Mesh, Curve
vector_length_spacing_4 = VectorLengthSpacing(
    Id="0",
    RebarShape=curve_to_rebar_shape_22.RebarShape,
    Vector=vec_15.Vector,
    SpacingLength=Slider(0.121, range=0..1),
    Type="0",
    Tolerance=0.0001)  # -> RebarGroup, Mesh, Curve
panel_23 = Panel("0.0001")
vector_length_spacing_5 = VectorLengthSpacing(
    Id="0",
    RebarShape=curve_to_rebar_shape_24.RebarShape,
    Vector=vec_17.Vector,
    SpacingLength=Slider(121, range=0..1000),
    Type="0",
    Tolerance=0.0001)  # -> RebarGroup, Mesh, Curve
vector_length_spacing_6 = VectorLengthSpacing(
    Id="1",
    RebarShape=curve_to_rebar_shape_23.RebarShape,
    Vector=vec_16.Vector,
    SpacingLength=Slider(100, range=0..1000),
    Type="0",
    Tolerance="0.0001")  # -> RebarGroup, Mesh, Curve
vector_length_spacing_7 = VectorLengthSpacing(
    Id="0",
    RebarShape=curve_to_rebar_shape_25.RebarShape,
    Vector=vec_18.Vector,
    SpacingLength=Slider(121, range=0..1000),
    Type="0",
    Tolerance=0.0001)  # -> RebarGroup, Mesh, Curve
vector_length_spacing_8 = VectorLengthSpacing(
    Id="0",
    RebarShape=curve_to_rebar_shape_26.RebarShape,
    Vector=vec_19.Vector,
    SpacingLength=Slider(0.121, range=0..1),
    Type="1",
    Tolerance=0.0001)  # -> RebarGroup, Mesh, Curve
vector_length_spacing_9 = VectorLengthSpacing(
    Id="0",
    RebarShape=curve_to_rebar_shape_27.RebarShape,
    Vector=vec_20.Vector,
    SpacingLength=Slider(0.121, range=0..1),
    Type="2",
    Tolerance=0.0001)  # -> RebarGroup, Mesh, Curve
vector_length_spacing_10 = VectorLengthSpacing(
    Id="0",
    RebarShape=curve_to_rebar_shape_28.RebarShape,
    Vector=vec_21.Vector,
    SpacingLength=Slider(0.1, range=0..0.1),
    Type="1",
    Tolerance=0.0001)  # -> RebarGroup, Mesh, Curve
vector_length_spacing_11 = VectorLengthSpacing(
    Id="0",
    RebarShape=curve_to_rebar_shape_32.RebarShape,
    Vector=vec_25.Vector,
    SpacingLength=Slider(0.2, range=0..1),
    Type="2",
    Tolerance=0.0001)  # -> RebarGroup, Mesh, Curve
vector_length_spacing_12 = VectorLengthSpacing(
    Id="0",
    RebarShape=curve_to_rebar_shape_30.RebarShape,
    Vector=vec_23.Vector,
    SpacingLength=Slider(0.121, range=0..1),
    Type="3",
    Tolerance=0.0001)  # -> RebarGroup, Mesh, Curve
vector_length_spacing_13 = VectorLengthSpacing(
    Id="0",
    RebarShape=curve_to_rebar_shape_29.RebarShape,
    Vector=vec_22.Vector,
    SpacingLength=Slider(121, range=0..1000),
    Type="1",
    Tolerance=0.0001)  # -> RebarGroup, Mesh, Curve
vector_length_spacing_14 = VectorLengthSpacing(
    Id="0",
    RebarShape=curve_to_rebar_shape_31.RebarShape,
    Vector=vec_24.Vector,
    SpacingLength=Slider(121, range=0..1000),
    Type="2",
    Tolerance=0.0001)  # -> RebarGroup, Mesh, Curve
vector_length_spacing_15 = VectorLengthSpacing(
    Id="0",
    RebarShape=curve_to_rebar_shape_33.RebarShape,
    Vector=vec_26.Vector,
    SpacingLength=Slider(100, range=1..2000),
    Type="1",
    Tolerance=0.0001)  # -> RebarGroup, Mesh, Curve
vector_length_spacing_16 = VectorLengthSpacing(
    Id="0",
    RebarShape=curve_to_rebar_shape_36.RebarShape,
    Vector=vec_29.Vector,
    SpacingLength=Slider(200, range=0..1000),
    Type="2",
    Tolerance=0.0001)  # -> RebarGroup, Mesh, Curve
vector_length_spacing_17 = VectorLengthSpacing(
    Id="0",
    RebarShape=curve_to_rebar_shape_35.RebarShape,
    Vector=vec_28.Vector,
    SpacingLength=Slider(0.199, range=0..1),
    Type="3",
    Tolerance=0.0001)  # -> RebarGroup, Mesh, Curve
vector_length_spacing_18 = VectorLengthSpacing(
    Id="0",
    RebarShape=curve_to_rebar_shape_34.RebarShape,
    Vector=vec_27.Vector,
    SpacingLength=Slider(121, range=0..1000),
    Type="3",
    Tolerance=0.0001)  # -> RebarGroup, Mesh, Curve
vector_length_spacing_19 = VectorLengthSpacing(
    Id="0",
    RebarShape=curve_to_rebar_shape_37.RebarShape,
    Vector=vec_30.Vector,
    SpacingLength=Slider(0.1, range=0..0.1),
    Type="0",
    Tolerance=0.0001)  # -> RebarGroup, Mesh, Curve
vector_length_spacing_20 = VectorLengthSpacing(
    Id="0",
    RebarShape=curve_to_rebar_shape_38.RebarShape,
    Vector=vec_31.Vector,
    SpacingLength=Slider(199, range=0..1000),
    Type="3",
    Tolerance=0.0001)  # -> RebarGroup, Mesh, Curve
vector_length_spacing_21 = VectorLengthSpacing(
    Id="0",
    RebarShape=curve_to_rebar_shape_39.RebarShape,
    Vector=vec_32.Vector,
    SpacingLength=Slider(0.2, range=0..1),
    Type="3",
    Tolerance=0.0001)  # -> RebarGroup, Mesh, Curve
vector_length_spacing_22 = VectorLengthSpacing(
    Id="0",
    RebarShape=curve_to_rebar_shape_40.RebarShape,
    Vector=vec_33.Vector,
    SpacingLength=Slider(100, range=0..1000),
    Type="0",
    Tolerance=0.0001)  # -> RebarGroup, Mesh, Curve
mesh_73 = Mesh([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])
mesh_74 = Mesh([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])
vector_length_spacing_23 = VectorLengthSpacing(
    Id="0",
    RebarShape=curve_to_rebar_shape_41.RebarShape,
    Vector=vec_34.Vector,
    SpacingLength=Slider(200, range=0..1000),
    Type="3",
    Tolerance=0.0001)  # -> RebarGroup, Mesh, Curve
mesh_75 = Mesh([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])
mesh_76 = Mesh([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])
mesh_77 = Mesh([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])
mesh_78 = Mesh([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])
demesh_146 = DeconstructMesh(Mesh=vector_length_spacing_2.Mesh)  # -> flatten(Vertices), Faces, Colours, Normals
demesh_147 = DeconstructMesh(Mesh=mesh_73)  # -> flatten(Vertices), Faces, Colours, Normals
demesh_148 = DeconstructMesh(Mesh=vector_length_spacing.Mesh)  # -> flatten(Vertices), Faces, Colours, Normals
demesh_149 = DeconstructMesh(Mesh=mesh_74)  # -> flatten(Vertices), Faces, Colours, Normals
panel_26 = Panel("""Rebar Group
Id: 1
Count: 11""")
demesh_150 = DeconstructMesh(Mesh=vector_length_spacing_3.Mesh)  # -> flatten(Vertices), Faces, Colours, Normals
demesh_151 = DeconstructMesh(Mesh=mesh_75)  # -> flatten(Vertices), Faces, Colours, Normals
demesh_152 = DeconstructMesh(Mesh=vector_length_spacing_4.Mesh)  # -> flatten(Vertices), Faces, Colours, Normals
demesh_153 = DeconstructMesh(Mesh=mesh_76)  # -> flatten(Vertices), Faces, Colours, Normals
mesh_79 = Mesh([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])
demesh_154 = DeconstructMesh(Mesh=vector_length_spacing_5.Mesh)  # -> flatten(Vertices), Faces, Colours, Normals
demesh_155 = DeconstructMesh(Mesh=mesh_77)  # -> flatten(Vertices), Faces, Colours, Normals
demesh_156 = DeconstructMesh(Mesh=vector_length_spacing_7.Mesh)  # -> flatten(Vertices), Faces, Colours, Normals
demesh_157 = DeconstructMesh(Mesh=mesh_78)  # -> flatten(Vertices), Faces, Colours, Normals
mesh_80 = Mesh([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])
mesh_81 = Mesh([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])
mesh_82 = Mesh([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])
mesh_83 = Mesh([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])
mesh_84 = Mesh([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])
mesh_85 = Mesh([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])
divide_3 = DivideCurve(Curve=vector_length_spacing_15.Curve, Count=10, Kinks=False)  # -> flatten(Points), Tangents, Parameters
mesh_86 = Mesh([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])
mesh_87 = Mesh([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])
mesh_88 = Mesh([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])
mesh_89 = Mesh([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])
divide_4 = DivideCurve(Curve=vector_length_spacing_7.Curve, Count=10, Kinks=False)  # -> flatten(Points), Tangents, Parameters
demesh_158 = DeconstructMesh(Mesh=vector_length_spacing_8.Mesh)  # -> flatten(Vertices), Faces, Colours, Normals
demesh_159 = DeconstructMesh(Mesh=mesh_79)  # -> flatten(Vertices), Faces, Colours, Normals
mesh_90 = Mesh([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])
demesh_160 = DeconstructMesh(Mesh=vector_length_spacing_9.Mesh)  # -> flatten(Vertices), Faces, Colours, Normals
mesh_91 = Mesh([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])
mesh_92 = Mesh([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])
demesh_161 = DeconstructMesh(Mesh=mesh_80)  # -> flatten(Vertices), Faces, Colours, Normals
demesh_162 = DeconstructMesh(Mesh=vector_length_spacing_10.Mesh)  # -> flatten(Vertices), Faces, Colours, Normals
demesh_163 = DeconstructMesh(Mesh=[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])  # -> flatten(Vertices), Faces, Colours, Normals
demesh_164 = DeconstructMesh(Mesh=vector_length_spacing_13.Mesh)  # -> flatten(Vertices), Faces, Colours, Normals
demesh_165 = DeconstructMesh(Mesh=mesh_81)  # -> flatten(Vertices), Faces, Colours, Normals
mesh_93 = Mesh([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])
divide_5 = DivideCurve(Curve=vector_length_spacing_19.Curve, Count=10, Kinks=False)  # -> flatten(Points), Tangents, Parameters
divide_6 = DivideCurve(Curve=vector_length_spacing_13.Curve, Count=10, Kinks=False)  # -> flatten(Points), Tangents, Parameters
demesh_166 = DeconstructMesh(Mesh=vector_length_spacing_12.Mesh)  # -> flatten(Vertices), Faces, Colours, Normals
demesh_167 = DeconstructMesh(Mesh=vector_length_spacing_14.Mesh)  # -> flatten(Vertices), Faces, Colours, Normals
demesh_168 = DeconstructMesh(Mesh=mesh_84)  # -> flatten(Vertices), Faces, Colours, Normals
demesh_169 = DeconstructMesh(Mesh=mesh_82)  # -> flatten(Vertices), Faces, Colours, Normals
demesh_170 = DeconstructMesh(Mesh=vector_length_spacing_11.Mesh)  # -> flatten(Vertices), Faces, Colours, Normals
demesh_171 = DeconstructMesh(Mesh=vector_length_spacing_15.Mesh)  # -> flatten(Vertices), Faces, Colours, Normals
divide_7 = DivideCurve(Curve=vector_length_spacing_14.Curve, Count=10, Kinks=False)  # -> flatten(Points), Tangents, Parameters
demesh_172 = DeconstructMesh(Mesh=mesh_85)  # -> flatten(Vertices), Faces, Colours, Normals
demesh_173 = DeconstructMesh(Mesh=mesh_83)  # -> flatten(Vertices), Faces, Colours, Normals
divide_8 = DivideCurve(Curve=vector_length_spacing_18.Curve, Count=10, Kinks=False)  # -> flatten(Points), Tangents, Parameters
divide_9 = DivideCurve(Curve=vector_length_spacing_20.Curve, Count=10, Kinks=False)  # -> flatten(Points), Tangents, Parameters
demesh_174 = DeconstructMesh(Mesh=vector_length_spacing_18.Mesh)  # -> flatten(Vertices), Faces, Colours, Normals
demesh_175 = DeconstructMesh(Mesh=vector_length_spacing_17.Mesh)  # -> flatten(Vertices), Faces, Colours, Normals
demesh_176 = DeconstructMesh(Mesh=mesh_86)  # -> flatten(Vertices), Faces, Colours, Normals
demesh_177 = DeconstructMesh(Mesh=mesh_88)  # -> flatten(Vertices), Faces, Colours, Normals
demesh_178 = DeconstructMesh(Mesh=vector_length_spacing_16.Mesh)  # -> flatten(Vertices), Faces, Colours, Normals
demesh_179 = DeconstructMesh(Mesh=mesh_87)  # -> flatten(Vertices), Faces, Colours, Normals
demesh_180 = DeconstructMesh(Mesh=vector_length_spacing_19.Mesh)  # -> flatten(Vertices), Faces, Colours, Normals
demesh_181 = DeconstructMesh(Mesh=vector_length_spacing_20.Mesh)  # -> flatten(Vertices), Faces, Colours, Normals
demesh_182 = DeconstructMesh(Mesh=mesh_89)  # -> flatten(Vertices), Faces, Colours, Normals
divide_10 = DivideCurve(Curve=vector_length_spacing_16.Curve, Count=10, Kinks=False)  # -> flatten(Points), Tangents, Parameters
assert_11 = Assert(TestNames="VectorLengthSpacingMilimeters_Id_Init", Expected=panel_26, Actual=vector_length_spacing_6.RebarGroup)  # -> Result, FailedInfo
demesh_183 = DeconstructMesh(Mesh=mesh_90)  # -> flatten(Vertices), Faces, Colours, Normals
demesh_184 = DeconstructMesh(Mesh=vector_length_spacing_21.Mesh)  # -> flatten(Vertices), Faces, Colours, Normals
demesh_185 = DeconstructMesh(Mesh=mesh_92)  # -> flatten(Vertices), Faces, Colours, Normals
demesh_186 = DeconstructMesh(Mesh=vector_length_spacing_22.Mesh)  # -> flatten(Vertices), Faces, Colours, Normals
demesh_187 = DeconstructMesh(Mesh=mesh_91)  # -> flatten(Vertices), Faces, Colours, Normals
demesh_188 = DeconstructMesh(Mesh=vector_length_spacing_23.Mesh)  # -> flatten(Vertices), Faces, Colours, Normals
divide_11 = DivideCurve(Curve=vector_length_spacing_23.Curve, Count=10, Kinks=False)  # -> flatten(Points), Tangents, Parameters
demesh_189 = DeconstructMesh(Mesh=mesh_93)  # -> flatten(Vertices), Faces, Colours, Normals
pt_120 = Point([Point(0, 1000, 0), Point(50, 1000, 0), Point(100, 1000, 0), Point(150, 1000, 0), Point(200, 1000, 0), Point(250, 1000, 0)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])
assert_point_list_76 = AssertPointList(
    TestName="VectorLengthSpacingMilimeters_EvenLength_Mesh",
    ExpectedPointList=demesh_147.Vertices,
    ActualPointList=demesh_146.Vertices,
    Tolerance="0.00001")  # -> Result, FailedInfo
assert_point_list_77 = AssertPointList(
    TestName="VectorLengthSpacingMeters_EvenLength_Mesh",
    ExpectedPointList=demesh_149.Vertices,
    ActualPointList=demesh_148.Vertices,
    Tolerance="0.00001")  # -> Result, FailedInfo
pt_121 = Point([Point(0, 0, 0), Point(50, 0, 0), Point(100, 0, 0), Point(150, 0, 0), Point(200, 0, 0), Point(250, 0, 0)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])
assert_point_list_78 = AssertPointList(
    TestName="VectorLengthSpacingMeters_SpacingLength_Mesh",
    ExpectedPointList=demesh_151.Vertices,
    ActualPointList=demesh_150.Vertices,
    Tolerance="0.00001")  # -> Result, FailedInfo
assert_point_list_79 = AssertPointList(
    TestName="VectorLengthSpacingMeters_Vector_Mesh",
    ExpectedPointList=demesh_153.Vertices,
    ActualPointList=demesh_152.Vertices,
    Tolerance="0.00001")  # -> Result, FailedInfo
pt_122 = Point([Point(0, 1000, 0), Point(50, 1000, 0), Point(100, 1000, 0), Point(150, 1000, 0), Point(200, 1000, 0), Point(250, 1000, 0)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])
pt_123 = Point([Point(0, 0, 0), Point(0.05, 0, 0), Point(0.1, 0, 0), Point(0.15, 0, 0), Point(0.2, 0, 0), Point(0.25, 0, 0)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])
assert_point_list_80 = AssertPointList(
    TestName="VectorLengthSpacingMilimeters_SpacingLength_Mesh",
    ExpectedPointList=demesh_155.Vertices,
    ActualPointList=demesh_154.Vertices,
    Tolerance="0.00001")  # -> Result, FailedInfo
assert_point_list_81 = AssertPointList(
    TestName="VectorLengthSpacingMilimeters_Vector_Mesh",
    ExpectedPointList=demesh_157.Vertices,
    ActualPointList=demesh_156.Vertices,
    Tolerance="0.00001")  # -> Result, FailedInfo
pt_124 = Point([Point(0, 0, 0), Point(50, 0, 0), Point(100, 0, 0), Point(150, 0, 0), Point(200, 0, 0), Point(250, 0, 0)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])
pt_125 = Point([Point(0, 0, 0), Point(50, 0, 0), Point(100, 0, 0), Point(150, 0, 0), Point(200, 0, 0), Point(250, 0, 0)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])
pt_126 = Point([Point(0, 0, 0), Point(50, 0, 0), Point(100, 0, 0), Point(150, 0, 0), Point(200, 0, 0), Point(250, 0, 0)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])
pt_127 = Point([Point(0, 0, 0), Point(50, 0, 0), Point(100, 0, 0), Point(150, 0, 0), Point(200, 0, 0), Point(250, 0, 0)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])
assert_point_list_82 = AssertPointList(
    TestName="VectorLengthSpacingMilimeters_Vector_Curve",
    ExpectedPointList=pt_121,
    ActualPointList=divide_4.Points,
    Tolerance="0.00001")  # -> Result, FailedInfo
assert_point_list_83 = AssertPointList(
    TestName="VectorLengthSpacingMeters_Type1_Mesh",
    ExpectedPointList=demesh_159.Vertices,
    ActualPointList=demesh_158.Vertices,
    Tolerance="0.00001")  # -> Result, FailedInfo
pt_128 = Point([Point(0, 0, 0), Point(50, 0, 0), Point(100, 0, 0), Point(150, 0, 0), Point(200, 0, 0), Point(250, 0, 0)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])
assert_point_list_84 = AssertPointList(
    TestName="VectorLengthSpacingMilimeters_Type1EvenLength_Curve",
    ExpectedPointList=pt_120,
    ActualPointList=divide_3.Points,
    Tolerance="0.00001")  # -> Result, FailedInfo
assert_point_list_85 = AssertPointList(
    TestName="VectorLengthSpacingMeters_Type2_Mesh",
    ExpectedPointList=demesh_161.Vertices,
    ActualPointList=demesh_160.Vertices,
    Tolerance="0.00001")  # -> Result, FailedInfo
assert_point_list_86 = AssertPointList(
    TestName="VectorLengthSpacingMeters_Type1EvenLength_Mesh",
    ExpectedPointList=demesh_163.Vertices,
    ActualPointList=demesh_162.Vertices,
    Tolerance="0.00001")  # -> Result, FailedInfo
assert_point_list_87 = AssertPointList(
    TestName="VectorLengthSpacingMilimeters_Type1_Mesh",
    ExpectedPointList=demesh_165.Vertices,
    ActualPointList=demesh_164.Vertices,
    Tolerance="0.00001")  # -> Result, FailedInfo
assert_point_list_88 = AssertPointList(
    TestName="VectorLengthSpacingMeters_Type3_Mesh",
    ExpectedPointList=demesh_168.Vertices,
    ActualPointList=demesh_166.Vertices,
    Tolerance="0.00001")  # -> Result, FailedInfo
assert_point_list_89 = AssertPointList(
    TestName="VectorLengthSpacingMilimeters_Type2_Mesh",
    ExpectedPointList=demesh_169.Vertices,
    ActualPointList=demesh_167.Vertices,
    Tolerance="0.00001")  # -> Result, FailedInfo
assert_point_list_90 = AssertPointList(
    TestName="VectorLengthSpacingMilimeters_Type1EvenLength_Mesh",
    ExpectedPointList=demesh_173.Vertices,
    ActualPointList=demesh_171.Vertices,
    Tolerance="0.00001")  # -> Result, FailedInfo
assert_point_list_91 = AssertPointList(
    TestName="VectorLengthSpacingMeters_Type2EvenLength_Mesh",
    ExpectedPointList=demesh_172.Vertices,
    ActualPointList=demesh_170.Vertices,
    Tolerance="0.00001")  # -> Result, FailedInfo
assert_point_list_92 = AssertPointList(
    TestName="VectorLengthSpacingMilimeters_Type1_Curve",
    ExpectedPointList=pt_122,
    ActualPointList=divide_6.Points,
    Tolerance="0.00001")  # -> Result, FailedInfo
assert_point_list_93 = AssertPointList(
    TestName="VectorLengthSpacingMilimeters_Type3EvenLength_Curve",
    ExpectedPointList=pt_123,
    ActualPointList=divide_5.Points,
    Tolerance="0.00001")  # -> Result, FailedInfo
assert_point_list_94 = AssertPointList(
    TestName="VectorLengthSpacingMeters_Type3Length_Mesh",
    ExpectedPointList=demesh_177.Vertices,
    ActualPointList=demesh_175.Vertices,
    Tolerance="0.00001")  # -> Result, FailedInfo
assert_point_list_95 = AssertPointList(
    TestName="VectorLengthSpacingMilimeters_Type2EvenLength_Mesh",
    ExpectedPointList=demesh_179.Vertices,
    ActualPointList=demesh_178.Vertices,
    Tolerance="0.00001")  # -> Result, FailedInfo
assert_point_list_96 = AssertPointList(
    TestName="VectorLengthSpacingMilimeters_Type3_Curve",
    ExpectedPointList=pt_124,
    ActualPointList=divide_8.Points,
    Tolerance="0.00001")  # -> Result, FailedInfo
assert_point_list_97 = AssertPointList(
    TestName="VectorLengthSpacingMeters_Diameter_Mesh",
    ExpectedPointList=demesh_182.Vertices,
    ActualPointList=demesh_180.Vertices,
    Tolerance="0.00001")  # -> Result, FailedInfo
assert_point_list_98 = AssertPointList(
    TestName="VectorLengthSpacingMilimeters_Type3Length_Mesh",
    ExpectedPointList=demesh_183.Vertices,
    ActualPointList=demesh_181.Vertices,
    Tolerance="0.00001")  # -> Result, FailedInfo
assert_point_list_99 = AssertPointList(
    TestName="VectorLengthSpacingMilimeters_Type3Length_Curve",
    ExpectedPointList=pt_125,
    ActualPointList=divide_9.Points,
    Tolerance="0.00001")  # -> Result, FailedInfo
assert_point_list_100 = AssertPointList(
    TestName="VectorLengthSpacingMeters_Type3EvenLength_Mesh",
    ExpectedPointList=demesh_185.Vertices,
    ActualPointList=demesh_184.Vertices,
    Tolerance="0.00001")  # -> Result, FailedInfo
assert_point_list_101 = AssertPointList(
    TestName="VectorLengthSpacingMilimeters_Type3_Mesh",
    ExpectedPointList=demesh_176.Vertices,
    ActualPointList=demesh_174.Vertices,
    Tolerance="0.00001")  # -> Result, FailedInfo
assert_point_list_102 = AssertPointList(
    TestName="VectorLengthSpacingMilimeters_Diameter_Mesh",
    ExpectedPointList=demesh_187.Vertices,
    ActualPointList=demesh_186.Vertices,
    Tolerance="0.00001")  # -> Result, FailedInfo
assert_point_list_103 = AssertPointList(
    TestName="VectorLengthSpacingMilimeters_Type2_Curve",
    ExpectedPointList=pt_126,
    ActualPointList=divide_7.Points,
    Tolerance="0.00001")  # -> Result, FailedInfo
assert_point_list_104 = AssertPointList(
    TestName="VectorLengthSpacingMilimeters_Type3EvenLength_Mesh",
    ExpectedPointList=demesh_189.Vertices,
    ActualPointList=demesh_188.Vertices,
    Tolerance="0.00001")  # -> Result, FailedInfo
assert_point_list_105 = AssertPointList(
    TestName="VectorLengthSpacingMilimeters_Type2EvenLength_Curve",
    ExpectedPointList=pt_127,
    ActualPointList=divide_10.Points,
    Tolerance="0.00001")  # -> Result, FailedInfo
assert_point_list_106 = AssertPointList(
    TestName="VectorLengthSpacingMilimeters_Type3EvenLength_Curve",
    ExpectedPointList=pt_128,
    ActualPointList=divide_11.Points,
    Tolerance="0.00001")  # -> Result, FailedInfo
entwine_15 = Entwine(
    Branch00=assert_point_list_76.Result,
    Branch01=assert_11.Result,
    Branch02=assert_point_list_80.Result,
    Branch03=assert_point_list_81.Result,
    Branch04=assert_point_list_82.Result,
    Branch05=assert_point_list_87.Result,
    Branch06=assert_point_list_92.Result,
    Branch07=assert_point_list_90.Result,
    Branch08=assert_point_list_84.Result,
    Branch09=assert_point_list_89.Result,
    Branch010=assert_point_list_103.Result,
    Branch011=assert_point_list_95.Result,
    Branch012=assert_point_list_105.Result,
    Branch013=assert_point_list_101.Result,
    Branch014=assert_point_list_96.Result,
    Branch015=assert_point_list_98.Result,
    Branch016=assert_point_list_99.Result,
    Branch017=assert_point_list_104.Result,
    Branch018=assert_point_list_106.Result,
    Branch019=assert_point_list_102.Result,
    FlattenInputs=True)  # -> flatten(Result)
entwine_16 = Entwine(
    Branch00=assert_point_list_77.Result,
    Branch01=assert_point_list_78.Result,
    Branch02=assert_point_list_79.Result,
    Branch03=assert_point_list_83.Result,
    Branch04=assert_point_list_86.Result,
    Branch05=assert_point_list_85.Result,
    Branch06=assert_point_list_91.Result,
    Branch07=assert_point_list_88.Result,
    Branch08=assert_point_list_94.Result,
    Branch09=assert_point_list_100.Result,
    Branch010=assert_point_list_97.Result,
    Branch011=assert_point_list_93.Result,
    FlattenInputs=True)  # -> flatten(Result)

# ----
# Custom Spacing Exceptions
number_slider_28 = Slider(7850, range=0..10000)
division_64 = Division(A=number_slider_28, B="1e9")
division_65 = Division(A=Slider(7850, range=0..10000), B="1e9")
division_66 = Division(A=Slider(7921, range=0..10000), B="1e9")
material_106 = Material(Name="Name of the material", Grade="Grade of the material", Density=division_64)
material_107 = Material(Name="Name of the material", Grade="Grade of the material", Density=division_65)
material_108 = Material(Name="Name of the material", Grade="Grade of the material", Density=division_66)
pt_129 = ConstructPoint(XCoordinate=0, YCoordinate=0, ZCoordinate=0)
pt_130 = ConstructPoint(XCoordinate=0, YCoordinate=0, ZCoordinate=0)
pt_131 = ConstructPoint(XCoordinate=Slider(500, range=0..1000), YCoordinate=0, ZCoordinate=0)
pt_132 = ConstructPoint(XCoordinate=0, YCoordinate=Slider(500, range=0..1000), ZCoordinate=0)
pt_133 = ConstructPoint(XCoordinate=0, YCoordinate=0, ZCoordinate=0)
pt_134 = ConstructPoint(XCoordinate=0, YCoordinate=0, ZCoordinate=0)
pt_135 = ConstructPoint(XCoordinate=Slider(500, range=0..1000), YCoordinate=0, ZCoordinate=0)
pt_136 = ConstructPoint(XCoordinate=0, YCoordinate=Slider(500, range=0..1000), ZCoordinate=0)
rebar_properties_104 = RebarProperties(Diameter=["12", "6"], Material=material_106)
ln_35 = Line(StartPoint=pt_129, EndPoint=pt_131)
ln_36 = Line(StartPoint=pt_130, EndPoint=pt_132)
rebar_properties_105 = RebarProperties(Diameter="12", Material=[material_107, material_108])
ln_37 = Line(StartPoint=pt_133, EndPoint=pt_135)
ln_38 = Line(StartPoint=pt_134, EndPoint=pt_136)
panel_27 = Panel("WithoutSpacingMilimeters_DifferentDiameters")
curve_to_rebar_shape_42 = CurveToRebarShape(Curve=[ln_35, ln_36], Properties=rebar_properties_104)  # -> RebarShape, Mesh
panel_28 = Panel("WithoutSpacingMilimeters_DifferentMaterials")
curve_to_rebar_shape_43 = CurveToRebarShape(Curve=[ln_37, ln_38], Properties=rebar_properties_105)  # -> RebarShape, Mesh
without_spacing = WithoutSpacing(Id="0", RebarShapes=curve_to_rebar_shape_42.RebarShape)  # -> CustomRebarGroup, Mesh, Curve
without_spacing_2 = WithoutSpacing(Id="0", RebarShapes=curve_to_rebar_shape_43.RebarShape)  # -> CustomRebarGroup, Mesh, Curve

panel_29 = Panel("""Rebar Group
Id: 1
Count: 1""")

# ----
# Custom Spacing
number_slider_29 = Slider(7850, range=0..10000)
division_67 = Division(A=number_slider_29, B="1e9")
division_68 = Division(A=Slider(7850, range=0..10000), B="1e9")
number_slider_30 = Slider(500, range=0..1000)
division_69 = Division(A=Slider(7850, range=0..10000), B="1e9")
material_109 = Material(Name="Name of the material", Grade="Grade of the material", Density=division_67)
material_110 = Material(Name="Name of the material", Grade="Grade of the material", Density=division_68)
material_111 = Material(Name="Name of the material", Grade="Grade of the material", Density=division_69)
pt_137 = ConstructPoint(XCoordinate=0, YCoordinate=0, ZCoordinate=0)
pt_138 = ConstructPoint(XCoordinate=Slider(500, range=0..1000), YCoordinate=0, ZCoordinate=0)
pt_139 = ConstructPoint(XCoordinate=0, YCoordinate=0, ZCoordinate=0)
pt_140 = ConstructPoint(XCoordinate=0, YCoordinate=0, ZCoordinate=0)
pt_141 = ConstructPoint(XCoordinate=Slider(500, range=0..1000), YCoordinate=0, ZCoordinate=0)
pt_142 = ConstructPoint(XCoordinate=0, YCoordinate=Slider(500, range=0..1000), ZCoordinate=0)
pt_143 = ConstructPoint(XCoordinate=Slider(500, range=0..1000), YCoordinate=0, ZCoordinate=0)
pt_144 = ConstructPoint(XCoordinate=number_slider_30, YCoordinate=number_slider_30, ZCoordinate=0)
pt_145 = ConstructPoint(XCoordinate=0, YCoordinate=Slider(500, range=0..1000), ZCoordinate=0)
pt_146 = ConstructPoint(XCoordinate=0, YCoordinate=0, ZCoordinate=0)
pt_147 = ConstructPoint(XCoordinate=0, YCoordinate=0, ZCoordinate=0)
pt_148 = ConstructPoint(XCoordinate=0, YCoordinate=0, ZCoordinate=0)
rebar_properties_106 = RebarProperties(Diameter="12", Material=material_109)
division_70 = Division(A=Slider(7850, range=0..10000), B="1e9")
rebar_properties_107 = RebarProperties(Diameter="12", Material=material_110)
ln_39 = Line(StartPoint=pt_137, EndPoint=pt_138)
ln_40 = Line(StartPoint=pt_139, EndPoint=pt_141)
ln_41 = Line(StartPoint=pt_140, EndPoint=pt_142)
rebar_properties_108 = RebarProperties(Diameter="12", Material=material_111)
ln_42 = Line(StartPoint=pt_146, EndPoint=pt_143)
ln_43 = Line(StartPoint=pt_147, EndPoint=pt_144)
ln_44 = Line(StartPoint=pt_148, EndPoint=pt_145)
material_112 = Material(Name="Name of the material", Grade="Grade of the material", Density=division_70)
curve_to_rebar_shape_44 = CurveToRebarShape(Curve=ln_39, Properties=rebar_properties_106)  # -> RebarShape, Mesh
curve_to_rebar_shape_45 = CurveToRebarShape(Curve=[ln_40, ln_41], Properties=rebar_properties_107)  # -> RebarShape, Mesh
curve_to_rebar_shape_46 = CurveToRebarShape(Curve=[ln_42, ln_43, ln_44], Properties=rebar_properties_108)  # -> RebarShape, Mesh
pt_149 = ConstructPoint(XCoordinate=0, YCoordinate=0, ZCoordinate=0)
pt_150 = ConstructPoint(XCoordinate=Slider(500, range=0..1000), YCoordinate=0, ZCoordinate=0)
rebar_properties_109 = RebarProperties(Diameter="12", Material=material_112)
ln_45 = Line(StartPoint=pt_149, EndPoint=pt_150)
without_spacing_3 = WithoutSpacing(Id="0", RebarShapes=curve_to_rebar_shape_44.RebarShape)  # -> CustomRebarGroup, Mesh, Curve
without_spacing_4 = WithoutSpacing(Id="0", RebarShapes=curve_to_rebar_shape_45.RebarShape)  # -> CustomRebarGroup, Mesh, Curve
curve_to_rebar_shape_47 = CurveToRebarShape(Curve=ln_45, Properties=rebar_properties_109)  # -> RebarShape, Mesh
without_spacing_5 = WithoutSpacing(Id="0", RebarShapes=curve_to_rebar_shape_46.RebarShape)  # -> CustomRebarGroup, Mesh, Curve
divide_12 = DivideCurve(Curve=without_spacing_3.Curve, Count=10, Kinks=False)  # -> flatten(Points), Tangents, Parameters
pt_151 = Point([Point(0, 0, 0), Point(50, 0, 0), Point(100, 0, 0), Point(150, 0, 0), Point(200, 0, 0), Point(250, 0, 0), Point(300, 0, 0), Point(350, 0, 0), Point(400, 0, 0), Point(450, 0, 0), Point(500, 0, 0)])
mesh_94 = Mesh(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)
mesh_95 = Mesh([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])
without_spacing_6 = WithoutSpacing(Id="1", RebarShapes=curve_to_rebar_shape_47.RebarShape)  # -> CustomRebarGroup, Mesh, Curve
demesh_190 = DeconstructMesh(Mesh=mesh_94)  # -> flatten(Vertices), Faces, Colours, Normals
demesh_191 = DeconstructMesh(Mesh=without_spacing_3.Mesh)  # -> flatten(Vertices), Faces, Colours, Normals
mesh_96 = Mesh([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])
assert_point_list_107 = AssertPointList(
    TestName="WithoutSpacingMilimeters_1Shape_Curve",
    ExpectedPointList=pt_151,
    ActualPointList=divide_12.Points,
    Tolerance="0.00001")  # -> Result, FailedInfo
demesh_192 = DeconstructMesh(Mesh=mesh_95)  # -> flatten(Vertices), Faces, Colours, Normals
demesh_193 = DeconstructMesh(Mesh=without_spacing_4.Mesh)  # -> flatten(Vertices), Faces, Colours, Normals
demesh_194 = DeconstructMesh(Mesh=mesh_96)  # -> flatten(Vertices), Faces, Colours, Normals
demesh_195 = DeconstructMesh(Mesh=without_spacing_5.Mesh)  # -> flatten(Vertices), Faces, Colours, Normals
divide_13 = DivideCurve(Curve=without_spacing_5.Curve, Count=10, Kinks=False)  # -> flatten(Points), Tangents, Parameters
pt_152 = Point([Point(0, 0, 0), Point(50, 0, 0), Point(100, 0, 0), Point(150, 0, 0), Point(200, 0, 0), Point(250, 0, 0), Point(300, 0, 0), Point(350, 0, 0), Point(400, 0, 0), Point(450, 0, 0)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])
assert_point_list_108 = AssertPointList(
    TestName="WithoutSpacingMilimeters_1Shape_Mesh",
    ExpectedPointList=demesh_190.Vertices,
    ActualPointList=demesh_191.Vertices,
    Tolerance="0.00001")  # -> Result, FailedInfo
assert_point_list_109 = AssertPointList(
    TestName="WithoutSpacingMilimeters_2Shape_Mesh",
    ExpectedPointList=demesh_192.Vertices,
    ActualPointList=demesh_193.Vertices,
    Tolerance="0.00001")  # -> Result, FailedInfo
assert_12 = Assert(TestNames="WithoutSpacingMilimeters_Id_Mesh", Expected=panel_29, Actual=without_spacing_6.CustomRebarGroup)  # -> Result, FailedInfo
assert_point_list_110 = AssertPointList(
    TestName="WithoutSpacingMilimeters_3Shape_Mesh",
    ExpectedPointList=demesh_194.Vertices,
    ActualPointList=demesh_195.Vertices,
    Tolerance="0.00001")  # -> Result, FailedInfo
assert_point_list_111 = AssertPointList(
    TestName="WithoutSpacingMilimeters_3Shape_Curve",
    ExpectedPointList=pt_152,
    ActualPointList=divide_13.Points,
    Tolerance="0.00001")  # -> Result, FailedInfo
entwine_17 = Entwine(
    Branch00=assert_point_list_108.Result,
    Branch01=assert_point_list_107.Result,
    Branch02=assert_12.Result,
    Branch03=assert_point_list_109.Result,
    Branch04=assert_point_list_110.Result,
    Branch05=assert_point_list_111.Result,
    FlattenInputs=True)  # -> flatten(Result)

pt_153 = Point([Point(-34.1906531, 31.09119607, 0), Point(15.44935664, 22.9335721, 0), Point(38.53369683, 12.69315051, 0), Point(45.30278906, -19.24307953, 0), Point(36.97159862, -32.95483047, 0), Point(2.952570969, -39.2032233, 0)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])
division_71 = Division(A=Slider(2400, range=0..10000), B="1e9")
profile_8 = Profile(Name="My profile", Points=pt_153, Tolerance=0.0001)  # -> Profile, Brep
pt_154 = Point([Point(-34.1906531, 31.09119607, 0), Point(15.44935664, 22.9335721, 0), Point(38.53369683, 12.69315051, 0), Point(45.30278906, -19.24307953, 0), Point(36.97159862, -32.95483047, 0), Point(2.952570969, -39.2032233, 0)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])
pt_155 = Point([Point(-34.1906531, 31.09119607, 0), Point(15.44935664, 22.9335721, 0), Point(38.53369683, 12.69315051, 0), Point(45.30278906, -19.24307953, 0), Point(36.97159862, -32.95483047, 0), Point(2.952570969, -39.2032233, 0)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])
pt_156 = Point([Point(-34.1906531, 31.09119607, 0), Point(15.44935664, 22.9335721, 0), Point(38.53369683, 12.69315051, 0), Point(45.30278906, -19.24307953, 0), Point(36.97159862, -32.95483047, 0), Point(2.952570969, -39.2032233, 0)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])
pt_157 = Point([Point(-34.1906531, 31.09119607, 0), Point(15.44935664, 22.9335721, 0), Point(38.53369683, 12.69315051, 0), Point(45.30278906, -19.24307953, 0), Point(36.97159862, -32.95483047, 0), Point(2.952570969, -39.2032233, 0)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])
division_72 = Division(A=Slider(2400, range=0..10000), B="1e9")
material_113 = Material(Name="Concrete", Grade="Grade", Density=division_71)
division_73 = Division(A=Slider(2400, range=0..10000), B="1e9")
division_74 = Division(A=Slider(2400, range=0..10000), B="1e9")
division_75 = Division(A=Slider(2400, range=0..10000), B="1e9")
profile_9 = Profile(Name="My profile", Points=pt_154, Tolerance=0.0001)  # -> Profile, Brep
profile_10 = Profile(Name="My profile", Points=pt_155, Tolerance=0.0001)  # -> Profile, Brep
profile_11 = Profile(Name="My profile", Points=pt_156, Tolerance=0.0001)  # -> Profile, Brep
profile_12 = Profile(Name="My profile", Points=pt_157, Tolerance=0.0001)  # -> Profile, Brep
line_2 = Line([Line((-285.7311079, -103.3992426, 0), (405.3386646, 676.1117795, 0)), Line((801.209917, -630.1465038, 0), (775.7612052, 908.331745, 0)), Line((-1003.46251, -319.2699278, 0), (-646.9455181, 1555.344989, 0)), Line((-189.8966165, 0, -98.38499217), (176.6759137, 0, 167.5824587))])
pt_158 = Point(Point(-3.915239776, 756.1192961, 0))
pt_159 = Point(Point(-164.7662244, -50.07091128, 0))
pt_160 = Point(Point(-164.7662244, -50.07091128, 0))
pt_161 = Point(Point(-3.915239776, 756.1192961, 0))
material_114 = Material(Name="Concrete", Grade="Grade", Density=division_72)
pt_162 = Point(Point(-3.915239776, 756.1192961, 0))
material_115 = Material(Name="Concrete", Grade="Grade", Density=division_73)
pt_163 = Point(Point(-164.7662244, -50.07091128, 0))
material_116 = Material(Name="Concrete", Grade="Grade", Density=division_74)
material_117 = Material(Name="Concrete", Grade="Grade", Density=division_75)
line_3 = Line([Line((-285.7311079, -103.3992426, 0), (405.3386646, 676.1117795, 0)), Line((801.209917, -630.1465038, 0), (775.7612052, 908.331745, 0)), Line((-1003.46251, -319.2699278, 0), (-646.9455181, 1555.344989, 0)), Line((-189.8966165, 0, -98.38499217), (176.6759137, 0, 167.5824587))])
ln_46 = Line(StartPoint=pt_158, EndPoint=pt_159)
ln_47 = Line(StartPoint=pt_161, EndPoint=pt_160)
profile_to_elements = ProfileToElements(
    Name="My element",
    Profile=profile_8.Profile,
    RotationAngle=degrees(Slider(270, range=0..360)),
    Material=material_113,
    Type="0",
    InsertLines=line_2)  # -> ElementGroup, Breps
ln_48 = Line(StartPoint=pt_162, EndPoint=pt_163)
profile_to_elements_2 = ProfileToElements(
    Name="My element",
    Profile=profile_9.Profile,
    RotationAngle=degrees(Slider(270, range=0..360)),
    Material=material_114,
    Type="0",
    InsertLines=ln_46)  # -> ElementGroup, Breps
profile_to_elements_3 = ProfileToElements(
    Name="My element",
    Profile=profile_10.Profile,
    RotationAngle=degrees(Slider(270, range=0..360)),
    Material=material_115,
    Type="0",
    InsertLines=line_3)  # -> ElementGroup, Breps
len = Length()
area = Area(Geometry=profile_8.Brep)  # -> Area, Centroid
profile_to_elements_4 = ProfileToElements(
    Name="My element",
    Profile=profile_11.Profile,
    RotationAngle=degrees(Slider(270, range=0..360)),
    Material=material_116,
    Type="0",
    InsertLines=ln_47)  # -> ElementGroup, Breps
profile_to_elements_5 = ProfileToElements(
    Name="My element",
    Profile=profile_12.Profile,
    RotationAngle=degrees(Slider(270, range=0..360)),
    Material=material_117,
    Type="0",
    InsertLines=ln_48)  # -> ElementGroup, Breps
len_2 = Length(Curve=ln_46)
area_2 = Area(Geometry=profile_9.Brep)  # -> Area, Centroid
# Profile To Elements
panel_30 = Panel("""Element Group
Count: 1""")
element_group_info = ElementGroupInfo(ElementGroup=profile_to_elements.ElementGroup)  # -> Amount, Material, Volume, Mass
multiplication = Multiplication(A=area.Area, B=len)
multiplication_2 = Multiplication(A=multiplication, B=division_71)
element_group_info_2 = ElementGroupInfo(ElementGroup=profile_to_elements_2.ElementGroup)  # -> Amount, Material, Volume, Mass
mesh_97 = MeshBrep(
    Brep=profile_to_elements_3.Breps,
    Settings={GridMaxCount=0, GridMinCount=16, JaggedSeams=False, MaxEdgeLength=0, MinEdgeLength=0.0001, MinTolerance=0, Refine=True, RefineAngle=0, RelativeTolerance=0.65, SimplePlanes=True, Tolerance=0})
mesh_98 = MeshBrep(
    Brep=profile_to_elements_5.Breps,
    Settings={GridMaxCount=0, GridMinCount=16, JaggedSeams=False, MaxEdgeLength=0, MinEdgeLength=0.0001, MinTolerance=0, Refine=True, RefineAngle=0, RelativeTolerance=0.65, SimplePlanes=True, Tolerance=0})
multiplication_3 = Multiplication(A=area_2.Area, B=len_2)
multiplication_4 = Multiplication(A=multiplication_3, B=division_72)
assert_13 = Assert(TestNames="ProfileToElementsMillimeters_Normal_Init", Expected=panel_30, Actual=profile_to_elements_4.ElementGroup)  # -> Result, FailedInfo
panel_31 = Panel("""Material
Name: Concrete
Grade: Grade
Density: 2.4E-06""")
demesh_196 = DeconstructMesh(Mesh=mesh_97)  # -> flatten(Vertices), Faces, Colours, Normals
pt_164 = Point([Point(-260.1469116, -126.0807266, 31.09119606), Point(-277.8900146, -110.3507156, 27.19449806), Point(-295.6330872, -94.62070465, 23.29780006), Point(-312.1916504, -79.94084167, 14.10023403), Point(-317.7550964, -75.00859833, -7.419899464), Point(-314.9894104, -77.46050262, -29.45063972)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])
demesh_197 = DeconstructMesh(Mesh=mesh_98)  # -> Vertices, Faces, Colours, Normals
format = Format(Format="{0:0.000}", Culture=127, Data0=multiplication_2)
format_2 = Format(Format="{0:0.000}", Culture=127, Data0=element_group_info.Mass)
pt_165 = Point([Point(-37.4450264, 762.8091431, 31.09119606), Point(11.23549843, 753.0964355, 22.93357277), Point(33.87364197, 748.5796509, 12.69315052), Point(40.51189804, 747.255188, -19.24308014), Point(32.34173965, 748.8853149, -32.95483017), Point(-1.019738674, 755.5415649, -39.20322418)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])
format_3 = Format(Format="{0:0.000}", Culture=127, Data0=element_group_info.Volume)
format_4 = Format(Format="{0:0.000}", Culture=127, Data0=multiplication)
panel_32 = Panel("""Material
Name: Concrete
Grade: Grade
Density: 2.4E-06""")
assert_14 = Assert(TestNames="ProfileToElementsMillimeters_Multiple_Amount", Expected="1", Actual=element_group_info.Amount)  # -> Result, FailedInfo
assert_15 = Assert(TestNames="ProfileToElementsMillimeters_Multiple_Material", Expected=panel_31, Actual=element_group_info.Material)  # -> Result, FailedInfo
format_5 = Format(Format="{0:0.000}", Culture=127, Data0=multiplication_4)
format_6 = Format(Format="{0:0.000}", Culture=127, Data0=element_group_info_2.Mass)
format_7 = Format(Format="{0:0.000}", Culture=127, Data0=element_group_info_2.Volume)
format_8 = Format(Format="{0:0.000}", Culture=127, Data0=multiplication_3)
assert_point_list_112 = AssertPointList(
    TestName="ProfileToElementsMillimeters_MultipleLines_Breps",
    ExpectedPointList=pt_164,
    ActualPointList=demesh_196.Vertices,
    Tolerance="0.0001")  # -> Result, FailedInfo
assert_point_list_113 = AssertPointList(
    TestName="ProfileToElementsMillimeters_Normal_Breps",
    ExpectedPointList=pt_165,
    ActualPointList=demesh_197.Vertices,
    Tolerance="0.0001")  # -> Result, FailedInfo
assert_16 = Assert(TestNames="ProfileToElementsMillimeters_Multiple_Mass", Expected=format_2, Actual=format)  # -> Result, FailedInfo
assert_17 = Assert(TestNames="ProfileToElementsMillimeters_Normal_Amount", Expected="1", Actual=element_group_info_2.Amount)  # -> Result, FailedInfo
assert_18 = Assert(TestNames="ProfileToElementsMillimeters_Normal_Material", Expected=panel_32, Actual=element_group_info_2.Material)  # -> Result, FailedInfo
assert_19 = Assert(TestNames="ProfileToElementsMillimeters_Multiple_Volume", Expected=format_4, Actual=format_3)  # -> Result, FailedInfo
assert_20 = Assert(TestNames="ProfileToElementsMillimeters_Normal_Mass", Expected=format_6, Actual=format_5)  # -> Result, FailedInfo
assert_21 = Assert(TestNames="ProfileToElementsMillimeters_Normal_Volume", Expected=format_8, Actual=format_7)  # -> Result, FailedInfo
entwine_18 = Entwine(
    Branch00=assert_13.Result,
    Branch01=assert_point_list_113.Result,
    Branch02=assert_point_list_112.Result,
    Branch03=assert_17.Result,
    Branch04=assert_18.Result,
    Branch05=assert_21.Result,
    Branch06=assert_20.Result,
    FlattenInputs=True)  # -> flatten(Result)

# ----
# Export report:
path = FilePath("C:\Users\code-structures\RiderProjects\T-Rex\TestsInsideGrasshopper\Report.md")  # disabled

# ----
# Curve Spacing
number_slider_31 = Slider(7850, range=0..10000)
division_76 = Division(A=number_slider_31, B="1e9")
division_77 = Division(A=Slider(7850, range=0..10000), B="1e9")
division_78 = Division(A=Slider(7850, range=0..10000), B="1e9")
material_118 = Material(Name="Name of the material", Grade="Grade of the material", Density=division_76)
division_79 = Division(A=Slider(7850, range=0..10000), B="1e9")
material_119 = Material(Name="Name of the material", Grade="Grade of the material", Density=division_77)
division_80 = Division(A=Slider(7850, range=0..10000), B="1e9")
division_81 = Division(A=Slider(7850, range=0..10000), B="1e9")
division_82 = Division(A=Slider(7850, range=0..10000), B="1e9")
division_83 = Division(A=Slider(7850, range=0..10000), B="1e9")
division_84 = Division(A=Slider(7850, range=0..10000), B="1e9")
division_85 = Division(A=Slider(7850, range=0..10000), B="1e9")
material_120 = Material(Name="Name of the material", Grade="Grade of the material", Density=division_78)
division_86 = Division(A=Slider(7850, range=0..10000), B="1e9")
material_121 = Material(Name="Name of the material", Grade="Grade of the material", Density=division_79)
division_87 = Division(A=Slider(7850, range=0..10000), B="1e9")
division_88 = Division(A=Slider(7850, range=0..10000), B="1e9")
division_89 = Division(A=Slider(7850, range=0..10000), B="1e9")
material_122 = Material(Name="Name of the material", Grade="Grade of the material", Density=division_81)
material_123 = Material(Name="Name of the material", Grade="Grade of the material", Density=division_82)
material_124 = Material(Name="Name of the material", Grade="Grade of the material", Density=division_83)
material_125 = Material(Name="Name of the material", Grade="Grade of the material", Density=division_80)
pt_166 = ConstructPoint(XCoordinate=0, YCoordinate=0, ZCoordinate=0)
pt_167 = ConstructPoint(XCoordinate=Slider(500, range=0..1000), YCoordinate=0, ZCoordinate=0)
material_126 = Material(Name="Name of the material", Grade="Grade of the material", Density=division_84)
material_127 = Material(Name="Name of the material", Grade="Grade of the material", Density=division_85)
material_128 = Material(Name="Name of the material", Grade="Grade of the material", Density=division_86)
pt_168 = ConstructPoint(XCoordinate=0, YCoordinate=0, ZCoordinate=0)
pt_169 = ConstructPoint(XCoordinate=Slider(500, range=0..1000), YCoordinate=0, ZCoordinate=0)
material_129 = Material(Name="Name of the material", Grade="Grade of the material", Density=division_87)
material_130 = Material(Name="Name of the material", Grade="Grade of the material", Density=division_88)
rebar_properties_110 = RebarProperties(Diameter="12", Material=material_118)
pt_170 = ConstructPoint(XCoordinate=0, YCoordinate=0, ZCoordinate=0)
pt_171 = ConstructPoint(XCoordinate=Slider(500, range=0..1000), YCoordinate=0, ZCoordinate=0)
material_131 = Material(Name="Name of the material", Grade="Grade of the material", Density=division_89)
pt_172 = ConstructPoint(XCoordinate=0, YCoordinate=0, ZCoordinate=0)
pt_173 = ConstructPoint(XCoordinate=Slider(500, range=0..1000), YCoordinate=0, ZCoordinate=0)
rebar_properties_111 = RebarProperties(Diameter="16", Material=material_119)
ln_49 = Line(StartPoint=pt_166, EndPoint=pt_167)
material_132 = Material(Name="Name of the material", Grade="Grade of the material", Density=Slider(7850, range=0..10000))
rebar_properties_112 = RebarProperties(Diameter="12", Material=material_120)
material_133 = Material(Name="Name of the material", Grade="Grade of the material", Density=Slider(7850, range=0..10000))
pt_174 = ConstructPoint(XCoordinate=0, YCoordinate=0, ZCoordinate=0)
pt_175 = ConstructPoint(XCoordinate=Slider(500, range=0..1000), YCoordinate=0, ZCoordinate=0)
pt_176 = ConstructPoint(XCoordinate=0, YCoordinate=0, ZCoordinate=0)
pt_177 = ConstructPoint(XCoordinate=Slider(500, range=0..1000), YCoordinate=0, ZCoordinate=0)
pt_178 = ConstructPoint(XCoordinate=0, YCoordinate=0, ZCoordinate=0)
pt_179 = ConstructPoint(XCoordinate=Slider(500, range=0..1000), YCoordinate=0, ZCoordinate=0)
pt_180 = ConstructPoint(XCoordinate=Slider(500, range=0..1000), YCoordinate=0, ZCoordinate=0)
pt_181 = ConstructPoint(XCoordinate=0, YCoordinate=0, ZCoordinate=0)
ln_50 = Line(StartPoint=pt_168, EndPoint=pt_169)
pt_182 = ConstructPoint(XCoordinate=0, YCoordinate=0, ZCoordinate=0)
pt_183 = ConstructPoint(XCoordinate=Slider(500, range=0..1000), YCoordinate=0, ZCoordinate=0)
pt_184 = ConstructPoint(XCoordinate=0, YCoordinate=0, ZCoordinate=0)
pt_185 = ConstructPoint(XCoordinate=Slider(500, range=0..1000), YCoordinate=0, ZCoordinate=0)
rebar_properties_113 = RebarProperties(Diameter="12", Material=material_121)
pt_186 = ConstructPoint(XCoordinate=0, YCoordinate=0, ZCoordinate=0)
pt_187 = ConstructPoint(XCoordinate=Slider(500, range=0..1000), YCoordinate=0, ZCoordinate=0)
material_134 = Material(Name="Name of the material", Grade="Grade of the material", Density=Slider(7850, range=0..10000))
ln_51 = Line(StartPoint=pt_170, EndPoint=pt_171)
pt_188 = ConstructPoint(XCoordinate=0, YCoordinate=0, ZCoordinate=0)
pt_189 = ConstructPoint(XCoordinate=Slider(500, range=0..1000), YCoordinate=0, ZCoordinate=0)
rebar_properties_114 = RebarProperties(Diameter="12", Material=material_122)
pt_190 = ConstructPoint(XCoordinate=0, YCoordinate=0, ZCoordinate=0)
pt_191 = ConstructPoint(XCoordinate=Slider(500, range=0..1000), YCoordinate=0, ZCoordinate=0)
rebar_properties_115 = RebarProperties(Diameter="12", Material=material_123)
rebar_properties_116 = RebarProperties(Diameter="12", Material=material_124)
material_135 = Material(Name="Name of the material", Grade="Grade of the material", Density=Slider(7850, range=0..10000))
ln_52 = Line(StartPoint=pt_172, EndPoint=pt_173)
rebar_properties_117 = RebarProperties(Diameter="12", Material=material_126)
material_136 = Material(Name="Name of the material", Grade="Grade of the material", Density=Slider(7850, range=0..10000))
rebar_properties_118 = RebarProperties(Diameter="12", Material=material_127)
pt_192 = ConstructPoint(XCoordinate=0, YCoordinate=0, ZCoordinate=0)
pt_193 = ConstructPoint(XCoordinate=Slider(500, range=0..1000), YCoordinate=0, ZCoordinate=0)
material_137 = Material(Name="Name of the material", Grade="Grade of the material", Density=Slider(7850, range=0..10000))
rebar_properties_119 = RebarProperties(Diameter="12", Material=material_128)
material_138 = Material(Name="Name of the material", Grade="Grade of the material", Density=Slider(7850, range=0..10000))
ln_53 = Line(StartPoint=pt_174, EndPoint=pt_175)
rebar_properties_120 = RebarProperties(Diameter="12", Material=material_129)
material_139 = Material(Name="Name of the material", Grade="Grade of the material", Density=Slider(7850, range=0..10000))
curve_to_rebar_shape_48 = CurveToRebarShape(Curve=ln_49, Properties=rebar_properties_110)  # -> RebarShape, Mesh
ln_54 = Line(StartPoint=pt_176, EndPoint=pt_177)
rebar_properties_121 = RebarProperties(Diameter="12", Material=material_125)
material_140 = Material(Name="Name of the material", Grade="Grade of the material", Density=Slider(7850, range=0..10000))
ln_55 = Line(StartPoint=pt_178, EndPoint=pt_179)
rebar_properties_122 = RebarProperties(Diameter="12", Material=material_130)
material_141 = Material(Name="Name of the material", Grade="Grade of the material", Density=Slider(7850, range=0..10000))
ln_56 = Line(StartPoint=pt_181, EndPoint=pt_183)
ln_57 = Line(StartPoint=pt_182, EndPoint=pt_180)
ln_58 = Line(StartPoint=pt_184, EndPoint=pt_185)
material_142 = Material(Name="Name of the material", Grade="Grade of the material", Density=Slider(7850, range=0..10000))
pt_194 = ConstructPoint(XCoordinate=0, YCoordinate=0, ZCoordinate=0)
pt_195 = ConstructPoint(XCoordinate=Slider(0.5, range=0..1), YCoordinate=0, ZCoordinate=0)
material_143 = Material(Name="Name of the material", Grade="Grade of the material", Density=Slider(7850, range=0..10000))
pt_196 = ConstructPoint(XCoordinate=0, YCoordinate=0, ZCoordinate=0)
pt_197 = ConstructPoint(XCoordinate=Slider(0.5, range=0..1), YCoordinate=0, ZCoordinate=0)
rebar_properties_123 = RebarProperties(Diameter="12", Material=material_131)
ln_59 = Line(StartPoint=pt_186, EndPoint=pt_187)
curve_to_rebar_shape_49 = CurveToRebarShape(Curve=ln_50, Properties=rebar_properties_111)  # -> RebarShape, Mesh
ln_60 = Line(StartPoint=pt_188, EndPoint=pt_189)
ln_61 = Line(StartPoint=pt_190, EndPoint=pt_191)
material_144 = Material(Name="Name of the material", Grade="Grade of the material", Density=Slider(7850, range=0..10000))
pt_198 = ConstructPoint(XCoordinate=0, YCoordinate=0, ZCoordinate=0)
curve_to_rebar_shape_50 = CurveToRebarShape(Curve=ln_51, Properties=rebar_properties_112)  # -> RebarShape, Mesh
pt_199 = ConstructPoint(XCoordinate=Slider(0.5, range=0..1), YCoordinate=0, ZCoordinate=0)
rebar_properties_124 = RebarProperties(Diameter="0.012", Material=material_132)
ln_62 = Line(StartPoint=pt_192, EndPoint=pt_193)
material_145 = Material(Name="Name of the material", Grade="Grade of the material", Density=Slider(7850, range=0..10000))
rebar_properties_125 = RebarProperties(Diameter="0.012", Material=material_133)
curve_to_rebar_shape_51 = CurveToRebarShape(Curve=ln_52, Properties=rebar_properties_113)  # -> RebarShape, Mesh
pt_200 = ConstructPoint(XCoordinate=0, YCoordinate=0, ZCoordinate=0)
pt_201 = ConstructPoint(XCoordinate=Slider(0.5, range=0..1), YCoordinate=0, ZCoordinate=0)
pt_202 = ConstructPoint(XCoordinate=0, YCoordinate=0, ZCoordinate=0)
pt_203 = ConstructPoint(XCoordinate=Slider(0.5, range=0..1), YCoordinate=0, ZCoordinate=0)
pt_204 = ConstructPoint(XCoordinate=0, YCoordinate=0, ZCoordinate=0)
pt_205 = ConstructPoint(XCoordinate=Slider(0.5, range=0..1), YCoordinate=0, ZCoordinate=0)
ln_63 = Line(StartPoint=pt_194, EndPoint=pt_195)
rebar_properties_126 = RebarProperties(Diameter="0.012", Material=material_134)
curve_to_rebar_shape_52 = CurveToRebarShape(Curve=ln_53, Properties=rebar_properties_114)  # -> RebarShape, Mesh
pt_206 = ConstructPoint(XCoordinate=0, YCoordinate=0, ZCoordinate=0)
pt_207 = ConstructPoint(XCoordinate=Slider(0.5, range=0..1), YCoordinate=0, ZCoordinate=0)
curve_to_rebar_shape_53 = CurveToRebarShape(Curve=ln_54, Properties=rebar_properties_115)  # -> RebarShape, Mesh
ln_64 = Line(StartPoint=pt_196, EndPoint=pt_197)
curve_to_rebar_shape_54 = CurveToRebarShape(Curve=ln_55, Properties=rebar_properties_116)  # -> RebarShape, Mesh
pt_208 = ConstructPoint(XCoordinate=0, YCoordinate=0, ZCoordinate=0)
pt_209 = ConstructPoint(XCoordinate=Slider(0.5, range=0..1), YCoordinate=0, ZCoordinate=0)
pt_210 = ConstructPoint(XCoordinate=0, YCoordinate=0, ZCoordinate=0)
curve_to_rebar_shape_55 = CurveToRebarShape(Curve=ln_56, Properties=rebar_properties_117)  # -> RebarShape, Mesh
pt_211 = ConstructPoint(XCoordinate=Slider(0.5, range=0..1), YCoordinate=0, ZCoordinate=0)
curve_to_rebar_shape_56 = CurveToRebarShape(Curve=ln_57, Properties=rebar_properties_121)  # -> RebarShape, Mesh
pt_212 = ConstructPoint(XCoordinate=0, YCoordinate=0, ZCoordinate=0)
curve_to_rebar_shape_57 = CurveToRebarShape(Curve=ln_58, Properties=rebar_properties_118)  # -> RebarShape, Mesh
pt_213 = ConstructPoint(XCoordinate=Slider(0.5, range=0..1), YCoordinate=0, ZCoordinate=0)
rebar_properties_127 = RebarProperties(Diameter="0.012", Material=material_135)
pt_214 = ConstructPoint(XCoordinate=0, YCoordinate=0, ZCoordinate=0)
pt_215 = ConstructPoint(XCoordinate=Slider(0.5, range=0..1), YCoordinate=0, ZCoordinate=0)
rebar_properties_128 = RebarProperties(Diameter="0.012", Material=material_136)
pt_216 = ConstructPoint(XCoordinate=0, YCoordinate=0, ZCoordinate=0)
pt_217 = ConstructPoint(XCoordinate=Slider(0.5, range=0..1), YCoordinate=0, ZCoordinate=0)
curve_to_rebar_shape_58 = CurveToRebarShape(Curve=ln_59, Properties=rebar_properties_119)  # -> RebarShape, Mesh
pt_218 = ConstructPoint(XCoordinate=0, YCoordinate=0, ZCoordinate=0)
pt_219 = ConstructPoint(XCoordinate=0, YCoordinate=Slider(500, range=0..1000), ZCoordinate=0)
ln_65 = Line(StartPoint=pt_198, EndPoint=pt_199)
curve_to_rebar_shape_59 = CurveToRebarShape(Curve=ln_60, Properties=rebar_properties_120)  # -> RebarShape, Mesh
rebar_properties_129 = RebarProperties(Diameter="0.012", Material=material_137)
rebar_properties_130 = RebarProperties(Diameter="0.012", Material=material_138)
curve_to_rebar_shape_60 = CurveToRebarShape(Curve=ln_61, Properties=rebar_properties_122)  # -> RebarShape, Mesh
rebar_properties_131 = RebarProperties(Diameter="0.012", Material=material_139)
pt_220 = ConstructPoint(XCoordinate=0, YCoordinate=0, ZCoordinate=0)
pt_221 = ConstructPoint(XCoordinate=Slider(0.5, range=0..1), YCoordinate=0, ZCoordinate=0)
rebar_properties_132 = RebarProperties(Diameter="0.012", Material=material_140)
ln_66 = Line(StartPoint=pt_200, EndPoint=pt_201)
rebar_properties_133 = RebarProperties(Diameter="0.012", Material=material_141)
ln_67 = Line(StartPoint=pt_202, EndPoint=pt_203)
pt_222 = ConstructPoint(XCoordinate=0, YCoordinate=0, ZCoordinate=0)
pt_223 = ConstructPoint(XCoordinate=0, YCoordinate=Slider(500, range=0..1000), ZCoordinate=0)
curve_to_rebar_shape_61 = CurveToRebarShape(Curve=ln_62, Properties=rebar_properties_123)  # -> RebarShape, Mesh
rebar_properties_134 = RebarProperties(Diameter="0.012", Material=material_142)
rebar_properties_135 = RebarProperties(Diameter="0.016", Material=material_143)
pt_224 = ConstructPoint(XCoordinate=0, YCoordinate=0, ZCoordinate=0)
pt_225 = ConstructPoint(XCoordinate=Slider(0.5, range=0..1), YCoordinate=0, ZCoordinate=0)
ln_68 = Line(StartPoint=pt_204, EndPoint=pt_205)
ln_69 = Line(StartPoint=pt_206, EndPoint=pt_207)
pt_226 = ConstructPoint(XCoordinate=0, YCoordinate=0, ZCoordinate=0)
pt_227 = ConstructPoint(XCoordinate=0, YCoordinate=Slider(500, range=0..1000), ZCoordinate=0)
ln_70 = Line(StartPoint=pt_208, EndPoint=pt_209)
ln_71 = Line(StartPoint=pt_210, EndPoint=pt_211)
ln_72 = Line(StartPoint=pt_212, EndPoint=pt_213)
rebar_properties_136 = RebarProperties(Diameter="0.012", Material=material_144)
curve_to_rebar_shape_62 = CurveToRebarShape(Curve=ln_63, Properties=rebar_properties_124)  # -> RebarShape, Mesh
ln_73 = Line(StartPoint=pt_214, EndPoint=pt_215)
pt_228 = ConstructPoint(XCoordinate=0, YCoordinate=0, ZCoordinate=0)
pt_229 = ConstructPoint(XCoordinate=0, YCoordinate=Slider(500, range=0..1000), ZCoordinate=0)
ln_74 = Line(StartPoint=pt_216, EndPoint=pt_217)
curve_to_rebar_shape_63 = CurveToRebarShape(Curve=ln_64, Properties=rebar_properties_125)  # -> RebarShape, Mesh
ln_75 = Line(StartPoint=pt_218, EndPoint=pt_219)
rebar_properties_137 = RebarProperties(Diameter="0.012", Material=material_145)
pt_230 = ConstructPoint(XCoordinate=0, YCoordinate=0, ZCoordinate=0)
pt_231 = ConstructPoint(XCoordinate=0, YCoordinate=Slider(500, range=0..1000), ZCoordinate=0)
ln_76 = Line(StartPoint=pt_220, EndPoint=pt_221)
pt_232 = ConstructPoint(XCoordinate=0, YCoordinate=0, ZCoordinate=0)
pt_233 = ConstructPoint(XCoordinate=0, YCoordinate=Slider(500, range=0..1000), ZCoordinate=0)
curve_to_rebar_shape_64 = CurveToRebarShape(Curve=ln_65, Properties=rebar_properties_126)  # -> RebarShape, Mesh
pt_234 = ConstructPoint(XCoordinate=0, YCoordinate=0, ZCoordinate=0)
ln_77 = Line(StartPoint=pt_222, EndPoint=pt_223)
pt_235 = ConstructPoint(XCoordinate=0, YCoordinate=Slider(1000, range=0..1000), ZCoordinate=0)
ln_78 = Line(StartPoint=pt_224, EndPoint=pt_225)
curve_to_rebar_shape_65 = CurveToRebarShape(Curve=ln_66, Properties=rebar_properties_127)  # -> RebarShape, Mesh
curve_to_rebar_shape_66 = CurveToRebarShape(Curve=ln_67, Properties=rebar_properties_128)  # -> RebarShape, Mesh
ln_79 = Line(StartPoint=pt_226, EndPoint=pt_227)
curve_to_rebar_shape_67 = CurveToRebarShape(Curve=ln_68, Properties=rebar_properties_129)  # -> RebarShape, Mesh
curve_to_rebar_shape_68 = CurveToRebarShape(Curve=ln_69, Properties=rebar_properties_130)  # -> RebarShape, Mesh
ln_80 = Line(StartPoint=pt_228, EndPoint=pt_229)
curve_to_rebar_shape_69 = CurveToRebarShape(Curve=ln_70, Properties=rebar_properties_131)  # -> RebarShape, Mesh
curve_to_rebar_shape_70 = CurveToRebarShape(Curve=ln_71, Properties=rebar_properties_132)  # -> RebarShape, Mesh
curve_to_rebar_shape_71 = CurveToRebarShape(Curve=ln_72, Properties=rebar_properties_133)  # -> RebarShape, Mesh
curve_to_rebar_shape_72 = CurveToRebarShape(Curve=ln_73, Properties=rebar_properties_134)  # -> RebarShape, Mesh
curve_to_rebar_shape_73 = CurveToRebarShape(Curve=ln_74, Properties=rebar_properties_135)  # -> RebarShape, Mesh
nurbs_5 = NurbsCurve(
    Vertices=[Point(-91.05627551, -153.3607074, 0), Point(213.6778964, -153.3607074, 0), Point(177.5395491, 47.35362701, 0), Point(-45.1508073, 84.95704245, 0)],
    Degree=3,
    Periodic=False)  # -> Curve, Length, Domain
ln_81 = Line(StartPoint=pt_230, EndPoint=pt_231)
ln_82 = Line(StartPoint=pt_232, EndPoint=pt_233)
nurbs_6 = NurbsCurve(
    Vertices=[Point(-91.05627551, -153.3607074, 0), Point(213.6778964, -153.3607074, 0), Point(177.5395491, 47.35362701, 0), Point(-45.1508073, 84.95704245, 0)],
    Degree=3,
    Periodic=False)  # -> Curve, Length, Domain
pi = Pi(Factor=Slider(0.5, range=0..1))
ln_83 = Line(StartPoint=pt_234, EndPoint=pt_235)
pline_10 = PolyLine(
    Vertices=[Point(-35.87615894, -143.4259335, 0), Point(309.0054816, 142.4627948, 0), Point(15.17539969, 348.9379876, 0), Point(-192.4342721, 103.8905061, 0)],
    Closed=False)
curve_to_rebar_shape_74 = CurveToRebarShape(Curve=ln_76, Properties=rebar_properties_136)  # -> RebarShape, Mesh
cir = Circle(Plane=PlaneXY(0, 0, 0), Radius=Slider(300, range=0..1000))
pline_11 = PolyLine(
    Vertices=[Point(-35.87615894, -143.4259335, 0), Point(309.0054816, 142.4627948, 0), Point(15.17539969, 348.9379876, 0), Point(-192.4342721, 103.8905061, 0)],
    Closed=True)
curve_to_rebar_shape_75 = CurveToRebarShape(Curve=ln_78, Properties=rebar_properties_137)  # -> RebarShape, Mesh
pline_12 = PolyLine(
    Vertices=[Point(-35.87615894, -143.4259335, 0), Point(309.0054816, 142.4627948, 0), Point(15.17539969, 348.9379876, 0), Point(-192.4342721, 103.8905061, 0)],
    Closed=True)
cir_2 = Circle(Plane=PlaneXY(0, 0, 0), Radius=Slider(300, range=0..1000))
pt_236 = ConstructPoint(XCoordinate=0, YCoordinate=0, ZCoordinate=0)
pt_237 = ConstructPoint(XCoordinate=0, YCoordinate=Slider(0.5, range=0..1), ZCoordinate=0)
curve_spacing = CurveSpacing(
    Id="0",
    RebarShape=curve_to_rebar_shape_56.RebarShape,
    Curve=nurbs_5.Curve,
    Count=Slider(10, range=0..100),
    RotationAngle=degrees(Slider(90, range=0..360)))  # -> RebarGroup, Mesh, Curve
pt_238 = ConstructPoint(XCoordinate=0, YCoordinate=0, ZCoordinate=0)
curve_spacing_2 = CurveSpacing(
    Id="0",
    RebarShape=curve_to_rebar_shape_58.RebarShape,
    Curve=pline_11,
    Count=Slider(10, range=0..100),
    RotationAngle=degrees(Slider(90, range=0..360)))  # -> RebarGroup, Mesh, Curve
pt_239 = ConstructPoint(XCoordinate=0, YCoordinate=Slider(0.5, range=0..1), ZCoordinate=0)
nurbs_7 = NurbsCurve(
    Vertices=[Point(-0.4418009493, -0.02492884866, 0), Point(0.5336038072, 1.050882235, 0), Point(2.446462193, 0.04031554104, 0), Point(0.2376521324, -1.129054491, 0)],
    Degree=3,
    Periodic=False)  # -> Curve, Length, Domain
pt_240 = ConstructPoint(XCoordinate=0, YCoordinate=0, ZCoordinate=0)
pt_241 = ConstructPoint(XCoordinate=0, YCoordinate=Slider(1, range=0..1), ZCoordinate=0)
pt_242 = ConstructPoint(XCoordinate=0, YCoordinate=0, ZCoordinate=0)
pt_243 = ConstructPoint(XCoordinate=0, YCoordinate=Slider(0.5, range=0..1), ZCoordinate=0)
pt_244 = ConstructPoint(XCoordinate=0, YCoordinate=0, ZCoordinate=0)
pt_245 = ConstructPoint(XCoordinate=0, YCoordinate=Slider(0.5, range=0..1), ZCoordinate=0)
pline_13 = PolyLine(
    Vertices=[Point(-0.5941680549, -0.1549270191, 0), Point(0.2292547575, 0.7834642614, 0), Point(1.012283243, 0.4727386718, 0), Point(0.8382769131, -0.2232866488, 0)],
    Closed=False)
pt_246 = ConstructPoint(XCoordinate=0, YCoordinate=0, ZCoordinate=0)
pt_247 = ConstructPoint(XCoordinate=0, YCoordinate=Slider(0.5, range=0..1), ZCoordinate=0)
curve_spacing_3 = CurveSpacing(
    Id="0",
    RebarShape=curve_to_rebar_shape_59.RebarShape,
    Curve=cir,
    Count=Slider(10, range=0..100),
    RotationAngle=degrees(Slider(90, range=0..360)))  # -> RebarGroup, Mesh, Curve
pline_14 = PolyLine(
    Vertices=[Point(-0.5941680549, -0.1549270191, 0), Point(0.2292547575, 0.7834642614, 0), Point(1.012283243, 0.4727386718, 0), Point(0.8382769131, -0.2232866488, 0)],
    Closed=True)
cir_3 = Circle(Plane=PlaneXY(0, 0, 0), Radius=Slider(0.3, range=0..1))
ln_84 = Line(StartPoint=pt_236, EndPoint=pt_237)
curve_spacing_4 = CurveSpacing(
    Id="0",
    RebarShape=curve_to_rebar_shape_62.RebarShape,
    Curve=nurbs_7.Curve,
    Count=Slider(10, range=0..100),
    RotationAngle=degrees(Slider(90, range=0..360)))  # -> RebarGroup, Mesh, Curve
mesh_99 = Mesh([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])
ln_85 = Line(StartPoint=pt_238, EndPoint=pt_239)
pi_2 = Pi(Factor=Slider(0.5, range=0..1))
ln_86 = Line(StartPoint=pt_240, EndPoint=pt_241)
ln_87 = Line(StartPoint=pt_242, EndPoint=pt_243)
ln_88 = Line(StartPoint=pt_244, EndPoint=pt_245)
curve_spacing_5 = CurveSpacing(
    Id="0",
    RebarShape=curve_to_rebar_shape_63.RebarShape,
    Curve=pline_13,
    Count=Slider(10, range=0..100),
    RotationAngle=degrees(Slider(90, range=0..360)))  # -> RebarGroup, Mesh, Curve
nurbs_8 = NurbsCurve(
    Vertices=[Point(-0.4418009493, -0.02492884866, 0), Point(0.5336038072, 1.050882235, 0), Point(2.446462193, 0.04031554104, 0), Point(0.2376521324, -1.129054491, 0)],
    Degree=3,
    Periodic=False)  # -> Curve, Length, Domain
panel_33 = Panel("""Rebar Group
Id: 1
Count: 10""")
mesh_100 = Mesh([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])
ln_89 = Line(StartPoint=pt_246, EndPoint=pt_247)
pline_15 = PolyLine(
    Vertices=[Point(-0.5941680549, -0.1549270191, 0), Point(0.2292547575, 0.7834642614, 0), Point(1.012283243, 0.4727386718, 0), Point(0.8382769131, -0.2232866488, 0)],
    Closed=False)
curve_spacing_6 = CurveSpacing(
    Id="0",
    RebarShape=curve_to_rebar_shape_64.RebarShape,
    Curve=pline_14,
    Count=Slider(10, range=0..100),
    RotationAngle=degrees(Slider(90, range=0..360)))  # -> RebarGroup, Mesh, Curve
demesh_198 = DeconstructMesh(Mesh=mesh_99)  # -> flatten(Vertices), Faces, Colours, Normals
pline_16 = PolyLine(
    Vertices=[Point(-0.5941680549, -0.1549270191, 0), Point(0.2292547575, 0.7834642614, 0), Point(1.012283243, 0.4727386718, 0), Point(0.8382769131, -0.2232866488, 0)],
    Closed=True)
cir_4 = Circle(Plane=PlaneXY(0, 0, 0), Radius=Slider(0.3, range=0..1))
mesh_101 = Mesh([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])
demesh_199 = DeconstructMesh(Mesh=mesh_100)  # -> flatten(Vertices), Faces, Colours, Normals
curve_spacing_7 = CurveSpacing(
    Id="0",
    RebarShape=curve_to_rebar_shape_65.RebarShape,
    Curve=cir_3,
    Count=Slider(10, range=0..100),
    RotationAngle=degrees(Slider(90, range=0..360)))  # -> RebarGroup, Mesh, Curve
mesh_102 = Mesh([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])
mesh_103 = Mesh([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])
mesh_104 = Mesh([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])
mesh_105 = Mesh([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])
mesh_106 = Mesh([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])
divide_14 = DivideCurve(Curve=curve_spacing_2.Curve, Count=10, Kinks=False)  # -> flatten(Points), Tangents, Parameters
demesh_200 = DeconstructMesh(Mesh=mesh_101)  # -> flatten(Vertices), Faces, Colours, Normals
divide_15 = DivideCurve(Curve=curve_spacing.Curve, Count=10, Kinks=False)  # -> flatten(Points), Tangents, Parameters
mesh_107 = Mesh([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])
demesh_201 = DeconstructMesh(Mesh=mesh_104)  # -> flatten(Vertices), Faces, Colours, Normals
divide_16 = DivideCurve(Curve=curve_spacing_3.Curve, Count=10, Kinks=False)  # -> flatten(Points), Tangents, Parameters
mesh_108 = Mesh([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])
demesh_202 = DeconstructMesh(Mesh=mesh_105)  # -> flatten(Vertices), Faces, Colours, Normals
demesh_203 = DeconstructMesh(Mesh=mesh_102)  # -> flatten(Vertices), Faces, Colours, Normals
demesh_204 = DeconstructMesh(Mesh=mesh_103)  # -> flatten(Vertices), Faces, Colours, Normals
demesh_205 = DeconstructMesh(Mesh=mesh_106)  # -> flatten(Vertices), Faces, Colours, Normals
pt_248 = Point([Point(-91.05627551, -153.3607074, 0), Point(-91.05627551, -153.3607074, 50), Point(-91.05627551, -153.3607074, 100), Point(-91.05627551, -153.3607074, 150), Point(-91.05627551, -153.3607074, 200), Point(-91.05627551, -153.3607074, 250)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])
pt_249 = Point([Point(-35.87615894, -143.4259335, 0), Point(-3.966685916, -181.919901, 0), Point(27.94278711, -220.4138685, 0), Point(59.85226014, -258.9078359, 0), Point(91.76173317, -297.4018034, 0), Point(123.6712062, -335.8957708, 0)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])
demesh_206 = DeconstructMesh(Mesh=mesh_107)  # -> flatten(Vertices), Faces, Colours, Normals
divide_17 = DivideCurve(Curve=curve_spacing_4.Curve, Count=10, Kinks=False)  # -> flatten(Points), Tangents, Parameters
pt_250 = Point([Point(-0.4418009493, -0.02492884866, 0), Point(-0.4418009493, -0.02492884866, -0.05), Point(-0.4418009493, -0.02492884866, -0.1), Point(-0.4418009493, -0.02492884866, -0.15), Point(-0.4418009493, -0.02492884866, -0.2), Point(-0.4418009493, -0.02492884866, -0.25)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])
demesh_207 = DeconstructMesh(Mesh=mesh_108)  # -> flatten(Vertices), Faces, Colours, Normals
divide_18 = DivideCurve(Curve=curve_spacing_5.Curve, Count=10, Kinks=False)  # -> flatten(Points), Tangents, Parameters
pt_251 = Point([Point(-0.5941680549, -0.1549270191, 0), Point(-0.5565855114, -0.1879050788, 0), Point(-0.5190029679, -0.2208831386, 0), Point(-0.4814204243, -0.2538611983, 0), Point(-0.4438378808, -0.286839258, 0), Point(-0.4062553373, -0.3198173177, 0)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])
divide_19 = DivideCurve(Curve=curve_spacing_6.Curve, Count=10, Kinks=False)  # -> flatten(Points), Tangents, Parameters
mesh_109 = Mesh([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])
pt_252 = Point([Point(-0.5941680549, -0.1549270191, 0), Point(-0.5565855114, -0.1879050788, 0), Point(-0.5190029679, -0.2208831386, 0), Point(-0.4814204243, -0.2538611983, 0), Point(-0.4438378808, -0.286839258, 0), Point(-0.4062553373, -0.3198173177, 0)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])
mesh_110 = Mesh([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])
mesh_111 = Mesh([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])
pt_253 = Point([Point(300, 0, 0), Point(300, 0, 50), Point(300, 0, 100), Point(300, 0, 150), Point(300, 0, 200), Point(300, 0, 250)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])
mesh_112 = Mesh([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])
mesh_113 = Mesh([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])
divide_20 = DivideCurve(Curve=curve_spacing_7.Curve, Count=10, Kinks=False)  # -> flatten(Points), Tangents, Parameters
mesh_114 = Mesh([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])
mesh_115 = Mesh([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])
mesh_116 = Mesh([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])
demesh_208 = DeconstructMesh(Mesh=mesh_109)  # -> flatten(Vertices), Faces, Colours, Normals
mesh_117 = Mesh([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])
demesh_209 = DeconstructMesh(Mesh=mesh_110)  # -> flatten(Vertices), Faces, Colours, Normals
pt_254 = Point([Point(0.3, 0, 0), Point(0.3, 0, 0.05), Point(0.3, 0, 0.1), Point(0.3, 0, 0.15), Point(0.3, 0, 0.2), Point(0.3, 0, 0.25)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])
demesh_210 = DeconstructMesh(Mesh=mesh_111)  # -> flatten(Vertices), Faces, Colours, Normals
assert_point_list_114 = AssertPointList(
    TestName="CurveSpacingMilimeters_Nurbs_Curve",
    ExpectedPointList=pt_248,
    ActualPointList=divide_15.Points,
    Tolerance="0.00001")  # -> Result, FailedInfo
demesh_211 = DeconstructMesh(Mesh=mesh_114)  # -> flatten(Vertices), Faces, Colours, Normals
mesh_118 = Mesh([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])
demesh_212 = DeconstructMesh(Mesh=mesh_115)  # -> flatten(Vertices), Faces, Colours, Normals
demesh_213 = DeconstructMesh(Mesh=mesh_112)  # -> flatten(Vertices), Faces, Colours, Normals
demesh_214 = DeconstructMesh(Mesh=mesh_113)  # -> flatten(Vertices), Faces, Colours, Normals
assert_point_list_115 = AssertPointList(
    TestName="CurveSpacingMilimeters_ClosedPolyline_Curve",
    ExpectedPointList=pt_249,
    ActualPointList=divide_14.Points,
    Tolerance="0.00001")  # -> Result, FailedInfo
demesh_215 = DeconstructMesh(Mesh=mesh_116)  # -> flatten(Vertices), Faces, Colours, Normals
assert_point_list_116 = AssertPointList(
    TestName="CurveSpacingMilimeters_ClosedCircle_Curve",
    ExpectedPointList=pt_253,
    ActualPointList=divide_16.Points,
    Tolerance="0.00001")  # -> Result, FailedInfo
demesh_216 = DeconstructMesh(Mesh=mesh_117)  # -> flatten(Vertices), Faces, Colours, Normals
demesh_217 = DeconstructMesh(Mesh=mesh_118)  # -> flatten(Vertices), Faces, Colours, Normals
assert_point_list_117 = AssertPointList(
    TestName="CurveSpacingMeters_Nurbs_Curve",
    ExpectedPointList=pt_250,
    ActualPointList=divide_17.Points,
    Tolerance="0.00001")  # -> Result, FailedInfo
assert_point_list_118 = AssertPointList(
    TestName="CurveSpacingMeters_OpenPolyline_Curve",
    ExpectedPointList=pt_251,
    ActualPointList=divide_18.Points,
    Tolerance="0.00001")  # -> Result, FailedInfo
assert_point_list_119 = AssertPointList(
    TestName="CurveSpacingMeters_ClosedPolyline_Curve",
    ExpectedPointList=pt_252,
    ActualPointList=divide_19.Points,
    Tolerance="0.00001")  # -> Result, FailedInfo
assert_point_list_120 = AssertPointList(
    TestName="CurveSpacingMeters_ClosedCircle_Curve",
    ExpectedPointList=pt_254,
    ActualPointList=divide_20.Points,
    Tolerance="0.00001")  # -> Result, FailedInfo

curve_spacing_8 = CurveSpacing(
    Id="0",
    RebarShape=curve_to_rebar_shape_49.RebarShape,
    Curve=ln_77,
    Count=Slider(10, range=0..100),
    RotationAngle=degrees(Slider(90, range=0..360)))  # -> RebarGroup, Mesh, Curve
curve_spacing_9 = CurveSpacing(
    Id="0",
    RebarShape=curve_to_rebar_shape_48.RebarShape,
    Curve=ln_75,
    Count=Slider(10, range=0..100),
    RotationAngle=degrees(Slider(90, range=0..360)))  # -> RebarGroup, Mesh, Curve
curve_spacing_10 = CurveSpacing(
    Id="1",
    RebarShape=curve_to_rebar_shape_50.RebarShape,
    Curve=ln_79,
    Count=Slider(10, range=0..100),
    RotationAngle=degrees(Slider(90, range=0..360)))  # -> RebarGroup, Mesh, Curve
curve_spacing_11 = CurveSpacing(
    Id="0",
    RebarShape=curve_to_rebar_shape_54.RebarShape,
    Curve=nurbs_6.Curve,
    Count=Slider(10, range=0..100),
    RotationAngle=degrees(Slider(90, range=0..360)))  # -> RebarGroup, Mesh, Curve
curve_spacing_12 = CurveSpacing(
    Id="0",
    RebarShape=curve_to_rebar_shape_51.RebarShape,
    Curve=ln_80,
    Count=Slider(3, range=0..100),
    RotationAngle=degrees(Slider(90, range=0..360)))  # -> RebarGroup, Mesh, Curve
curve_spacing_13 = CurveSpacing(
    Id="0",
    RebarShape=curve_to_rebar_shape_53.RebarShape,
    Curve=ln_82,
    Count=Slider(10, range=0..100),
    RotationAngle=degrees(Slider(45, range=0..360)))  # -> RebarGroup, Mesh, Curve
curve_spacing_14 = CurveSpacing(
    Id="0",
    RebarShape=curve_to_rebar_shape_55.RebarShape,
    Curve=ln_83,
    Count=Slider(10, range=0..100),
    RotationAngle=degrees(Slider(90, range=0..360)))  # -> RebarGroup, Mesh, Curve
curve_spacing_15 = CurveSpacing(Id="0", RebarShape=curve_to_rebar_shape_52.RebarShape, Curve=ln_81, Count=Slider(10, range=0..100), RotationAngle=pi)  # -> RebarGroup, Mesh, Curve
curve_spacing_16 = CurveSpacing(
    Id="0",
    RebarShape=curve_to_rebar_shape_60.RebarShape,
    Curve=pline_12,
    Count=Slider(10, range=0..100),
    RotationAngle=degrees(Slider(90, range=0..360)))  # -> RebarGroup, Mesh, Curve
curve_spacing_17 = CurveSpacing(
    Id="0",
    RebarShape=curve_to_rebar_shape_57.RebarShape,
    Curve=pline_10,
    Count=Slider(10, range=0..100),
    RotationAngle=degrees(Slider(90, range=0..360)))  # -> RebarGroup, Mesh, Curve
curve_spacing_18 = CurveSpacing(
    Id="0",
    RebarShape=curve_to_rebar_shape_61.RebarShape,
    Curve=cir_2,
    Count=Slider(10, range=0..100),
    RotationAngle=degrees(Slider(90, range=0..360)))  # -> RebarGroup, Mesh, Curve
curve_spacing_19 = CurveSpacing(
    Id="0",
    RebarShape=curve_to_rebar_shape_67.RebarShape,
    Curve=ln_85,
    Count=Slider(10, range=0..100),
    RotationAngle=degrees(Slider(90, range=0..360)))  # -> RebarGroup, Mesh, Curve
curve_spacing_20 = CurveSpacing(
    Id="0",
    RebarShape=curve_to_rebar_shape_66.RebarShape,
    Curve=ln_84,
    Count=Slider(3, range=0..100),
    RotationAngle=degrees(Slider(90, range=0..360)))  # -> RebarGroup, Mesh, Curve
curve_spacing_21 = CurveSpacing(
    Id="0",
    RebarShape=curve_to_rebar_shape_71.RebarShape,
    Curve=nurbs_8.Curve,
    Count=Slider(10, range=0..100),
    RotationAngle=degrees(Slider(90, range=0..360)))  # -> RebarGroup, Mesh, Curve
curve_spacing_22 = CurveSpacing(Id="0", RebarShape=curve_to_rebar_shape_69.RebarShape, Curve=ln_87, Count=Slider(10, range=0..100), RotationAngle=pi_2)  # -> RebarGroup, Mesh, Curve
curve_spacing_23 = CurveSpacing(
    Id="0",
    RebarShape=curve_to_rebar_shape_70.RebarShape,
    Curve=ln_88,
    Count=Slider(10, range=0..100),
    RotationAngle=degrees(Slider(45, range=0..360)))  # -> RebarGroup, Mesh, Curve
curve_spacing_24 = CurveSpacing(
    Id="0",
    RebarShape=curve_to_rebar_shape_68.RebarShape,
    Curve=ln_86,
    Count=Slider(10, range=0..100),
    RotationAngle=degrees(Slider(90, range=0..360)))  # -> RebarGroup, Mesh, Curve
curve_spacing_25 = CurveSpacing(
    Id="0",
    RebarShape=curve_to_rebar_shape_72.RebarShape,
    Curve=pline_15,
    Count=Slider(10, range=0..100),
    RotationAngle=degrees(Slider(90, range=0..360)))  # -> RebarGroup, Mesh, Curve
curve_spacing_26 = CurveSpacing(
    Id="0",
    RebarShape=curve_to_rebar_shape_73.RebarShape,
    Curve=ln_89,
    Count=Slider(10, range=0..100),
    RotationAngle=degrees(Slider(90, range=0..360)))  # -> RebarGroup, Mesh, Curve
curve_spacing_27 = CurveSpacing(
    Id="0",
    RebarShape=curve_to_rebar_shape_74.RebarShape,
    Curve=pline_16,
    Count=Slider(10, range=0..100),
    RotationAngle=degrees(Slider(90, range=0..360)))  # -> RebarGroup, Mesh, Curve
curve_spacing_28 = CurveSpacing(
    Id="0",
    RebarShape=curve_to_rebar_shape_75.RebarShape,
    Curve=cir_4,
    Count=Slider(10, range=0..100),
    RotationAngle=degrees(Slider(90, range=0..360)))  # -> RebarGroup, Mesh, Curve

demesh_218 = DeconstructMesh(Mesh=curve_spacing_9.Mesh)  # -> flatten(Vertices), Faces, Colours, Normals
demesh_219 = DeconstructMesh(Mesh=curve_spacing_8.Mesh)  # -> flatten(Vertices), Faces, Colours, Normals
demesh_220 = DeconstructMesh(Mesh=curve_spacing_12.Mesh)  # -> flatten(Vertices), Faces, Colours, Normals
demesh_221 = DeconstructMesh(Mesh=curve_spacing_15.Mesh)  # -> flatten(Vertices), Faces, Colours, Normals
demesh_222 = DeconstructMesh(Mesh=curve_spacing_13.Mesh)  # -> flatten(Vertices), Faces, Colours, Normals
demesh_223 = DeconstructMesh(Mesh=curve_spacing_11.Mesh)  # -> flatten(Vertices), Faces, Colours, Normals
assert_22 = Assert(TestNames="CurveSpacingMilimeters_Id_String", Expected=panel_33, Actual=curve_spacing_10.RebarGroup)  # -> Result, FailedInfo
demesh_224 = DeconstructMesh(Mesh=curve_spacing_14.Mesh)  # -> flatten(Vertices), Faces, Colours, Normals
demesh_225 = DeconstructMesh(Mesh=curve_spacing_17.Mesh)  # -> flatten(Vertices), Faces, Colours, Normals
demesh_226 = DeconstructMesh(Mesh=curve_spacing_16.Mesh)  # -> flatten(Vertices), Faces, Colours, Normals
demesh_227 = DeconstructMesh(Mesh=curve_spacing_18.Mesh)  # -> flatten(Vertices), Faces, Colours, Normals
assert_point_list_121 = AssertPointList(
    TestName="CurveSpacingMilimeters_Normal_Mesh",
    ExpectedPointList=demesh_198.Vertices,
    ActualPointList=demesh_218.Vertices,
    Tolerance="0.00001")  # -> Result, FailedInfo
assert_point_list_122 = AssertPointList(
    TestName="CurveSpacingMilimeters_Diameter_Mesh",
    ExpectedPointList=demesh_199.Vertices,
    ActualPointList=demesh_219.Vertices,
    Tolerance="0.00001")  # -> Result, FailedInfo
assert_point_list_123 = AssertPointList(
    TestName="CurveSpacingMilimeters_Count_Mesh",
    ExpectedPointList=demesh_200.Vertices,
    ActualPointList=demesh_220.Vertices,
    Tolerance="0.00001")  # -> Result, FailedInfo
demesh_228 = DeconstructMesh(Mesh=curve_spacing_20.Mesh)  # -> flatten(Vertices), Faces, Colours, Normals
assert_point_list_124 = AssertPointList(
    TestName="CurveSpacingMilimeters_RotationAnglesRadius_Mesh",
    ExpectedPointList=demesh_201.Vertices,
    ActualPointList=demesh_221.Vertices,
    Tolerance="0.00001")  # -> Result, FailedInfo
demesh_229 = DeconstructMesh(Mesh=curve_spacing_19.Mesh)  # -> flatten(Vertices), Faces, Colours, Normals
assert_point_list_125 = AssertPointList(
    TestName="CurveSpacingMilimeters_RotationAnglesDegrees_Mesh",
    ExpectedPointList=demesh_202.Vertices,
    ActualPointList=demesh_222.Vertices,
    Tolerance="0.00001")  # -> Result, FailedInfo
assert_point_list_126 = AssertPointList(
    TestName="CurveSpacingMilimeters_Nurbs_Mesh",
    ExpectedPointList=demesh_203.Vertices,
    ActualPointList=demesh_223.Vertices,
    Tolerance="0.00001")  # -> Result, FailedInfo
demesh_230 = DeconstructMesh(Mesh=curve_spacing_24.Mesh)  # -> flatten(Vertices), Faces, Colours, Normals
assert_point_list_127 = AssertPointList(
    TestName="CurveSpacingMilimeters_CurveLength_Mesh",
    ExpectedPointList=demesh_204.Vertices,
    ActualPointList=demesh_224.Vertices,
    Tolerance="0.00001")  # -> Result, FailedInfo
assert_point_list_128 = AssertPointList(
    TestName="CurveSpacingMilimeters_OpenPolyline_Mesh",
    ExpectedPointList=demesh_205.Vertices,
    ActualPointList=demesh_225.Vertices,
    Tolerance="0.00001")  # -> Result, FailedInfo
demesh_231 = DeconstructMesh(Mesh=curve_spacing_22.Mesh)  # -> flatten(Vertices), Faces, Colours, Normals
demesh_232 = DeconstructMesh(Mesh=curve_spacing_23.Mesh)  # -> flatten(Vertices), Faces, Colours, Normals
demesh_233 = DeconstructMesh(Mesh=curve_spacing_21.Mesh)  # -> flatten(Vertices), Faces, Colours, Normals
demesh_234 = DeconstructMesh(Mesh=curve_spacing_25.Mesh)  # -> flatten(Vertices), Faces, Colours, Normals
demesh_235 = DeconstructMesh(Mesh=curve_spacing_26.Mesh)  # -> flatten(Vertices), Faces, Colours, Normals
assert_point_list_129 = AssertPointList(
    TestName="CurveSpacingMilimeters_ClosedPolyline_Mesh",
    ExpectedPointList=demesh_206.Vertices,
    ActualPointList=demesh_226.Vertices,
    Tolerance="0.00001")  # -> Result, FailedInfo
demesh_236 = DeconstructMesh(Mesh=curve_spacing_27.Mesh)  # -> flatten(Vertices), Faces, Colours, Normals
assert_point_list_130 = AssertPointList(
    TestName="CurveSpacingMilimeters_ClosedCircle_Mesh",
    ExpectedPointList=demesh_207.Vertices,
    ActualPointList=demesh_227.Vertices,
    Tolerance="0.00001")  # -> Result, FailedInfo
demesh_237 = DeconstructMesh(Mesh=curve_spacing_28.Mesh)  # -> flatten(Vertices), Faces, Colours, Normals
assert_point_list_131 = AssertPointList(
    TestName="CurveSpacingMeters_Normal_Mesh",
    ExpectedPointList=demesh_209.Vertices,
    ActualPointList=demesh_229.Vertices,
    Tolerance="0.00001")  # -> Result, FailedInfo
assert_point_list_132 = AssertPointList(
    TestName="CurveSpacingMeters_CurveLength_Mesh",
    ExpectedPointList=demesh_210.Vertices,
    ActualPointList=demesh_230.Vertices,
    Tolerance="0.00001")  # -> Result, FailedInfo
assert_point_list_133 = AssertPointList(
    TestName="CurveSpacingMeters_Count_Mesh",
    ExpectedPointList=demesh_208.Vertices,
    ActualPointList=demesh_228.Vertices,
    Tolerance="0.00001")  # -> Result, FailedInfo
assert_point_list_134 = AssertPointList(
    TestName="CurveSpacingMeters_RotationAnglesRadius_Mesh",
    ExpectedPointList=demesh_211.Vertices,
    ActualPointList=demesh_231.Vertices,
    Tolerance="0.00001")  # -> Result, FailedInfo
assert_point_list_135 = AssertPointList(
    TestName="CurveSpacingMeters_RotationAnglesDegrees_Mesh",
    ExpectedPointList=demesh_212.Vertices,
    ActualPointList=demesh_232.Vertices,
    Tolerance="0.00001")  # -> Result, FailedInfo
assert_point_list_136 = AssertPointList(
    TestName="CurveSpacingMeters_Nurbs_Mesh",
    ExpectedPointList=demesh_213.Vertices,
    ActualPointList=demesh_233.Vertices,
    Tolerance="0.00001")  # -> Result, FailedInfo
assert_point_list_137 = AssertPointList(
    TestName="CurveSpacingMeters_OpenPolyline_Mesh",
    ExpectedPointList=demesh_214.Vertices,
    ActualPointList=demesh_234.Vertices,
    Tolerance="0.00001")  # -> Result, FailedInfo
assert_point_list_138 = AssertPointList(
    TestName="CurveSpacingMeters_Diameter_Mesh",
    ExpectedPointList=demesh_215.Vertices,
    ActualPointList=demesh_235.Vertices,
    Tolerance="0.00001")  # -> Result, FailedInfo
assert_point_list_139 = AssertPointList(
    TestName="CurveSpacingMeters_ClosedPolyline_Mesh",
    ExpectedPointList=demesh_216.Vertices,
    ActualPointList=demesh_236.Vertices,
    Tolerance="0.00001")  # -> Result, FailedInfo
assert_point_list_140 = AssertPointList(
    TestName="CurveSpacingMeters_ClosedCircle_Mesh",
    ExpectedPointList=demesh_217.Vertices,
    ActualPointList=demesh_237.Vertices,
    Tolerance="0.00001")  # -> Result, FailedInfo
entwine_19 = Entwine(
    Branch00=assert_point_list_121.Result,
    Branch01=assert_point_list_122.Result,
    Branch02=assert_22.Result,
    Branch03=assert_point_list_127.Result,
    Branch04=assert_point_list_123.Result,
    Branch05=assert_point_list_125.Result,
    Branch06=assert_point_list_124.Result,
    Branch07=assert_point_list_126.Result,
    Branch08=assert_point_list_128.Result,
    Branch09=assert_point_list_129.Result,
    Branch010=assert_point_list_130.Result,
    Branch011=assert_point_list_114.Result,
    Branch012=assert_point_list_115.Result,
    Branch013=assert_point_list_116.Result,
    FlattenInputs=True)  # -> flatten(Result)
entwine_20 = Entwine(
    Branch00=assert_point_list_131.Result,
    Branch01=assert_point_list_138.Result,
    Branch02=assert_point_list_132.Result,
    Branch03=assert_point_list_133.Result,
    Branch04=assert_point_list_135.Result,
    Branch05=assert_point_list_134.Result,
    Branch06=assert_point_list_136.Result,
    Branch07=assert_point_list_137.Result,
    Branch08=assert_point_list_139.Result,
    Branch09=assert_point_list_140.Result,
    Branch010=assert_point_list_117.Result,
    Branch011=assert_point_list_118.Result,
    Branch012=assert_point_list_119.Result,
    Branch013=assert_point_list_120.Result,
    FlattenInputs=True)  # -> flatten(Result)

# ----
# Rebar Group Info
number_slider_32 = Slider(7850, range=0..10000)
division_90 = Division(A=number_slider_32, B="1e9")
division_91 = Division(A=Slider(7850, range=0..10000), B="1e9")
division_92 = Division(A=Slider(7850, range=0..10000), B="1e9")
division_93 = Division(A=Slider(7850, range=0..10000), B="1e9")
material_146 = Material(Name="Steel", Grade="Grade", Density=division_90)
division_94 = Division(A=Slider(7850, range=0..10000), B="1e9")
division_95 = Division(A=Slider(7850, range=0..10000), B="1e9")
division_96 = Division(A=Slider(8000, range=0..10000), B="1e9")
material_147 = Material(Name="Steel", Grade="Grade", Density=division_91)
material_148 = Material(Name="Steel", Grade="Grade", Density=division_92)
division_97 = Division(A=Slider(7850, range=0..10000), B="1e9")
division_98 = Division(A=Slider(7850, range=0..10000), B="1e9")
material_149 = Material(Name="Steel", Grade="Grade", Density=division_93)
material_150 = Material(Name="Steel", Grade="Grade", Density=division_94)
division_99 = Division(A=Slider(7850, range=0..10000), B="1e9")
division_100 = Division(A=Slider(7850, range=0..10000), B="1e9")
division_101 = Division(A=Slider(7850, range=0..10000), B="1e9")
material_151 = Material(Name="Steel2", Grade="Grade3", Density=division_96)
pt_255 = ConstructPoint(XCoordinate=0, YCoordinate=0, ZCoordinate=0)
material_152 = Material(Name="Steel", Grade="Grade", Density=division_95)
pt_256 = ConstructPoint(XCoordinate=Slider(1000, range=0..1000), YCoordinate=0, ZCoordinate=0)
division_102 = Division(A=Slider(7850, range=0..10000), B="1e9")
division_103 = Division(A=Slider(7850, range=0..10000), B="1e9")
pt_257 = ConstructPoint(XCoordinate=0, YCoordinate=0, ZCoordinate=0)
pt_258 = ConstructPoint(XCoordinate=Slider(1000, range=0..1000), YCoordinate=0, ZCoordinate=0)
division_104 = Division(A=Slider(7850, range=0..10000), B="1e9")
division_105 = Division(A=Slider(7850, range=0..10000), B="1e9")
division_106 = Division(A=Slider(7850, range=0..10000), B="1e9")
pt_259 = ConstructPoint(XCoordinate=0, YCoordinate=0, ZCoordinate=0)
pt_260 = ConstructPoint(XCoordinate=Slider(1000, range=0..1000), YCoordinate=0, ZCoordinate=0)
material_153 = Material(Name="Steel", Grade="Grade", Density=division_97)
division_107 = Division(A=Slider(7850, range=0..10000), B="1e9")
material_154 = Material(Name="Steel", Grade="Grade", Density=division_98)
material_155 = Material(Name="Steel", Grade="Grade", Density=division_101)
material_156 = Material(Name="Steel", Grade="Grade", Density=division_99)
rebar_properties_138 = RebarProperties(Diameter="10", Material=material_146)
material_157 = Material(Name="Steel", Grade="Grade", Density=division_100)
pt_261 = ConstructPoint(XCoordinate=0, YCoordinate=0, ZCoordinate=0)
pt_262 = ConstructPoint(XCoordinate=Slider(100, range=0..1000), YCoordinate=0, ZCoordinate=0)
material_158 = Material(Name="Steel", Grade="Grade", Density=division_102)
pt_263 = ConstructPoint(XCoordinate=0, YCoordinate=0, ZCoordinate=0)
ln_90 = Line(StartPoint=pt_255, EndPoint=pt_256)
pt_264 = ConstructPoint(XCoordinate=Slider(1000, range=0..1000), YCoordinate=0, ZCoordinate=0)
pt_265 = ConstructPoint(XCoordinate=0, YCoordinate=0, ZCoordinate=0)
material_159 = Material(Name="Steel", Grade="Grade", Density=division_103)
pt_266 = ConstructPoint(XCoordinate=Slider(500, range=0..1000), YCoordinate=0, ZCoordinate=0)
rebar_properties_139 = RebarProperties(Diameter="12", Material=material_147)
nurbs_9 = NurbsCurve(
    Vertices=[Point(1.758094, 9.996640324, 0), Point(341.1789777, 439.0758707, 0), Point(842.8387744, 195.7175012, 0), Point(407.3553764, -88.20059647, 0)],
    Degree=3,
    Periodic=False)  # -> Curve, Length, Domain
material_160 = Material(Name="Steel", Grade="Grade", Density=division_104)
rebar_properties_140 = RebarProperties(Diameter="10", Material=material_148)
ln_91 = Line(StartPoint=pt_257, EndPoint=pt_258)
material_161 = Material(Name="Steel", Grade="Grade", Density=division_105)
nurbs_10 = NurbsCurve(
    Vertices=[Point(386.008151, -92.47004155, 0), Point(1113.948537, 135.9452701, 0), Point(620.8276303, 603.4495062, 0), Point(294.2150818, 490.3092116, 0), Point(785.2012658, -173.589498, 0), Point(1113.948537, 554.3508878, 0), Point(1476.851368, 319.5314085, 0)],
    Degree=3,
    Periodic=False)  # -> Curve, Length, Domain
material_162 = Material(Name="Steel", Grade="Grade", Density=division_106)
ln_92 = Line(StartPoint=pt_259, EndPoint=pt_260)
pt_267 = ConstructPoint(XCoordinate=0, YCoordinate=0, ZCoordinate=0)
pt_268 = ConstructPoint(XCoordinate=Slider(500, range=0..1000), YCoordinate=0, ZCoordinate=0)
pt_269 = ConstructPoint(XCoordinate=0, YCoordinate=0, ZCoordinate=0)
pt_270 = ConstructPoint(XCoordinate=Slider(1000, range=0..1000), YCoordinate=0, ZCoordinate=0)
material_163 = Material(Name="Steel", Grade="Grade", Density=division_107)
rebar_properties_141 = RebarProperties(Diameter="12", Material=material_149)
rebar_properties_142 = RebarProperties(Diameter="10", Material=material_150)
rebar_properties_143 = RebarProperties(Diameter="10", Material=material_151)
ln_93 = Line(StartPoint=pt_261, EndPoint=pt_262)
rebar_properties_144 = RebarProperties(Diameter="12", Material=material_152)
pt_271 = ConstructPoint(XCoordinate=0, YCoordinate=0, ZCoordinate=0)
pt_272 = ConstructPoint(XCoordinate=Slider(500, range=0..1000), YCoordinate=0, ZCoordinate=0)
ln_94 = Line(StartPoint=pt_263, EndPoint=pt_264)
ln_95 = Line(StartPoint=pt_265, EndPoint=pt_266)
pt_273 = ConstructPoint(XCoordinate=0, YCoordinate=0, ZCoordinate=0)
pt_274 = ConstructPoint(XCoordinate=Slider(500, range=0..1000), YCoordinate=0, ZCoordinate=0)
pt_275 = ConstructPoint(XCoordinate=0, YCoordinate=0, ZCoordinate=0)
pt_276 = ConstructPoint(XCoordinate=Slider(500, range=0..1000), YCoordinate=0, ZCoordinate=0)
rebar_properties_145 = RebarProperties(Diameter="10", Material=material_153)
division_108 = Division(A=Slider(7850, range=0..10000), B="1e9")
curve_to_rebar_shape_76 = CurveToRebarShape(Curve=ln_90, Properties=rebar_properties_138)  # -> RebarShape, Mesh
pt_277 = ConstructPoint(XCoordinate=0, YCoordinate=0, ZCoordinate=0)
pt_278 = ConstructPoint(XCoordinate=Slider(500, range=0..1000), YCoordinate=0, ZCoordinate=0)
ln_96 = Line(StartPoint=pt_267, EndPoint=pt_268)
pt_279 = ConstructPoint(XCoordinate=0, YCoordinate=0, ZCoordinate=0)
ln_97 = Line(StartPoint=pt_269, EndPoint=pt_270)
pt_280 = ConstructPoint(XCoordinate=Slider(500, range=0..1000), YCoordinate=0, ZCoordinate=0)
material_164 = Material(Name="Steel", Grade="Grade", Density=Slider(7850, range=0..10000))
number_slider_33 = Slider(500, range=0..1000)
curve_to_rebar_shape_77 = CurveToRebarShape(Curve=ln_91, Properties=rebar_properties_139)  # -> RebarShape, Mesh
rebar_properties_146 = RebarProperties(Diameter="12", Material=material_154)
division_109 = Division(A=Slider(7850, range=0..10000), B="1e9")
pt_281 = ConstructPoint(XCoordinate=0, YCoordinate=0, ZCoordinate=0)
pt_282 = ConstructPoint(XCoordinate=Slider(500, range=0..1000), YCoordinate=0, ZCoordinate=0)
pt_283 = ConstructPoint(XCoordinate=0, YCoordinate=0, ZCoordinate=0)
curve_to_rebar_shape_78 = CurveToRebarShape(Curve=ln_92, Properties=rebar_properties_140)  # -> RebarShape, Mesh
pt_284 = ConstructPoint(XCoordinate=Slider(500, range=0..1000), YCoordinate=0, ZCoordinate=0)
material_165 = Material(Name="Steel", Grade="Grade", Density=Slider(7850, range=0..10000))
rebar_properties_147 = RebarProperties(Diameter="10", Material=material_155)
division_110 = Division(A=Slider(7850, range=0..10000), B="1e9")
nurbs_11 = NurbsCurve(
    Vertices=[Point(1.758094, 9.996640324, 0), Point(341.1789777, 439.0758707, 0), Point(842.8387744, 195.7175012, 0), Point(407.3553764, -88.20059647, 0)],
    Degree=3,
    Periodic=False)  # -> Curve, Length, Domain
pt_285 = ConstructPoint(XCoordinate=0, YCoordinate=0, ZCoordinate=0)
rebar_properties_148 = RebarProperties(Diameter="12", Material=material_156)
material_166 = Material(Name="Steel", Grade="Grade", Density=Slider(7850, range=0..10000))
pt_286 = ConstructPoint(XCoordinate=Slider(500, range=0..1000), YCoordinate=0, ZCoordinate=0)
rebar_properties_149 = RebarProperties(Diameter="12", Material=material_157)
rebar_properties_150 = RebarProperties(Diameter="12", Material=material_158)
division_111 = Division(A=Slider(7850, range=0..10000), B="1e9")
rebar_properties_151 = RebarProperties(Diameter="12", Material=material_159)
rebar_properties_152 = RebarProperties(Diameter="10", Material=material_160)
ln_98 = Line(StartPoint=pt_271, EndPoint=pt_272)
pipe = Pipe(Curve=ln_98, Radius=expr("X/2", "12"), Caps=1)
material_167 = Material(Name="Steel", Grade="Grade", Density=division_108)
rebar_properties_153 = RebarProperties(Diameter="12", Material=material_161)
rebar_properties_154 = RebarProperties(Diameter="12", Material=material_162)
curve_to_rebar_shape_79 = CurveToRebarShape(Curve=ln_93, Properties=rebar_properties_142)  # -> RebarShape, Mesh
ln_99 = Line(StartPoint=pt_273, EndPoint=pt_274)
ln_100 = Line(StartPoint=pt_275, EndPoint=pt_276)
rebar_properties_155 = RebarProperties(Diameter="12", Material=material_163)
material_168 = Material(Name="Steel", Grade="Grade", Density=Slider(7850, range=0..10000))
curve_to_rebar_shape_80 = CurveToRebarShape(Curve=ln_94, Properties=rebar_properties_143)  # -> RebarShape, Mesh
curve_to_rebar_shape_81 = CurveToRebarShape(Curve=ln_95, Properties=rebar_properties_141)  # -> RebarShape, Mesh
ln_101 = Line(StartPoint=pt_277, EndPoint=pt_278)
material_169 = Material(Name="Steel", Grade="Grade", Density=Slider(7850, range=0..10000))
material_170 = Material(Name="Steel", Grade="Grade", Density=division_109)
ln_102 = Line(StartPoint=pt_279, EndPoint=pt_280)
material_171 = Material(Name="Steel2", Grade="Grade3", Density=Slider(8000, range=0..10000))
pt_287 = ConstructPoint(XCoordinate=0, YCoordinate=0, ZCoordinate=0)
pt_288 = ConstructPoint(XCoordinate=Slider(1, range=0..1), YCoordinate=0, ZCoordinate=0)
material_172 = Material(Name="Steel", Grade="Grade", Density=division_110)
ln_103 = Line(StartPoint=pt_281, EndPoint=pt_282)
ln_104 = Line(StartPoint=pt_283, EndPoint=pt_284)
curve_to_rebar_shape_82 = CurveToRebarShape(Curve=ln_96, Properties=rebar_properties_144)  # -> RebarShape, Mesh
pt_289 = ConstructPoint(XCoordinate=0, YCoordinate=0, ZCoordinate=0)
vec_35 = VectorXYZ(XComponent=0, YComponent=Slider(1000, range=0..1000), ZComponent=0)  # -> Vector, Length
curve_to_rebar_shape_83 = CurveToRebarShape(Curve=ln_97, Properties=rebar_properties_145)  # -> RebarShape, Mesh
pt_290 = ConstructPoint(XCoordinate=Slider(1, range=0..1), YCoordinate=0, ZCoordinate=0)
material_173 = Material(Name="Steel", Grade="Grade", Density=division_111)
ln_105 = Line(StartPoint=pt_285, EndPoint=pt_286)
pt_291 = ConstructPoint(XCoordinate=0, YCoordinate=0, ZCoordinate=0)
pt_292 = ConstructPoint(XCoordinate=Slider(1, range=0..1), YCoordinate=0, ZCoordinate=0)
material_174 = Material(Name="Steel", Grade="Grade", Density=Slider(7850, range=0..10000))
nurbs_12 = NurbsCurve(
    Vertices=[Point(386.008151, -92.47004155, 0), Point(1113.948537, 135.9452701, 0), Point(620.8276303, 603.4495062, 0), Point(294.2150818, 490.3092116, 0), Point(785.2012658, -173.589498, 0), Point(1113.948537, 554.3508878, 0), Point(1476.851368, 319.5314085, 0)],
    Degree=3,
    Periodic=False)  # -> Curve, Length, Domain
curve_to_rebar_shape_84 = CurveToRebarShape(Curve=nurbs_10.Curve, Properties=rebar_properties_152)  # -> RebarShape, Mesh
material_175 = Material(Name="Steel", Grade="Grade", Density=Slider(7850, range=0..10000))
vec_36 = VectorXYZ(XComponent=0, YComponent=Slider(1000, range=0..1000), ZComponent=0)  # -> Vector, Length
material_176 = Material(Name="Steel", Grade="Grade", Density=Slider(7850, range=0..10000))
pipe_2 = Pipe(Curve=ln_99, Radius=expr("X/2", "12"), Caps=1)
pipe_3 = Pipe(Curve=ln_100, Radius=expr("X/2", "12"), Caps=1)
volume = Volume(Geometry=pipe)  # -> Volume, Centroid
vec_37 = VectorXYZ(XComponent=0, YComponent=Slider(1000, range=0..1000), ZComponent=0)  # -> Vector, Length
pipe_4 = Pipe(Curve=ln_95, Radius=expr("X/2", "12"), Caps=1)
pipe_5 = Pipe(Curve=ln_101, Radius=expr("X/2", "12"), Caps=1)
material_177 = Material(Name="Steel", Grade="Grade", Density=Slider(7850, range=0..10000))
curve_to_rebar_shape_85 = CurveToRebarShape(Curve=nurbs_9.Curve, Properties=rebar_properties_147)  # -> RebarShape, Mesh
pt_293 = ConstructPoint(XCoordinate=0, YCoordinate=0, ZCoordinate=0)
pt_294 = ConstructPoint(XCoordinate=Slider(500, range=0..1000), YCoordinate=0, ZCoordinate=0)
division_112 = Division(A=Slider(7850, range=0..10000), B="1e9")
pt_295 = ConstructPoint(XCoordinate=0, YCoordinate=0, ZCoordinate=0)
pt_296 = ConstructPoint(XCoordinate=0, YCoordinate=0, ZCoordinate=0)
pipe_6 = Pipe(Curve=ln_102, Radius=expr("X/2", "12"), Caps=1)
pt_297 = ConstructPoint(XCoordinate=Slider(500, range=0..1000), YCoordinate=0, ZCoordinate=0)
pt_298 = ConstructPoint(XCoordinate=0, YCoordinate=Slider(500, range=0..1000), ZCoordinate=0)
material_178 = Material(Name="Steel", Grade="Grade", Density=Slider(7850, range=0..10000))
curve_to_rebar_shape_86 = CurveToRebarShape(Curve=ln_98, Properties=rebar_properties_146)  # -> RebarShape, Mesh
material_179 = Material(Name="Steel", Grade="Grade", Density=Slider(7850, range=0..10000))
rebar_properties_156 = RebarProperties(Diameter="0.010", Material=material_164)
material_180 = Material(Name="Steel", Grade="Grade", Density=Slider(7850, range=0..10000))
panel_34 = Panel("""Material
Name: Steel
Grade: Grade
Density: 7.85E-06""")
pt_299 = ConstructPoint(XCoordinate=0, YCoordinate=0, ZCoordinate=0)
pt_300 = ConstructPoint(XCoordinate=Slider(0.1, range=0..0.1), YCoordinate=0, ZCoordinate=0)
scale = Scale(Geometry=nurbs_11.Curve, Center=Point(0, 0, 0), Factor=Slider(0.001, range=0..0.001))  # -> Geometry, Transform
pipe_7 = Pipe(Curve=ln_103, Radius=expr("X/2", "12"), Caps=1)
pipe_8 = Pipe(Curve=ln_104, Radius=expr("X/2", "12"), Caps=1)
pipe_9 = Pipe(Curve=ln_96, Radius=expr("X/2", "12"), Caps=1)
pt_301 = ConstructPoint(XCoordinate=0, YCoordinate=0, ZCoordinate=0)
material_181 = Material(Name="Steel", Grade="Grade", Density=Slider(7850, range=0..10000))
pt_302 = ConstructPoint(XCoordinate=Slider(500, range=0..1000), YCoordinate=0, ZCoordinate=0)
pt_303 = ConstructPoint(XCoordinate=0, YCoordinate=0, ZCoordinate=0)
pt_304 = ConstructPoint(XCoordinate=Slider(500, range=0..1000), YCoordinate=0, ZCoordinate=0)
pt_305 = ConstructPoint(XCoordinate=number_slider_33, YCoordinate=number_slider_33, ZCoordinate=0)
pt_306 = ConstructPoint(XCoordinate=0, YCoordinate=Slider(500, range=0..1000), ZCoordinate=0)
pt_307 = ConstructPoint(XCoordinate=0, YCoordinate=0, ZCoordinate=0)
pt_308 = ConstructPoint(XCoordinate=0, YCoordinate=0, ZCoordinate=0)
pt_309 = ConstructPoint(XCoordinate=0, YCoordinate=0, ZCoordinate=0)
ln_106 = Line(StartPoint=pt_287, EndPoint=pt_288)
pt_310 = ConstructPoint(XCoordinate=Slider(1, range=0..1), YCoordinate=0, ZCoordinate=0)
curve_to_rebar_shape_87 = CurveToRebarShape(Curve=ln_99, Properties=rebar_properties_148)  # -> RebarShape, Mesh
division_113 = Division(A=Slider(7850, range=0..10000), B="1e9")
pipe_10 = Pipe(Curve=ln_105, Radius=expr("X/2", "12"), Caps=1)
curve_to_rebar_shape_88 = CurveToRebarShape(Curve=ln_100, Properties=rebar_properties_149)  # -> RebarShape, Mesh
material_182 = Material(Name="Steel", Grade="Grade", Density=Slider(7850, range=0..10000))
rebar_properties_157 = RebarProperties(Diameter="0.012", Material=material_165)
vec_38 = VectorXYZ(XComponent=0, YComponent=Slider(1000, range=0..1000), ZComponent=0)  # -> Vector, Length
material_183 = Material(Name="Steel", Grade="Grade", Density=Slider(7850, range=0..10000))
panel_35 = Panel("""Material
Name: Steel
Grade: Grade
Density: 7.85E-06""")
curve_to_rebar_shape_89 = CurveToRebarShape(Curve=ln_101, Properties=rebar_properties_150)  # -> RebarShape, Mesh
rebar_properties_158 = RebarProperties(Diameter="0.010", Material=material_166)
rebar_properties_159 = RebarProperties(Diameter="12", Material=material_167)
material_184 = Material(Name="Steel", Grade="Grade", Density=Slider(7850, range=0..10000))
vec_39 = VectorXYZ(XComponent=0, YComponent=Slider(1000, range=0..1000), ZComponent=0)  # -> Vector, Length
vector_count_spacing_12 = VectorCountSpacing(Id="0", RebarShape=curve_to_rebar_shape_76.RebarShape, Vector=vec_35.Vector, Count=Slider(10, range=0..100))  # -> RebarGroup, Mesh, Curve
ln_107 = Line(StartPoint=pt_289, EndPoint=pt_290)
curve_to_rebar_shape_90 = CurveToRebarShape(Curve=ln_102, Properties=rebar_properties_151)  # -> RebarShape, Mesh
material_185 = Material(Name="Steel", Grade="Grade", Density=Slider(7850, range=0..10000))
panel_36 = Panel("""Material
Name: Steel
Grade: Grade
Density: 7.85E-06""")
material_186 = Material(Name="Steel", Grade="Grade", Density=Slider(7850, range=0..10000))
pt_311 = ConstructPoint(XCoordinate=0, YCoordinate=0, ZCoordinate=0)
pt_312 = ConstructPoint(XCoordinate=Slider(0.5, range=0..1), YCoordinate=0, ZCoordinate=0)
ln_108 = Line(StartPoint=pt_291, EndPoint=pt_292)
nurbs_13 = NurbsCurve(
    Vertices=[Point(1.758094, 9.996640324, 0), Point(341.1789777, 439.0758707, 0), Point(842.8387744, 195.7175012, 0), Point(407.3553764, -88.20059647, 0)],
    Degree=3,
    Periodic=False)  # -> Curve, Length, Domain
pt_313 = ConstructPoint(XCoordinate=0, YCoordinate=0, ZCoordinate=0)
pt_314 = ConstructPoint(XCoordinate=Slider(1, range=0..1), YCoordinate=0, ZCoordinate=0)
material_187 = Material(Name="Steel", Grade="Grade", Density=Slider(7850, range=0..10000))
volume_2 = Volume(Geometry=pipe_2)  # -> Volume, Centroid
curve_to_rebar_shape_91 = CurveToRebarShape(Curve=ln_103, Properties=rebar_properties_153)  # -> RebarShape, Mesh
volume_3 = Volume(Geometry=pipe_3)  # -> Volume, Centroid
vector_count_spacing_13 = VectorCountSpacing(Id="0", RebarShape=curve_to_rebar_shape_77.RebarShape, Vector=vec_36.Vector, Count=Slider(10, range=0..100))  # -> RebarGroup, Mesh, Curve
curve_to_rebar_shape_92 = CurveToRebarShape(Curve=ln_104, Properties=rebar_properties_154)  # -> RebarShape, Mesh
material_188 = Material(Name="Steel", Grade="Grade", Density=division_112)
pt_315 = ConstructPoint(XCoordinate=0, YCoordinate=0, ZCoordinate=0)
pt_316 = ConstructPoint(XCoordinate=Slider(0.5, range=0..1), YCoordinate=0, ZCoordinate=0)
rebar_properties_160 = RebarProperties(Diameter="12", Material=material_170)
pt_317 = ConstructPoint(XCoordinate=0, YCoordinate=0, ZCoordinate=0)
volume_4 = Volume(Geometry=pipe_4)  # -> Volume, Centroid
vector_count_spacing_14 = VectorCountSpacing(Id="1", RebarShape=curve_to_rebar_shape_78.RebarShape, Vector=vec_37.Vector, Count=Slider(10, range=0..100))  # -> RebarGroup, Mesh, Curve
pt_318 = ConstructPoint(XCoordinate=0, YCoordinate=Slider(500, range=0..1000), ZCoordinate=0)
volume_5 = Volume(Geometry=pipe_5)  # -> Volume, Centroid
curve_to_rebar_shape_93 = CurveToRebarShape(Curve=ln_105, Properties=rebar_properties_155)  # -> RebarShape, Mesh
vec_40 = VectorXYZ(XComponent=0, YComponent=Slider(1000, range=0..1000), ZComponent=0)  # -> Vector, Length
rebar_properties_161 = RebarProperties(Diameter="12", Material=material_172)
volume_6 = Volume(Geometry=pipe_6)  # -> Volume, Centroid
ln_109 = Line(StartPoint=pt_293, EndPoint=pt_294)
pt_319 = ConstructPoint(XCoordinate=0, YCoordinate=0, ZCoordinate=0)
ln_110 = Line(StartPoint=pt_295, EndPoint=pt_297)
pt_320 = ConstructPoint(XCoordinate=Slider(0.5, range=0..1), YCoordinate=0, ZCoordinate=0)
ln_111 = Line(StartPoint=pt_296, EndPoint=pt_298)
rebar_properties_162 = RebarProperties(Diameter="0.010", Material=material_168)
multiplication_5 = Multiplication(A=volume.Volume, B="11")
scale_2 = Scale(Geometry=nurbs_12.Curve, Center=Point(0, 0, 0), Factor=Slider(0.001, range=0..0.001))  # -> Geometry, Transform
panel_37 = Panel("""Material
Name: Steel
Grade: Grade
Density: 7.85E-06""")
volume_7 = Volume(Geometry=pipe_7)  # -> Volume, Centroid
rebar_properties_163 = RebarProperties(Diameter="0.012", Material=material_169)
material_189 = Material(Name="Steel", Grade="Grade", Density=division_113)
volume_8 = Volume(Geometry=pipe_8)  # -> Volume, Centroid
volume_9 = Volume(Geometry=pipe_9)  # -> Volume, Centroid
rebar_properties_164 = RebarProperties(Diameter="0.010", Material=material_171)
rebar_properties_165 = RebarProperties(Diameter="12", Material=material_173)
ln_112 = Line(StartPoint=pt_299, EndPoint=pt_300)
panel_38 = Panel("""Material
Name: Steel2
Grade: Grade3
Density: 8E-06""")
volume_10 = Volume(Geometry=pipe_10)  # -> Volume, Centroid
pt_321 = ConstructPoint(XCoordinate=0, YCoordinate=0, ZCoordinate=0)
pt_322 = ConstructPoint(XCoordinate=Slider(0.5, range=0..1), YCoordinate=0, ZCoordinate=0)
ln_113 = Line(StartPoint=pt_301, EndPoint=pt_302)
ln_114 = Line(StartPoint=pt_308, EndPoint=pt_305)
ln_115 = Line(StartPoint=pt_309, EndPoint=pt_306)
vec_41 = VectorXYZ(XComponent=0, YComponent=Slider(1000, range=0..1000), ZComponent=0)  # -> Vector, Length
ln_116 = Line(StartPoint=pt_307, EndPoint=pt_310)
rebar_properties_166 = RebarProperties(Diameter="0.012", Material=material_176)
vector_count_spacing_15 = VectorCountSpacing(Id="0", RebarShape=curve_to_rebar_shape_79.RebarShape, Vector=vec_38.Vector, Count=Slider(10, range=0..100))  # -> RebarGroup, Mesh, Curve
scale_3 = Scale(Geometry=nurbs_13.Curve, Center=Point(0, 0, 0), Factor=0.001)  # -> Geometry, Transform
ln_117 = Line(StartPoint=pt_303, EndPoint=pt_304)
pt_323 = ConstructPoint(XCoordinate=0, YCoordinate=0, ZCoordinate=0)
pt_324 = ConstructPoint(XCoordinate=Slider(0.5, range=0..1), YCoordinate=0, ZCoordinate=0)
pt_325 = ConstructPoint(XCoordinate=0, YCoordinate=0, ZCoordinate=0)
pt_326 = ConstructPoint(XCoordinate=Slider(0.5, range=0..1), YCoordinate=0, ZCoordinate=0)
rebar_properties_167 = RebarProperties(Diameter="0.010", Material=material_174)
vector_count_spacing_16 = VectorCountSpacing(Id="0", RebarShape=curve_to_rebar_shape_80.RebarShape, Vector=vec_39.Vector, Count=Slider(10, range=0..100))  # -> RebarGroup, Mesh, Curve
rebar_properties_168 = RebarProperties(Diameter="0.012", Material=material_175)
panel_39 = Panel("""Material
Name: Steel
Grade: Grade
Density: 7.85E-06""")
curve_to_rebar_shape_94 = CurveToRebarShape(Curve=ln_106, Properties=rebar_properties_156)  # -> RebarShape, Mesh
ln_118 = Line(StartPoint=pt_311, EndPoint=pt_312)
pt_327 = ConstructPoint(XCoordinate=0, YCoordinate=0, ZCoordinate=0)
pt_328 = ConstructPoint(XCoordinate=Slider(0.5, range=0..1), YCoordinate=0, ZCoordinate=0)
vec_42 = VectorXYZ(XComponent=0, YComponent=Slider(1000, range=0..1000), ZComponent=0)  # -> Vector, Length
vec_43 = VectorXYZ(XComponent=0, YComponent=Slider(1000, range=0..1000), ZComponent=0)  # -> Vector, Length
pt_329 = ConstructPoint(XCoordinate=0, YCoordinate=0, ZCoordinate=0)
ln_119 = Line(StartPoint=pt_313, EndPoint=pt_314)
pt_330 = ConstructPoint(XCoordinate=Slider(0.5, range=0..1), YCoordinate=0, ZCoordinate=0)
cir_5 = Circle(Plane=PlaneXY(0, 0, 0), Radius=Slider(500, range=0..1000))
curve_to_rebar_shape_95 = CurveToRebarShape(Curve=ln_107, Properties=rebar_properties_157)  # -> RebarShape, Mesh
ln_120 = Line(StartPoint=pt_315, EndPoint=pt_316)
rebar_properties_169 = RebarProperties(Diameter="0.012", Material=material_177)
ln_121 = Line(StartPoint=pt_317, EndPoint=pt_318)
vec_44 = VectorXYZ(XComponent=0, YComponent=Slider(1000, range=0..1000), ZComponent=0)  # -> Vector, Length
pt_331 = ConstructPoint(XCoordinate=0, YCoordinate=0, ZCoordinate=0)
vec_45 = VectorXYZ(XComponent=0, YComponent=Slider(1000, range=0..1000), ZComponent=0)  # -> Vector, Length
series = Series(Start=0, Step=Slider(1, range=0..1000), Count=Slider(200, range=0..100000))
pt_332 = ConstructPoint(XCoordinate=Slider(0.5, range=0..1), YCoordinate=0, ZCoordinate=0)
pt_333 = ConstructPoint(XCoordinate=0, YCoordinate=0, ZCoordinate=0)
vector_count_spacing_17 = VectorCountSpacing(Id="0", RebarShape=curve_to_rebar_shape_83.RebarShape, Vector=vec_40.Vector, Count=Slider(100000, range=0..100000))  # -> RebarGroup, Mesh, Curve
curve_to_rebar_shape_96 = CurveToRebarShape(Curve=ln_108, Properties=rebar_properties_158)  # -> RebarShape, Mesh
pt_334 = ConstructPoint(XCoordinate=Slider(0.5, range=0..1), YCoordinate=0, ZCoordinate=0)
multiplication_6 = Multiplication(A=volume_2.Volume, B="11")
rebar_properties_170 = RebarProperties(Diameter="0.010", Material=material_178)
multiplication_7 = Multiplication(A=volume_3.Volume, B="11")
panel_40 = Panel("""Material
Name: Steel
Grade: Grade
Density: 7.85E-06""")
vec_46 = VectorXYZ(XComponent=0, YComponent=Slider(1000, range=0..1000), ZComponent=0)  # -> Vector, Length
pt_335 = ConstructPoint(XCoordinate=0, YCoordinate=0, ZCoordinate=0)
rebar_properties_171 = RebarProperties(Diameter="0.012", Material=material_179)
ln_122 = Line(StartPoint=pt_319, EndPoint=pt_320)
pt_336 = ConstructPoint(XCoordinate=Slider(0.5, range=0..1), YCoordinate=0, ZCoordinate=0)
rebar_properties_172 = RebarProperties(Diameter="0.012", Material=material_180)
multiplication_8 = Multiplication(A=volume_4.Volume, B="10")
vec_47 = VectorXYZ(XComponent=0, YComponent=Slider(1000, range=0..1000), ZComponent=0)  # -> Vector, Length
multiplication_9 = Multiplication(A=volume_5.Volume, B="11")
rebar_properties_173 = RebarProperties(Diameter="0.012", Material=material_184)
series_2 = Series(Start=0, Step=Slider(200, range=0..1000), Count=Slider(10, range=0..10))
multiplication_10 = Multiplication(A=volume_6.Volume, B="10")
rebar_properties_174 = RebarProperties(Diameter="0.012", Material=material_181)
rebar_properties_175 = RebarProperties(Diameter="0.012", Material=material_182)
curve_to_rebar_shape_97 = CurveToRebarShape(Curve=ln_109, Properties=rebar_properties_159)  # -> RebarShape, Mesh
vec_48 = VectorXYZ(XComponent=0, YComponent=Slider(1000, range=0..1000), ZComponent=0)  # -> Vector, Length
rebar_properties_176 = RebarProperties(Diameter="0.010", Material=material_183)
vec_49 = VectorXYZ(XComponent=0, YComponent=Slider(1000, range=0..1000), ZComponent=0)  # -> Vector, Length
ln_123 = Line(StartPoint=pt_321, EndPoint=pt_322)
vector_count_spacing_18 = VectorCountSpacing(Id="0", RebarShape=curve_to_rebar_shape_85.RebarShape, Vector=vec_41.Vector, Count=Slider(10, range=0..100))  # -> RebarGroup, Mesh, Curve
panel_41 = Panel("""Material
Name: Steel
Grade: Grade
Density: 7.85E-06""")
multiplication_11 = Multiplication(A=volume_7.Volume, B="11")
rebar_properties_177 = RebarProperties(Diameter="12", Material=material_188)
multiplication_12 = Multiplication(A=volume_8.Volume, B="10")
multiplication_13 = Multiplication(A=volume_9.Volume, B="10")
vec_50 = VectorXYZ(XComponent=0, YComponent=Slider(1000, range=0..1000), ZComponent=0)  # -> Vector, Length
rebar_properties_178 = RebarProperties(Diameter="0.012", Material=material_185)
rebar_properties_179 = RebarProperties(Diameter="0.012", Material=material_186)
curve_to_rebar_shape_98 = CurveToRebarShape(Curve=ln_112, Properties=rebar_properties_162)  # -> RebarShape, Mesh
multiplication_14 = Multiplication(A=volume_10.Volume, B="10")
ln_124 = Line(StartPoint=pt_323, EndPoint=pt_324)
ln_125 = Line(StartPoint=pt_325, EndPoint=pt_326)
series_3 = Series(Start=0, Step=Slider(1, range=0..1000), Count=Slider(200, range=0..100000))
curve_to_rebar_shape_99 = CurveToRebarShape(Curve=ln_113, Properties=rebar_properties_160)  # -> RebarShape, Mesh
rebar_properties_180 = RebarProperties(Diameter="0.012", Material=material_187)
curve_to_rebar_shape_100 = CurveToRebarShape(Curve=ln_116, Properties=rebar_properties_164)  # -> RebarShape, Mesh
ln_126 = Line(StartPoint=pt_327, EndPoint=pt_328)
entwine_21 = Entwine(
    Branch00="0",
    Branch01="10",
    Branch02="10",
    Branch03=panel_34,
    Branch04="785398.163",
    Branch05="6.165376",
    FlattenInputs=True)  # -> flatten(Result)
vector_count_spacing_19 = VectorCountSpacing(Id="0", RebarShape=curve_to_rebar_shape_84.RebarShape, Vector=vec_42.Vector, Count=Slider(10, range=0..100))  # -> RebarGroup, Mesh, Curve
Y = UnitY(Factor=series)
curve_to_rebar_shape_101 = CurveToRebarShape(Curve=[ln_110, ln_111], Properties=rebar_properties_161)  # -> RebarShape, Mesh
rebar_group_info = RebarGroupInfo(RebarGroup=vector_count_spacing_12.RebarGroup)  # -> Id, Diameter, Amount, Material, Volume, Weight
format_9 = Format(Format="{0:0}", Culture=127, Data0=multiplication_5)
ln_127 = Line(StartPoint=pt_329, EndPoint=pt_330)
rebar_properties_181 = RebarProperties(Diameter="12", Material=material_189)
vector_length_spacing_24 = VectorLengthSpacing(
    Id="0",
    RebarShape=curve_to_rebar_shape_86.RebarShape,
    Vector=vec_43.Vector,
    SpacingLength=Slider(100, range=0..1000),
    Type="0",
    Tolerance=0.0001)  # -> RebarGroup, Mesh, Curve
entwine_22 = Entwine(
    Branch00="0",
    Branch01="12",
    Branch02="10",
    Branch03=panel_35,
    Branch04="1130973.355",
    Branch05="8.878141",
    FlattenInputs=True)  # -> flatten(Result)
curve_to_rebar_shape_102 = CurveToRebarShape(Curve=ln_118, Properties=rebar_properties_163)  # -> RebarShape, Mesh
rebar_group_info_2 = RebarGroupInfo(RebarGroup=vector_count_spacing_13.RebarGroup)  # -> Id, Diameter, Amount, Material, Volume, Weight
vector_length_spacing_25 = VectorLengthSpacing(
    Id="0",
    RebarShape=curve_to_rebar_shape_87.RebarShape,
    Vector=vec_44.Vector,
    SpacingLength=Slider(100, range=0..1000),
    Type="2",
    Tolerance=0.0001)  # -> RebarGroup, Mesh, Curve
ln_128 = Line(StartPoint=pt_331, EndPoint=pt_332)
ln_129 = Line(StartPoint=pt_333, EndPoint=pt_334)
nurbs_14 = NurbsCurve(
    Vertices=[Point(1.758094, 9.996640324, 0), Point(341.1789777, 439.0758707, 0), Point(842.8387744, 195.7175012, 0), Point(407.3553764, -88.20059647, 0)],
    Degree=3,
    Periodic=False)  # -> Curve, Length, Domain
Y_2 = UnitY(Factor=series_2)
vec_51 = VectorXYZ(XComponent=0, YComponent=Slider(1, range=0..1), ZComponent=0)  # -> Vector, Length
curve_to_rebar_shape_103 = CurveToRebarShape(Curve=ln_119, Properties=rebar_properties_167)  # -> RebarShape, Mesh
curve_to_rebar_shape_104 = CurveToRebarShape(Curve=[ln_117, ln_114, ln_115], Properties=rebar_properties_165)  # -> RebarShape, Mesh
entwine_23 = Entwine(
    Branch00="1",
    Branch01="10",
    Branch02="10",
    Branch03=panel_36,
    Branch04="785398.163",
    Branch05="6.165376",
    FlattenInputs=True)  # -> flatten(Result)
vector_length_spacing_26 = VectorLengthSpacing(
    Id="0",
    RebarShape=curve_to_rebar_shape_88.RebarShape,
    Vector=vec_45.Vector,
    SpacingLength=Slider(100, range=0..1000),
    Type="3",
    Tolerance=0.0001)  # -> RebarGroup, Mesh, Curve
rebar_group_info_3 = RebarGroupInfo(RebarGroup=vector_count_spacing_14.RebarGroup)  # -> Id, Diameter, Amount, Material, Volume, Weight
ln_130 = Line(StartPoint=pt_335, EndPoint=pt_336)
format_10 = Format(Format="{0:0}", Culture=127, Data0=multiplication_7)
panel_42 = Panel("""Material
Name: Steel
Grade: Grade
Density: 7.85E-06""")
curve_to_rebar_shape_105 = CurveToRebarShape(Curve=ln_120, Properties=rebar_properties_166)  # -> RebarShape, Mesh
curve_to_rebar_shape_106 = CurveToRebarShape(Curve=scale_2.Geometry, Properties=rebar_properties_176)  # -> RebarShape, Mesh
vector_length_spacing_27 = VectorLengthSpacing(
    Id="0",
    RebarShape=curve_to_rebar_shape_89.RebarShape,
    Vector=vec_46.Vector,
    SpacingLength=Slider(100, range=0..1000),
    Type="1",
    Tolerance=0.0001)  # -> RebarGroup, Mesh, Curve
vec_52 = VectorXYZ(XComponent=0, YComponent=Slider(1, range=0..1), ZComponent=0)  # -> Vector, Length
vector_length_spacing_28 = VectorLengthSpacing(
    Id="0",
    RebarShape=curve_to_rebar_shape_90.RebarShape,
    Vector=vec_47.Vector,
    SpacingLength=Slider(121, range=0..1000),
    Type="0",
    Tolerance=0.0001)  # -> RebarGroup, Mesh, Curve
vec_53 = VectorXYZ(XComponent=0, YComponent=Slider(1, range=0..1), ZComponent=0)  # -> Vector, Length
nurbs_15 = NurbsCurve(
    Vertices=[Point(1.758094, 9.996640324, 0), Point(341.1789777, 439.0758707, 0), Point(842.8387744, 195.7175012, 0), Point(407.3553764, -88.20059647, 0)],
    Degree=3,
    Periodic=False)  # -> Curve, Length, Domain
curve_to_rebar_shape_107 = CurveToRebarShape(Curve=ln_122, Properties=rebar_properties_168)  # -> RebarShape, Mesh
Y_3 = UnitY(Factor=series_3)
format_11 = Format(Format="{0:0}", Culture=127, Data0=multiplication_6)
curve_to_rebar_shape_108 = CurveToRebarShape(Curve=scale.Geometry, Properties=rebar_properties_170)  # -> RebarShape, Mesh
vector_length_spacing_29 = VectorLengthSpacing(
    Id="0",
    RebarShape=curve_to_rebar_shape_92.RebarShape,
    Vector=vec_49.Vector,
    SpacingLength=Slider(121, range=0..1000),
    Type="3",
    Tolerance=0.0001)  # -> RebarGroup, Mesh, Curve
format_12 = Format(Format="{0:0}", Culture=127, Data0=multiplication_10)
format_13 = Format(Format="{0:0}", Culture=127, Data0=multiplication_11)
vector_length_spacing_30 = VectorLengthSpacing(
    Id="0",
    RebarShape=curve_to_rebar_shape_93.RebarShape,
    Vector=vec_50.Vector,
    SpacingLength=Slider(121, range=0..1000),
    Type="1",
    Tolerance=0.0001)  # -> RebarGroup, Mesh, Curve
vector_length_spacing_31 = VectorLengthSpacing(
    Id="0",
    RebarShape=curve_to_rebar_shape_91.RebarShape,
    Vector=vec_48.Vector,
    SpacingLength=Slider(121, range=0..1000),
    Type="2",
    Tolerance=0.0001)  # -> RebarGroup, Mesh, Curve
format_14 = Format(Format="{0:0}", Culture=127, Data0=multiplication_8)
entwine_24 = Entwine(
    Branch00="0",
    Branch01="10",
    Branch02="10",
    Branch03=panel_37,
    Branch04="78539.816",
    Branch05="0.616538",
    FlattenInputs=True)  # -> flatten(Result)
panel_43 = Panel("""Material
Name: Steel
Grade: Grade
Density: 7.85E-06""")
move = Move(Geometry=scale_3.Geometry, Motion=Y)  # -> Geometry, Transform
rebar_group_info_4 = RebarGroupInfo(RebarGroup=vector_count_spacing_15.RebarGroup)  # -> Id, Diameter, Amount, Material, Volume, Weight
curve_to_rebar_shape_109 = CurveToRebarShape(Curve=ln_123, Properties=rebar_properties_169)  # -> RebarShape, Mesh
format_15 = Format(Format="{0:0}", Culture=127, Data0=multiplication_13)
entwine_25 = Entwine(
    Branch00="0",
    Branch01="10",
    Branch02="10",
    Branch03=panel_38,
    Branch04="785398.163",
    Branch05="2.0 * Pi",
    FlattenInputs=True)  # -> flatten(Result)
number_slider_34 = Slider(10, range=0..100)
cluster = Cluster(C=scale.Geometry, A="0.010", B=number_slider_34)
panel_44 = Panel("""Material
Name: Steel
Grade: Grade
Density: 7850""")
rebar_group_info_5 = RebarGroupInfo(RebarGroup=vector_count_spacing_16.RebarGroup)  # -> Id, Diameter, Amount, Material, Volume, Weight
format_16 = Format(Format="{0:0}", Culture=127, Data0=multiplication_12)
curve_to_rebar_shape_110 = CurveToRebarShape(Curve=ln_124, Properties=rebar_properties_171)  # -> RebarShape, Mesh
curve_to_rebar_shape_111 = CurveToRebarShape(Curve=ln_125, Properties=rebar_properties_172)  # -> RebarShape, Mesh
panel_45 = Panel("""Material
Name: Steel
Grade: Grade
Density: 7.85E-06""")
move_2 = Move(Geometry=nurbs_14.Curve, Motion=Y_2)  # -> Geometry, Transform
vec_54 = VectorXYZ(XComponent=0, YComponent=Slider(1, range=0..1), ZComponent=0)  # -> Vector, Length
panel_46 = Panel("""Material
Name: Steel
Grade: Grade
Density: 7850""")
curve_to_rebar_shape_112 = CurveToRebarShape(Curve=ln_126, Properties=rebar_properties_174)  # -> RebarShape, Mesh
vec_55 = VectorXYZ(XComponent=0, YComponent=Slider(1, range=0..1), ZComponent=0)  # -> Vector, Length
vector_count_spacing_20 = VectorCountSpacing(Id="0", RebarShape=curve_to_rebar_shape_94.RebarShape, Vector=vec_51.Vector, Count=Slider(10, range=0..100))  # -> RebarGroup, Mesh, Curve
cluster_2 = Cluster(C=ln_123, A="0.012", B="11")
curve_to_rebar_shape_113 = CurveToRebarShape(Curve=ln_127, Properties=rebar_properties_175)  # -> RebarShape, Mesh
format_17 = Format(Format="{0:0}", Culture=127, Data0=multiplication_14)
panel_47 = Panel("""Material
Name: Steel
Grade: Grade
Density: 7.85E-06""")
entwine_26 = Entwine(
    Branch00="0",
    Branch01="10",
    Branch02="100000",
    Branch03=panel_39,
    Branch04="7853981633.974",
    Branch05="61653.755827",
    FlattenInputs=True)  # -> flatten(Result)
panel_48 = Panel("""Material
Name: Steel
Grade: Grade
Density: 7850""")
rebar_group_info_6 = RebarGroupInfo(RebarGroup=vector_count_spacing_17.RebarGroup)  # -> Id, Diameter, Amount, Material, Volume, Weight
number_slider_35 = Slider(10, range=0..100)
cluster_3 = Cluster(C=scale_2.Geometry, A="0.010", B=number_slider_35)
curve_to_rebar_shape_114 = CurveToRebarShape(Curve=ln_128, Properties=rebar_properties_178)  # -> RebarShape, Mesh
move_3 = Move(Geometry=nurbs_15.Curve, Motion=Y_3)  # -> Geometry, Transform
vector_count_spacing_21 = VectorCountSpacing(Id="0", RebarShape=curve_to_rebar_shape_95.RebarShape, Vector=vec_52.Vector, Count=Slider(10, range=0..100))  # -> RebarGroup, Mesh, Curve
curve_to_rebar_shape_115 = CurveToRebarShape(Curve=ln_129, Properties=rebar_properties_179)  # -> RebarShape, Mesh
panel_49 = Panel("""Material
Name: Steel
Grade: Grade
Density: 7.85E-06""")
vector_count_spacing_22 = VectorCountSpacing(Id="1", RebarShape=curve_to_rebar_shape_96.RebarShape, Vector=vec_53.Vector, Count=Slider(10, range=0..100))  # -> RebarGroup, Mesh, Curve
panel_50 = Panel("""Material
Name: Steel
Grade: Grade
Density: 7.85E-06""")
curve_to_rebar_shape_116 = CurveToRebarShape(Curve=ln_130, Properties=rebar_properties_180)  # -> RebarShape, Mesh
vec_56 = VectorXYZ(XComponent=0, YComponent=Slider(1, range=0..1), ZComponent=0)  # -> Vector, Length
format_18 = Format(Format="{0:0}", Culture=127, Data0=multiplication_9)
format_19 = Format(Format="{0:0.00000000}", Culture=127, Data0=cluster_3)
entwine_27 = Entwine(
    Branch00="0",
    Branch01="10",
    Branch02="10",
    Branch03=panel_40,
    Branch04="781855",
    Branch05="6.137559",
    FlattenInputs=True)  # -> flatten(Result)
rebar_group_info_7 = RebarGroupInfo(RebarGroup=vector_count_spacing_18.RebarGroup)  # -> Id, Diameter, Amount, Material, Volume, Weight
panel_51 = Panel("""Material
Name: Steel
Grade: Grade
Density: 7850""")
format_20 = Format(Format="{0:0.00000000}", Culture=127, Data0=cluster)
cluster_4 = Cluster(C=ln_124, A="0.012", B="11")
pt_337 = ConstructPoint(XCoordinate=0, YCoordinate=0, ZCoordinate=0)
pt_338 = ConstructPoint(XCoordinate=0, YCoordinate=Slider(0.5, range=0..1), ZCoordinate=0)
panel_52 = Panel("""Material
Name: Steel
Grade: Grade
Density: 7.85E-06""")
division_114 = Division(A="0.012", B=2)
panel_53 = Panel("""Material
Name: Steel
Grade: Grade
Density: 7.85E-06""")
cluster_5 = Cluster(C=ln_126, A="0.012", B="11")
panel_54 = Panel("""Material
Name: Steel2
Grade: Grade3
Density: 8000""")
panel_55 = Panel("""Material
Name: Steel
Grade: Grade
Density: 7850""")
vec_57 = VectorXYZ(XComponent=0, YComponent=Slider(1, range=0..1), ZComponent=0)  # -> Vector, Length
entwine_28 = Entwine(
    Branch00="0",
    Branch01="10",
    Branch02="10",
    Branch03=panel_41,
    Branch04="2040034",
    Branch05="16.014264",
    FlattenInputs=True)  # -> flatten(Result)
rebar_group_info_8 = RebarGroupInfo(RebarGroup=vector_count_spacing_19.RebarGroup)  # -> Id, Diameter, Amount, Material, Volume, Weight
division_115 = Division(A="12", B=2)
vector_count_spacing_23 = VectorCountSpacing(Id="0", RebarShape=curve_to_rebar_shape_98.RebarShape, Vector=vec_54.Vector, Count=Slider(10, range=0..100))  # -> RebarGroup, Mesh, Curve
panel_56 = Panel("""Material
Name: Steel
Grade: Grade
Density: 7.85E-06""")
cluster_6 = Cluster(C=ln_127, A="0.012", B="10")
curve_to_rebar_shape_117 = CurveToRebarShape(Curve=move.Geometry, Properties=rebar_properties_173)  # -> RebarShape, Mesh
custom_spacing = CustomSpacing(Id="0", RebarShapes=curve_to_rebar_shape_97.RebarShape)  # -> RebarGroup, Mesh, Curve
vector_count_spacing_24 = VectorCountSpacing(Id="0", RebarShape=curve_to_rebar_shape_100.RebarShape, Vector=vec_55.Vector, Count=Slider(10, range=0..100))  # -> RebarGroup, Mesh, Curve
panel_57 = Panel("""Material
Name: Steel
Grade: Grade
Density: 7850""")
cluster_7 = Cluster(C=ln_118, A="0.012", B="10")
len_3 = Length(Curve=scale_3.Geometry)
vec_58 = VectorXYZ(XComponent=0, YComponent=Slider(1, range=0..1), ZComponent=0)  # -> Vector, Length
vec_59 = VectorXYZ(XComponent=0, YComponent=Slider(1, range=0..1), ZComponent=0)  # -> Vector, Length
cluster_8 = Cluster(C=ln_129, A="0.012", B="10")
curve_to_rebar_shape_118 = CurveToRebarShape(Curve=move_2.Geometry, Properties=rebar_properties_177)  # -> RebarShape, Mesh
cluster_9 = Cluster(C=ln_122, A="0.012", B="10")
cluster_10 = Cluster(C=ln_130, A="0.012", B="10")
division_116 = Division(A="12", B=2)
cluster_11 = Cluster(C=ln_125, A="0.012", B="11")
format_21 = Format(Format="{0:0.000}", Culture=127, Data0=rebar_group_info.Volume)
panel_58 = Panel("""Material
Name: Steel
Grade: Grade
Density: 7.85E-06""")
format_22 = Format(Format="{0:0.00000000}", Culture=127, Data0=cluster_2)
custom_spacing_2 = CustomSpacing(Id="1", RebarShapes=curve_to_rebar_shape_99.RebarShape)  # -> RebarGroup, Mesh, Curve
len_4 = Length(Curve=nurbs_14.Curve)
cluster_12 = Cluster(C=ln_128, A="0.012", B="11")
vec_60 = VectorXYZ(XComponent=0, YComponent=Slider(1, range=0..1), ZComponent=0)  # -> Vector, Length
vector_count_spacing_25 = VectorCountSpacing(Id="0", RebarShape=curve_to_rebar_shape_103.RebarShape, Vector=vec_56.Vector, Count=Slider(100000, range=0..100000))  # -> RebarGroup, Mesh, Curve
format_23 = Format(Format="{0:0.00000000}", Culture=127, Data0=cluster_4)
sqr = Square(Value=division_114)
rebar_group_info_9 = RebarGroupInfo(RebarGroup=vector_length_spacing_24.RebarGroup)  # -> Id, Diameter, Amount, Material, Volume, Weight
vec_61 = VectorXYZ(XComponent=0, YComponent=Slider(1, range=0..1), ZComponent=0)  # -> Vector, Length
vec_62 = VectorXYZ(XComponent=0, YComponent=Slider(1, range=0..5), ZComponent=0)  # -> Vector, Length
curve_to_rebar_shape_119 = CurveToRebarShape(Curve=move_3.Geometry, Properties=rebar_properties_181)  # -> RebarShape, Mesh
cir_6 = Circle(Plane=PlaneXY(0, 0, 0), Radius=Slider(0.5, range=0..1))
ln_131 = Line(StartPoint=pt_337, EndPoint=pt_338)
panel_59 = Panel("""Material
Name: Steel
Grade: Grade
Density: 7850""")
panel_60 = Panel("""Material
Name: Steel
Grade: Grade
Density: 7.85E-06""")
rebar_group_info_10 = RebarGroupInfo(RebarGroup=vector_length_spacing_25.RebarGroup)  # -> Id, Diameter, Amount, Material, Volume, Weight
format_24 = Format(Format="{0:0.00000000}", Culture=127, Data0=cluster_5)
rebar_group_info_11 = RebarGroupInfo(RebarGroup=vector_length_spacing_26.RebarGroup)  # -> Id, Diameter, Amount, Material, Volume, Weight
sqr_2 = Square(Value=division_115)
len_5 = Length(Curve=nurbs_15.Curve)
entwine_29 = Entwine(
    Branch00="0",
    Branch01="12",
    Branch02="1",
    Branch03=panel_42,
    Branch04="56548.667765",
    Branch05="0.443907",
    FlattenInputs=True)  # -> flatten(Result)
custom_spacing_3 = CustomSpacing(Id="0", RebarShapes=curve_to_rebar_shape_101.RebarShape)  # -> RebarGroup, Mesh, Curve
vec_63 = VectorXYZ(XComponent=0, YComponent=Slider(1, range=0..1), ZComponent=0)  # -> Vector, Length
vec_64 = VectorXYZ(XComponent=0, YComponent=Slider(1, range=0..1), ZComponent=0)  # -> Vector, Length
vec_65 = VectorXYZ(XComponent=0, YComponent=Slider(1, range=0..1), ZComponent=0)  # -> Vector, Length
vector_count_spacing_26 = VectorCountSpacing(Id="0", RebarShape=curve_to_rebar_shape_108.RebarShape, Vector=vec_57.Vector, Count=number_slider_34)  # -> RebarGroup, Mesh, Curve
rebar_group_info_12 = RebarGroupInfo(RebarGroup=vector_length_spacing_27.RebarGroup)  # -> Id, Diameter, Amount, Material, Volume, Weight
entwine_30 = Entwine(
    Branch00="0",
    Branch01="12",
    Branch02="11",
    Branch03=panel_43,
    Branch04=format_9,
    Branch05="4.882977",
    FlattenInputs=True)  # -> flatten(Result)
format_25 = Format(Format="{0:0.00000000}", Culture=127, Data0=cluster_6)
panel_61 = Panel("""Material
Name: Steel
Grade: Grade
Density: 7.85E-06""")
format_26 = Format(Format="{0:0.000}", Culture=127, Data0=rebar_group_info_2.Volume)
format_27 = Format(Format="{0:0.00000000}", Culture=127, Data0=cluster_7)
rebar_group_info_13 = RebarGroupInfo(RebarGroup=vector_length_spacing_28.RebarGroup)  # -> Id, Diameter, Amount, Material, Volume, Weight
custom_spacing_4 = CustomSpacing(Id="0", RebarShapes=curve_to_rebar_shape_105.RebarShape)  # -> RebarGroup, Mesh, Curve
vec_66 = VectorXYZ(XComponent=0, YComponent=Slider(1, range=0..1), ZComponent=0)  # -> Vector, Length
panel_62 = Panel("""Material
Name: Steel
Grade: Grade
Density: 7850""")
format_28 = Format(Format="{0:0.00000000}", Culture=127, Data0=cluster_8)
format_29 = Format(Format="{0:0.00000000}", Culture=127, Data0=cluster_9)
format_30 = Format(Format="{0:0.00000000}", Culture=127, Data0=cluster_10)
vector_length_spacing_32 = VectorLengthSpacing(
    Id="0",
    RebarShape=curve_to_rebar_shape_109.RebarShape,
    Vector=vec_59.Vector,
    SpacingLength=Slider(0.1, range=0..0.1),
    Type="0",
    Tolerance=0.0001)  # -> RebarGroup, Mesh, Curve
entwine_31 = Entwine(
    Branch00="0",
    Branch01="12",
    Branch02="11",
    Branch03=panel_49,
    Branch04=format_11,
    Branch05="4.882977",
    FlattenInputs=True)  # -> flatten(Result)
entwine_32 = Entwine(
    Branch00="0",
    Branch01="12",
    Branch02="11",
    Branch03=panel_50,
    Branch04=format_10,
    Branch05="4.882977",
    FlattenInputs=True)  # -> flatten(Result)
format_31 = Format(Format="{0:0.00000000}", Culture=127, Data0=cluster_11)
sqr_3 = Square(Value=division_116)
rebar_group_info_14 = RebarGroupInfo(RebarGroup=vector_length_spacing_31.RebarGroup)  # -> Id, Diameter, Amount, Material, Volume, Weight
multiplication_15 = Multiplication(A=len_3, B="200")
rebar_group_info_15 = RebarGroupInfo(RebarGroup=vector_length_spacing_29.RebarGroup)  # -> Id, Diameter, Amount, Material, Volume, Weight
entwine_33 = Entwine(
    Branch00="0",
    Branch01="0.01",
    Branch02="10",
    Branch03=panel_44,
    Branch04="0.00078540",
    Branch05="6.165376",
    FlattenInputs=True)  # -> flatten(Result)
vector_count_spacing_27 = VectorCountSpacing(Id="0", RebarShape=curve_to_rebar_shape_106.RebarShape, Vector=vec_58.Vector, Count=number_slider_35)  # -> RebarGroup, Mesh, Curve
rebar_group_info_16 = RebarGroupInfo(RebarGroup=vector_count_spacing_20.RebarGroup)  # -> Id, Diameter, Amount, Material, Volume, Weight
format_32 = Format(Format="{0:0.00000000}", Culture=127, Data0=cluster_12)
entwine_34 = Entwine(
    Branch00="0",
    Branch01="12",
    Branch02="11",
    Branch03=panel_47,
    Branch04=format_18,
    Branch05="4.882977",
    FlattenInputs=True)  # -> flatten(Result)
format_33 = Format(Format="{0:0.000}", Culture=127, Data0=rebar_group_info_3.Volume)
rebar_group_info_17 = RebarGroupInfo(RebarGroup=vector_length_spacing_30.RebarGroup)  # -> Id, Diameter, Amount, Material, Volume, Weight
assert_list = AssertList(
    TestName="RebarGroupMilimeters_Normal_AllInfo",
    ExpectedList=entwine_21,
    ActualList=[rebar_group_info.Id, rebar_group_info.Diameter, rebar_group_info.Amount, rebar_group_info.Material, format_21, rebar_group_info.Weight])  # -> Result, FailedInfo
entwine_35 = Entwine(
    Branch00="0",
    Branch01="12",
    Branch02="10",
    Branch03=panel_45,
    Branch04=format_12,
    Branch05="4.43907",
    FlattenInputs=True)  # -> flatten(Result)
multiplication_16 = Multiplication(A=len_4, B="10")
pi_3 = Pi(Factor=sqr)
entwine_36 = Entwine(
    Branch00="0",
    Branch01="0.012",
    Branch02="10",
    Branch03=panel_46,
    Branch04="0.00113097",
    Branch05="8.878141",
    FlattenInputs=True)  # -> flatten(Result)
vector_length_spacing_33 = VectorLengthSpacing(
    Id="0",
    RebarShape=curve_to_rebar_shape_110.RebarShape,
    Vector=vec_62.Vector,
    SpacingLength=Slider(0.1, range=0..1),
    Type="2",
    Tolerance=0.0001)  # -> RebarGroup, Mesh, Curve
format_34 = Format(Format="{0:0.000}", Culture=127, Data0=rebar_group_info_4.Volume)
rebar_group_info_18 = RebarGroupInfo(RebarGroup=vector_count_spacing_21.RebarGroup)  # -> Id, Diameter, Amount, Material, Volume, Weight
vector_length_spacing_34 = VectorLengthSpacing(
    Id="0",
    RebarShape=curve_to_rebar_shape_111.RebarShape,
    Vector=vec_60.Vector,
    SpacingLength=Slider(0.1, range=0..0.1),
    Type="3",
    Tolerance=0.0001)  # -> RebarGroup, Mesh, Curve
entwine_37 = Entwine(
    Branch00="1",
    Branch01="0.01",
    Branch02="10",
    Branch03=panel_48,
    Branch04="0.00078540",
    Branch05="6.165376",
    FlattenInputs=True)  # -> flatten(Result)
entwine_38 = Entwine(
    Branch00="0",
    Branch01="12",
    Branch02="11",
    Branch03=panel_53,
    Branch04=format_13,
    Branch05="4.882977",
    FlattenInputs=True)  # -> flatten(Result)
format_35 = Format(Format="{0:0.000}", Culture=127, Data0=rebar_group_info_5.Volume)
entwine_39 = Entwine(
    Branch00="0",
    Branch01="12",
    Branch02="10",
    Branch03=panel_52,
    Branch04=format_16,
    Branch05="4.43907",
    FlattenInputs=True)  # -> flatten(Result)
rebar_group_info_19 = RebarGroupInfo(RebarGroup=vector_count_spacing_22.RebarGroup)  # -> Id, Diameter, Amount, Material, Volume, Weight
pi_4 = Pi(Factor=sqr_2)
vector_length_spacing_35 = VectorLengthSpacing(
    Id="0",
    RebarShape=curve_to_rebar_shape_112.RebarShape,
    Vector=vec_61.Vector,
    SpacingLength=Slider(0.1, range=0..1),
    Type="1",
    Tolerance=0.0001)  # -> RebarGroup, Mesh, Curve
entwine_40 = Entwine(
    Branch00="0",
    Branch01="12",
    Branch02="10",
    Branch03=panel_56,
    Branch04=format_17,
    Branch05="4.43907",
    FlattenInputs=True)  # -> flatten(Result)
vector_length_spacing_36 = VectorLengthSpacing(
    Id="0",
    RebarShape=curve_to_rebar_shape_113.RebarShape,
    Vector=vec_65.Vector,
    SpacingLength=Slider(0.121, range=0..1),
    Type="0",
    Tolerance=0.0001)  # -> RebarGroup, Mesh, Curve
multiplication_17 = Multiplication(A=len_5, B="200")
custom_spacing_5 = CustomSpacing(Id="0", RebarShapes=curve_to_rebar_shape_104.RebarShape)  # -> RebarGroup, Mesh, Curve
assert_list_2 = AssertList(
    TestName="RebarGroupMilimeters_Diameter_AllInfo",
    ExpectedList=entwine_22,
    ActualList=[rebar_group_info_2.Id, rebar_group_info_2.Diameter, rebar_group_info_2.Amount, rebar_group_info_2.Material, format_26, rebar_group_info_2.Weight])  # -> Result, FailedInfo
vector_length_spacing_37 = VectorLengthSpacing(
    Id="0",
    RebarShape=curve_to_rebar_shape_115.RebarShape,
    Vector=vec_64.Vector,
    SpacingLength=Slider(0.121, range=0..1),
    Type="3",
    Tolerance=0.0001)  # -> RebarGroup, Mesh, Curve
vector_length_spacing_38 = VectorLengthSpacing(
    Id="0",
    RebarShape=curve_to_rebar_shape_114.RebarShape,
    Vector=vec_63.Vector,
    SpacingLength=Slider(0.121, range=0..1),
    Type="2",
    Tolerance=0.0001)  # -> RebarGroup, Mesh, Curve
panel_64 = Panel("""Material
Name: Steel
Grade: Grade
Density: 7.85E-06""")
format_36 = Format(Format="{0:0.000}", Culture=127, Data0=rebar_group_info_6.Volume)
pi_5 = Pi(Factor=sqr_3)
vector_length_spacing_39 = VectorLengthSpacing(
    Id="0",
    RebarShape=curve_to_rebar_shape_116.RebarShape,
    Vector=vec_66.Vector,
    SpacingLength=Slider(0.121, range=0..1),
    Type="1",
    Tolerance=0.0001)  # -> RebarGroup, Mesh, Curve
entwine_41 = Entwine(
    Branch00="0",
    Branch01="0.01",
    Branch02="10",
    Branch03=panel_51,
    Branch04="0.00007854",
    Branch05="0.616538",
    FlattenInputs=True)  # -> flatten(Result)
rebar_group_info_20 = RebarGroupInfo(RebarGroup=vector_count_spacing_23.RebarGroup)  # -> Id, Diameter, Amount, Material, Volume, Weight
entwine_42 = Entwine(
    Branch00="0",
    Branch01="12",
    Branch02="10",
    Branch03=panel_58,
    Branch04=format_14,
    Branch05="4.43907",
    FlattenInputs=True)  # -> flatten(Result)
entwine_43 = Entwine(
    Branch00="0",
    Branch01="0.01",
    Branch02="10",
    Branch03=panel_54,
    Branch04="0.00078540",
    Branch05="2.0 * Pi",
    FlattenInputs=True)  # -> flatten(Result)
rebar_group_info_21 = RebarGroupInfo(RebarGroup=vector_count_spacing_24.RebarGroup)  # -> Id, Diameter, Amount, Material, Volume, Weight
panel_65 = Panel("""Material
Name: Steel
Grade: Grade
Density: 7850""")
custom_spacing_6 = CustomSpacing(Id="0", RebarShapes=curve_to_rebar_shape_117.RebarShape)  # -> RebarGroup, Mesh, Curve
assert_list_3 = AssertList(
    TestName="RebarGroupMilimeters_LengthsOfLineBar_AllInfo",
    ExpectedList=entwine_24,
    ActualList=[rebar_group_info_4.Id, rebar_group_info_4.Diameter, rebar_group_info_4.Amount, rebar_group_info_4.Material, format_34, rebar_group_info_4.Weight])  # -> Result, FailedInfo
multiplication_18 = Multiplication(A=multiplication_15, B=pi_3)
panel_66 = Panel("""Material
Name: Steel
Grade: Grade
Density: 7850""")
entwine_44 = Entwine(
    Branch00="0",
    Branch01="12",
    Branch02="10",
    Branch03=panel_60,
    Branch04=format_15,
    Branch05="4.43907",
    FlattenInputs=True)  # -> flatten(Result)
rebar_group_info_22 = RebarGroupInfo(RebarGroup=custom_spacing.RebarGroup)  # -> Id, Diameter, Amount, Material, Volume, Weight
entwine_45 = Entwine(
    Branch00="0",
    Branch01="0.01",
    Branch02="100000",
    Branch03=panel_55,
    Branch04="7.85398163",
    Branch05="61653.755827",
    FlattenInputs=True)  # -> flatten(Result)
panel_67 = Panel("""Material
Name: Steel
Grade: Grade
Density: 7.85E-06""")
custom_spacing_7 = CustomSpacing(Id="0", RebarShapes=curve_to_rebar_shape_119.RebarShape)  # -> RebarGroup, Mesh, Curve
rebar_group_info_23 = RebarGroupInfo(RebarGroup=vector_count_spacing_25.RebarGroup)  # -> Id, Diameter, Amount, Material, Volume, Weight
custom_spacing_8 = CustomSpacing(Id="0", RebarShapes=curve_to_rebar_shape_118.RebarShape)  # -> RebarGroup, Mesh, Curve
multiplication_19 = Multiplication(A=multiplication_16, B=pi_4)
panel_68 = Panel("""Material
Name: Steel
Grade: Grade
Density: 7850""")
assert_list_4 = AssertList(
    TestName="RebarGroupMilimeters_Id_AllInfo",
    ExpectedList=entwine_23,
    ActualList=[rebar_group_info_3.Id, rebar_group_info_3.Diameter, rebar_group_info_3.Amount, rebar_group_info_3.Material, format_33, rebar_group_info_3.Weight])  # -> Result, FailedInfo
panel_69 = Panel("""Material
Name: Steel
Grade: Grade
Density: 7850""")
panel_70 = Panel("""Material
Name: Steel
Grade: Grade
Density: 7850""")
format_37 = Format(Format="{0:0}", Culture=127, Data0=rebar_group_info_7.Volume)
entwine_46 = Entwine(
    Branch00="0",
    Branch01="0.012",
    Branch02="1",
    Branch03=panel_57,
    Branch04="0.00005655",
    Branch05="0.443907",
    FlattenInputs=True)  # -> flatten(Result)
panel_71 = Panel("""Material
Name: Steel
Grade: Grade
Density: 7850""")
assert_list_5 = AssertList(
    TestName="RebarGroupMilimeters_Material_AllInfo",
    ExpectedList=entwine_25,
    ActualList=[rebar_group_info_5.Id, rebar_group_info_5.Diameter, rebar_group_info_5.Amount, rebar_group_info_5.Material, format_35, rebar_group_info_5.Weight])  # -> Result, FailedInfo
entwine_47 = Entwine(
    Branch00="0",
    Branch01="0.01",
    Branch02="10",
    Branch03=panel_59,
    Branch04=format_20,
    Branch05="6.137559",
    FlattenInputs=True)  # -> flatten(Result)
format_38 = Format(Format="{0:0}", Culture=127, Data0=rebar_group_info_8.Volume)
rebar_group_info_24 = RebarGroupInfo(RebarGroup=vector_count_spacing_26.RebarGroup)  # -> Id, Diameter, Amount, Material, Volume, Weight
multiplication_20 = Multiplication(A=multiplication_17, B=pi_5)
panel_72 = Panel("""Material
Name: Steel
Grade: Grade
Density: 7850""")
assert_list_6 = AssertList(
    TestName="RebarGroupMilimeters_HugeCount_AllInfo",
    ExpectedList=entwine_26,
    ActualList=[rebar_group_info_6.Id, rebar_group_info_6.Diameter, rebar_group_info_6.Amount, rebar_group_info_6.Material, format_36, rebar_group_info_6.Weight])  # -> Result, FailedInfo
rebar_group_info_25 = RebarGroupInfo(RebarGroup=custom_spacing_2.RebarGroup)  # -> Id, Diameter, Amount, Material, Volume, Weight
format_39 = Format(Format="{0:0}", Culture=127, Data0=rebar_group_info_11.Volume)
entwine_48 = Entwine(
    Branch00="1",
    Branch01="12",
    Branch02="1",
    Branch03=panel_61,
    Branch04="56548.667765",
    Branch05="0.443907",
    FlattenInputs=True)  # -> flatten(Result)
entwine_49 = Entwine(
    Branch00="0",
    Branch01="0.01",
    Branch02="10",
    Branch03=panel_62,
    Branch04=format_19,
    Branch05="16.014264",
    FlattenInputs=True)  # -> flatten(Result)
rebar_group_info_26 = RebarGroupInfo(RebarGroup=vector_count_spacing_27.RebarGroup)  # -> Id, Diameter, Amount, Material, Volume, Weight
panel_73 = Panel("""Material
Name: Steel
Grade: Grade
Density: 7850""")
format_40 = Format(Format="{0:0}", Culture=127, Data0=rebar_group_info_14.Volume)
format_41 = Format(Format="{0:0}", Culture=127, Data0=rebar_group_info_9.Volume)
format_42 = Format(Format="{0:0}", Culture=127, Data0=rebar_group_info_15.Volume)
rebar_group_info_27 = RebarGroupInfo(RebarGroup=custom_spacing_3.RebarGroup)  # -> Id, Diameter, Amount, Material, Volume, Weight
format_43 = Format(Format="{0:0.00000000}", Culture=127, Data0=rebar_group_info_16.Volume)
panel_74 = Panel("""Material
Name: Steel
Grade: Grade
Density: 7850""")
format_44 = Format(Format="{0:0}", Culture=127, Data0=rebar_group_info_10.Volume)
rebar_group_info_28 = RebarGroupInfo(RebarGroup=vector_length_spacing_32.RebarGroup)  # -> Id, Diameter, Amount, Material, Volume, Weight
rebar_group_info_29 = RebarGroupInfo(RebarGroup=custom_spacing_4.RebarGroup)  # -> Id, Diameter, Amount, Material, Volume, Weight
format_45 = Format(Format="{0:0}", Culture=127, Data0=rebar_group_info_13.Volume)
format_46 = Format(Format="{0:0}", Culture=127, Data0=rebar_group_info_12.Volume)
assert_list_7 = AssertList(
    TestName="RebarGroupMilimeters_Nurbs2_AllInfo",
    ExpectedList=entwine_28,
    ActualList=[rebar_group_info_8.Id, rebar_group_info_8.Diameter, rebar_group_info_8.Amount, rebar_group_info_8.Material, format_38, rebar_group_info_8.Weight])  # -> Result, FailedInfo
panel_75 = Panel("""Material
Name: Steel
Grade: Grade
Density: 7850""")
entwine_50 = Entwine(
    Branch00=rebar_group_info_22.Id,
    Branch01=rebar_group_info_22.Diameter,
    Branch02=rebar_group_info_22.Amount,
    Branch03=rebar_group_info_22.Material,
    Branch04=rebar_group_info_22.Volume,
    Branch05=rebar_group_info_22.Weight,
    FlattenInputs=True)  # -> flatten(Result)
panel_76 = Panel("""Material
Name: Steel
Grade: Grade
Density: 7850""")
rebar_group_info_30 = RebarGroupInfo(RebarGroup=vector_length_spacing_33.RebarGroup)  # -> Id, Diameter, Amount, Material, Volume, Weight
format_47 = Format(Format="{0:0}", Culture=127, Data0=rebar_group_info_17.Volume)
rebar_group_info_31 = RebarGroupInfo(RebarGroup=vector_length_spacing_34.RebarGroup)  # -> Id, Diameter, Amount, Material, Volume, Weight
entwine_51 = Entwine(
    Branch00="0",
    Branch01="12",
    Branch02="2",
    Branch03=panel_64,
    Branch04="113097.335529",
    Branch05="0.887814",
    FlattenInputs=True)  # -> flatten(Result)
rebar_group_info_32 = RebarGroupInfo(RebarGroup=vector_length_spacing_35.RebarGroup)  # -> Id, Diameter, Amount, Material, Volume, Weight
rebar_group_info_33 = RebarGroupInfo(RebarGroup=custom_spacing_5.RebarGroup)  # -> Id, Diameter, Amount, Material, Volume, Weight
entwine_52 = Entwine(
    Branch00="0",
    Branch01="0.012",
    Branch02="11",
    Branch03=panel_65,
    Branch04=format_22,
    Branch05="4.882977",
    FlattenInputs=True)  # -> flatten(Result)
assert_list_8 = AssertList(
    TestName="RebarGroupMilimeters_VectorLengthSpacingType3_AllInfo",
    ExpectedList=entwine_39,
    ActualList=[rebar_group_info_15.Id, rebar_group_info_15.Diameter, rebar_group_info_15.Amount, rebar_group_info_15.Material, format_42, rebar_group_info_15.Weight])  # -> Result, FailedInfo
panel_77 = Panel("""Material
Name: Steel
Grade: Grade
Density: 7.85E-06""")
format_48 = Format(Format="{0:0.00000000}", Culture=127, Data0=rebar_group_info_19.Volume)
rebar_group_info_34 = RebarGroupInfo(RebarGroup=vector_length_spacing_36.RebarGroup)  # -> Id, Diameter, Amount, Material, Volume, Weight
format_49 = Format(Format="{0:0.00000000}", Culture=127, Data0=rebar_group_info_18.Volume)
assert_list_9 = AssertList(
    TestName="RebarGroupMilimeters_VectorLengthSpacingType2_AllInfo",
    ExpectedList=entwine_38,
    ActualList=[rebar_group_info_14.Id, rebar_group_info_14.Diameter, rebar_group_info_14.Amount, rebar_group_info_14.Material, format_40, rebar_group_info_14.Weight])  # -> Result, FailedInfo
assert_list_10 = AssertList(
    TestName="RebarGroupMilimeters_VectorLengthSpacingType0Even_AllInfo",
    ExpectedList=entwine_30,
    ActualList=[rebar_group_info_9.Id, rebar_group_info_9.Diameter, rebar_group_info_9.Amount, rebar_group_info_9.Material, format_41, rebar_group_info_9.Weight])  # -> Result, FailedInfo
assert_list_11 = AssertList(
    TestName="RebarGroupMilimeters_VectorLengthSpacingType3Even_AllInfo",
    ExpectedList=entwine_32,
    ActualList=[rebar_group_info_11.Id, rebar_group_info_11.Diameter, rebar_group_info_11.Amount, rebar_group_info_11.Material, format_39, rebar_group_info_11.Weight])  # -> Result, FailedInfo
entwine_53 = Entwine(
    Branch00="0",
    Branch01="0.012",
    Branch02="11",
    Branch03=panel_71,
    Branch04=format_23,
    Branch05="4.882977",
    FlattenInputs=True)  # -> flatten(Result)
entwine_54 = Entwine(
    Branch00="0",
    Branch01="0.012",
    Branch02="11",
    Branch03=panel_69,
    Branch04=format_31,
    Branch05="4.882977",
    FlattenInputs=True)  # -> flatten(Result)
rebar_group_info_35 = RebarGroupInfo(RebarGroup=vector_length_spacing_38.RebarGroup)  # -> Id, Diameter, Amount, Material, Volume, Weight
rebar_group_info_36 = RebarGroupInfo(RebarGroup=vector_length_spacing_37.RebarGroup)  # -> Id, Diameter, Amount, Material, Volume, Weight
entwine_55 = Entwine(
    Branch00="0",
    Branch01="0.012",
    Branch02="11",
    Branch03=panel_68,
    Branch04=format_24,
    Branch05="4.882977",
    FlattenInputs=True)  # -> flatten(Result)
rebar_group_info_37 = RebarGroupInfo(RebarGroup=vector_length_spacing_39.RebarGroup)  # -> Id, Diameter, Amount, Material, Volume, Weight
entwine_56 = Entwine(
    Branch00=rebar_group_info_25.Id,
    Branch01=rebar_group_info_25.Diameter,
    Branch02=rebar_group_info_25.Amount,
    Branch03=rebar_group_info_25.Material,
    Branch04=rebar_group_info_25.Volume,
    Branch05=rebar_group_info_25.Weight,
    FlattenInputs=True)  # -> flatten(Result)
entwine_57 = Entwine(
    Branch00="0",
    Branch01="0.012",
    Branch02="10",
    Branch03=panel_70,
    Branch04=format_25,
    Branch05="4.43907",
    FlattenInputs=True)  # -> flatten(Result)
panel_78 = Panel("""Material
Name: Steel
Grade: Grade
Density: 7.85E-06""")
assert_list_12 = AssertList(
    TestName="RebarGroupMilimeters_Nurbs_AllInfo",
    ExpectedList=entwine_27,
    ActualList=[rebar_group_info_7.Id, rebar_group_info_7.Diameter, rebar_group_info_7.Amount, rebar_group_info_7.Material, format_37, rebar_group_info_7.Weight])  # -> Result, FailedInfo
entwine_58 = Entwine(
    Branch00="0",
    Branch01="12",
    Branch02="3",
    Branch03=panel_67,
    Branch04="193069.228416",
    Branch05="1.515593",
    FlattenInputs=True)  # -> flatten(Result)
entwine_59 = Entwine(
    Branch00="0",
    Branch01="0.012",
    Branch02="11",
    Branch03=panel_66,
    Branch04=format_32,
    Branch05="4.882977",
    FlattenInputs=True)  # -> flatten(Result)
entwine_60 = Entwine(
    Branch00="0",
    Branch01="0.012",
    Branch02="10",
    Branch03=panel_72,
    Branch04=format_28,
    Branch05="4.43907",
    FlattenInputs=True)  # -> flatten(Result)
format_50 = Format(Format="{0:0.00000000}", Culture=127, Data0=rebar_group_info_20.Volume)
assert_list_13 = AssertList(
    TestName="RebarGroupMilimeters_VectorLengthSpacingType0_AllInfo",
    ExpectedList=entwine_35,
    ActualList=[rebar_group_info_13.Id, rebar_group_info_13.Diameter, rebar_group_info_13.Amount, rebar_group_info_13.Material, format_45, rebar_group_info_13.Weight])  # -> Result, FailedInfo
entwine_61 = Entwine(
    Branch00="0",
    Branch01="0.012",
    Branch02="10",
    Branch03=panel_73,
    Branch04=format_30,
    Branch05="4.43907",
    FlattenInputs=True)  # -> flatten(Result)
assert_list_14 = AssertList(TestName="CustomRebarGroupInfoMilimeters_Id_AllInfo", ExpectedList=entwine_48, ActualList=entwine_56)  # -> Result, FailedInfo
assert_list_15 = AssertList(
    TestName="RebarGroupMeters_Normal_AllInfo",
    ExpectedList=entwine_33,
    ActualList=[rebar_group_info_16.Id, rebar_group_info_16.Diameter, rebar_group_info_16.Amount, rebar_group_info_16.Material, format_43, rebar_group_info_16.Weight])  # -> Result, FailedInfo
format_51 = Format(Format="{0:0.00000000}", Culture=127, Data0=rebar_group_info_21.Volume)
assert_list_16 = AssertList(TestName="CustomRebarGroupInfoMilimeters_1Shape_AllInfo", ExpectedList=entwine_29, ActualList=entwine_50)  # -> Result, FailedInfo
assert_list_17 = AssertList(
    TestName="RebarGroupMeters_Id_AllInfo",
    ExpectedList=entwine_37,
    ActualList=[rebar_group_info_19.Id, rebar_group_info_19.Diameter, rebar_group_info_19.Amount, rebar_group_info_19.Material, format_48, rebar_group_info_19.Weight])  # -> Result, FailedInfo
entwine_62 = Entwine(
    Branch00=rebar_group_info_27.Id,
    Branch01=rebar_group_info_27.Diameter,
    Branch02=rebar_group_info_27.Amount,
    Branch03=rebar_group_info_27.Material,
    Branch04=rebar_group_info_27.Volume,
    Branch05=rebar_group_info_27.Weight,
    FlattenInputs=True)  # -> flatten(Result)
assert_list_18 = AssertList(
    TestName="RebarGroupMilimeters_VectorLengthSpacingType1Even_AllInfo",
    ExpectedList=entwine_34,
    ActualList=[rebar_group_info_12.Id, rebar_group_info_12.Diameter, rebar_group_info_12.Amount, rebar_group_info_12.Material, format_46, rebar_group_info_12.Weight])  # -> Result, FailedInfo
assert_list_19 = AssertList(
    TestName="RebarGroupMeters_Diameter_AllInfo",
    ExpectedList=entwine_36,
    ActualList=[rebar_group_info_18.Id, rebar_group_info_18.Diameter, rebar_group_info_18.Amount, rebar_group_info_18.Material, format_49, rebar_group_info_18.Weight])  # -> Result, FailedInfo
assert_list_20 = AssertList(
    TestName="RebarGroupMilimeters_VectorLengthSpacingType1_AllInfo",
    ExpectedList=entwine_40,
    ActualList=[rebar_group_info_17.Id, rebar_group_info_17.Diameter, rebar_group_info_17.Amount, rebar_group_info_17.Material, format_47, rebar_group_info_17.Weight])  # -> Result, FailedInfo
format_52 = Format(Format="{0:0.00000000}", Culture=127, Data0=rebar_group_info_23.Volume)
rebar_group_info_38 = RebarGroupInfo(RebarGroup=custom_spacing_8.RebarGroup)  # -> Id, Diameter, Amount, Material, Volume, Weight
format_53 = Format(Format="{0:0.00000000}", Culture=127, Data0=rebar_group_info_29.Volume)
assert_list_21 = AssertList(
    TestName="RebarGroupMeters_LengthsOfLineBar_AllInfo",
    ExpectedList=entwine_41,
    ActualList=[rebar_group_info_20.Id, rebar_group_info_20.Diameter, rebar_group_info_20.Amount, rebar_group_info_20.Material, format_50, rebar_group_info_20.Weight])  # -> Result, FailedInfo
format_54 = Format(Format="{0:0.00000000}", Culture=127, Data0=rebar_group_info_26.Volume)
entwine_63 = Entwine(
    Branch00="0",
    Branch01="0.012",
    Branch02="10",
    Branch03=panel_74,
    Branch04=format_27,
    Branch05="4.43907",
    FlattenInputs=True)  # -> flatten(Result)
entwine_64 = Entwine(
    Branch00=rebar_group_info_33.Id,
    Branch01=rebar_group_info_33.Diameter,
    Branch02=rebar_group_info_33.Amount,
    Branch03=rebar_group_info_33.Material,
    Branch04=rebar_group_info_33.Volume,
    Branch05=rebar_group_info_33.Weight,
    FlattenInputs=True)  # -> flatten(Result)
assert_list_22 = AssertList(
    TestName="RebarGroupMeters_Material_AllInfo",
    ExpectedList=entwine_43,
    ActualList=[rebar_group_info_21.Id, rebar_group_info_21.Diameter, rebar_group_info_21.Amount, rebar_group_info_21.Material, format_51, rebar_group_info_21.Weight])  # -> Result, FailedInfo
assert_list_23 = AssertList(
    TestName="RebarGroupMeters_Nurbs2_AllInfo",
    ExpectedList=entwine_49,
    ActualList=[rebar_group_info_26.Id, rebar_group_info_26.Diameter, rebar_group_info_26.Amount, rebar_group_info_26.Material, format_54, rebar_group_info_26.Weight])  # -> Result, FailedInfo
rebar_group_info_39 = RebarGroupInfo(RebarGroup=custom_spacing_7.RebarGroup)  # -> Id, Diameter, Amount, Material, Volume, Weight
assert_list_24 = AssertList(TestName="CustomRebarGroupInfoMilimeters_2RebarCurves_AllInfo", ExpectedList=entwine_51, ActualList=entwine_62)  # -> Result, FailedInfo
format_55 = Format(Format="{0:0.00000000}", Culture=127, Data0=rebar_group_info_24.Volume)
assert_list_25 = AssertList(
    TestName="RebarGroupMilimeters_VectorLengthSpacingType2Even_AllInfo",
    ExpectedList=entwine_31,
    ActualList=[rebar_group_info_10.Id, rebar_group_info_10.Diameter, rebar_group_info_10.Amount, rebar_group_info_10.Material, format_44, rebar_group_info_10.Weight])  # -> Result, FailedInfo
entwine_65 = Entwine(
    Branch00="0",
    Branch01="0.012",
    Branch02="10",
    Branch03=panel_75,
    Branch04=format_29,
    Branch05="4.43907",
    FlattenInputs=True)  # -> flatten(Result)
format_56 = Format(Format="{0:0.00000000}", Culture=127, Data0=rebar_group_info_28.Volume)
entwine_66 = Entwine(
    Branch00="0",
    Branch01="0.012",
    Branch02="200",
    Branch03=panel_76,
    Branch04=multiplication_18,
    Branch05="176.761685",
    FlattenInputs=True)  # -> flatten(Result)
assert_list_26 = AssertList(TestName="CustomRebarGroupInfoMilimeters_3RebarCurves_AllInfo", ExpectedList=entwine_58, ActualList=entwine_64)  # -> Result, FailedInfo
assert_list_27 = AssertList(
    TestName="RebarGroupMeters_Nurbs_AllInfo",
    ExpectedList=entwine_47,
    ActualList=[rebar_group_info_24.Id, rebar_group_info_24.Diameter, rebar_group_info_24.Amount, rebar_group_info_24.Material, format_55, rebar_group_info_24.Weight])  # -> Result, FailedInfo
entwine_67 = Entwine(
    Branch00=rebar_group_info_29.Id,
    Branch01=rebar_group_info_29.Diameter,
    Branch02=rebar_group_info_29.Amount,
    Branch03=rebar_group_info_29.Material,
    Branch04=format_53,
    Branch05=rebar_group_info_29.Weight,
    FlattenInputs=True)  # -> flatten(Result)
assert_list_28 = AssertList(TestName="CustomRebarGroupInfoMeters_1Shape_AllInfo", ExpectedList=entwine_46, ActualList=entwine_67)  # -> Result, FailedInfo
entwine_68 = Entwine(
    Branch00="0",
    Branch01="12",
    Branch02="10",
    Branch03=panel_77,
    Branch04=multiplication_19,
    Branch05="8.838084",
    FlattenInputs=True)  # -> flatten(Result)
assert_list_29 = AssertList(
    TestName="RebarGroupMeters_HugeCount_AllInfo",
    ExpectedList=entwine_45,
    ActualList=[rebar_group_info_23.Id, rebar_group_info_23.Diameter, rebar_group_info_23.Amount, rebar_group_info_23.Material, format_52, rebar_group_info_23.Weight])  # -> Result, FailedInfo
entwine_69 = Entwine(
    Branch00="0",
    Branch01="12",
    Branch02="200",
    Branch03=panel_78,
    Branch04=multiplication_20,
    Branch05="176.761685",
    FlattenInputs=True)  # -> flatten(Result)
format_57 = Format(Format="{0:0.00000000}", Culture=127, Data0=rebar_group_info_30.Volume)
format_58 = Format(Format="{0:0.00000000}", Culture=127, Data0=rebar_group_info_36.Volume)
format_59 = Format(Format="{0:0.00000000}", Culture=127, Data0=rebar_group_info_32.Volume)
entwine_70 = Entwine(
    Branch00=rebar_group_info_38.Id,
    Branch01=rebar_group_info_38.Diameter,
    Branch02=rebar_group_info_38.Amount,
    Branch03=rebar_group_info_38.Material,
    Branch04=rebar_group_info_38.Volume,
    Branch05=rebar_group_info_38.Weight,
    FlattenInputs=True)  # -> flatten(Result)
format_60 = Format(Format="{0:0.00000000}", Culture=127, Data0=rebar_group_info_34.Volume)
format_61 = Format(Format="{0:0.00000000}", Culture=127, Data0=rebar_group_info_31.Volume)
assert_list_30 = AssertList(
    TestName="RebarGroupMeters_VectorLengthSpacingType0Even_AllInfo",
    ExpectedList=entwine_52,
    ActualList=[rebar_group_info_28.Id, rebar_group_info_28.Diameter, rebar_group_info_28.Amount, rebar_group_info_28.Material, format_56, rebar_group_info_28.Weight])  # -> Result, FailedInfo
format_62 = Format(Format="{0:0.00000000}", Culture=127, Data0=rebar_group_info_35.Volume)
format_63 = Format(Format="{0:0.00000000}", Culture=127, Data0=rebar_group_info_37.Volume)
entwine_71 = Entwine(
    Branch00=rebar_group_info_39.Id,
    Branch01=rebar_group_info_39.Diameter,
    Branch02=rebar_group_info_39.Amount,
    Branch03=rebar_group_info_39.Material,
    Branch04=rebar_group_info_39.Volume,
    Branch05=rebar_group_info_39.Weight,
    FlattenInputs=True)  # -> flatten(Result)
assert_list_31 = AssertList(
    TestName="RebarGroupMeters_VectorLengthSpacingType2Even_AllInfo",
    ExpectedList=entwine_53,
    ActualList=[rebar_group_info_30.Id, rebar_group_info_30.Diameter, rebar_group_info_30.Amount, rebar_group_info_30.Material, format_57, rebar_group_info_30.Weight])  # -> Result, FailedInfo
assert_list_32 = AssertList(
    TestName="RebarGroupMeters_VectorLengthSpacingType3_AllInfo",
    ExpectedList=entwine_60,
    ActualList=[rebar_group_info_36.Id, rebar_group_info_36.Diameter, rebar_group_info_36.Amount, rebar_group_info_36.Material, format_58, rebar_group_info_36.Weight])  # -> Result, FailedInfo
assert_list_33 = AssertList(
    TestName="RebarGroupMeters_VectorLengthSpacingType0_AllInfo",
    ExpectedList=entwine_57,
    ActualList=[rebar_group_info_34.Id, rebar_group_info_34.Diameter, rebar_group_info_34.Amount, rebar_group_info_34.Material, format_60, rebar_group_info_34.Weight])  # -> Result, FailedInfo
assert_list_34 = AssertList(
    TestName="RebarGroupMeters_VectorLengthSpacingType3Even_AllInfo",
    ExpectedList=entwine_54,
    ActualList=[rebar_group_info_31.Id, rebar_group_info_31.Diameter, rebar_group_info_31.Amount, rebar_group_info_31.Material, format_61, rebar_group_info_31.Weight])  # -> Result, FailedInfo
rebar_group_info_40 = RebarGroupInfo(RebarGroup=custom_spacing_6.RebarGroup)  # -> Id, Diameter, Amount, Material, Volume, Weight
assert_list_35 = AssertList(
    TestName="RebarGroupMeters_VectorLengthSpacingType2_AllInfo",
    ExpectedList=entwine_59,
    ActualList=[rebar_group_info_35.Id, rebar_group_info_35.Diameter, rebar_group_info_35.Amount, rebar_group_info_35.Material, format_62, rebar_group_info_35.Weight])  # -> Result, FailedInfo
assert_list_36 = AssertList(
    TestName="RebarGroupMeters_VectorLengthSpacingType1_AllInfo",
    ExpectedList=entwine_61,
    ActualList=[rebar_group_info_37.Id, rebar_group_info_37.Diameter, rebar_group_info_37.Amount, rebar_group_info_37.Material, format_63, rebar_group_info_37.Weight])  # -> Result, FailedInfo
assert_list_37 = AssertList(
    TestName="RebarGroupMeters_VectorLengthSpacingType1Even_AllInfo",
    ExpectedList=entwine_55,
    ActualList=[rebar_group_info_32.Id, rebar_group_info_32.Diameter, rebar_group_info_32.Amount, rebar_group_info_32.Material, format_59, rebar_group_info_32.Weight])  # -> Result, FailedInfo
assert_list_38 = AssertList(TestName="CustomRebarGroupInfoMilimeters_10Nurbs_AllInfo", ExpectedList=entwine_68, ActualList=entwine_70)  # -> Result, FailedInfo
assert_list_39 = AssertList(TestName="CustomRebarGroupInfoMilimeters_ManyNurbs_AllInfo", ExpectedList=entwine_69, ActualList=entwine_71)  # -> Result, FailedInfo
entwine_72 = Entwine(
    Branch00=rebar_group_info_40.Id,
    Branch01=rebar_group_info_40.Diameter,
    Branch02=rebar_group_info_40.Amount,
    Branch03=rebar_group_info_40.Material,
    Branch04=rebar_group_info_40.Volume,
    Branch05=rebar_group_info_40.Weight,
    FlattenInputs=True)  # -> flatten(Result)
assert_list_40 = AssertList(TestName="CustomRebarGroupInfoMeters_ManyNurbs_AllInfo", ExpectedList=entwine_66, ActualList=entwine_72)  # -> Result, FailedInfo
entwine_73 = Entwine(Branch00=assert_list_28.Result, Branch01=assert_list_40.Result, FlattenInputs=True)  # -> flatten(Result)
entwine_74 = Entwine(
    Branch00=assert_list_16.Result,
    Branch01=assert_list_14.Result,
    Branch02=assert_list_24.Result,
    Branch03=assert_list_26.Result,
    Branch04=assert_list_38.Result,
    Branch05=assert_list_39.Result,
    FlattenInputs=True)  # -> flatten(Result)

curve_spacing_29 = CurveSpacing(
    Id="0",
    RebarShape=curve_to_rebar_shape_82.RebarShape,
    Curve=cir_5,
    Count=Slider(10, range=0..100),
    RotationAngle=degrees(Slider(90, range=0..360)))  # -> RebarGroup, Mesh, Curve
curve_spacing_30 = CurveSpacing(
    Id="0",
    RebarShape=curve_to_rebar_shape_81.RebarShape,
    Curve=ln_121,
    Count=Slider(10, range=0..100),
    RotationAngle=degrees(Slider(90, range=0..360)))  # -> RebarGroup, Mesh, Curve
curve_spacing_31 = CurveSpacing(
    Id="0",
    RebarShape=curve_to_rebar_shape_102.RebarShape,
    Curve=ln_131,
    Count=Slider(10, range=0..100),
    RotationAngle=degrees(Slider(90, range=0..360)))  # -> RebarGroup, Mesh, Curve
curve_spacing_32 = CurveSpacing(
    Id="0",
    RebarShape=curve_to_rebar_shape_107.RebarShape,
    Curve=cir_6,
    Count=Slider(10, range=0..100),
    RotationAngle=degrees(Slider(90, range=0..360)))  # -> RebarGroup, Mesh, Curve

rebar_group_info_41 = RebarGroupInfo(RebarGroup=curve_spacing_30.RebarGroup)  # -> Id, Diameter, Amount, Material, Volume, Weight
rebar_group_info_42 = RebarGroupInfo(RebarGroup=curve_spacing_29.RebarGroup)  # -> Id, Diameter, Amount, Material, Volume, Weight
format_64 = Format(Format="{0:0}", Culture=127, Data0=rebar_group_info_41.Volume)
format_65 = Format(Format="{0:0}", Culture=127, Data0=rebar_group_info_42.Volume)
assert_list_41 = AssertList(
    TestName="RebarGroupMilimeters_CurveSpacing_AllInfo",
    ExpectedList=entwine_42,
    ActualList=[rebar_group_info_41.Id, rebar_group_info_41.Diameter, rebar_group_info_41.Amount, rebar_group_info_41.Material, format_64, rebar_group_info_41.Weight])  # -> Result, FailedInfo
assert_list_42 = AssertList(
    TestName="RebarGroupMilimeters_CurveSpacingClosed_AllInfo",
    ExpectedList=entwine_44,
    ActualList=[rebar_group_info_42.Id, rebar_group_info_42.Diameter, rebar_group_info_42.Amount, rebar_group_info_42.Material, format_65, rebar_group_info_42.Weight])  # -> Result, FailedInfo
rebar_group_info_43 = RebarGroupInfo(RebarGroup=curve_spacing_31.RebarGroup)  # -> Id, Diameter, Amount, Material, Volume, Weight
rebar_group_info_44 = RebarGroupInfo(RebarGroup=curve_spacing_32.RebarGroup)  # -> Id, Diameter, Amount, Material, Volume, Weight
format_66 = Format(Format="{0:0.00000000}", Culture=127, Data0=rebar_group_info_43.Volume)
assert_list_43 = AssertList(
    TestName="RebarGroupMeters_CurveSpacing_AllInfo",
    ExpectedList=entwine_63,
    ActualList=[rebar_group_info_43.Id, rebar_group_info_43.Diameter, rebar_group_info_43.Amount, rebar_group_info_43.Material, format_66, rebar_group_info_43.Weight])  # -> Result, FailedInfo
format_67 = Format(Format="{0:0.00000000}", Culture=127, Data0=rebar_group_info_44.Volume)
assert_list_44 = AssertList(
    TestName="RebarGroupMeters_CurveSpacingClosed_AllInfo",
    ExpectedList=entwine_65,
    ActualList=[rebar_group_info_44.Id, rebar_group_info_44.Diameter, rebar_group_info_44.Amount, rebar_group_info_44.Material, format_67, rebar_group_info_44.Weight])  # -> Result, FailedInfo
entwine_75 = Entwine(
    Branch00=assert_list.Result,
    Branch01=assert_list_2.Result,
    Branch02=assert_list_3.Result,
    Branch03=assert_list_4.Result,
    Branch04=assert_list_5.Result,
    Branch05=assert_list_6.Result,
    Branch06=assert_list_12.Result,
    Branch07=assert_list_7.Result,
    Branch08=assert_list_10.Result,
    Branch09=assert_list_13.Result,
    Branch010=assert_list_18.Result,
    Branch011=assert_list_20.Result,
    Branch012=assert_list_25.Result,
    Branch013=assert_list_9.Result,
    Branch014=assert_list_11.Result,
    Branch015=assert_list_8.Result,
    Branch016=assert_list_41.Result,
    Branch017=assert_list_42.Result,
    FlattenInputs=True)  # -> flatten(Result)
entwine_76 = Entwine(
    Branch00=assert_list_15.Result,
    Branch01=assert_list_19.Result,
    Branch02=assert_list_21.Result,
    Branch03=assert_list_17.Result,
    Branch04=assert_list_22.Result,
    Branch05=assert_list_29.Result,
    Branch06=assert_list_27.Result,
    Branch07=assert_list_23.Result,
    Branch08=assert_list_30.Result,
    Branch09=assert_list_33.Result,
    Branch010=assert_list_37.Result,
    Branch011=assert_list_36.Result,
    Branch012=assert_list_31.Result,
    Branch013=assert_list_35.Result,
    Branch014=assert_list_34.Result,
    Branch015=assert_list_32.Result,
    Branch016=assert_list_43.Result,
    Branch017=assert_list_44.Result,
    FlattenInputs=True)  # -> flatten(Result)

# ----
# Result:
total = Total(Results=flatten([entwine_3, entwine_4, entwine, entwine_8, entwine_7, entwine_6, entwine_9, entwine_10, entwine_11, entwine_12, entwine_13, entwine_14, entwine_15, entwine_16, entwine_19, entwine_20, entwine_17, entwine_75, entwine_76, entwine_74, entwine_73, entwine_5, entwine_2, entwine_18]))  # -> TotalResult, ReportPart
panel_79 = Panel(total.TotalResult)

# ----
# Table of contents:
# Bending Roller
# Cover Dimensions
# Material
# Rebar Properties
# L-Bar Shape
# Spacer Shape
# Stirrup Shape
# Rectangle To Line Bar Shape
# Rectangle To U-Bar Shape
# Rectangle To Stirrup Shape
create_report = CreateReport(ReportParts=[calendar, total.ReportPart], TableOfContents=False)
# Unit Tests inside Grasshopper
# 
# Required plugins:
# - T-Rex
# - Pterodactyl
# - Brontosaurus
save_report = SaveReport(Report=create_report, Path=path)  # disabled

# ==== cluster Cluster
A = ClusterInput()
division = Division(A=A, B=2)
C = ClusterInput()
sqr = Square(Value=division)
len = Length(Curve=C)
pi = Pi(Factor=sqr)
multiplication = Multiplication(A=len, B=pi)
B = ClusterInput()
multiplication_2 = Multiplication(A=multiplication, B=B)
R = ClusterOutput(multiplication_2)
