# Grasshopper definition GrasshopperUnitTests.gh (Grasshopper 1.0.7)
# plug-ins: Brontosaurus, T-Rex

# ----
# Rebar Properties
number_slider = Slider(7850, range=0..10000)
division = Division(A=number_slider, B="10e9")
material = Material(Name="Name of the material", Grade="Grade of the material", Density=division)
material_2 = Material(Name="Name of the material", Grade="Grade of the material", Density="7850")
panel = Panel("""Rebar Properties
Diameter: 20
Material: Name of the material""")
panel_2 = Panel("""Rebar Properties
Diameter: 0.02
Material: Name of the material""")
rebar_properties = RebarProperties(Diameter="20", Material=material)
rebar_properties_2 = RebarProperties(Diameter="0.020", Material=material_2)
assert = Assert(TestNames="TestRebarPropertiesMilimeters_Normal_Init", Expected=panel, Actual=rebar_properties)  # -> Result, FailedInfo
assert_2 = Assert(TestNames="TestRebarPropertiesMeters_Normal_Init", Expected=panel_2, Actual=rebar_properties_2)  # -> Result, FailedInfo

# ----
# Cover Dimensions
number_slider_2 = Slider(300, range=0..1000)
# Unit Tests inside Grasshopper
# 
# Required plugins:
# - T-Rex
# - Brontosaurus
panel_3 = Panel("TestCoverDimensionsMilimeters_Normal_Init")
cover_dimensions = CoverDimensions(
    Left=Slider(100, range=0..1000),
    Right=Slider(200, range=0..1000),
    Top=number_slider_2,
    Bottom=Slider(400, range=0..1000))
panel_4 = Panel("""Cover Dimensions
Left: 0.01
Right: 0.02
Top: 0.03
Bottom: 0.045""")
cover_dimensions_2 = CoverDimensions(
    Left=Slider(0.01, range=0..0.1),
    Right=Slider(0.02, range=0..0.1),
    Top=Slider(0.03, range=0..0.1),
    Bottom=Slider(0.045, range=0..0.1))
# Naming convencion:
# TestComponentNameUnits_Input_Output
panel_5 = Panel("""Cover Dimensions
Left: 100
Right: 200
Top: 300
Bottom: 400""")
assert_3 = Assert(TestNames=panel_3, Expected=panel_5, Actual=cover_dimensions)  # -> Result, FailedInfo
assert_4 = Assert(TestNames="TestCoverDimensionsMeters_Normal_Init", Expected=panel_4, Actual=cover_dimensions_2)  # -> Result, FailedInfo

# ----
# Material
number_slider_3 = Slider(7850, range=0..10000)
division_2 = Division(A=number_slider_3, B="10e9")
panel_6 = Panel("""Material
Name: Name of the material
Grade: Grade of the material
Density: 7.85E-07""")
panel_7 = Panel("""Material
Name: Name of the material
Grade: Grade of the material
Density: 7850""")
material_3 = Material(Name="Name of the material", Grade="Grade of the material", Density=division_2)
material_4 = Material(Name="Name of the material", Grade="Grade of the material", Density="7850")
assert_5 = Assert(TestNames="TestMaterialMilimeters_Normal_Init", Expected=panel_6, Actual=material_3)  # -> Result, FailedInfo
assert_6 = Assert(TestNames="TestMaterialMeters_Normal_Init", Expected=panel_7, Actual=material_4)  # -> Result, FailedInfo

entwine = Entwine(Branch00=assert_5.Result, Branch01=assert_6.Result, FlattenInputs=True)  # -> flatten(Result)
entwine_2 = Entwine(Branch00=assert_3.Result, Branch01=assert_4.Result, FlattenInputs=True)  # -> flatten(Result)
entwine_3 = Entwine(Branch00=assert.Result, Branch01=assert_2.Result, FlattenInputs=True)  # -> flatten(Result)

# ----
# Stirrup Shape
number_slider_4 = Slider(7850, range=0..10000)
division_3 = Division(A=number_slider_4, B="10e9")
division_4 = Division(A=Slider(7850, range=0..10000), B="10e9")
division_5 = Division(A=Slider(7850, range=0..10000), B="10e9")
division_6 = Division(A=Slider(7850, range=0..10000), B="10e9")
material_5 = Material(Name="Name of the material", Grade="Grade of the material", Density=division_3)
material_6 = Material(Name="Name of the material", Grade="Grade of the material", Density=Slider(7850, range=0..10000))
material_7 = Material(Name="Name of the material", Grade="Grade of the material", Density=division_4)
material_8 = Material(Name="Name of the material", Grade="Grade of the material", Density=division_5)
material_9 = Material(Name="Name of the material", Grade="Grade of the material", Density=Slider(7850, range=0..10000))
material_10 = Material(Name="Name of the material", Grade="Grade of the material", Density=division_6)
material_11 = Material(Name="Name of the material", Grade="Grade of the material", Density=Slider(7850, range=0..10000))
material_12 = Material(Name="Name of the material", Grade="Grade of the material", Density=Slider(7850, range=0..10000))
material_13 = Material(Name="Name of the material", Grade="Grade of the material", Density=Slider(7850, range=0..10000))
material_14 = Material(Name="Name of the material", Grade="Grade of the material", Density=Slider(7850, range=0..10000))
rebar_properties_3 = RebarProperties(Diameter="12", Material=material_5)
rebar_properties_4 = RebarProperties(Diameter="12", Material=material_7)
rebar_properties_5 = RebarProperties(Diameter="0.012", Material=material_6)
rebar_properties_6 = RebarProperties(Diameter="12", Material=material_8)
rebar_properties_7 = RebarProperties(Diameter="12", Material=material_10)
rebar_properties_8 = RebarProperties(Diameter="0.012", Material=material_9)
rebar_properties_9 = RebarProperties(Diameter="0.012", Material=material_11)
rebar_properties_10 = RebarProperties(Diameter="0.012", Material=material_12)
rebar_properties_11 = RebarProperties(Diameter="0.008", Material=material_13)
rebar_properties_12 = RebarProperties(Diameter="0.012", Material=material_14)
xy = XYPlane(Origin=Point(0, 0, 0))
xy_2 = XYPlane(Origin=Point(0, 0, 0))
xz = XZPlane(Origin=Point(0, 0, 0))
xy_3 = XYPlane(Origin=Point(0, 0, 0))
xy_4 = XYPlane(Origin=Point(0, 0, 0))
xy_5 = XYPlane(Origin=Point(0, 0, 0))
xz_2 = XZPlane(Origin=Point(0, 0, 0))
xy_6 = XYPlane(Origin=Point(0, 0, 0))
xy_7 = XYPlane(Origin=Point(0, 0, 0))
xy_8 = XYPlane(Origin=Point(0, 0, 0))
stirrup_shape = StirrupShape(
    Plane=xy,
    Height=Slider(250, range=0..1000),
    Width=Slider(300, range=0..1000),
    HooksType="0",
    HookLength=Slider(100, range=0..100),
    Properties=rebar_properties_3,
    BendingRollerDiameter="80")  # -> RebarShape, Mesh
stirrup_shape_2 = StirrupShape(
    Plane=xy_2,
    Height=Slider(250, range=0..1000),
    Width=Slider(300, range=0..1000),
    HooksType="0",
    HookLength=Slider(200, range=0..1100),
    Properties=rebar_properties_4,
    BendingRollerDiameter="80")  # -> RebarShape, Mesh
stirrup_shape_3 = StirrupShape(
    Plane=xy_3,
    Height=Slider(0.25, range=0..1),
    Width=Slider(0.3, range=0..1),
    HooksType="0",
    HookLength=Slider(0.1, range=0..0.1),
    Properties=rebar_properties_5,
    BendingRollerDiameter="0.080")  # -> RebarShape, Mesh
stirrup_shape_4 = StirrupShape(
    Plane=xz,
    Height=Slider(250, range=0..1000),
    Width=Slider(300, range=0..1000),
    HooksType="0",
    HookLength=Slider(100, range=0..100),
    Properties=rebar_properties_6,
    BendingRollerDiameter="80")  # -> RebarShape, Mesh
stirrup_shape_5 = StirrupShape(
    Plane=xy_4,
    Height=Slider(250, range=0..1000),
    Width=Slider(300, range=0..1000),
    HooksType="1",
    HookLength=Slider(100, range=0..1100),
    Properties=rebar_properties_7,
    BendingRollerDiameter="80")  # -> RebarShape, Mesh
stirrup_shape_6 = StirrupShape(
    Plane=xy_5,
    Height=Slider(0.25, range=0..1),
    Width=Slider(0.3, range=0..1),
    HooksType="0",
    HookLength=Slider(0.2, range=0..0.2),
    Properties=rebar_properties_8,
    BendingRollerDiameter="0.080")  # -> RebarShape, Mesh
stirrup_shape_7 = StirrupShape(
    Plane=xz_2,
    Height=Slider(0.25, range=0..1),
    Width=Slider(0.3, range=0..1),
    HooksType="0",
    HookLength=Slider(0.1, range=0..0.1),
    Properties=rebar_properties_9,
    BendingRollerDiameter="0.080")  # -> RebarShape, Mesh
stirrup_shape_8 = StirrupShape(
    Plane=xy_6,
    Height=Slider(0.25, range=0..1),
    Width=Slider(0.3, range=0..1),
    HooksType="1",
    HookLength=Slider(0.1, range=0..0.1),
    Properties=rebar_properties_10,
    BendingRollerDiameter="0.048")  # -> RebarShape, Mesh
stirrup_shape_9 = StirrupShape(
    Plane=xy_7,
    Height=Slider(0.25, range=0..1),
    Width=Slider(0.3, range=0..1),
    HooksType="0",
    HookLength=Slider(0.1, range=0..0.1),
    Properties=rebar_properties_11,
    BendingRollerDiameter="0.080")  # -> RebarShape, Mesh
stirrup_shape_10 = StirrupShape(
    Plane=xy_8,
    Height=Slider(0.8, range=0..1),
    Width=Slider(0.2, range=0..1),
    HooksType="0",
    HookLength=Slider(0.1, range=0..0.1),
    Properties=rebar_properties_12,
    BendingRollerDiameter="0.080")  # -> RebarShape, Mesh
mesh = Mesh(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)
mesh_2 = Mesh(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)
mesh_3 = Mesh(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)
mesh_4 = Mesh(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)
mesh_5 = Mesh(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)
demesh = DeconstructMesh(Mesh=mesh)  # -> Vertices, Faces, Colours, Normals
demesh_2 = DeconstructMesh(Mesh=stirrup_shape.Mesh)  # -> Vertices, Faces, Colours, Normals
mesh_6 = Mesh(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)
mesh_7 = Mesh(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)
mesh_8 = Mesh(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)
demesh_3 = DeconstructMesh(Mesh=mesh_2)  # -> Vertices, Faces, Colours, Normals
mesh_9 = Mesh(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)
demesh_4 = DeconstructMesh(Mesh=stirrup_shape_2.Mesh)  # -> Vertices, Faces, Colours, Normals
demesh_5 = DeconstructMesh(Mesh=mesh_3)  # -> Vertices, Faces, Colours, Normals
demesh_6 = DeconstructMesh(Mesh=stirrup_shape_3.Mesh)  # -> Vertices, Faces, Colours, Normals
mesh_10 = Mesh(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)
demesh_7 = DeconstructMesh(Mesh=mesh_4)  # -> Vertices, Faces, Colours, Normals
demesh_8 = DeconstructMesh(Mesh=stirrup_shape_4.Mesh)  # -> Vertices, Faces, Colours, Normals
demesh_9 = DeconstructMesh(Mesh=mesh_5)  # -> Vertices, Faces, Colours, Normals
demesh_10 = DeconstructMesh(Mesh=stirrup_shape_5.Mesh)  # -> Vertices, Faces, Colours, Normals
demesh_11 = DeconstructMesh(Mesh=mesh_6)  # -> Vertices, Faces, Colours, Normals
demesh_12 = DeconstructMesh(Mesh=stirrup_shape_6.Mesh)  # -> Vertices, Faces, Colours, Normals
demesh_13 = DeconstructMesh(Mesh=mesh_7)  # -> Vertices, Faces, Colours, Normals
demesh_14 = DeconstructMesh(Mesh=stirrup_shape_7.Mesh)  # -> Vertices, Faces, Colours, Normals
demesh_15 = DeconstructMesh(Mesh=mesh_8)  # -> Vertices, Faces, Colours, Normals
demesh_16 = DeconstructMesh(Mesh=stirrup_shape_8.Mesh)  # -> Vertices, Faces, Colours, Normals
demesh_17 = DeconstructMesh(Mesh=mesh_9)  # -> Vertices, Faces, Colours, Normals
demesh_18 = DeconstructMesh(Mesh=stirrup_shape_9.Mesh)  # -> Vertices, Faces, Colours, Normals
demesh_19 = DeconstructMesh(Mesh=mesh_10)  # -> Vertices, Faces, Colours, Normals
demesh_20 = DeconstructMesh(Mesh=stirrup_shape_10.Mesh)  # -> Vertices, Faces, Colours, Normals
assert_point_list = AssertPointList(
    TestName="TestStirrupShapeMilimeters_XYPlane_Mesh",
    ExpectedPointList=demesh.Vertices,
    ActualPointList=demesh_2.Vertices,
    Tolerance="0.00001")  # -> Result, FailedInfo
assert_point_list_2 = AssertPointList(
    TestName="TestStirrupShapeMilimeters_HookLength_Mesh",
    ExpectedPointList=demesh_3.Vertices,
    ActualPointList=demesh_4.Vertices,
    Tolerance="0.00001")  # -> Result, FailedInfo
assert_point_list_3 = AssertPointList(
    TestName="TestStirrupShapeMeters_XYPlane_Mesh",
    ExpectedPointList=demesh_5.Vertices,
    ActualPointList=demesh_6.Vertices,
    Tolerance="0.00001")  # -> Result, FailedInfo
assert_point_list_4 = AssertPointList(
    TestName="TestStirrupShapeMilimeters_XZPlane_Mesh",
    ExpectedPointList=demesh_7.Vertices,
    ActualPointList=demesh_8.Vertices,
    Tolerance="0.00001")  # -> Result, FailedInfo
assert_point_list_5 = AssertPointList(
    TestName="TestStirrupShapeMilimeters_HookType1_Mesh",
    ExpectedPointList=demesh_9.Vertices,
    ActualPointList=demesh_10.Vertices,
    Tolerance="0.00001")  # -> Result, FailedInfo
assert_point_list_6 = AssertPointList(
    TestName="TestStirrupShapeMeters_HookLength_Mesh",
    ExpectedPointList=demesh_11.Vertices,
    ActualPointList=demesh_12.Vertices,
    Tolerance="0.00001")  # -> Result, FailedInfo
assert_point_list_7 = AssertPointList(
    TestName="TestStirrupShapeMeters_XZPlane_Mesh",
    ExpectedPointList=demesh_13.Vertices,
    ActualPointList=demesh_14.Vertices,
    Tolerance="0.00001")  # -> Result, FailedInfo
assert_point_list_8 = AssertPointList(
    TestName="TestStirrupShapeMeters_HookType1AndBendingRoller_Mesh",
    ExpectedPointList=demesh_15.Vertices,
    ActualPointList=demesh_16.Vertices,
    Tolerance="0.00001")  # -> Result, FailedInfo
assert_point_list_9 = AssertPointList(
    TestName="TestStirrupShapeMeters_Diameter_Mesh",
    ExpectedPointList=demesh_17.Vertices,
    ActualPointList=demesh_18.Vertices,
    Tolerance="0.00001")  # -> Result, FailedInfo
assert_point_list_10 = AssertPointList(
    TestName="TestStirrupShapeMeters_HeightAndWidth_Mesh",
    ExpectedPointList=demesh_19.Vertices,
    ActualPointList=demesh_20.Vertices,
    Tolerance="0.00001")  # -> Result, FailedInfo

# ----
# Spacer Shape
number_slider_5 = Slider(7850, range=0..10000)
division_7 = Division(A=number_slider_5, B="10e9")
division_8 = Division(A=Slider(7850, range=0..10000), B="10e9")
material_15 = Material(Name="Name of the material", Grade="Grade of the material", Density=division_7)
material_16 = Material(Name="Name of the material", Grade="Grade of the material", Density=division_8)
material_17 = Material(Name="Name of the material", Grade="Grade of the material", Density=Slider(7850, range=0..10000))
material_18 = Material(Name="Name of the material", Grade="Grade of the material", Density=Slider(7850, range=0..10000))
rebar_properties_13 = RebarProperties(Diameter="20", Material=material_15)
rebar_properties_14 = RebarProperties(Diameter="20", Material=material_16)
rebar_properties_15 = RebarProperties(Diameter="0.010", Material=material_17)
rebar_properties_16 = RebarProperties(Diameter="0.020", Material=material_18)
pt = Point(Point(0, 0, 0))
xy_9 = XYPlane(Origin=Point(0, 0, 0))
xy_10 = XYPlane(Origin=Point(0, 0, 0))
xz_3 = XZPlane(Origin=pt)
xy_11 = XYPlane(Origin=Point(0, 0, 0))
spacer_shape = SpacerShape(
    Plane=xy_9,
    Height=Slider(200, range=0..1000),
    Length=Slider(300, range=0..1000),
    Width=Slider(500, range=0..1000),
    Properties=rebar_properties_13,
    BendingRollerDiameter="80")  # -> RebarShape, Mesh
spacer_shape_2 = SpacerShape(
    Plane=xz_3,
    Height=Slider(200, range=0..1000),
    Length=Slider(300, range=0..1000),
    Width=Slider(500, range=0..1000),
    Properties=rebar_properties_14,
    BendingRollerDiameter="80")  # -> RebarShape, Mesh
spacer_shape_3 = SpacerShape(
    Plane=xy_10,
    Height=Slider(0.2, range=0..0.2),
    Length=Slider(0.3, range=0..0.3),
    Width=Slider(0.5, range=0..0.5),
    Properties=rebar_properties_15,
    BendingRollerDiameter="0.080")  # -> RebarShape, Mesh
spacer_shape_4 = SpacerShape(
    Plane=xy_11,
    Height=Slider(0.2, range=0..0.2),
    Length=Slider(0.3, range=0..0.3),
    Width=Slider(0.5, range=0..0.5),
    Properties=rebar_properties_16,
    BendingRollerDiameter="0.080")  # -> RebarShape, Mesh
mesh_11 = Mesh(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)
mesh_12 = Mesh(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)
mesh_13 = Mesh(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)
mesh_14 = Mesh(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)
demesh_21 = DeconstructMesh(Mesh=mesh_11)  # -> Vertices, Faces, Colours, Normals
demesh_22 = DeconstructMesh(Mesh=spacer_shape.Mesh)  # -> Vertices, Faces, Colours, Normals
demesh_23 = DeconstructMesh(Mesh=mesh_12)  # -> Vertices, Faces, Colours, Normals
demesh_24 = DeconstructMesh(Mesh=spacer_shape_2.Mesh)  # -> Vertices, Faces, Colours, Normals
demesh_25 = DeconstructMesh(Mesh=mesh_13)  # -> Vertices, Faces, Colours, Normals
demesh_26 = DeconstructMesh(Mesh=spacer_shape_3.Mesh)  # -> Vertices, Faces, Colours, Normals
demesh_27 = DeconstructMesh(Mesh=mesh_14)  # -> Vertices, Faces, Colours, Normals
demesh_28 = DeconstructMesh(Mesh=spacer_shape_4.Mesh)  # -> Vertices, Faces, Colours, Normals
assert_point_list_11 = AssertPointList(
    TestName="TestSpacerShapeMilimeters_XYPlane_Mesh",
    ExpectedPointList=demesh_21.Vertices,
    ActualPointList=demesh_22.Vertices,
    Tolerance="0.00001")  # -> Result, FailedInfo
assert_point_list_12 = AssertPointList(
    TestName="TestSpacerShapeMilimeters_XZPlane_Mesh",
    ExpectedPointList=demesh_23.Vertices,
    ActualPointList=demesh_24.Vertices,
    Tolerance="0.00001")  # -> Result, FailedInfo
assert_point_list_13 = AssertPointList(
    TestName="TestSpacerShapeMeters_Diameter_Mesh",
    ExpectedPointList=demesh_25.Vertices,
    ActualPointList=demesh_26.Vertices,
    Tolerance="0.00001")  # -> Result, FailedInfo
assert_point_list_14 = AssertPointList(
    TestName="TestSpacerShapeMeters_XYPlane_Mesh",
    ExpectedPointList=demesh_27.Vertices,
    ActualPointList=demesh_28.Vertices,
    Tolerance="0.00001")  # -> Result, FailedInfo

# ----
# L-Bar Shape
number_slider_6 = Slider(7850, range=0..10000)
division_9 = Division(A=number_slider_6, B="10e9")
division_10 = Division(A=Slider(7850, range=0..10000), B="10e9")
material_19 = Material(Name="Name of the material", Grade="Grade of the material", Density=Slider(7850, range=0..10000))
material_20 = Material(Name="Name of the material", Grade="Grade of the material", Density=division_9)
material_21 = Material(Name="Name of the material", Grade="Grade of the material", Density=Slider(7850, range=0..10000))
material_22 = Material(Name="Name of the material", Grade="Grade of the material", Density=division_10)
rebar_properties_17 = RebarProperties(Diameter="0.010", Material=material_19)
pt_2 = Point(Point(1.360044089, 1.132041681, 0))
rebar_properties_18 = RebarProperties(Diameter="20", Material=material_20)
rebar_properties_19 = RebarProperties(Diameter="0.020", Material=material_21)
rebar_properties_20 = RebarProperties(Diameter="20", Material=material_22)
pt_3 = Point(Point(1.360044089, 1.132041681, 0))
pt_4 = Point(Point(10, 20, 30))
yz = YZPlane(Origin=pt_2)
xy_12 = XYPlane(Origin=Point(0, 0, 0))
yz_2 = YZPlane(Origin=pt_3)
xz_4 = XZPlane(Origin=pt_4)
l_bar_shape = LBarShape(
    Plane=yz,
    Height=Slider(0.2, range=0..0.2),
    Width=Slider(0.1, range=0..0.2),
    Properties=rebar_properties_17,
    BendingRollerDiameter="0.080")  # -> RebarShape, Mesh
l_bar_shape_2 = LBarShape(
    Plane=xy_12,
    Height=Slider(100, range=0..1000),
    Width=Slider(200, range=0..1000),
    Properties=rebar_properties_18,
    BendingRollerDiameter="80")  # -> RebarShape, Mesh
l_bar_shape_3 = LBarShape(
    Plane=yz_2,
    Height=Slider(0.2, range=0..0.2),
    Width=Slider(0.1, range=0..0.2),
    Properties=rebar_properties_19,
    BendingRollerDiameter="0.080")  # -> RebarShape, Mesh
l_bar_shape_4 = LBarShape(
    Plane=xz_4,
    Height=Slider(100, range=0..1000),
    Width=Slider(200, range=0..1000),
    Properties=rebar_properties_20,
    BendingRollerDiameter="80")  # -> RebarShape, Mesh
mesh_15 = Mesh(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)
mesh_16 = Mesh(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)
mesh_17 = Mesh(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)
mesh_18 = Mesh(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)
demesh_29 = DeconstructMesh(Mesh=mesh_15)  # -> Vertices, Faces, Colours, Normals
demesh_30 = DeconstructMesh(Mesh=l_bar_shape.Mesh)  # -> Vertices, Faces, Colours, Normals
demesh_31 = DeconstructMesh(Mesh=mesh_16)  # -> Vertices, Faces, Colours, Normals
demesh_32 = DeconstructMesh(Mesh=l_bar_shape_2.Mesh)  # -> Vertices, Faces, Colours, Normals
demesh_33 = DeconstructMesh(Mesh=mesh_17)  # -> Vertices, Faces, Colours, Normals
demesh_34 = DeconstructMesh(Mesh=l_bar_shape_3.Mesh)  # -> Vertices, Faces, Colours, Normals
demesh_35 = DeconstructMesh(Mesh=mesh_18)  # -> Vertices, Faces, Colours, Normals
demesh_36 = DeconstructMesh(Mesh=l_bar_shape_4.Mesh)  # -> Vertices, Faces, Colours, Normals
assert_point_list_15 = AssertPointList(
    TestName="TestLBarShapeMeters_Diameter_Mesh",
    ExpectedPointList=demesh_29.Vertices,
    ActualPointList=demesh_30.Vertices,
    Tolerance="0.00001")  # -> Result, FailedInfo
assert_point_list_16 = AssertPointList(
    TestName="TestLBarShapeMilimeters_XYPlane_Mesh",
    ExpectedPointList=demesh_31.Vertices,
    ActualPointList=demesh_32.Vertices,
    Tolerance="0.00001")  # -> Result, FailedInfo
assert_point_list_17 = AssertPointList(
    TestName="TestLBarShapeMilimeters_XZPlane_Mesh",
    ExpectedPointList=demesh_35.Vertices,
    ActualPointList=demesh_36.Vertices,
    Tolerance="0.00001")  # -> Result, FailedInfo
assert_point_list_18 = AssertPointList(
    TestName="TestLBarShapeMeters_YZPlane_Mesh",
    ExpectedPointList=demesh_33.Vertices,
    ActualPointList=demesh_34.Vertices,
    Tolerance="0.00001")  # -> Result, FailedInfo

entwine_4 = Entwine(
    Branch00=assert_point_list_16.Result,
    Branch01=assert_point_list_17.Result,
    Branch02=assert_point_list_18.Result,
    Branch03=assert_point_list_15.Result,
    FlattenInputs=True)  # -> flatten(Result)
entwine_5 = Entwine(
    Branch00=assert_point_list_11.Result,
    Branch01=assert_point_list_12.Result,
    Branch02=assert_point_list_14.Result,
    Branch03=assert_point_list_13.Result,
    FlattenInputs=True)  # -> flatten(Result)
entwine_6 = Entwine(
    Branch00=assert_point_list.Result,
    Branch01=assert_point_list_2.Result,
    Branch02=assert_point_list_5.Result,
    Branch03=assert_point_list_4.Result,
    Branch04=assert_point_list_3.Result,
    Branch05=assert_point_list_6.Result,
    Branch06=assert_point_list_8.Result,
    Branch07=assert_point_list_7.Result,
    Branch08=assert_point_list_9.Result,
    Branch09=assert_point_list_10.Result,
    FlattenInputs=True)  # -> flatten(Result)

# ----
# Rectangle To Line Bar Shape
number_slider_7 = Slider(7850, range=0..10000)
number_slider_8 = Slider(100, range=0..1000)
number_slider_9 = Slider(100, range=0..1000)
number_slider_10 = Slider(150, range=0..1000)
number_slider_11 = Slider(150, range=0..1000)
number_slider_12 = Slider(100, range=0..1000)
number_slider_13 = Slider(150, range=0..1000)
division_11 = Division(A=number_slider_7, B="10e9")
division_12 = Division(A=Slider(7850, range=0..10000), B="10e9")
division_13 = Division(A=Slider(7850, range=0..10000), B="10e9")
division_14 = Division(A=Slider(7850, range=0..10000), B="10e9")
neg = Negative(Value=number_slider_9)
neg_2 = Negative(Value=number_slider_10)
material_23 = Material(Name="Name of the material", Grade="Grade of the material", Density=division_11)
neg_3 = Negative(Value=number_slider_8)
division_15 = Division(A=Slider(7850, range=0..10000), B="10e9")
neg_4 = Negative(Value=number_slider_11)
material_24 = Material(Name="Name of the material", Grade="Grade of the material", Density=division_12)
xy_13 = XYPlane(Origin=Point(0, 0, 0))
division_16 = Division(A=Slider(7850, range=0..10000), B="10e9")
xy_14 = XYPlane(Origin=Point(0, 0, 0))
material_25 = Material(Name="Name of the material", Grade="Grade of the material", Density=division_13)
xy_15 = XYPlane(Origin=Point(0, 0, 0))
material_26 = Material(Name="Name of the material", Grade="Grade of the material", Density=division_14)
dom = ConstructDomain(DomainStart=number_slider_9, DomainEnd=neg)
dom_2 = ConstructDomain(DomainStart=0, DomainEnd=Slider(300, range=0..1000))
division_17 = Division(A=Slider(7850, range=0..10000), B="10e9")
dom_3 = ConstructDomain(DomainStart=0, DomainEnd=Slider(200, range=0..1000))
dom_4 = ConstructDomain(DomainStart=number_slider_10, DomainEnd=neg_2)
division_18 = Division(A=Slider(7850, range=0..10000), B="10e9")
neg_5 = Negative(Value=number_slider_12)
xy_16 = XYPlane(Origin=Point(0, 0, 0))
material_27 = Material(Name="Name of the material", Grade="Grade of the material", Density=division_15)
neg_6 = Negative(Value=number_slider_13)
dom_5 = ConstructDomain(DomainStart=number_slider_8, DomainEnd=neg_3)
dom_6 = ConstructDomain(DomainStart=number_slider_11, DomainEnd=neg_4)
division_19 = Division(A=Slider(7850, range=0..10000), B="10e9")
rectangle = Rectangle(Plane=xy_13, XSize=Slider(200, range=0..1000), YSize=Slider(300, range=0..1000), Radius=0)  # -> Rectangle, Length
xy_17 = XYPlane(Origin=Point(0, 0, 0))
neg_7 = Negative(Value=Slider(200, range=0..1000))
material_28 = Material(Name="Name of the material", Grade="Grade of the material", Density=division_16)
rectangle_2 = Rectangle(Plane=xy_14, XSize=Slider(200, range=0..1000), YSize=Slider(300, range=0..1000), Radius=0)  # -> Rectangle, Length
xy_18 = XYPlane(Origin=Point(0, 0, 0))
neg_8 = Negative(Value=Slider(200, range=0..1000))
neg_9 = Negative(Value=Slider(300, range=0..1000))
material_29 = Material(Name="Name of the material", Grade="Grade of the material", Density=Slider(7850, range=0..10000))
rectangle_3 = Rectangle(Plane=xy_15, XSize=Slider(200, range=0..1000), YSize=Slider(300, range=0..1000), Radius=0)  # -> Rectangle, Length
material_30 = Material(Name="Name of the material", Grade="Grade of the material", Density=division_17)
xy_19 = XYPlane(Origin=Point(0, 0, 0))
material_31 = Material(Name="Name of the material", Grade="Grade of the material", Density=division_18)
rectangle_4 = Rectangle(Plane=xy_16, XSize=Slider(200, range=0..1000), YSize=Slider(300, range=0..1000), Radius=0)  # -> Rectangle, Length
material_32 = Material(Name="Name of the material", Grade="Grade of the material", Density=Slider(7850, range=0..10000))
xy_20 = XYPlane(Origin=Point(0, 0, 0))
dom_7 = ConstructDomain(DomainStart=number_slider_12, DomainEnd=neg_5)
dom_8 = ConstructDomain(DomainStart=number_slider_13, DomainEnd=neg_6)
division_20 = Division(A=Slider(7850, range=0..10000), B="10e9")
material_33 = Material(Name="Name of the material", Grade="Grade of the material", Density=division_19)
xy_21 = XYPlane(Origin=Point(0, 0, 0))
xz_5 = XZPlane(Origin=Point(0, 0, 0))
cover_dimensions_3 = CoverDimensions(
    Left=Slider(10, range=0..100),
    Right=Slider(20, range=0..100),
    Top=Slider(30, range=0..100),
    Bottom=Slider(40, range=0..100))
rectangle_5 = Rectangle(Plane=xy_17, XSize=neg_7, YSize=Slider(300, range=0..1000), Radius=0)  # -> Rectangle, Length
xy_22 = XYPlane(Origin=Point(0, 0, 0))
rebar_properties_21 = RebarProperties(Diameter="20", Material=material_23)
cover_dimensions_4 = CoverDimensions(
    Left=Slider(10, range=0..100),
    Right=Slider(20, range=0..100),
    Top=Slider(30, range=0..100),
    Bottom=Slider(40, range=0..100))
rectangle_6 = Rectangle(Plane=xy_18, XSize=neg_8, YSize=neg_9, Radius=0)  # -> Rectangle, Length
rebar_properties_22 = RebarProperties(Diameter="20", Material=material_24)
cover_dimensions_5 = CoverDimensions(
    Left=Slider(10, range=0..100),
    Right=Slider(20, range=0..100),
    Top=Slider(30, range=0..100),
    Bottom=Slider(40, range=0..100))
rectangle_7 = Rectangle(Plane=xy_19, XSize=Slider(0.2, range=0..1), YSize=Slider(0.3, range=0..1), Radius=0)  # -> Rectangle, Length
rebar_properties_23 = RebarProperties(Diameter="20", Material=material_25)
cover_dimensions_6 = CoverDimensions(
    Left=Slider(10, range=0..100),
    Right=Slider(20, range=0..100),
    Top=Slider(30, range=0..100),
    Bottom=Slider(40, range=0..100))
rectangle_8 = Rectangle(Plane=xy_20, XSize=dom, YSize=dom_2, Radius=0)  # -> Rectangle, Length
material_34 = Material(Name="Name of the material", Grade="Grade of the material", Density=division_20)
rectangle_9 = Rectangle(Plane=xy_21, XSize=dom_3, YSize=dom_4, Radius=0)  # -> Rectangle, Length
rebar_properties_24 = RebarProperties(Diameter="20", Material=material_26)
rectangle_10 = Rectangle(Plane=xz_5, XSize=Slider(0.2, range=0..1), YSize=Slider(0.3, range=0..1), Radius=0)  # -> Rectangle, Length
cover_dimensions_7 = CoverDimensions(
    Left=Slider(10, range=0..100),
    Right=Slider(20, range=0..100),
    Top=Slider(30, range=0..100),
    Bottom=Slider(40, range=0..100))
xy_23 = XYPlane(Origin=Point(0, 0, 0))
rectangle_11 = Rectangle(Plane=xy_22, XSize=dom_5, YSize=dom_6, Radius=0)  # -> Rectangle, Length
rebar_properties_25 = RebarProperties(Diameter="20", Material=material_27)
cover_dimensions_8 = CoverDimensions(
    Left=Slider(10, range=0..100),
    Right=Slider(20, range=0..100),
    Top=Slider(30, range=0..100),
    Bottom=Slider(40, range=0..100))
rebar_properties_26 = RebarProperties(Diameter="20", Material=material_28)
cover_dimensions_9 = CoverDimensions(
    Left=Slider(0.01, range=0..0.11),
    Right=Slider(0.02, range=0..0.11),
    Top=Slider(0.03, range=0..0.11),
    Bottom=Slider(0.04, range=0..0.11))
cover_dimensions_10 = CoverDimensions(
    Left=Slider(10, range=0..100),
    Right=Slider(20, range=0..100),
    Top=Slider(30, range=0..100),
    Bottom=Slider(40, range=0..100))
rebar_properties_27 = RebarProperties(Diameter="0.020", Material=material_29)
cover_dimensions_11 = CoverDimensions(
    Left=Slider(10, range=0..100),
    Right=Slider(20, range=0..100),
    Top=Slider(30, range=0..100),
    Bottom=Slider(40, range=0..100))
rebar_properties_28 = RebarProperties(Diameter="20", Material=material_30)
cover_dimensions_12 = CoverDimensions(
    Left=Slider(0.01, range=0..0.11),
    Right=Slider(0.02, range=0..0.11),
    Top=Slider(0.03, range=0..0.11),
    Bottom=Slider(0.04, range=0..0.11))
rectangle_12 = Rectangle(Plane=xy_23, XSize=dom_7, YSize=dom_8, Radius=0)  # -> Rectangle, Length
rebar_properties_29 = RebarProperties(Diameter="20", Material=material_31)
cover_dimensions_13 = CoverDimensions(
    Left=Slider(10, range=0..100),
    Right=Slider(20, range=0..100),
    Top=Slider(30, range=0..100),
    Bottom=Slider(40, range=0..100))
rebar_properties_30 = RebarProperties(Diameter="0.020", Material=material_32)
rebar_properties_31 = RebarProperties(Diameter="20", Material=material_33)
rectangle_to_line_bar_shape = RectangleToLineBarShape(
    Rectangle=rectangle.Rectangle,
    Properties=rebar_properties_21,
    Position=Slider(0, range=0..3),
    CoverDimensions=cover_dimensions_3)  # -> RebarShape, Mesh
rectangle_to_line_bar_shape_2 = RectangleToLineBarShape(
    Rectangle=rectangle_2.Rectangle,
    Properties=rebar_properties_22,
    Position=Slider(1, range=0..3),
    CoverDimensions=cover_dimensions_4)  # -> RebarShape, Mesh
panel_8 = Panel("TestLineBarShapeMilimeters_XYPlaneRectangleNegativeXAndY_Mesh")
rectangle_to_line_bar_shape_3 = RectangleToLineBarShape(
    Rectangle=rectangle_3.Rectangle,
    Properties=rebar_properties_23,
    Position=Slider(2, range=0..3),
    CoverDimensions=cover_dimensions_5)  # -> RebarShape, Mesh
cover_dimensions_14 = CoverDimensions(
    Left=Slider(10, range=0..100),
    Right=Slider(20, range=0..100),
    Top=Slider(30, range=0..100),
    Bottom=Slider(40, range=0..100))
rectangle_to_line_bar_shape_4 = RectangleToLineBarShape(
    Rectangle=rectangle_4.Rectangle,
    Properties=rebar_properties_24,
    Position=Slider(3, range=0..3),
    CoverDimensions=cover_dimensions_6)  # -> RebarShape, Mesh
rebar_properties_32 = RebarProperties(Diameter="12", Material=material_34)
panel_9 = Panel("TestLineBarShapeMilimeters_XYPlaneRectangleWithDescendingX_Mesh")
panel_10 = Panel("TestLineBarShapeMilimeters_XYPlaneRectangleWithDescendingXAndY_Mesh")
panel_11 = Panel("TestLineBarShapeMilimeters_XYPlaneRectangleWithDescendingY_Mesh")
rectangle_to_line_bar_shape_5 = RectangleToLineBarShape(
    Rectangle=rectangle_5.Rectangle,
    Properties=rebar_properties_25,
    Position=Slider(0, range=0..3),
    CoverDimensions=cover_dimensions_7)  # -> RebarShape, Mesh
rectangle_to_line_bar_shape_6 = RectangleToLineBarShape(
    Rectangle=rectangle_6.Rectangle,
    Properties=rebar_properties_26,
    Position=Slider(0, range=0..3),
    CoverDimensions=cover_dimensions_8)  # -> RebarShape, Mesh
rectangle_to_line_bar_shape_7 = RectangleToLineBarShape(
    Rectangle=rectangle_7.Rectangle,
    Properties=rebar_properties_27,
    Position=Slider(0, range=0..3),
    CoverDimensions=cover_dimensions_9)  # -> RebarShape, Mesh
rectangle_to_line_bar_shape_8 = RectangleToLineBarShape(
    Rectangle=rectangle_8.Rectangle,
    Properties=rebar_properties_28,
    Position=Slider(0, range=0..3),
    CoverDimensions=cover_dimensions_10)  # -> RebarShape, Mesh
rectangle_to_line_bar_shape_9 = RectangleToLineBarShape(
    Rectangle=rectangle_9.Rectangle,
    Properties=rebar_properties_29,
    Position=Slider(0, range=0..3),
    CoverDimensions=cover_dimensions_11)  # -> RebarShape, Mesh
rectangle_to_line_bar_shape_10 = RectangleToLineBarShape(
    Rectangle=rectangle_10.Rectangle,
    Properties=rebar_properties_30,
    Position=Slider(0, range=0..3),
    CoverDimensions=cover_dimensions_12)  # -> RebarShape, Mesh
rectangle_to_line_bar_shape_11 = RectangleToLineBarShape(
    Rectangle=rectangle_11.Rectangle,
    Properties=rebar_properties_31,
    Position=Slider(0, range=0..3),
    CoverDimensions=cover_dimensions_13)  # -> RebarShape, Mesh
mesh_19 = Mesh(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)
mesh_20 = Mesh(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)
mesh_21 = Mesh(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)
rectangle_to_line_bar_shape_12 = RectangleToLineBarShape(
    Rectangle=rectangle_12.Rectangle,
    Properties=rebar_properties_32,
    Position=Slider(0, range=0..3),
    CoverDimensions=cover_dimensions_14)  # -> RebarShape, Mesh
demesh_37 = DeconstructMesh(Mesh=rectangle_to_line_bar_shape.Mesh)  # -> Vertices, Faces, Colours, Normals
mesh_22 = Mesh(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)
demesh_38 = DeconstructMesh(Mesh=mesh_19)  # -> Vertices, Faces, Colours, Normals
demesh_39 = DeconstructMesh(Mesh=rectangle_to_line_bar_shape_2.Mesh)  # -> Vertices, Faces, Colours, Normals
demesh_40 = DeconstructMesh(Mesh=mesh_20)  # -> Vertices, Faces, Colours, Normals
mesh_23 = Mesh(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)
mesh_24 = Mesh(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)
demesh_41 = DeconstructMesh(Mesh=rectangle_to_line_bar_shape_3.Mesh)  # -> Vertices, Faces, Colours, Normals
demesh_42 = DeconstructMesh(Mesh=mesh_21)  # -> Vertices, Faces, Colours, Normals
demesh_43 = DeconstructMesh(Mesh=rectangle_to_line_bar_shape_4.Mesh)  # -> Vertices, Faces, Colours, Normals
demesh_44 = DeconstructMesh(Mesh=mesh_22)  # -> Vertices, Faces, Colours, Normals
mesh_25 = Mesh(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)
demesh_45 = DeconstructMesh(Mesh=rectangle_to_line_bar_shape_5.Mesh)  # -> Vertices, Faces, Colours, Normals
mesh_26 = Mesh(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)
demesh_46 = DeconstructMesh(Mesh=mesh_23)  # -> Vertices, Faces, Colours, Normals
mesh_27 = Mesh(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)
mesh_28 = Mesh(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)
demesh_47 = DeconstructMesh(Mesh=rectangle_to_line_bar_shape_6.Mesh)  # -> Vertices, Faces, Colours, Normals
demesh_48 = DeconstructMesh(Mesh=mesh_24)  # -> Vertices, Faces, Colours, Normals
mesh_29 = Mesh(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)
demesh_49 = DeconstructMesh(Mesh=rectangle_to_line_bar_shape_7.Mesh)  # -> Vertices, Faces, Colours, Normals
demesh_50 = DeconstructMesh(Mesh=mesh_25)  # -> Vertices, Faces, Colours, Normals
demesh_51 = DeconstructMesh(Mesh=rectangle_to_line_bar_shape_8.Mesh)  # -> Vertices, Faces, Colours, Normals
demesh_52 = DeconstructMesh(Mesh=mesh_26)  # -> Vertices, Faces, Colours, Normals
demesh_53 = DeconstructMesh(Mesh=rectangle_to_line_bar_shape_9.Mesh)  # -> Vertices, Faces, Colours, Normals
demesh_54 = DeconstructMesh(Mesh=mesh_27)  # -> Vertices, Faces, Colours, Normals
assert_point_list_19 = AssertPointList(
    TestName="TestLineBarShapeMilimeters_XYPlaneRectangle_Mesh",
    ExpectedPointList=demesh_38.Vertices,
    ActualPointList=demesh_37.Vertices,
    Tolerance="0.00001")  # -> Result, FailedInfo
demesh_55 = DeconstructMesh(Mesh=rectangle_to_line_bar_shape_10.Mesh)  # -> Vertices, Faces, Colours, Normals
demesh_56 = DeconstructMesh(Mesh=mesh_28)  # -> Vertices, Faces, Colours, Normals
demesh_57 = DeconstructMesh(Mesh=rectangle_to_line_bar_shape_11.Mesh)  # -> Vertices, Faces, Colours, Normals
demesh_58 = DeconstructMesh(Mesh=mesh_29)  # -> Vertices, Faces, Colours, Normals
assert_point_list_20 = AssertPointList(
    TestName="TestLineBarShapeMilimeters_Position1_Mesh",
    ExpectedPointList=demesh_40.Vertices,
    ActualPointList=demesh_39.Vertices,
    Tolerance="0.00001")  # -> Result, FailedInfo
mesh_30 = Mesh(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)
assert_point_list_21 = AssertPointList(
    TestName="TestLineBarShapeMilimeters_Position2_Mesh",
    ExpectedPointList=demesh_42.Vertices,
    ActualPointList=demesh_41.Vertices,
    Tolerance="0.00001")  # -> Result, FailedInfo
assert_point_list_22 = AssertPointList(
    TestName="TestLineBarShapeMilimeters_Position3_Mesh",
    ExpectedPointList=demesh_44.Vertices,
    ActualPointList=demesh_43.Vertices,
    Tolerance="0.00001")  # -> Result, FailedInfo
assert_point_list_23 = AssertPointList(
    TestName="TestLineBarShapeMilimeters_XYPlaneRectangleNegativeX_Mesh",
    ExpectedPointList=demesh_46.Vertices,
    ActualPointList=demesh_45.Vertices,
    Tolerance="0.00001")  # -> Result, FailedInfo
demesh_59 = DeconstructMesh(Mesh=rectangle_to_line_bar_shape_12.Mesh)  # -> Vertices, Faces, Colours, Normals
demesh_60 = DeconstructMesh(Mesh=mesh_30)  # -> Vertices, Faces, Colours, Normals
assert_point_list_24 = AssertPointList(TestName=panel_8, ExpectedPointList=demesh_48.Vertices, ActualPointList=demesh_47.Vertices, Tolerance="0.00001")  # -> Result, FailedInfo
assert_point_list_25 = AssertPointList(
    TestName="TestLineBarShapeMeters_XYPlaneRectangle_Mesh",
    ExpectedPointList=demesh_50.Vertices,
    ActualPointList=demesh_49.Vertices,
    Tolerance="0.00001")  # -> Result, FailedInfo
assert_point_list_26 = AssertPointList(TestName=panel_9, ExpectedPointList=demesh_52.Vertices, ActualPointList=demesh_51.Vertices, Tolerance="0.00001")  # -> Result, FailedInfo
assert_point_list_27 = AssertPointList(TestName=panel_11, ExpectedPointList=demesh_54.Vertices, ActualPointList=demesh_53.Vertices, Tolerance="0.00001")  # -> Result, FailedInfo
assert_point_list_28 = AssertPointList(
    TestName="TestLineBarShapeMeters_XZPlaneRectangle_Mesh",
    ExpectedPointList=demesh_56.Vertices,
    ActualPointList=demesh_55.Vertices,
    Tolerance="0.00001")  # -> Result, FailedInfo
assert_point_list_29 = AssertPointList(TestName=panel_10, ExpectedPointList=demesh_58.Vertices, ActualPointList=demesh_57.Vertices, Tolerance="0.00001")  # -> Result, FailedInfo
assert_point_list_30 = AssertPointList(
    TestName="TestLineBarShapeMilimeters_Diameter_Mesh",
    ExpectedPointList=demesh_60.Vertices,
    ActualPointList=demesh_59.Vertices,
    Tolerance="0.00001")  # -> Result, FailedInfo

entwine_7 = Entwine(
    Branch00=assert_point_list_19.Result,
    Branch01=assert_point_list_20.Result,
    Branch02=assert_point_list_21.Result,
    Branch03=assert_point_list_22.Result,
    Branch04=assert_point_list_23.Result,
    Branch05=assert_point_list_24.Result,
    Branch06=assert_point_list_26.Result,
    Branch07=assert_point_list_27.Result,
    Branch08=assert_point_list_29.Result,
    Branch09=assert_point_list_30.Result,
    Branch010=assert_point_list_25.Result,
    Branch011=assert_point_list_28.Result,
    FlattenInputs=True)  # -> flatten(Result)

# ----
# Rectangle To U-Bar Shape
number_slider_14 = Slider(7850, range=0..10000)
division_21 = Division(A=number_slider_14, B="10e9")
division_22 = Division(A=Slider(7850, range=0..10000), B="10e9")
division_23 = Division(A=Slider(7850, range=0..10000), B="10e9")
number_slider_15 = Slider(0.2, range=0..1)
material_35 = Material(Name="Name of the material", Grade="Grade of the material", Density=division_21)
material_36 = Material(Name="Name of the material", Grade="Grade of the material", Density=division_22)
division_24 = Division(A=Slider(7850, range=0..10000), B="10e9")
division_25 = Division(A=Slider(7850, range=0..10000), B="10e9")
material_37 = Material(Name="Name of the material", Grade="Grade of the material", Density=division_23)
xy_24 = XYPlane(Origin=Point(0, 0, 0))
xy_25 = XYPlane(Origin=Point(0, 0, 0))
division_26 = Division(A=Slider(7850, range=0..10000), B="10e9")
xy_26 = XYPlane(Origin=Point(0, 0, 0))
material_38 = Material(Name="Name of the material", Grade="Grade of the material", Density=division_24)
material_39 = Material(Name="Name of the material", Grade="Grade of the material", Density=division_25)
xy_27 = XYPlane(Origin=Point(0, 0, 0))
material_40 = Material(Name="Name of the material", Grade="Grade of the material", Density=division_26)
xy_28 = XYPlane(Origin=Point(0, 0, 0))
neg_10 = Negative(Value=number_slider_15)
rectangle_13 = Rectangle(Plane=xy_24, XSize=Slider(200, range=0..1000), YSize=Slider(300, range=0..1000), Radius=0)  # -> Rectangle, Length
material_41 = Material(Name="Name of the material", Grade="Grade of the material", Density=Slider(7850, range=0..10000))
rectangle_14 = Rectangle(Plane=xy_25, XSize=Slider(200, range=0..1000), YSize=Slider(300, range=0..1000), Radius=0)  # -> Rectangle, Length
material_42 = Material(Name="Name of the material", Grade="Grade of the material", Density=Slider(7850, range=0..10000))
xy_29 = XYPlane(Origin=Point(0, 0, 0))
rebar_properties_33 = RebarProperties(Diameter="12", Material=material_35)
cover_dimensions_15 = CoverDimensions(
    Left=Slider(10, range=0..100),
    Right=Slider(20, range=0..100),
    Top=Slider(30, range=0..100),
    Bottom=Slider(40, range=0..100))
rectangle_15 = Rectangle(Plane=xy_26, XSize=Slider(200, range=0..1000), YSize=Slider(300, range=0..1000), Radius=0)  # -> Rectangle, Length
material_43 = Material(Name="Name of the material", Grade="Grade of the material", Density=Slider(7850, range=0..10000))
rebar_properties_34 = RebarProperties(Diameter="20", Material=material_36)
cover_dimensions_16 = CoverDimensions(
    Left=Slider(10, range=0..100),
    Right=Slider(20, range=0..100),
    Top=Slider(30, range=0..100),
    Bottom=Slider(40, range=0..100))
material_44 = Material(Name="Name of the material", Grade="Grade of the material", Density=Slider(7850, range=0..10000))
rebar_properties_35 = RebarProperties(Diameter="12", Material=material_37)
cover_dimensions_17 = CoverDimensions(
    Left=Slider(10, range=0..100),
    Right=Slider(20, range=0..100),
    Top=Slider(30, range=0..100),
    Bottom=Slider(40, range=0..100))
dom_9 = ConstructDomain(DomainStart=number_slider_15, DomainEnd=neg_10)
xy_30 = XYPlane(Origin=Point(0, 0, 0))
xz_6 = XZPlane(Origin=Point(0, 0, 0))
rectangle_16 = Rectangle(Plane=xy_27, XSize=Slider(200, range=0..1000), YSize=Slider(300, range=0..1000), Radius=0)  # -> Rectangle, Length
xy_31 = XYPlane(Origin=Point(0, 0, 0))
rectangle_17 = Rectangle(Plane=xy_28, XSize=Slider(200, range=0..1000), YSize=Slider(300, range=0..1000), Radius=0)  # -> Rectangle, Length
rebar_properties_36 = RebarProperties(Diameter="12", Material=material_38)
cover_dimensions_18 = CoverDimensions(
    Left=Slider(10, range=0..100),
    Right=Slider(20, range=0..100),
    Top=Slider(30, range=0..100),
    Bottom=Slider(40, range=0..100))
xy_32 = XYPlane(Origin=Point(0, 0, 0))
rebar_properties_37 = RebarProperties(Diameter="12", Material=material_39)
cover_dimensions_19 = CoverDimensions(
    Left=Slider(10, range=0..100),
    Right=Slider(20, range=0..100),
    Top=Slider(30, range=0..100),
    Bottom=Slider(40, range=0..100))
rectangle_18 = Rectangle(Plane=xy_29, XSize=Slider(200, range=0..1000), YSize=Slider(300, range=0..1000), Radius=0)  # -> Rectangle, Length
rectangle_19 = Rectangle(Plane=xy_30, XSize=Slider(0.2, range=0..1), YSize=Slider(0.3, range=0..1), Radius=0)  # -> Rectangle, Length
rectangle_20 = Rectangle(Plane=xz_6, XSize=Slider(0.2, range=0..1), YSize=Slider(0.3, range=0..1), Radius=0)  # -> Rectangle, Length
cover_dimensions_20 = CoverDimensions(
    Left=Slider(0.01, range=0..0.11),
    Right=Slider(0.02, range=0..0.11),
    Top=Slider(0.03, range=0..0.11),
    Bottom=Slider(0.04, range=0..0.11))
rebar_properties_38 = RebarProperties(Diameter="12", Material=material_40)
cover_dimensions_21 = CoverDimensions(
    Left=Slider(10, range=0..100),
    Right=Slider(20, range=0..100),
    Top=Slider(30, range=0..100),
    Bottom=Slider(40, range=0..100))
cover_dimensions_22 = CoverDimensions(
    Left=Slider(0.01, range=0..0.11),
    Right=Slider(0.02, range=0..0.11),
    Top=Slider(0.03, range=0..0.11),
    Bottom=Slider(0.04, range=0..0.11))
rectangle_21 = Rectangle(Plane=xy_31, XSize=Slider(0.2, range=0..1), YSize=Slider(0.3, range=0..1), Radius=0)  # -> Rectangle, Length
cover_dimensions_23 = CoverDimensions(
    Left=Slider(0.01, range=0..0.11),
    Right=Slider(0.02, range=0..0.11),
    Top=Slider(0.03, range=0..0.11),
    Bottom=Slider(0.04, range=0..0.11))
rebar_properties_39 = RebarProperties(Diameter="0.012", Material=material_41)
rectangle_22 = Rectangle(Plane=xy_32, XSize=dom_9, YSize=Slider(0.3, range=0..1), Radius=0)  # -> Rectangle, Length
rebar_properties_40 = RebarProperties(Diameter="0.012", Material=material_42)
cover_dimensions_24 = CoverDimensions(
    Left=Slider(0.01, range=0..0.11),
    Right=Slider(0.02, range=0..0.11),
    Top=Slider(0.03, range=0..0.11),
    Bottom=Slider(0.04, range=0..0.11))
rebar_properties_41 = RebarProperties(Diameter="0.012", Material=material_43)
rebar_properties_42 = RebarProperties(Diameter="0.012", Material=material_44)
rectangle_to_u_bar_shape = RectangleToUBarShape(
    Rectangle=rectangle_13.Rectangle,
    Properties=rebar_properties_33,
    BendingRollerDiameter="60",
    Position=Slider(0, range=0..3),
    CoverDimensions=cover_dimensions_15,
    HookLength=Slider(100, range=0..1000))  # -> RebarShape, Mesh
rectangle_to_u_bar_shape_2 = RectangleToUBarShape(
    Rectangle=rectangle_14.Rectangle,
    Properties=rebar_properties_34,
    BendingRollerDiameter="60",
    Position=Slider(0, range=0..3),
    CoverDimensions=cover_dimensions_16,
    HookLength=Slider(100, range=0..1000))  # -> RebarShape, Mesh
rectangle_to_u_bar_shape_3 = RectangleToUBarShape(
    Rectangle=rectangle_15.Rectangle,
    Properties=rebar_properties_35,
    BendingRollerDiameter="80",
    Position=Slider(0, range=0..3),
    CoverDimensions=cover_dimensions_17,
    HookLength=Slider(100, range=0..1000))  # -> RebarShape, Mesh
rectangle_to_u_bar_shape_4 = RectangleToUBarShape(
    Rectangle=rectangle_16.Rectangle,
    Properties=rebar_properties_36,
    BendingRollerDiameter="60",
    Position=Slider(1, range=0..3),
    CoverDimensions=cover_dimensions_18,
    HookLength=Slider(100, range=0..1000))  # -> RebarShape, Mesh
rectangle_to_u_bar_shape_5 = RectangleToUBarShape(
    Rectangle=rectangle_17.Rectangle,
    Properties=rebar_properties_37,
    BendingRollerDiameter="60",
    Position=Slider(2, range=0..3),
    CoverDimensions=cover_dimensions_19,
    HookLength=Slider(100, range=0..1000))  # -> RebarShape, Mesh
rectangle_to_u_bar_shape_6 = RectangleToUBarShape(
    Rectangle=rectangle_18.Rectangle,
    Properties=rebar_properties_38,
    BendingRollerDiameter="60",
    Position=Slider(3, range=0..3),
    CoverDimensions=cover_dimensions_21,
    HookLength=Slider(100, range=0..1000))  # -> RebarShape, Mesh
rectangle_to_u_bar_shape_7 = RectangleToUBarShape(
    Rectangle=rectangle_19.Rectangle,
    Properties=rebar_properties_39,
    BendingRollerDiameter="0.060",
    Position=Slider(0, range=0..3),
    CoverDimensions=cover_dimensions_20,
    HookLength=Slider(0.1, range=0..0.1))  # -> RebarShape, Mesh
rectangle_to_u_bar_shape_8 = RectangleToUBarShape(
    Rectangle=rectangle_20.Rectangle,
    Properties=rebar_properties_40,
    BendingRollerDiameter="0.060",
    Position=Slider(0, range=0..3),
    CoverDimensions=cover_dimensions_22,
    HookLength=Slider(0.1, range=0..0.1))  # -> RebarShape, Mesh
rectangle_to_u_bar_shape_9 = RectangleToUBarShape(
    Rectangle=rectangle_21.Rectangle,
    Properties=rebar_properties_41,
    BendingRollerDiameter="0.060",
    Position=Slider(0, range=0..3),
    CoverDimensions=cover_dimensions_23,
    HookLength=Slider(0.05, range=0..0.1))  # -> RebarShape, Mesh
rectangle_to_u_bar_shape_10 = RectangleToUBarShape(
    Rectangle=rectangle_22.Rectangle,
    Properties=rebar_properties_42,
    BendingRollerDiameter="0.060",
    Position=Slider(0, range=0..3),
    CoverDimensions=cover_dimensions_24,
    HookLength=Slider(0.1, range=0..0.1))  # -> RebarShape, Mesh
mesh_31 = Mesh(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)
mesh_32 = Mesh(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)
mesh_33 = Mesh(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)
demesh_61 = DeconstructMesh(Mesh=rectangle_to_u_bar_shape.Mesh)  # -> Vertices, Faces, Colours, Normals
demesh_62 = DeconstructMesh(Mesh=mesh_31)  # -> Vertices, Faces, Colours, Normals
demesh_63 = DeconstructMesh(Mesh=rectangle_to_u_bar_shape_2.Mesh)  # -> Vertices, Faces, Colours, Normals
demesh_64 = DeconstructMesh(Mesh=mesh_32)  # -> Vertices, Faces, Colours, Normals
demesh_65 = DeconstructMesh(Mesh=rectangle_to_u_bar_shape_3.Mesh)  # -> Vertices, Faces, Colours, Normals
mesh_34 = Mesh(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)
demesh_66 = DeconstructMesh(Mesh=mesh_33)  # -> Vertices, Faces, Colours, Normals
mesh_35 = Mesh(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)
mesh_36 = Mesh(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)
demesh_67 = DeconstructMesh(Mesh=rectangle_to_u_bar_shape_4.Mesh)  # -> Vertices, Faces, Colours, Normals
demesh_68 = DeconstructMesh(Mesh=mesh_34)  # -> Vertices, Faces, Colours, Normals
mesh_37 = Mesh(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)
demesh_69 = DeconstructMesh(Mesh=rectangle_to_u_bar_shape_5.Mesh)  # -> Vertices, Faces, Colours, Normals
demesh_70 = DeconstructMesh(Mesh=mesh_35)  # -> Vertices, Faces, Colours, Normals
mesh_38 = Mesh(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)
mesh_39 = Mesh(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)
demesh_71 = DeconstructMesh(Mesh=rectangle_to_u_bar_shape_6.Mesh)  # -> Vertices, Faces, Colours, Normals
demesh_72 = DeconstructMesh(Mesh=mesh_36)  # -> Vertices, Faces, Colours, Normals
mesh_40 = Mesh(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)
# Rectangle To Stirrup Shape
assert_point_list_31 = AssertPointList(
    TestName="TestUBarShapeMilimeters_XYPlaneRectangle_Mesh",
    ExpectedPointList=demesh_62.Vertices,
    ActualPointList=demesh_61.Vertices,
    Tolerance="0.00001")  # -> Result, FailedInfo
demesh_73 = DeconstructMesh(Mesh=rectangle_to_u_bar_shape_7.Mesh)  # -> Vertices, Faces, Colours, Normals
demesh_74 = DeconstructMesh(Mesh=mesh_37)  # -> Vertices, Faces, Colours, Normals
assert_point_list_32 = AssertPointList(
    TestName="TestUBarShapeMilimeters_Diameter_Mesh",
    ExpectedPointList=demesh_64.Vertices,
    ActualPointList=demesh_63.Vertices,
    Tolerance="0.00001")  # -> Result, FailedInfo
demesh_75 = DeconstructMesh(Mesh=rectangle_to_u_bar_shape_8.Mesh)  # -> Vertices, Faces, Colours, Normals
demesh_76 = DeconstructMesh(Mesh=mesh_38)  # -> Vertices, Faces, Colours, Normals
assert_point_list_33 = AssertPointList(
    TestName="TestUBarShapeMilimeters_BendingRoller_Mesh",
    ExpectedPointList=demesh_66.Vertices,
    ActualPointList=demesh_65.Vertices,
    Tolerance="0.00001")  # -> Result, FailedInfo
demesh_77 = DeconstructMesh(Mesh=rectangle_to_u_bar_shape_9.Mesh)  # -> Vertices, Faces, Colours, Normals
demesh_78 = DeconstructMesh(Mesh=mesh_39)  # -> Vertices, Faces, Colours, Normals
demesh_79 = DeconstructMesh(Mesh=rectangle_to_u_bar_shape_10.Mesh)  # -> Vertices, Faces, Colours, Normals
demesh_80 = DeconstructMesh(Mesh=mesh_40)  # -> Vertices, Faces, Colours, Normals
assert_point_list_34 = AssertPointList(
    TestName="TestUBarShapeMilimeters_Position1_Mesh",
    ExpectedPointList=demesh_68.Vertices,
    ActualPointList=demesh_67.Vertices,
    Tolerance="0.00001")  # -> Result, FailedInfo
assert_point_list_35 = AssertPointList(
    TestName="TestUBarShapeMilimeters_Position2_Mesh",
    ExpectedPointList=demesh_70.Vertices,
    ActualPointList=demesh_69.Vertices,
    Tolerance="0.00001")  # -> Result, FailedInfo
assert_point_list_36 = AssertPointList(
    TestName="TestUBarShapeMilimeters_Position3_Mesh",
    ExpectedPointList=demesh_72.Vertices,
    ActualPointList=demesh_71.Vertices,
    Tolerance="0.00001")  # -> Result, FailedInfo
assert_point_list_37 = AssertPointList(
    TestName="TestUBarShapeMeters_XYPlaneRectangle_Mesh",
    ExpectedPointList=demesh_74.Vertices,
    ActualPointList=demesh_73.Vertices,
    Tolerance="0.00001")  # -> Result, FailedInfo
assert_point_list_38 = AssertPointList(
    TestName="TestUBarShapeMeters_XZPlaneRectangle_Mesh",
    ExpectedPointList=demesh_76.Vertices,
    ActualPointList=demesh_75.Vertices,
    Tolerance="0.00001")  # -> Result, FailedInfo
assert_point_list_39 = AssertPointList(
    TestName="TestUBarShapeMeters_HookLength_Mesh",
    ExpectedPointList=demesh_78.Vertices,
    ActualPointList=demesh_77.Vertices,
    Tolerance="0.00001")  # -> Result, FailedInfo
assert_point_list_40 = AssertPointList(
    TestName="TestUBarShapeMeters_XYPlaneRectangleDescendingX_Mesh",
    ExpectedPointList=demesh_80.Vertices,
    ActualPointList=demesh_79.Vertices,
    Tolerance="0.00001")  # -> Result, FailedInfo

entwine_8 = Entwine(
    Branch00=assert_point_list_31.Result,
    Branch01=assert_point_list_32.Result,
    Branch02=assert_point_list_33.Result,
    Branch03=assert_point_list_34.Result,
    Branch04=assert_point_list_35.Result,
    Branch05=assert_point_list_36.Result,
    Branch06=assert_point_list_37.Result,
    Branch07=assert_point_list_38.Result,
    Branch08=assert_point_list_39.Result,
    Branch09=assert_point_list_40.Result,
    FlattenInputs=True)  # -> flatten(Result)

# ----
# Result:
total = Total(Results=flatten([entwine_2, entwine, entwine_3, entwine_4, entwine_5, entwine_6, entwine_7, entwine_8]))  # -> TotalResult, ReportPart
panel_12 = Panel(total.TotalResult)
