# Grasshopper definition MeshElements.gh (Grasshopper 1.0.7)
# plug-ins: T-Rex

brep = Brep(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)
brep_2 = Brep(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)
brep_3 = Brep(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)
brep_4 = Brep(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)
division = Division(A=Slider(2400, range=0..10000), B="1e9")
division_2 = Division(A=Slider(2400, range=0..10000), B="1e9")
mesh = MeshBrep(
    Brep=brep,
    Settings={GridMaxCount=0, GridMinCount=16, JaggedSeams=False, MaxEdgeLength=0, MinEdgeLength=0.0001, MinTolerance=0, Refine=True, RefineAngle=0, RelativeTolerance=0.65, SimplePlanes=True, Tolerance=0})
division_3 = Division(A=Slider(2400, range=0..10000), B="1e9")
mesh_2 = MeshBrep(
    Brep=brep_2,
    Settings={GridMaxCount=0, GridMinCount=16, JaggedSeams=False, MaxEdgeLength=0, MinEdgeLength=0.0001, MinTolerance=0, Refine=True, RefineAngle=0, RelativeTolerance=0.65, SimplePlanes=True, Tolerance=0})
mesh_3 = MeshBrep(
    Brep=brep_3,
    Settings={GridMaxCount=0, GridMinCount=16, JaggedSeams=False, MaxEdgeLength=0, MinEdgeLength=0.0001, MinTolerance=0, Refine=True, RefineAngle=0, RelativeTolerance=0.65, SimplePlanes=True, Tolerance=0})
division_4 = Division(A=Slider(2400, range=0..10000), B="1e9")
material = Material(Name="Other name", Grade="Other Grade name", Density=division)
material_2 = Material(Name="Other name", Grade="Other Grade name", Density=division_2)
mesh_4 = MeshBrep(
    Brep=brep_4,
    Settings={GridMaxCount=0, GridMinCount=16, JaggedSeams=False, MaxEdgeLength=0, MinEdgeLength=0.0001, MinTolerance=0, Refine=True, RefineAngle=0, RelativeTolerance=0.65, SimplePlanes=True, Tolerance=0})
material_3 = Material(Name="Other name", Grade="Other Grade name", Density=division_3)
material_4 = Material(Name="Material name", Grade="Grade name", Density=division_4)
yz = YZPlane(Origin=Point(18100.13667, 1175.606115, 0))
xy = XYPlane(Origin=Point(13987.78629, 1495.192497, 0))
xz = XZPlane(Origin=Point(13844.42683, 4039.148313, 0))
xy_2 = XYPlane(Origin=Point(8459.275724, 879.16198, 0))
xy_3 = XYPlane(Origin=Point(3736.421002, 865.4397629, 0))
xy_4 = XYPlane(Origin=Point(0, 0, 0))
mesh_to_elements = MeshToElements(Name="Element name", Mesh=mesh, Material=material, Type=Slider(3, range=0..3), InsertPlanes=[xy, xz, yz])  # -> ElementGroup, Meshes
mesh_to_elements_2 = MeshToElements(Name="Element name", Mesh=mesh_2, Material=material_2, Type=Slider(2, range=0..3), InsertPlanes=xy_2)  # -> ElementGroup, Meshes
mesh_to_elements_3 = MeshToElements(Name="Element name", Mesh=mesh_3, Material=material_3, Type=Slider(1, range=0..3), InsertPlanes=xy_3)  # -> ElementGroup, Meshes
mesh_to_elements_4 = MeshToElements(Name="Element name", Mesh=mesh_4, Material=material_4, Type=Slider(0, range=0..3), InsertPlanes=xy_4)  # -> ElementGroup, Meshes
path = FilePath("C:\Users\pc\RiderProjects\T-Rex\TestsInsideGrasshopper\IFCAndDotbimTests\IFCFiles\MeshElements.ifc")
path_2 = FilePath("C:\Users\pc\RiderProjects\T-Rex\TestsInsideGrasshopper\IFCAndDotbimTests\IFCFiles\MeshElements.bim")
create_ifc = CreateIFC(
    Groups=[mesh_to_elements_4.ElementGroup, mesh_to_elements_3.ElementGroup, mesh_to_elements_2.ElementGroup, mesh_to_elements.ElementGroup],
    ProjectName="Project",
    BuildingName="Building",
    Path=path)
create_dotbim = CreateDotbim(
    Groups=[mesh_to_elements_4.ElementGroup, mesh_to_elements_3.ElementGroup, mesh_to_elements_2.ElementGroup, mesh_to_elements.ElementGroup],
    ProjectName="Project",
    BuildingName="Building",
    GeometryScaleFactor=Slider(0.001, range=0..0.001),
    Path=path_2)
