# Grasshopper definition MixedElements.gh (Grasshopper 1.0.7)
# plug-ins: T-Rex

division = Division(A=Slider(7850, range=0..10000), B="1e9")
material = Material(Name="Name of the material", Grade="Grade of the material", Density=division)
pt = ConstructPoint(XCoordinate=0, YCoordinate=0, ZCoordinate=0)
pt_2 = ConstructPoint(XCoordinate=Slider(500, range=0..1000), YCoordinate=0, ZCoordinate=0)
rebar_properties = RebarProperties(Diameter="20", Material=material)
ln = Line(StartPoint=pt, EndPoint=pt_2)
brep = Brep(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)
pt_3 = Point([Point(-50.61382004, 34.83884019, 0), Point(-8.156349148, 40.06437507, 0), Point(21.8904764, 21.77500299, 0), Point(-3.910602059, -0.4335202397, 0), Point(22.21707233, -19.37608418, 0), Point(34.62771767, -6.638842908, 0), Point(53.24368568, -18.39629639, 0), Point(17.97132525, -53.01546496, 0), Point(-52.24679969, -1.739903959, 0)])
division_2 = Division(A=Slider(2400, range=0..10000), B="1e9")
mesh = MeshBrep(
    Brep=brep,
    Settings={GridMaxCount=0, GridMinCount=16, JaggedSeams=False, MaxEdgeLength=0, MinEdgeLength=0.0001, MinTolerance=0, Refine=True, RefineAngle=0, RelativeTolerance=0.65, SimplePlanes=True, Tolerance=0})
division_3 = Division(A=Slider(2400, range=0..10000), B="1e9")
curve_to_rebar_shape = CurveToRebarShape(Curve=ln, Properties=rebar_properties)  # -> RebarShape, Mesh
material_2 = Material(Name="Other name", Grade="Other Grade name", Density=division_2)
profile = Profile(Name="Profile name", Points=pt_3, Tolerance=0.0001)  # -> Profile, Brep
material_3 = Material(Name="Material name", Grade="Grade name", Density=division_3)
yz = YZPlane(Origin=Point(18100.13667, 1175.606115, 0))
xy = XYPlane(Origin=Point(13987.78629, 1495.192497, 0))
xz = XZPlane(Origin=Point(13844.42683, 4039.148313, 0))
line = Line(Line((351.1489197, -500.8199794, 0), (248.5792147, 879.037207, 0)))
mesh_to_elements = MeshToElements(Name="Element name", Mesh=mesh, Material=material_2, Type=Slider(3, range=0..3), InsertPlanes=[xy, xz, yz])  # -> ElementGroup, Meshes
nurbs = NurbsCurve(
    Vertices=[Point(2666.108301, -26.32553221, 0), Point(3168.802054, 260.3974601, 0), Point(3217.929721, 798.5076921, 0), Point(3016.364568, 1175.544284, 0), Point(2508.957547, 1503.262923, 0), Point(2123.949713, 1399.383982, 0), Point(2066.983537, 1015.884306, 0), Point(1829.779858, 0, 697.8350593), Point(2193.726753, 0, 1041.562683), Point(2896.346455, 0, 1228.590949)],
    Degree=3,
    Periodic=False)  # -> Curve, Length, Domain
profile_to_elements = ProfileToElements(
    Name="Element name",
    Profile=profile.Profile,
    RotationAngle=degrees(Slider(0, range=0..100)),
    Material=material_3,
    Type="1",
    InsertLines=line)  # -> ElementGroup, Breps
curve_spacing = CurveSpacing(
    Id="0",
    RebarShape=curve_to_rebar_shape.RebarShape,
    Curve=nurbs.Curve,
    Count=Slider(10, range=0..100),
    RotationAngle=degrees(Slider(90, range=0..360)))  # -> RebarGroup, Mesh, Curve
path = FilePath("C:\Users\pc\RiderProjects\T-Rex\TestsInsideGrasshopper\IFCAndDotbimTests\IFCFiles\MixedElements.bim")
path_2 = FilePath("C:\Users\pc\RiderProjects\T-Rex\TestsInsideGrasshopper\IFCAndDotbimTests\IFCFiles\MixedElements.ifc")
create_ifc = CreateIFC(
    Groups=[profile_to_elements.ElementGroup, mesh_to_elements.ElementGroup, curve_spacing.RebarGroup],
    ProjectName="Mixed project",
    BuildingName="Mixed building",
    Path=path_2)
create_dotbim = CreateDotbim(
    Groups=[curve_spacing.RebarGroup, profile_to_elements.ElementGroup, mesh_to_elements.ElementGroup],
    ProjectName="Mixed project",
    BuildingName="Mixed building",
    GeometryScaleFactor=Slider(0.001, range=0..0.001),
    Path=path)
