# Grasshopper definition ProfileElements.gh (Grasshopper 1.0.7)
# plug-ins: T-Rex

pt = Point([Point(-50.61382004, 34.83884019, 0), Point(-8.156349148, 40.06437507, 0), Point(21.8904764, 21.77500299, 0), Point(-3.910602059, -0.4335202397, 0), Point(22.21707233, -19.37608418, 0), Point(34.62771767, -6.638842908, 0), Point(53.24368568, -18.39629639, 0), Point(17.97132525, -53.01546496, 0), Point(-52.24679969, -1.739903959, 0)])
division = Division(A=Slider(2400, range=0..10000), B="1e9")
division_2 = Division(A=Slider(2400, range=0..10000), B="1e9")
division_3 = Division(A=Slider(2400, range=0..10000), B="1e9")
division_4 = Division(A=Slider(2400, range=0..10000), B="1e9")
material = Material(Name="Material name", Grade="Grade name", Density=division)
profile = Profile(Name="Profile name", Points=pt, Tolerance=0.0001)  # -> Profile, Brep
material_2 = Material(Name="Material name", Grade="Grade name", Density=division_2)
material_3 = Material(Name="Material name", Grade="Grade name", Density=division_3)
material_4 = Material(Name="Material name", Grade="Grade name", Density=division_4)
line = Line([Line((1800.641022, 1247.8852, 0), (2444.067123, -658.0141917, 0)), Line((2030.014406, 1239.233424, 0), (2797.330963, -699.6107295, 0)), Line((2423.139731, 1094.886252, 0), (3105.529582, -613.5786894, 0))])
line_2 = Line(Line((1017.291439, 0, -42.09673882), (2057.269693, 0, 662.1405041)))
line_3 = Line(Line((351.1489197, -500.8199794, 0), (248.5792147, 879.037207, 0)))
line_4 = Line(Line((-238.0431771, -445.431398, 0), (-317.0932842, 907.7566239, 0)))
profile_to_elements = ProfileToElements(
    Name="Element name",
    Profile=profile.Profile,
    RotationAngle=degrees(Slider(0, range=0..100)),
    Material=material_2,
    Type="3",
    InsertLines=line)  # -> ElementGroup, Breps
profile_to_elements_2 = ProfileToElements(
    Name="Element name",
    Profile=profile.Profile,
    RotationAngle=degrees(Slider(0, range=0..100)),
    Material=material,
    Type="2",
    InsertLines=line_2)  # -> ElementGroup, Breps
profile_to_elements_3 = ProfileToElements(
    Name="Element name",
    Profile=profile.Profile,
    RotationAngle=degrees(Slider(0, range=0..100)),
    Material=material_3,
    Type="1",
    InsertLines=line_3)  # -> ElementGroup, Breps
profile_to_elements_4 = ProfileToElements(
    Name="Element name",
    Profile=profile.Profile,
    RotationAngle=degrees(Slider(90, range=0..100)),
    Material=material_4,
    Type="0",
    InsertLines=line_4)  # -> ElementGroup, Breps
path = FilePath("C:\Users\pc\RiderProjects\T-Rex\TestsInsideGrasshopper\IFCAndDotbimTests\IFCFiles\ProfileElements.ifc")
path_2 = FilePath("C:\Users\pc\RiderProjects\T-Rex\TestsInsideGrasshopper\IFCAndDotbimTests\IFCFiles\ProfileElements.bim")
create_dotbim = CreateDotbim(
    Groups=[profile_to_elements_4.ElementGroup, profile_to_elements_3.ElementGroup, profile_to_elements_2.ElementGroup, profile_to_elements.ElementGroup],
    ProjectName="Profile elements",
    BuildingName="Building name",
    GeometryScaleFactor=Slider(0.001, range=0..0.001),
    Path=path_2)
create_ifc = CreateIFC(
    Groups=[profile_to_elements_4.ElementGroup, profile_to_elements_3.ElementGroup, profile_to_elements_2.ElementGroup, profile_to_elements.ElementGroup],
    ProjectName="Profile elements",
    BuildingName="Building name",
    Path=path)
