# Grasshopper definition GrasshopperUnitTests.gh (Grasshopper 1.0.7)
# plug-ins: Brontosaurus, T-Rex

# ----
# Rebar Properties
number_slider = Slider(7750, range=0..10000)
division = Division(A=number_slider, B="10e9")
material = Material(Name="Name of the material", Grade="Grade of the material", Density=division)
material_2 = Material(Name="Name of the material", Grade="Grade of the material", Density="7750")
panel = Panel("""Rebar Properties
Diameter: 20
Material: Name of the material""")
panel_2 = Panel("""Rebar Properties
Diameter: 0.02
Material: Name of the material""")
rebar_properties = RebarProperties(Diameter="20", Material=material)
rebar_properties_2 = RebarProperties(Diameter="0.020", Material=material_2)
assert = Assert(TestNames="TestRebarPropertiesMilimeters_Normal_Init", Expected=panel, Actual=rebar_properties)  # -> Result, FailedInfo
assert_2 = Assert(TestNames="TestRebarPropertiesMeters_Normal_Init", Expected=panel_2, Actual=rebar_properties_2)  # -> Result, FailedInfo

# ----
# Cover Dimensions
number_slider_2 = Slider(300, range=0..1000)
# Unit Tests inside Grasshopper
# 
# Required plugins:
# - T-Rex
# - Brontosaurus
panel_3 = Panel("TestCoverDimensionsMilimeters_Normal_Init")
cover_dimensions = CoverDimensions(
    Left=Slider(100, range=0..1000),
    Right=Slider(200, range=0..1000),
    Top=number_slider_2,
    Bottom=Slider(400, range=0..1000))
panel_4 = Panel("""Cover Dimensions
Left: 0.01
Right: 0.02
Top: 0.03
Bottom: 0.045""")
cover_dimensions_2 = CoverDimensions(
    Left=Slider(0.01, range=0..0.1),
    Right=Slider(0.02, range=0..0.1),
    Top=Slider(0.03, range=0..0.1),
    Bottom=Slider(0.045, range=0..0.1))
# Naming convencion:
# TestComponentNameUnits_Input_Output
panel_5 = Panel("""Cover Dimensions
Left: 100
Right: 200
Top: 300
Bottom: 400""")
assert_3 = Assert(TestNames=panel_3, Expected=panel_5, Actual=cover_dimensions)  # -> Result, FailedInfo
assert_4 = Assert(TestNames="TestCoverDimensionsMeters_Normal_Init", Expected=panel_4, Actual=cover_dimensions_2)  # -> Result, FailedInfo

# ----
# Material
number_slider_3 = Slider(7750, range=0..10000)
division_2 = Division(A=number_slider_3, B="10e9")
panel_6 = Panel("""Material
Name: Name of the material
Grade: Grade of the material
Density: 7.75E-07""")
panel_7 = Panel("""Material
Name: Name of the material
Grade: Grade of the material
Density: 7750""")
material_3 = Material(Name="Name of the material", Grade="Grade of the material", Density=division_2)
material_4 = Material(Name="Name of the material", Grade="Grade of the material", Density="7750")
assert_5 = Assert(TestNames="TestMaterialMilimeters_Normal_Init", Expected=panel_6, Actual=material_3)  # -> Result, FailedInfo
assert_6 = Assert(TestNames="TestMaterialMeters_Normal_Init", Expected=panel_7, Actual=material_4)  # -> Result, FailedInfo

# ----
# L-Bar Shape
number_slider_4 = Slider(7750, range=0..10000)
division_3 = Division(A=number_slider_4, B="10e9")
division_4 = Division(A=Slider(7750, range=0..10000), B="10e9")
material_5 = Material(Name="Name of the material", Grade="Grade of the material", Density=division_3)
material_6 = Material(Name="Name of the material", Grade="Grade of the material", Density=Slider(7750, range=0..10000))
material_7 = Material(Name="Name of the material", Grade="Grade of the material", Density=division_4)
rebar_properties_3 = RebarProperties(Diameter="20", Material=material_5)
rebar_properties_4 = RebarProperties(Diameter="0.020", Material=material_6)
rebar_properties_5 = RebarProperties(Diameter="20", Material=material_7)
pt = Point(Point(10, 20, 30))
pt_2 = Point(Point(10, 20, 30))
xy = XYPlane(Origin=Point(0, 0, 0))
yz = YZPlane(Origin=pt)
xz = XZPlane(Origin=pt_2)
l_bar_shape = LBarShape(
    Plane=xy,
    Height=Slider(100, range=0..1000),
    Width=Slider(200, range=0..1000),
    Properties=rebar_properties_3,
    BendingRollerDiameter="80")  # -> RebarShape, Mesh
l_bar_shape_2 = LBarShape(
    Plane=yz,
    Height=Slider(0.2, range=0..0.2),
    Width=Slider(0.1, range=0..0.2),
    Properties=rebar_properties_4,
    BendingRollerDiameter="0.080")  # -> RebarShape, Mesh
l_bar_shape_3 = LBarShape(
    Plane=xz,
    Height=Slider(100, range=0..1000),
    Width=Slider(200, range=0..1000),
    Properties=rebar_properties_5,
    BendingRollerDiameter="80")  # -> RebarShape, Mesh
mesh = Mesh(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)
mesh_2 = Mesh(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)
mesh_3 = Mesh(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)
demesh = DeconstructMesh(Mesh=mesh)  # -> Vertices, Faces, Colours, Normals
demesh_2 = DeconstructMesh(Mesh=l_bar_shape.Mesh)  # -> Vertices, Faces, Colours, Normals
demesh_3 = DeconstructMesh(Mesh=mesh_2)  # -> Vertices, Faces, Colours, Normals
demesh_4 = DeconstructMesh(Mesh=l_bar_shape_2.Mesh)  # -> Vertices, Faces, Colours, Normals
demesh_5 = DeconstructMesh(Mesh=mesh_3)  # -> Vertices, Faces, Colours, Normals
demesh_6 = DeconstructMesh(Mesh=l_bar_shape_3.Mesh)  # -> Vertices, Faces, Colours, Normals
assert_point_list = AssertPointList(
    TestName="TestLBarShapeMilimeters_XYPlane_Mesh",
    ExpectedPointList=demesh.Vertices,
    ActualPointList=demesh_2.Vertices,
    Tolerance="0.00001")  # -> Result, FailedInfo
assert_point_list_2 = AssertPointList(
    TestName="TestLBarShapeMilimeters_XZPlane_Mesh",
    ExpectedPointList=demesh_5.Vertices,
    ActualPointList=demesh_6.Vertices,
    Tolerance="0.00001")  # -> Result, FailedInfo
assert_point_list_3 = AssertPointList(
    TestName="TestLBarShapeMeters_YZPlane_Mesh",
    ExpectedPointList=demesh_3.Vertices,
    ActualPointList=demesh_4.Vertices,
    Tolerance="0.00001")  # -> Result, FailedInfo

# ----
# Result:
total = Total(Results=flatten([assert_3.Result, assert_4.Result, assert_6.Result, assert_5.Result, assert_2.Result, assert.Result, assert_point_list.Result, assert_point_list_2.Result, assert_point_list_3.Result]))  # -> TotalResult, ReportPart
panel_8 = Panel(total.TotalResult)
